# Grasshopper definition Aa Params_geometry.ghx (Grasshopper 0.6.19)

# 注意：当以非box几何体输入到box输入端时，box将会建立一个bounding box将原几何体包围
crv = Curve(<curve referenced from the Rhino model>)
# box可以通过几个较简单的参量即可定义的rhino对象。每次当你设置set one box 或者set multple boxes时，并不是直接选取对象，而是类似于通过xyz三个坐标构建立方体的方式使得box赋值。
# 
# 英文help：代表一列有方向性的Box几何体。Box参量可以存储连续的数据，你可以通过参数菜单设置连续的数据。
box = Box()
# Plan 定义较为简单。确定x，y轴的方向，再根据右手定则即可判断出z轴的方向。因此，plan的赋值以直接定义赋值为主。
# 
# 英文help：plan 代表一列平面。平面由原点和三个向量定义。他们代表了通常在转换操作中实用的当前的坐标系统。平面参量可以存储连续的数据。你可以通过参数菜单设置连续的记录。
pln = Plane()
# Circle是较为容易定义的rhino对象。因此对其赋值以圆心加半径的方式完成。
# 
# 英文help：circle代表了一列简单圆形。圆形以参数的形式存储在gh中，由于在rhino中的圆形并不一定总是圆形，因此并没有直接与rhino中的圆形连接。线型
# 以及morph变形都会将其转变为椭圆或者nurbs曲线。
circle = Circle()
# 右键 set one Plan  设置一个平面
pln_2 = Plane(Plane(origin=(-242, 293, 0), x=(0.99612985, 0.0878938103, 0), y=(-0.0878938103, 0.99612985, 0)))
# 右键 set one box    指定一个box
box_2 = Box({Plane=PlaneXY(-92.9125802, 105.5505909, 0), X=Domain(0, 63.64553563), Y=Domain(0, 87.99969909), Z=Domain(0, 56.29266109)})
# 右键 set one circle   设置一个圆
circle_2 = Circle({Plane=Plane(origin=(33.67547981, 19.34298288, 0), x=(0.2842480264, 0.9587507807, 0), y=(-0.9587507807, 0.2842480264, 0)), Radius=43.72024438})
viewer = ParamViewer(pln_2)
panel = Panel(pln_2)
viewer_2 = ParamViewer(circle_2)
panel_2 = Panel(circle_2)
panel_3 = Panel(box_2)
viewer_3 = ParamViewer(box_2)
box_3 = Box(crv)
# 右键  set multiple boxes     指定多个boxes
box_4 = Box([{Plane=PlaneXY(-551.3377365, -396.4444195, 0), X=Domain(0, 118.9590425), Y=Domain(0, 154.3319781), Z=Domain(0, 60.78250253)}, {Plane=PlaneXY(-345.7402244, -380.0701761, 0), X=Domain(0, 158.3249295), Y=Domain(0, 187.141076), Z=Domain(0, 114.5943611)}])
# 右键  set multiple plans    设置多个平面
pln_3 = Plane([Plane(origin=(-368, -29, 0), x=(0.5144957554, 0.8574929257, 0), y=(-0.8574929257, 0.5144957554, 0)), Plane(origin=(-236, -41, 0), x=(-0.0318986524, 0.9994911085, 0), y=(-0.9994911085, -0.0318986524, 0)), Plane(origin=(-230, 105, 0), x=(0.02499219116, 0.9996876464, 0), y=(0.9996876464, -0.02499219116, 0))])
# 右键  set multiple circles    设置多个圆
circle_3 = Circle([{Plane=Plane(origin=(147.8634172, 66.07697434, 0), x=(0.3438097721, 0.9390393179, 0), y=(-0.9390393179, 0.3438097721, 0)), Radius=32.6428654}, {Plane=Plane(origin=(104.4505431, 146.1304903, 0), x=(0.7740065768, 0.6331775574, 0), y=(-0.6331775574, 0.7740065768, 0)), Radius=45.98112883}, {Plane=Plane(origin=(-34.46030709, 103.7853835, 0), x=(0.9201755022, 0.391506124, 0), y=(-0.391506124, 0.9201755022, 0)), Radius=33.31582742}])
viewer_4 = ParamViewer(box_4)
panel_4 = Panel(box_4)
viewer_5 = ParamViewer(pln_3)
panel_5 = Panel(pln_3)
viewer_6 = ParamViewer(circle_3)
panel_6 = Panel(circle_3)
panel_7 = Panel("surface可以从其他面类型中图圆形，圆柱形，以及单面breps还有锥体获得数据")
# 右键 set one Brep    指定一个Brep
brep = BRep(<brep referenced from the Rhino model>)
# Surface包含的面较广：平面曲线，空间曲线都是surface的范畴。因此，sufrace的变化较多，其赋值以选取rhino参展对象为主。
# 
# 英文help：surface代表了一列面几何体。surface几何体是各种曲面类型的通用代表
srf = Surface()
# Brep是一系列的几何表面，与box不同的是他的变化很多：可以是的多重曲面，也可以是封闭的几何体表皮。因此它是以选定rhino程序中几何对象的方式赋值的。正因为如此，它是gh与rhino对象之间曲面实体对象的主要参数接口对象。
# 
# 英文help：Brep代表了一列Brep几何体。Brep在犀牛中可以代表几何体的表皮，各种曲面及多重曲面。如果一个Brep物件只有一个面，它一般会被认为是曲面。
brep_2 = BRep()
# 右键 set one surface  指定一个曲面
srf_2 = Surface(<surface referenced from the Rhino model>)
box_5 = Box({Plane=PlaneXY(33.75410738, 65.67453337, 0), X=Domain(0, 242.7474185), Y=Domain(0, 106.4442258), Z=Domain(0, 256.9000774)})
line = Line()
panel_8 = Panel("注意:右键 reparameter可以将曲面的uv值重新定义在0~1之间。")
panel_9 = Panel("reparemeter选定")
panel_10 = Panel("注意：breph几何体可以从其他breps曲面，圆和其他boxes中提取数据。")
# 右键 set one line  设置一条线
panel_11 = Panel("line也是较为容易定义的rhino对象。因此对其赋值以两点定线的方式完成。")
panel_12 = Panel("reparemeter未选定")
sph = Sphere(
    B=Plane(origin=(1.365065699, 2.742264549, 0), x=(0.9996702987, -0.02567671811, 0), y=(0.02567671811, 0.9996702987, 0)),
    R=199)
cone = Cone(B=Plane(origin=(-779, 252, 0), x=(0.9805806757, 0.1961161351, 0), y=(-0.1961161351, 0.9805806757, 0)), R=10, L=5)  # -> C, T
circle_4 = Circle({Plane=Plane(origin=(33.67547981, 19.34298288, 0), x=(0.2842480264, 0.9587507807, 0), y=(-0.9587507807, 0.2842480264, 0)), Radius=43.72024438})
srf_3 = Surface(<surface referenced from the Rhino model>)
srf_4 = Surface(unitize(<surface referenced from the Rhino model>))
srf_5 = Surface(sph)
srf_6 = Surface(cone.C)
viewer_7 = ParamViewer(circle_4)
panel_13 = Panel(circle_4)
viewer_8 = ParamViewer(srf_2)
panel_14 = Panel(srf_2)
brep_3 = BRep(box_5)
viewer_9 = ParamViewer(brep)
panel_15 = Panel(brep)
divide = DivideInterval²(I=srf_3, U=1, V=1)
divide_2 = DivideInterval²(I=srf_4, U=1, V=1)
panel_16 = Panel(srf_5)
panel_17 = Panel(srf_6)
panel_18 = Panel(brep_3)
panel_19 = Panel(divide)
panel_20 = Panel(divide_2)
# 右键  set multiple Breps     指定多个Breps
brep_4 = BRep(<brep referenced from the Rhino model>)
# 右键  set multiple surfaces    指定多个曲面
srf_7 = Surface([<surface referenced from the Rhino model> x2])
# 右键  set multiple lines   设置多条线
circle_5 = Circle([{Plane=Plane(origin=(147.8634172, 66.07697434, 0), x=(0.3438097721, 0.9390393179, 0), y=(-0.9390393179, 0.3438097721, 0)), Radius=32.6428654}, {Plane=Plane(origin=(104.4505431, 146.1304903, 0), x=(0.7740065768, 0.6331775574, 0), y=(-0.6331775574, 0.7740065768, 0)), Radius=45.98112883}, {Plane=Plane(origin=(-34.46030709, 103.7853835, 0), x=(0.9201755022, 0.391506124, 0), y=(-0.391506124, 0.9201755022, 0)), Radius=33.31582742}])
panel_21 = Panel(brep_4)
viewer_10 = ParamViewer(brep_4)
viewer_11 = ParamViewer(srf_7)
panel_22 = Panel(srf_7)
viewer_12 = ParamViewer(circle_5)
panel_23 = Panel(circle_5)
panel_24 = Panel("注意：mesh几何体可以从其他meshes和boxes中提取数据。")
panel_25 = Panel("提取笛卡尔平面定位点坐标")
panel_26 = Panel("""提取RGB坐标0对应-1，255对应1其余之相应取值

R=0，G=255，B=136""")
panel_27 = Panel("英文help：meshes代表了一列mesh几何体。meshes在rhino中只由三角与四边形组成。meshes总包括点数据列，法线数据列和面数据列。meshes同样可选则性的包含点材质坐标和颜色。")
arc = CircularArc({Plane=Plane(origin=(147.7039193, 702.7184711, 0), x=(-0.7435504473, -0.6686798429, 0), y=(-0.6686798429, 0.7435504473, 0)), Radius=174.7569406, Angle=0, Angle=1.119456025})
# Point是rhino最基本的几何对象，由于point的位置变化很多，因此采用参照rhino几何点的方式赋值。
# 
# 英文help：point以×的形式出现在预览窗口中。point参量可以存储连续数据。你可以通过参数菜单设置连续的数据。
pt = Point()
# 注意：point 可以与点，向量，颜色以及平面等不同种类数据中提取相应数据。
panel_28 = Panel("提取笛卡尔向量坐标")
mesh = Mesh()
arc_2 = CircularArc()
# 右键 set one Arc 设置一条圆弧
panel_29 = Panel("Arc也是较为容易定义的rhino对象。因此对其赋值以半径加弧长的方式完成。")
box_6 = Box({Plane=PlaneXY(-17.4669879, -287.3961957, 0), X=Domain(0, 183.5874513), Y=Domain(0, 174.6579396), Z=Domain(0, 36.13614227)})
# 右键 set one Mesh   指定一个Mesh
mesh_2 = Mesh(<mesh referenced from the Rhino model>)
# 右键 set one point  指定一个点
pt_2 = Point(<point referenced from the Rhino model>)
mesh_3 = Mesh(box_6)
viewer_13 = ParamViewer(arc)
viewer_14 = ParamViewer(pt_2)
panel_30 = Panel(pt_2)
panel_31 = Panel(mesh_2)
panel_32 = Panel(arc)
viewer_15 = ParamViewer(mesh_2)
panel_33 = Panel(mesh_3)
Z = UnitZ(F=1)
yz = YZPlane(O=Point(0, 0, 0))
argb = ARGB(A=0, R=0, G=255, B=135)
pt_3 = Point(Z)
pt_4 = Point(yz)
pt_5 = Point(argb)
# 右键  set multiple Meshes   指定多个Meshes
mesh_4 = Mesh([<mesh referenced from the Rhino model> x3])
# 右键  set multiple Arcs   设置多条圆弧
arc_3 = CircularArc([{Plane=Plane(origin=(-181, -22, 0), x=(0.9403762258, -0.3401360817, 0), y=(0.3401360817, 0.9403762258, 0)), Radius=49.979996, Angle=0, Angle=0.5581549368}, {Plane=Plane(origin=(-180, -10, 0), x=(0.9012524245, 0.4332944349, 0), y=(-0.4332944349, 0.9012524245, 0)), Radius=57.69748695, Angle=0, Angle=2.031021385}, {Plane=Plane(origin=(-240, -10, 0), x=(0.4728177048, -0.8811602681, 0), y=(0.8811602681, 0.4728177048, 0)), Radius=46.5295605, Angle=0, Angle=0.8923648824}])
# 右键  set multiple points   指定多个点
pt_6 = Point([<point referenced from the Rhino model> x3])
viewer_16 = ParamViewer(arc_3)
panel_34 = Panel(arc_3)
viewer_17 = ParamViewer(pt_6)
panel_35 = Panel(pt_6)
viewer_18 = ParamViewer(mesh_4)
panel_36 = Panel(mesh_4)
panel_37 = Panel(pt_3)
panel_38 = Panel(pt_4)
panel_39 = Panel(pt_5)
panel_40 = Panel("Curve是较难用少量rhino几何元素定义的rhino对象。在概念上它包含的rhino对象除了之前提到的所有线型外还有多段线，多重曲线，甚至实体的边线。因此对其赋值以直接选取rhino中的多种curve对象而非定义的方式来完成。它是最常用的线型rhino对象与gh的接口。")
crv_2 = Curve(<curve referenced from the Rhino model>)
# Twisted boxes可以通过定义八个脚点来定义一个扭曲的盒子。
# 
# 英文help：twisted box代表了一列扭转的boxes。twistedboxes主要使用在变形部件中他们主要定义非euclidian空间。twisted box可以存储连续数据。你可以通过参数菜单设置连续数据。
tbox = TwistedBox()
# 右键 set one Twisted box   指定一个Twisted box
tbox_2 = TwistedBox({C=Point(-15, 12, 0), C=Point(-5, 12, 0), C=Point(-5, 20, 0), C=Point(-15, 20, 0), C=Point(-15, 12, 7), C=Point(-15, 7, 7), C=Point(-1, 7, 7), C=Point(-1, 22, 7)})
# 注意：twisted box由八个角点坐标定义。当多于两个角点相同时，box将会衰减变形。托普关系将会丢失部分点与边线有时甚至是面。
# 
# 注意：twisted box接受多种格式的数据。当遇到任何一种非box几何体时，这一非box几何体的世界边界box将会被提取作为twisted box的数据。
crv_3 = Curve(<curve referenced from the Rhino model>)
# 右键 set one Curve 设置一条曲线
crv_4 = Curve(<curve referenced from the Rhino model>)
# vector的定义相对简单，只需要起点与终点。因此向量的赋值采用起点至终点的向量坐标。
# 
# 英文help：vector代表一列3d向量。向量与点可以互换。但是为了清楚起见，他们拥有各自的参量种类。向量参数可以通过参数菜单记录连续数据。
vec = Vector()
# 注意：vector代表相对坐标（点代表绝对坐标），因此在视窗中不显示预览。
# 
# vector可以与点，向量，颜色以及平面等不同种类数据中提取相应数据。
panel_42 = Panel("提取笛卡尔向量坐标")
# 右键 set one vector   设置一个向量
vec_2 = Vector(Vector(11.38574462, 6.319872908, 0))
panel_43 = Panel(tbox_2)
viewer_19 = ParamViewer(tbox_2)
viewer_20 = ParamViewer(crv_4)
panel_44 = Panel(crv_4)
tbox_3 = TwistedBox(crv_3)
viewer_21 = ParamViewer(vec_2)
panel_45 = Panel(vec_2)
pt_7 = Point(<point referenced from the Rhino model>)
yz_2 = YZPlane(O=Point(0, 0, 0))
# 右键  set multiple Twisted boxes   指定多个Twisted boxes
tbox_4 = TwistedBox([{C=Point(3091.994613, 3671.141946, 0), C=Point(3091.994613, 3681.141946, 0), C=Point(3388.106117, 4755.637168, 0), C=Point(2313.610895, 5051.748672, 0), C=Point(192.0166478, 2813.208083, 0), C=Point(398.9368691, 1740.759557, 0), C=Point(3091.994613, 3681.141946, 0), C=Point(3388.106117, 4755.637168, 0)}, {C=Point(2494.930551, 5518.500788, 0), C=Point(2504.930551, 5518.500788, 0), C=Point(5188.826902, 7352.896893, 0), C=Point(3321.523754, 7118.563215, 0), C=Point(1311.012112, 5576.081138, 0), C=Point(4254.771057, 6033.258704, 0), C=Point(5188.826902, 7352.896893, 0), C=Point(1895.34121, 7901.546645, 0)}, {C=Point(-638.6080379, 4330.923445, 0), C=Point(5704.612196, 4040.876287, 0), C=Point(7983.393288, 6206.317266, 0), C=Point(5857.826363, 5507.305915, 0), C=Point(2338.833035, 6275.262381, 0), C=Point(-3267.815151, 2321.567422, 0), C=Point(3696.396422, 2569.955124, 0), C=Point(7301.783503, 7101.197433, 0)}])
# 右键  set multiple Curves  指定多条曲线
crv_5 = Curve([<curve referenced from the Rhino model> x3])
vec_3 = Vector(pt_7)
vec_4 = Vector(yz_2)
# 右键  set multiple vectors   设置多个向量
vec_5 = Vector([Vector(-4.170202167, 13.64031845, 0), Vector(6.810466151, 13.64031845, 0), Vector(19.16371801, 3.117177982, 0)])
panel_46 = Panel(tbox_4)
viewer_22 = ParamViewer(tbox_4)
viewer_23 = ParamViewer(crv_5)
panel_47 = Panel(crv_5)
panel_48 = Panel(vec_3)
panel_49 = Panel(vec_4)
viewer_24 = ParamViewer(vec_5)
panel_50 = Panel(vec_5)
# 右键 set one Geometry   指定一个Geometry
panel_51 = Panel("Geometry可以简单理解为物体。与Brep的主要区别在于它可以识别更多种类的参量。")
geo = Geometry()
geo_2 = Geometry(<0, culture=neutral, publickeytoken=null referenced from the Rhino model>)
panel_52 = Panel(geo_2)
viewer_25 = ParamViewer(geo_2)
# 右键  set multiple Geometries  指定多个Geometries
geo_3 = Geometry([<0, culture=neutral, publickeytoken=null referenced from the Rhino model> x6])
panel_53 = Panel(geo_3)
viewer_26 = ParamViewer(geo_3)
