# Grasshopper definition Ab params_primitive.ghx (Grasshopper 0.6.19)

bool = Boolean()
panel = Panel("""英文help：代表一列布尔值（真假）。布尔参量可以存储连续数据。你可以通过参数菜单设置连续的数据。

注意:布尔值可以通过勾选invert菜单被反转。""")
data = Data()
panel_2 = Panel("英文help：代表任何的一列参量。这一参数类型可以代表任何参量。")
num = Number(28.9)
vec = Vector(Vector(-26.89408521, -12.89629665, 0))
pt = Point(Point(-1391, 38, 0))
pln = Plane(Plane(origin=(-18.04854685, -2.983193306, 0), x=(0.719618962, -0.6943691738, 0), y=(0.6943691738, 0.719618962, 0)))
box = Box({Plane=PlaneXY(-27.91701678, -48.48724205, 0), X=Domain(0, 18.31907392), Y=Domain(0, 9.970279572), Z=Domain(0, 15.26733293)})
srf = Surface(<surface referenced from the Rhino model>)
# 注意:布尔参量可以接受多重格式的数据。当遇到数据时，0的数据为假，其余数据均为真。除了数字数据外其余数据均转换为字符数据，然后根据系统标准布尔分析惯例将得到的数据带入运算器中。
toggle = BooleanToggle(True)
bool_2 = Boolean("0")
bool_3 = Boolean("2")
data_2 = Data([num, vec, pt, pln, box, srf])
bool_4 = Boolean(Toggle(False))
bool_5 = Boolean([Toggle(False), Toggle(False), toggle])
panel_3 = Panel(data_2)
panel_4 = Panel(bool_3)
panel_5 = Panel(bool_2)
panel_6 = Panel(bool_4)
panel_7 = Panel(bool_5)
panel_8 = Panel("英文help：代表一列物件的指示代码。guid参量可以存储连续数据。你可以通过参数菜单设置连续的数据。")
str = String()
panel_9 = Panel("英文help: 代表一列字符。字符参量可以存储连续数据。你可以通过参数菜单设置连续的数据。")
panel_10 = Panel("""注意:尽管算数表达式可以产生字符型数据。字符型参量并没有内嵌的表达式评估机制。如果你想通过算数表达式编写字符，你应该使用算数部件（F（x），F（x，y），F（x，y，z））。
所有的数据（除了空值）可以被转化为字符型数据。注意转化算法由各自的层级定义提供。""")
panel_11 = Panel("英文help: integer代表一列整型数据。整型参数可以存储连续数据。你可以通过参数菜单设置连续的数据。")
int = Integer()
panel_12 = Panel("注意：整形数据可以接受多种数据。当遇到数值型数据类型（整型或者双精度浮点型），一个估算将会起作用。当遇到字符型数据时，一个文本估测将会起作用。所有的双精度浮点型数据将会取与其最接近的整数。")
panel_13 = Panel("英文help:  number代表一列双精度浮点数据。双精度浮点数据参数可以存储连续数据。你可以通过参数菜单设置连续的数据。")
panel_14 = Panel("注意：双精度浮点数据可以接受多种数据。当遇到数值型数据类型（整型或者双精度浮点型），一个准确的数据转换将会起作用。当遇到字符型数据时，一个文本估测将会起作用。")
id = Guid()
num_2 = Number()
# 注意:guid参量可以从正确的格式如字符，参照物体，以及物件名字（如果全部失败的话）得到数据。如果你提供并给合法的ｉｄ格式字符。grasshopper将会在当前文档反复强调并试图找到第一个与所给字符相等的第一个物件。
panel_15 = Panel("c23f7ffd-5034-44a5-94e3-9a3c53dead5c")
col = Colour()
panel_16 = Panel("英文help: 代表一列颜色值。颜色参量可以存储连续数据。你可以通过参数菜单设置连续的数据。")
panel_17 = Panel("注意:输出的数值与颜色RGB值相对应。同理输入RGB的三个数值可以得到对应的颜色。")
panel_18 = Panel("help: interval2代表二维区间数据（或者uv范围）。二维区间数据典型的用来代表表面阈值。一个二维区间由两个一维区间组成。")
panel_19 = Panel("""注意：二维区间数据可以从一位区间数据中提取数据。一维数据被拷贝到u方向上。
      二位区间数据可以从所有的去面上获得数据。这种情况下，曲面的范围被复制。""")
interval² = Interval²()
panel_20 = Panel("""英文help: interval代表一维区间数据（或者范围）。这一数据类型在参数为on时可以循环。一维区间数据典型的应用代表是曲线范围。
     一个区间有起始两个数字组成。这两个数字指明了这个区域的限制范围。每一个在这中间的数字都属于这个区间的一部分。""")
panel_21 = Panel("""注意：间隔可以从数字型数据中提取数据。如果输入v为双精度浮点数据或者整数数据。一个从0之v的间隔将会被建立。如果v为0或者负值。注意这将导致递减间隔。

间隔可以从所有的曲线数据中汲取数据。在这种情况下。曲线阈值被拷贝。""")
interval = Interval()
# 右键 set one string  设置一列字符
# 右键  set multiple strings   设置多列字符
str_2 = String("123*12")
str_3 = String(["123", "123123", "123123123123"])
int_2 = Integer([1, 2, 3, 4])
# 右键 set one number  设置一个数字
# 右键  set multiple  numbers  设置多个数字
num_3 = Number(12.45)
# 右键 set one Integer 设置一个整数
# 右键  set multiple Integer   设置多个整数
int_3 = Integer(0)
num_4 = Number([12.43, 25.12, 10])
id_2 = Guid([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])
col_2 = Colour([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])
# 右键 set one colour 设置一个颜色
# 右键  set multiple colours   设置多个颜色
col_3 = Colour(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)
# 右键 set one guid  选择一个参量
# 右键  set multiple guids   选择多个参量
id_3 = Guid(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)
# 右键  set one interval2  设置一个二维区间
# 右键  set multiple interval2s  设置多个二维区间
interval²_2 = Interval²(Domain2(u=0.4..1.1, v=0.2..0.6))
interval²_3 = Interval²([Domain2(u=1..2, v=1..2), Domain2(u=4..8, v=2..7), Domain2(u=2..8, v=1..9)])
interval_2 = Interval(Domain(1, 2))
# 右键 set one interval  设置一个区间
# 右键  set multiple intervals  设置多个区间
interval_3 = Interval(Domain(1, 2))
interval_4 = Interval([Domain(1, 2), Domain(3, 4), Domain(5, 6)])
id_4 = Guid(panel_15)
int_4 = Integer("1")
str_4 = String("1.4")
panel_22 = Panel(interval_2)
panel_23 = Panel(str_2)
panel_24 = Panel(str_3)
panel_25 = Panel(int_2)
panel_26 = Panel(num_4)
panel_27 = Panel(int_3)
panel_28 = Panel(num_3)
panel_29 = Panel(id_3)
panel_30 = Panel(id_2)
panel_31 = Panel(col_3)
panel_32 = Panel(col_2)
int_5 = Integer("1.8")
panel_33 = Panel(interval²_3)
panel_34 = Panel(interval²_2)
col_4 = Colour("255,0,255")
panel_35 = Panel(interval_4)
panel_36 = Panel(interval_3)
interval_5 = Interval("-1")
panel_37 = Panel(id_4)
num_5 = Number(int_4)
num_6 = Number(str_4)
interval²_4 = Interval²(interval_2)
panel_38 = Panel(int_5)
panel_39 = Panel(col_4)
panel_40 = Panel(interval_5)
panel_41 = Panel(num_6)
panel_42 = Panel(num_5)
panel_43 = Panel(interval²_4)
path = DataPath()
panel_44 = Panel("""英文help:代表一列树形分支路径数据。grasshopper以分级的方式存储数据与树形分支结构相同。在树形数据结构里的每一个分支由一系列整数索引所定义。

路径数据可以存储连续数据。你可以通过参数菜单设置连续的数据记录。""")
# 右键  set path   设置一个路径如{0:0:0}
# 右键  Manage  path collection  设置多个路径
path_2 = DataPath("{0:0:0}")
path_3 = DataPath(["{0:0:0}", "{0:0:1}", "{0:0:2}"])
panel_45 = Panel(path_2)
panel_46 = Panel(path_3)
image = ImageSampler(FilePath="D:\桌面文件\导出图片\EP12.jpg", Interpolate=False, Wrap=1, Filter="Colour")
panel_47 = Panel("英文help: 代表一列始建于日期值。时间参数可以存储连续数据。你可以通过参数菜单设置连续数据。")
time = Time()
panel_48 = Panel("时间参数目前不能与任何grasshopper部件连用，他们将会在以后的功能中得到运用。")
panel_49 = Panel("""help:代表一列渲染（渲染材质）值。shader使用在实时及渲染显示几何体时。grasshopper渲染以提供多设置的可以在视窗中实施观察的rhino基本材质为基础。

另外，grasshopper渲染同样支持参照rdk材质。这种材质包含程序及贴图和网格细分材质。注意所有的高级rdk渲染是在opengl中是如何降级为rhino基本材质的。""")
panel_50 = Panel("""diffuse(漫反射)
漫反射通道代表了基本颜色。这一通道依靠光源。
emission(自发光)
自发光通道被加载到漫反射通道独立于灯光系统。它可以使物体在黑暗环境中发光。
specular(镜面反射)
镜面反射通道空值高光的颜色。高光颜色同灯光颜色相混。
ambient(环境光
环境光同自发光相似。但是在opengl是口中不可见。
reflection（反射光）
反射通道影响反射物体的颜色。这一通道在opengl视口不可见。
transparent(透明度)
透明度通道影响折射物体的颜色。这一通道在opengl是口中不可见。""")
shader = Shader()
# 图像通道
# texture（材质)
# 当定义材质时，材质通道覆盖漫反射通道。
# bump(凹凸贴图)
# 凹凸贴图通道重新排列一个表面的法向量以造成一种幻像。
# transparency(透明度)
# 当定义时，透明度通道控制本物件的不透明度。
# Emap(环境贴图)
# 当定义后，环境贴图模拟环境反射。
panel_51 = Panel("""IOR
渲染的ior值代表了折射率。这一属性在opengl是口中没有视觉影响。
Name
Name值可选区域。它包含了为这一渲染所起的友好的材质名称。
Shine(光泽)
Shine空值高光的范围。低的shine值导致小的高光。高的shine值导致平滑的面积较大的高光。0无高光。
Reflectivity（反射）
Reflectivity空值反射的程度。这一通道在opengl视窗不可见。
Transparency(透明度)
Transparency控制这一物体的密实程度。""")
# 右键  set one time  设置一个时间
time_2 = Time(37850020000)
shader_2 = Shader([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])
panel_52 = Panel(time_2)
panel_53 = Panel(shader_2)
