# Grasshopper definition Ba logic_boolean.ghx (Grasshopper 0.6.19)

panel = Panel(""""与门"
A,B(或A,B,C）里存在一个布尔值或更多为false，则结果为false；
全部是"true"时，为"true".""")
panel_2 = Panel("""关于number和boolean的转换关系

"0" = "false"
非"0"的数 = "true"
""")
panel_3 = Panel(""""或门"
A,B(或A,B,C）里存在一个布尔值或更多为true，则结果为true；
全部是"false"时，为"false".""")
panel_4 = Panel(""""非或"
在输入条件相同的条件下，输出结果和"或门"向反。
相当于"或门"加"非门"
""")
panel_5 = Panel(""""非门"
输入"true"，得到"false"
输入"false"，得到"true"
""")
panel_6 = Panel(""""同或"
当A,B两端输入boolean值相同时输出"true"
当A,B两端输入boolean值不同时输出"false"
""")
panel_7 = Panel(""""非与"
在输入条件相同的条件下，输出结果和"与门"向反。
相当于"与门"加"非门"
""")
panel_8 = Panel(""""异或"
当A,B两端输入boolean值相同时输出"false"
当A,B两端输入boolean值不同时输出"true"
""")
panel_9 = Panel(""""投票"
这个运算器将输出，"票数"相对多的boolean值""")
and = GateAnd(
    A=[Toggle(True), Toggle(False), Toggle(True), Toggle(False)],
    B=[Toggle(True), Toggle(True), Toggle(False), Toggle(False)])
and_2 = GateAndTernary()
or = GateOrTernary()
or_2 = GateOr(
    A=[Toggle(True), Toggle(False), Toggle(True), Toggle(False)],
    B=[Toggle(True), Toggle(True), Toggle(False), Toggle(False)])
and_3 = GateAnd(A="1", B="0")
not = GateNot(A=[Toggle(True), Toggle(False)])
and_4 = GateAnd(A=Toggle(True), B=Toggle(False))
nand = GateNand(
    A=[Toggle(True), Toggle(False), Toggle(True), Toggle(False)],
    B=[Toggle(True), Toggle(True), Toggle(False), Toggle(False)])
nor = GateNor(
    A=[Toggle(True), Toggle(False), Toggle(True), Toggle(False)],
    B=[Toggle(True), Toggle(True), Toggle(False), Toggle(False)])
and_5 = GateAnd()
or_3 = GateOr()
xnor = GateXnor(
    A=[Toggle(True), Toggle(False), Toggle(True), Toggle(False)],
    B=[Toggle(True), Toggle(True), Toggle(False), Toggle(False)])
xor = GateXor(
    A=[Toggle(True), Toggle(False), Toggle(True), Toggle(False)],
    B=[Toggle(True), Toggle(True), Toggle(False), Toggle(False)])
vote = GateMajority(A=Toggle(False), B=Toggle(False), C=Toggle(True))
not_2 = GateNot(A=or_3)
not_3 = GateNot(A=and_5)
panel_10 = Panel(and_3)
panel_11 = Panel(and_4)
panel_12 = Panel(and)
panel_13 = Panel(or_2)
or_4 = GateOr()
and_6 = GateAnd()
panel_14 = Panel(not)
panel_15 = Panel(xnor)
panel_16 = Panel(nor)
panel_17 = Panel(nand)
panel_18 = Panel(xor)
panel_19 = Panel(vote)
and_7 = GateAndTernary()
or_5 = GateOrTernary()
nor_2 = GateNor()
not_4 = GateNot()
xnor_2 = GateXnor()
nand_2 = GateNand()
xor_2 = GateXor()
vote_2 = GateMajority()
