# Grasshopper definition Bb logic-list.ghx (Grasshopper 0.6.19)

panel = Panel("""Split list/列表分段
使列表偏移若干位。

输入参数
L 原列表
i 断开位置（的编号）

输出参数
A 断开位置前的列表
B 断开位置后的列表""")
panel_2 = Panel("""Item/项
输入列表中对象的编号（一个或多个），从中选出对象。

输入参数
L 原列表
I 指定编号（一个或多个）
W 若给定编号超出了原列表的范围，是否允许按原列表顺序将原列表滚动重复以强制选出超出范围的编号的对应项。

输出参数
E 选出的项""")
panel_3 = Panel("""Sort List/整理列表
将一系列对象分别给与特定的编号，再按编号的大小顺序排列对象。编号可以以数字或字符串的方式输入。

输入参数
K 包含编号的列表
A 要整理的对象列表

输出参数
L 编号排序的结果
A 整理后的对象列表""")
panel_4 = Panel("""Reverse List/倒转列表
将列表中的对象按编号倒置的方式重新排序。

输入参数
L 原列表

输出参数
L 倒转列表""")
panel_5 = Panel("""List length/列表长度（列表包含的对象个数）
对象在列表中都有对应的编号。第一个对象对应编号是0，第二个对应的是1，以此类推。一个列表中可能出现的最大编号等于列表长度值减去一。

输入参数
L 基础列表

输出参数
L 列表所包含对象的个数""")
item = ListItem(W=False)
# Dispatch/数据分流
# 将一系列对象以编号顺序按指定的布尔排列顺序分为两个部分。该运算器功能与[Cull Pattern]非常相似，只是它并不是删除对应false的项，而是将其归为另一部分。
# 
# 输入参数：
# L 对象集合
# p 布尔排列
# 
# 输出参数：
# A 对应true的项
# B 对应false的项
dispatch = Dispatch(P=[True, False])  # -> A, B
# shift list/列表移位
# 使列表偏移若干位。
# 
# 输入参数
# L 原列表
# S 偏移位数，若为正整数，则向后偏移，若为负整数，则向前偏移
# W 是否允许原列表滚动重复，以使偏移后的列表保持原列表的对象数量
# 
# 输出参数
# L 偏移后的列表
shift = ShiftList(S=1, W=False)
# Sub List/子列表
# 输入一个区间，将原列表中在指定区间内的项选择出来。
# 
# 输入参数
# L 原列表
# I 指定区间
# C 若区间范围超出了原列表的范围，是否允许按原列表顺序将新的子列表补足
# 
# 输出参数
# L 子列表
# I 子列表中的项在原列表中的编号
sort = SortList()  # -> L, A
subset = SubList(C=False)  # -> L, I
lng = ListLength()
rev = ReverseList()
split = SplitList()  # -> A, B
# Null Item/空变量对象评价
# 以布尔的方式评价列表中对象是否为空变量。
# 
# 输入参数
# I 列表
# 
# 输出参数
# N 将空变量(null)显示为true，其余显示为false
# 
# X 将错误变量(invalid)显示为true，其余显示为false
null = NullItem()  # -> N, X
weave = Weave(P=[0, 1], NullGaps=False)
series = Series(S=0, N=1, C=10)
series_2 = Series(S=0, N=1, C=10)
series_3 = Series(S=0, N=1, C=10)
series_4 = Series(S=0, N=1, C=10)
int = Integer([0, 1, 2, 0, 0, 1, 2])
str = String(["a", "b", "c", "d"])
str_2 = String(["1", "2", "3", "4", "5", "6", "7", "8", "9"])
str_3 = String(["金", "木", "水", "火", "土", "我", "靠"])
series_5 = Series(S=0, N=1, C=10)
# Weave/编织
# 为列表设定编号（如有3个列表，则分别为0，1，2）后，再设置从列表中提取数据的模式，按顺序提取。
# 例：列表0：a,b,c
#         列表1：你，我，他
#         列表2：1，2，3
#         提取模式：2，0，1
# 
#         结果列表：1，a，你，2，b，我，3，c，他
# 
# 输入参数
# P 提取模式
# 0 列表0
# 1 列表1
# .......
# 
# 输出参数
# W 编织后的列表
int_2 = Integer([0, 1, 2, 0, 0, 1, 2])
str_4 = String(["a", "b", "c", "d"])
str_5 = String(["1", "2", "3", "4", "5", "6", "7", "8", "9"])
str_6 = String(["金", "木", "水", "火", "土", "我", "靠"])
series_6 = Series(S=0, N=1, C=10)
series_7 = Series(S=0, N=1, C=10)
series_8 = Series(S=0, N=1, C=10)
series_9 = Series(S=0, N=1, C=10)
series_10 = Series(S=0, N=1, C=10)
str_7 = String(["a", "b", "c", "d", "e", "f", "g", "h", "i"])
str_8 = String(["a", "b", "c", "d", "e", "f", "g", "h", "i"])
pt = PointXYZ(X=series_5, Y=0, Z=0)
int_3 = Integer([2, 5, 9, 3, 4, 7, 6, 8, 1, 0])
vb = DotNETVBScript(x=series_6)  # -> out, A
# ---------- vb: C# ----------
    If x Mod 2 = 0 Then A = x
# ---------- end vb ----------
cir = Circle(P=PlaneXY(0, 0, 0), R=series_7)
panel_6 = Panel(int)
panel_7 = Panel(str)
panel_8 = Panel(int_2)
panel_9 = Panel(str_4)
panel_10 = Panel(series)
lng_2 = ListLength(L=series)
rev_2 = ReverseList(L=series_3)
panel_11 = Panel(series_3)
panel_12 = Panel(series_2)
panel_13 = Panel(series_4)
panel_14 = Panel(str_2)
panel_15 = Panel(str_5)
panel_16 = Panel(series_8)
split_2 = SplitList(L=series_8, i=Slider(1.9875, range=0..3))  # -> A, B
series_11 = Series(S=0, N=1, C=10)
series_12 = Series(S=0, N=1, C=10)
dispatch_2 = Dispatch(L=series_2, P=[Toggle(False), Toggle(True)])  # -> A, B
dispatch_3 = Dispatch(L=series_4, P=[Toggle(False), Toggle(True), Toggle(True)])  # -> A, B
int_4 = Interval(A=Slider(3.827160494, range=0..10), B=Slider(18.5, range=0..20))
int_5 = Interval(A=Slider(3.827160494, range=0..10), B=Slider(18.5, range=0..20))
shift_2 = ShiftList(L=series_9, S=Slider(3, range=0..3), W=Toggle(True))
shift_3 = ShiftList(L=series_10, S=Slider(3, range=0..3), W=Toggle(False))
panel_17 = Panel(pt)
panel_18 = Panel(series_9)
panel_19 = Panel(series_10)
panel_20 = Panel(str_3)
panel_21 = Panel(str_6)
panel_22 = Panel(str_7)
panel_23 = Panel(str_8)
item_2 = ListItem(L=str_8, i=Slider(3.5, range=0..20), W=Toggle(False))
item_3 = ListItem(L=str_7, i=Slider(14.10003662, range=0..20), W=Toggle(True))
panel_24 = Panel(cir)
panel_25 = Panel(vb.A)
panel_26 = Panel(int_3)
panel_27 = Panel(lng_2)
sort_2 = SortList(K=int_3, A=pt)  # -> L, A
weave_2 = Weave(P=int, _0=str, _1=str_2, _2=str_3, NullGaps=True)
weave_3 = Weave(P=int_2, _0=str_4, _1=str_5, _2=str_6, NullGaps=False)
panel_28 = Panel(rev_2)
null_2 = NullItem(I=vb.A)  # -> N, X
null_3 = NullItem(I=cir)  # -> N, X
panel_29 = Panel(dispatch_2.A)
panel_30 = Panel(dispatch_2.B)
panel_31 = Panel(dispatch_3.A)
panel_32 = Panel(dispatch_3.B)
panel_33 = Panel(shift_2)
panel_34 = Panel(shift_3)
panel_35 = Panel(series_12)
panel_36 = Panel(series_11)
panel_37 = Panel(split_2.B)
panel_38 = Panel(split_2.A)
subset_2 = SubList(L=series_11, I=int_4, C=Toggle(False))  # -> L, I
subset_3 = SubList(L=series_12, I=int_5, C=Toggle(True))  # -> L, I
panel_39 = Panel(item_2)
panel_40 = Panel(item_3)
panel_41 = Panel(weave_2)
panel_42 = Panel(weave_3)
panel_43 = Panel(sort_2.L)
panel_44 = Panel(sort_2.A)
panel_45 = Panel(null_2.N)
panel_46 = Panel(null_3.N)
panel_47 = Panel(subset_2.L)
panel_48 = Panel(subset_2.I)
panel_49 = Panel(subset_3.L)
panel_50 = Panel(subset_3.I)
panel_51 = Panel(null_2.X)
panel_52 = Panel(null_3.X)
