# Grasshopper definition Bd logic-set.ghx (Grasshopper 0.6.19)

panel = Panel("""Cull Parttern/按规律删除一部分
将原列表以给定的布尔序列的循环来删除对应为false的项

输入参数
L  原列表
P  布尔排列

输出参数
L 去除后的列表""")
panel_2 = Panel("""Fibonacci/斐波那契数列
创建斐波那契数列，设置第0，1项，之后第N项等于它之前两项的和

输入参数
A  第0项数字
B  第1项数字
N 数列包含数的个数

输出参数
S 所得的斐波那契数列""")
panel_3 = Panel("""Range/范围
将一个范围等分成N段，提取处在等分点的数字（包括范围的首尾）。

输入参数
D  给与范围
N  分段数

输出参数
R 震荡后的列表
I 处在等分点的数字（包括范围的首尾）""")
panel_4 = Panel("""Series/数列
生成一组等差数列

输入参数
S   起始数
N  差值
C  数组包含的数的个数

输出参数
S 所得的等差数列""")
# Jitter/震荡
# 随机打乱一个列表的顺序
# 
# 输入参数
# L  原列表
# J 震荡程度，范围为0到1的区间，控制一个项能在整个列表中以自身为震荡中心的“振幅”，当设为0，则无法震荡，设为1，则允许项的最大“振幅”为整个列表的长度。
# S 随机种子
# 
# 
# 输出参数
# R 震荡后的列表
# I 震荡后的列表中的项在原列表中的编号
dup = DuplicateData(O=True)
series = Series(S=0, C=10)
# Cull Nth/去除Nth
# 在列表中从第N项开始，每隔N项去除一项，也就是删除列表中编号为N的正整数倍减去1的项（如N=3，则删除第2，5，8......项）
# 
# 输入参数
# L 原列表
# N N
# 
# 输出参数
# L 去除后的列表
# Duplicate Data/复制数据
# 将数据复制任意次数
# 
# 输入参数
# D 原数据或数据列表
# N 复制次数
# O 若输入项D为列表，是否保持原列表的顺序:
# true，则保持，以整个列表为单位排序，
# false，则将复制出的相同的项排列在一起。
# 
# 输出参数
# D 复制出的列表
cull = CullNth(N=2)
# Random/随机
# 随机生成一组数
# 
# 输入参数
# R   随机生成的范围
# N  随机生成的个数
# S  随机种子
# I  是否强制生成整数:
# true，则强制生成整数，false则不
# 
# 输出参数
# R 所得的随机数列
fib = Fibonacci(B=1, N=10)
jitter = Jitter(J=1, S=2)  # -> R, I
range = Range(D=Domain(0, 1))
cull_2 = CullPattern(P=[False, False, True, True])
random = Random(R=Domain(0, 1), S=2, I=False)
pt = PointXYZ(X=[0, 1, 2], Y=0, Z=0)
pt_2 = PointXYZ(X=[0, 1, 2], Y=0, Z=0)
series_2 = Series(S=0, N=1, C=10)
str = String(["a", "b", "c", "d", "e", "f", "g", "h", "i", "j"])
str_2 = String(["a", "b", "c", "d", "e", "f", "g", "h", "i", "j"])
panel_5 = Panel(pt)
panel_6 = Panel(pt_2)
panel_7 = Panel(str)
int = Interval(A=Slider(2.30864254, range=0..5), B=Slider(4.864198661, range=0..5))
panel_8 = Panel(series_2)
cull_3 = CullNth(L=str, N=Slider(3.079012647, range=0..5))
int_2 = Interval(A=Slider(29.25001144, range=0..100), B=Slider(70.41976364, range=0..100))
cull_4 = CullPattern(L=series_2, P=[Toggle(False), Toggle(True), Toggle(True)])
dup_2 = DuplicateData(D=pt, N=Slider(4.607408312, range=0..10), O=Toggle(False))
dup_3 = DuplicateData(D=pt_2, N=Slider(4.607408312, range=0..10), O=Toggle(True))
series_3 = Series(S=Slider(0.7534999847, range=0..1), N=Slider(0.3709999084, range=0..1), C=Slider(7.684997559, range=0..10))
fib_2 = Fibonacci(A=Slider(0.5, range=0..10), B=Slider(2.5, range=0..10), N=Slider(7.75, range=0..10))
panel_9 = Panel(str_2)
jitter_2 = Jitter(L=str_2, J=Slider(0.4950000763, range=0..1), S=Slider(47.5, range=0..100))  # -> R, I
range_2 = Range(D=int, N=Slider(7.799999237, range=0..10))
panel_10 = Panel(cull_4)
panel_11 = Panel(cull_3)
panel_12 = Panel(dup_2)
panel_13 = Panel(int)
panel_14 = Panel(dup_3)
panel_15 = Panel(int_2)
panel_16 = Panel(series_3)
panel_17 = Panel(fib_2)
random_2 = Random(R=int_2, N=Slider(5.174999237, range=0..10), S=Slider(70.41976364, range=0..100), I=Toggle(False))
panel_18 = Panel(jitter_2.R)
panel_19 = Panel(jitter_2.I)
panel_20 = Panel(range_2)
panel_21 = Panel(random_2)
