# Grasshopper definition Be logic-tree.ghx (Grasshopper 0.6.19)

panel = Panel("""Filter是一个数据分流的开关运算器，但G值为N的时候S端将输出第N项的数据。

右键output Manager可以添加输入端""")
panel_2 = Panel("""Graft是一个让树生长的运算器

Graft可以让每个树枝上的叶子都继续生长出一个树枝。而每个树枝上只有一片叶子。即有多少个数据就建立多少个路径，而每个路径上一个数据。

S为boolean项，S为false时null项不生成路径。""")
# Merge用于把两个数据连接到一起。
# 
# 如果A,B项为线形数据，则连接结果也是线形连接
# 
# 如果A.B项为树形数据，则连接结果会按路径分开混接。
# 
# Merge(Merge Mutiple)功能同上，右键output Manager 添加输入端
series = Series(S=0, N=1, C=10)
panel_3 = Panel("""Compare 用于判断路径和掩码是否匹配

branch符合mask输出true；branch不符合mask输出false    """)
series_2 = Series(S=0, N=1, C=10)
series_3 = Series(S=3, N=1, C=10)
panel_4 = Panel("""Branch用于从一棵树上抽取一个树枝

P项用于输入要抽取的路径""")
# Simplify可谓一个优化树形数据的运输器。它可以直接砍掉这个树形数据路径相同的部分。
# 
# 比如 {0:0:1};{0:0:3} 这个数据之前有相同的 {0:0} 于是直接被砍成 {1},{3}。主要用于简化数据结构。
pt = PointXYZ(X=0, Y=0, Z=0)
panel_5 = Panel("""Item用于从一棵树上抽取一片树叶

P:用于输入要抽取的路径   i:用于输入要抽取的第几片叶子""")
pt_2 = PointXYZ(X=0, Y=0, Z=0)
panel_6 = Panel("""Prune用于砍掉一个树上的树叶数在指定范围内的树枝。

当一个树枝上的树叶（数据）数，大于N0小于N1的时候，这个树枝将会被砍掉。""")
pt_3 = PointXYZ(X=0, Y=0, Z=0)
pt_4 = PointXYZ(X=0, Y=0, Z=0)
panel_7 = Panel("""BANG!用来将一颗树分解，把各各树枝分解出来。

右键output Manager可以增加输出项""")
int = Integer([0, 0, 0, 1])
int_2 = Integer([0, 0, 0, 2])
panel_8 = Panel("""Gate是另一个数据分流的开关运算器，但G值为N的时候S端的数据将从右侧第N项输出。

右键output Manager可以添加输入端""")
int_3 = Integer([0, 0, 0])
int_4 = Integer([0, 0, 1, 1])
panel_9 = Panel("""Flatten的功能和右键Flatten一样，可以将一个树形数据转换成线性数据

P项为路径项，用来控制生成的线性数据所在的的路径位置。""")
# "树形数据"是指整个数据结构成树形，如右图params viewer显示。这种数据有八10个路径（树枝），每条路径上有8个数据（树叶）又如panel中显示的{0:0:1}代表树枝的路径，路径下的8个数据即为这个路径上的数据。
# 
# 
# 注意：运算器中的连线问题
# 单线为单个数据；双线为多个线形数据；虚线为多个树形数据
pt_5 = PointXYZ(X=0, Y=0, Z=0)
panel_10 = Panel("""clean用于清理一组数据中的null和invalid部分

X,E为boolean值，X为true清理invalid项，E为true清理null项。""")
pt_6 = PointXYZ(X=0, Y=0, Z=0)
pt_7 = PointXYZ(X=0, Y=0, Z=0)
int_5 = Integer([0, 0, 1])
pt_8 = PointXYZ(X=0, Y=0, Z=0)
int_6 = Integer([0, 0, 2, 1])
int_7 = Integer([0, 0, 2])
int_8 = Integer([0, 0, 1])
int_9 = Integer([0, 0, 2])
int_10 = Integer([0, 1, 0])
int_11 = Integer([0, 0, 0, 2])
int_12 = Integer([0, 0, 2, 1])
int_13 = Integer([0, 0, 0, 2])
# create branch 和 decompose branch
# 
# create branch 可以利用一段数组，创建一个路径。
# decompose branch 过程与 create branch 向反，可以把路径名分级成数组。
int_14 = Integer([0, 1, 2])
cir = Circle(P=pt, R=10)
cir_2 = Circle(P=pt_2, R=10)
cir_3 = Circle(P=pt_3, R=10)
cir_4 = Circle(P=pt_4, R=10)
series_4 = Series(S=0, N=3, C=3)
# Replace 可以从一棵树上利用掩码抽选出一些树枝，在集合到指定的树枝上。
# 
# S为掩码输入项，如0:0:? （?代表任意数；*代表任意几个数）
# 
# P为路径输入项，如{0:0:1}
series_5 = Series(S=0, N=3, C=3)
cir_5 = Circle(P=pt_5, R=10)
cir_6 = Circle(P=pt_6, R=10)
series_6 = Series(S=0, N=5, C=6)
cir_7 = Circle(P=pt_8, R=10)
cir_8 = Circle(P=pt_7, R=10)
series_7 = Series(S=0, N=5, C=6)
branch = CreateBranch(I=int_3)
branch_2 = CreateBranch(I=int)
series_8 = Series(S=0, N=2, C=5)
branch_3 = CreateBranch(I=int_5)
series_9 = Series(S=0, N=3, C=10)
branch_4 = CreateBranch(I=int_4)
series_10 = Series(S=0, N=3, C=10)
branch_5 = CreateBranch(I=int_7)
branch_6 = CreateBranch(I=int_6)
panel_11 = Panel(series_3)
branch_7 = CreateBranch(I=int_2)
series_11 = Series(S=0, N=2, C=5)
series_12 = Series(S=0, N=3, C=10)
branch_8 = CreateBranch(I=int_12)
branch_9 = CreateBranch(I=int_11)
series_13 = Series(S=0, N=3, C=10)
branch_10 = CreateBranch(I=int_13)
panel_12 = Panel(int_14)
branch_11 = CreateBranch(I=int_8)
branch_12 = CreateBranch(I=int_9)
branch_13 = CreateBranch(I=int_10)
graft = GraftTree(D=series_2, S=False)
divide = DivideCurve(C=cir, N=10, K=False)  # -> P, T, t
divide_2 = DivideCurve(C=cir_2, N=10, K=False)  # -> P, T, t
flatten = FlattenTree(D=series_4, P=branch)
divide_3 = DivideCurve(C=cir_3, N=10, K=False)  # -> P, T, t
divide_4 = DivideCurve(C=cir_4, N=10, K=False)  # -> P, T, t
flatten_2 = FlattenTree(D=series_5, P=branch_2)
panel_13 = Panel(series)
flatten_3 = FlattenTree(D=series_6, P=branch_3)
flatten_4 = FlattenTree(D=series_7, P=branch_4)
divide_5 = DivideCurve(C=cir_5, N=10, K=False)  # -> P, T, t
divide_6 = DivideCurve(C=cir_6, N=10, K=False)  # -> P, T, t
divide_7 = DivideCurve(C=cir_8, N=10, K=False)  # -> P, T, t
divide_8 = DivideCurve(C=cir_7, N=10, K=False)  # -> P, T, t
flatten_5 = FlattenTree(D=series_9, P=branch_5)
flatten_6 = FlattenTree(D=series_8, P=branch_6)
flatten_7 = FlattenTree(D=series_10, P=branch_7)
flatten_8 = FlattenTree(D=series_11, P=branch_8)
flatten_9 = FlattenTree(D=series_12, P=branch_9)
flatten_10 = FlattenTree(D=series_13, P=branch_10)
branch_14 = CreateBranch(I=int_14)
merge = Merge(A=series, B=series_3)
ln = Line(A=pt, B=divide.P)
ln_2 = Line(A=pt_2, B=divide_2.P)
ln_3 = Line(A=pt_3, B=divide_3.P)
ln_4 = Line(A=pt_4, B=divide_4.P)
ln_5 = Line(A=pt_5, B=divide_5.P)
ln_6 = Line(A=pt_6, B=divide_6.P)
ln_7 = Line(A=pt_7, B=divide_7.P)
ln_8 = Line(A=pt_8, B=divide_8.P)
panel_14 = Panel(flatten_4)
panel_15 = Panel(flatten_7)
panel_16 = Panel(flatten_2)
panel_17 = Panel(flatten_6)
panel_18 = Panel(branch_14)
viewer = ParamViewer(graft)
compare = PathCompare(P=[branch_11, branch_12, branch_13], M="0:0:?")
divide_9 = DivideCurve(C=ln, N=7, K=False)  # -> P, T, t
divide_10 = DivideCurve(C=ln_2, N=7, K=False)  # -> P, T, t
divide_11 = DivideCurve(C=ln_3, N=7, K=False)  # -> P, T, t
divide_12 = DivideCurve(C=ln_4, N=7, K=False)  # -> P, T, t
divide_13 = DivideCurve(C=ln_6, N=7, K=False)  # -> P, T, t
divide_14 = DivideCurve(C=ln_5, N=7, K=False)  # -> P, T, t
divide_15 = DivideCurve(C=ln_7, N=7, K=False)  # -> P, T, t
divide_16 = DivideCurve(C=ln_8, N=7, K=False)  # -> P, T, t
panel_19 = Panel(merge)
branch_15 = DecomposeBranch(B=branch_14)
int_15 = Integer([0, 1, 2])
merge_2 = MergeMultiple(_0=flatten, _1=flatten_3, _2=flatten_5)
dist = Distance(A=divide_9.P, B=pt)
dist_2 = Distance(A=divide_10.P, B=pt_2)
dist_3 = Distance(A=divide_11.P, B=pt_3)
dist_4 = Distance(A=divide_12.P, B=pt_4)
dist_5 = Distance(A=divide_14.P, B=pt_5)
dist_6 = Distance(A=divide_13.P, B=pt_6)
dist_7 = Distance(A=divide_15.P, B=pt_7)
dist_8 = Distance(A=divide_16.P, B=pt_8)
panel_20 = Panel(branch_15)
panel_21 = Panel(compare)
merge_3 = MergeMultiple(_0=flatten_2, _1=flatten_4, _2=flatten_7, _3=flatten_6)
branch_16 = CreateBranch(I=int_15)
gate = StreamGate(S=flatten_10, G=Slider(1, range=0..1))  # -> _0, _1
filter = StreamFilter(G=Slider(1, range=0..1), _0=flatten_9, _1=flatten_8)
series_14 = Series(S=0, N=1, C=10)
series_15 = Series(S=3, N=1, C=10)
div = Division(A=dist, B=7)
div_2 = Division(A=dist_2, B=7)
compare_2 = PathCompare(M="*")
div_3 = Division(A=dist_3, B=7)
div_4 = Division(A=dist_4, B=7)
div_5 = Division(A=dist_6, B=7)
div_6 = Division(A=dist_5, B=7)
prune = PruneTree(D=merge_2, N0="4", N1="6")
div_7 = Division(A=dist_7, B=7)
div_8 = Division(A=dist_8, B=7)
int_16 = Integer([0, 0, 0])
int_17 = Integer([0, 0, 0])
branch_17 = CreateBranch()
branch_18 = DecomposeBranch()
panel_22 = Panel(branch_16)
cir_9 = Circle(P=divide_10.P, R=div_2)
cir_10 = Circle(P=divide_14.P, R=div_6)
viewer_2 = ParamViewer(divide_14.P)
cir_11 = Circle(P=divide_13.P, R=div_5)
bang = ExplodeTree(T=cir_11)  # -> _1, _2, _3, _4, _5, _6, _7, _8, _9, _10
cir_12 = Circle(P=divide_15.P, R=div_7)
cir_13 = Circle(P=divide_16.P, R=div_8)
graft_2 = GraftTree(D=series_14, S=False)
graft_3 = GraftTree(D=series_15, S=False)
panel_23 = Panel("这一部分数据中，由于部分圆的半径为0（不成立）所以会输出一部分invalid circle")
panel_24 = Panel(filter)
panel_25 = Panel(prune)
cir_14 = Circle(P=divide_9.P, R=div)
cir_15 = Circle(P=divide_11.P, R=div_3)
cir_16 = Circle(P=divide_12.P, R=div_4)
clean = CleanTree(D=cir_13, X=Toggle(True), E=False)
branch_19 = CreateBranch(I=int_16)
branch_20 = CreateBranch(I=["0", "0", Slider(0, range=0..9)])
branch_21 = CreateBranch(I=["0", "0", Slider(4, range=0..9)])
branch_22 = CreateBranch(I=int_17)
merge_4 = Merge()
prune_2 = PruneTree(N0=0, N1=0)
panel_26 = Panel(gate._1)
panel_27 = Panel(gate._0)
graft_4 = GraftTree(S=False)
bang_2 = ExplodeTree()  # -> _1, _2
simplify = SimplifyTree(T=cir_14)
simplify_2 = SimplifyTree()
flatten_11 = FlattenTree(D=cir_12, P=branch_16)
replace = ReplaceBranches(S="*")
flatten_12 = FlattenTree(P="{0}")
clean_2 = CleanTree(X=True, E=False)
panel_28 = Panel(bang._1)
graft_5 = GraftTree(D=cir_9, S=False)
panel_29 = Panel(bang._2)
panel_30 = Panel(graft_3)
panel_31 = Panel(bang._3)
panel_32 = Panel(bang._4)
panel_33 = Panel(bang._5)
gate_2 = StreamGate(G=0)  # -> _0, _1
filter_2 = StreamFilter(G=0)
panel_34 = Panel(bang._6)
replace_2 = ReplaceBranches(D=merge_3, S="0:0:0:?", R=branch_19)
panel_35 = Panel(bang._7)
merge_5 = MergeMultiple()
replace_3 = ReplaceBranches(D=merge_3, S="0:*:1", R=branch_22)
item = TreeItem(W=False)
branch_23 = TreeBranch()
panel_36 = Panel(bang._8)
branch_24 = TreeBranch(T=cir_15, P=branch_20)
item_2 = TreeItem(T=cir_16, P=branch_21, i=Slider(5, range=0..7), W=False)
panel_37 = Panel(bang._9)
panel_38 = Panel(bang._10)
panel_39 = Panel(cir_11)
panel_40 = Panel(cir_12)
panel_41 = Panel(cir_13)
panel_42 = Panel(clean)
panel_43 = Panel(flatten_11)
viewer_3 = ParamViewer(graft_5)
panel_44 = Panel(merge_2)
panel_45 = Panel(cir_14)
panel_46 = Panel(simplify)
panel_47 = Panel(cir_10)
panel_48 = Panel(graft_2)
panel_49 = Panel(graft_5)
merge_6 = Merge(A=graft_2, B=graft_3)
panel_50 = Panel(cir_15)
panel_51 = Panel(branch_24)
panel_52 = Panel(cir_16)
panel_53 = Panel(item_2)
panel_54 = Panel(replace_2)
panel_55 = Panel(replace_3)
viewer_4 = ParamViewer(cir_14)
viewer_5 = ParamViewer(simplify)
panel_56 = Panel(merge_6)
