# Grasshopper definition Ca Scalar_Constants2.ghx (Grasshopper 0.6.19)

# Epsilon：传说中的一个无限趋近于0的数，却不等于0。
# 
# 输入N：倍数
# 输出y：输出值
# 注意：panel会自行将输入端的数据约等于并显示和输出。在这里如果可以看到一个圆的半径若是0，这为Invalid Circle，而Epsilon输出的并不是0，所以将得到有效的圆。
eps = Epsilon(N=1)
panel = Panel("由于grasshopper中很多运算器中默认的角度单位是弧度，也就是2Pi=360度，所以我们也可以直接用Pi来获取我们想要的角度")
# Pi：传说中的圆周率。
# 
# 输入N：倍数
# 输出y：输出值
pi = Pi(N=1)
# Natural logarithm：传说中的自然对数。
# 
# 输入N：倍数
# 输出y：输出值
# Golden Ratio：传说中的黄金比例。
# 
# 输入N：倍数
# 输出y：输出值
E = NaturalLogarithm(N=1)
phi = GoldenRatio(N=1)
panel_2 = Panel(eps)
cir = Circle(P=PlaneXY(0, 0, 0), R=eps)
arc = Arc(P=PlaneXY(0, 0, 0), R=pi, A=Domain(0, 3.141592654))  # -> A, L
panel_3 = Panel(pi)
panel_4 = Panel(E)
panel_5 = Panel(phi)
panel_6 = Panel(cir)
panel_7 = Panel(arc.A)
cir_2 = Circle(P=PlaneXY(0, 0, 0), R=panel_2)
panel_8 = Panel(cir_2)
eps_2 = Epsilon(N=1)
pi_2 = Pi(N=1)
phi_2 = GoldenRatio(N=1)
E_2 = NaturalLogarithm(N=1)
