# Grasshopper definition Cb Scalar_interval.ghx (Grasshopper 0.6.19)

panel = Panel("""Divide interval可以将一个区间等分成几个相等的区间，并依次排开

I:输入区间
C:划分的组数""")
panel_2 = Panel("""Interval输入一个区间的起始值和终点值得到一个区间。

A:起始值
B:终点值""")
panel_3 = Panel("""Bounds可以通过一个数组得到一个区间，所得到的区间为包含这个数组所有数值的最小区间。

N:输入数组
I:输出区间""")
panel_4 = Panel("""Interval2 通过定义UV坐标上的两个区间来确定一个面域。

U:U方向的区间
V:V方向的区间""")
series = Series(S=0, N=1, C=10)
panel_5 = Panel("""Interval2 通过定义UV坐标上的四个极限坐标值来确定一个面域。

U0:U方向起始值
U1:U方向终止值
V0:V方向起始值
V1:V方向终止值""")
series_2 = Series(S=0, N=1, C=10)
bnd = Bounds(N=series)
bnd_2 = Bounds(N=series_2)
int = Interval(A=Slider(1, range=0..10), B=Slider(4, range=0..10))
int_2 = Interval(A=Slider(3, range=0..10), B=Slider(8, range=0..10))
int_3 = Interval(A=Slider(1, range=0..10), B=Slider(4, range=0..10))
panel_6 = Panel(bnd_2)
int² = Interval²(U0=Slider(1, range=0..10), U1=Slider(4, range=0..10), V0=Slider(3, range=0..10), V1=Slider(8, range=0..10))
div = DivideInterval(I=bnd, C=Slider(4, range=0..10))
panel_7 = Panel(div)
panel_8 = Panel(int)
int²_2 = Interval²(U=int_3, V=int_2)
panel_9 = Panel(int²)
bnd_3 = Bounds()
div_2 = DivideInterval(C=10)
int_4 = Interval()
panel_10 = Panel(int²_2)
int²_3 = Interval²(U1=1, V0=0, V1=1)
int²_4 = Interval²()
panel_11 = Panel("""Divide interval2可以将一个面域按照UV法则等分出若干个面域，这个运输器也可以用于等分曲面。

I:属于面域或曲面
U:U方向划分数
V:V方向划分数""")
panel_12 = Panel("""Bounds 2D可以通过一组点集得到一个面域，所得到的面域为包含这组点集所有点的最小面域。

C:输入点集
I:输出面域""")
recgrid = GridRectangular(P=PlaneXY(0, 0, 0), X=5, Y=5, S=1)  # -> G, C, M
panel_13 = Panel("""Interval components 运算过程与Interval可逆可以把一个区间拆解成它的起始值和终止值。

S:起始值
E:终止值""")
recgrid_2 = GridRectangular(P=PlaneXY(0, 0, 0), X=5, Y=5, S=1)  # -> G, C, M
bnd_4 = Bounds2D(C=recgrid_2.G)
panel_14 = Panel("""Interval2 components 过程与Interval2可逆，可以将一个面域拆分成UV坐标上的四个极限坐标值

U0:U方向起始值
U1:U方向终止值
V0:V方向起始值
V1:V方向终止值""")
bnd_5 = Bounds2D(C=recgrid.G)
panel_15 = Panel("""Interval2 components 过程与Interval2可逆，可以将一个面域拆分成UV坐标上的区间。

U:U方向的区间
V:V方向的区间""")
int_5 = Interval(A=Slider(2, range=0..10), B=Slider(4, range=0..10))
panel_16 = Panel(bnd_4)
divide = DivideInterval²(I=bnd_5, U=Slider(4, range=0..10), V=Slider(4, range=0..10))
int_6 = IntervalComponents(I=int_5)  # -> S, E
int_7 = Interval(A=Slider(1, range=0..10), B=Slider(4, range=0..10))
int_8 = Interval(A=Slider(3, range=0..10), B=Slider(8, range=0..10))
int²_5 = Interval²(U0=Slider(1, range=0..10), U1=Slider(4, range=0..10), V0=Slider(3, range=0..10), V1=Slider(8, range=0..10))
panel_17 = Panel(divide)
panel_18 = Panel(int_6.S)
bnd_6 = Bounds2D()
panel_19 = Panel(int_6.E)
int²_6 = Interval²(U=int_7, V=int_8)
int_9 = Interval²Components(I=int²_5)  # -> U0, U1, V0, V1
divide_2 = DivideInterval²(U=10, V=10)
int_10 = IntervalComponents()  # -> S, E
int_11 = Interval²Components(I=int²_6)  # -> U, V
panel_20 = Panel(int_9.U0)
panel_21 = Panel(int_9.U1)
panel_22 = Panel(int_11.U)
panel_23 = Panel(int_9.V0)
panel_24 = Panel(int_11.V)
panel_25 = Panel(int_9.V1)
int_12 = Interval²Components()  # -> U0, U1, V0, V1
int_13 = Interval²Components()  # -> U, V
