# Grasshopper definition Cc Scalar_Operators.ghx (Grasshopper 0.6.19)

slider = Slider(8, range=0..10)
slider_2 = Slider(2, range=0..10)
slider_3 = Slider(3, range=0..10)
slider_4 = Slider(4, range=0..10)
panel = Panel("""输入端
A：数据一
B：数据二""")
panel_2 = Panel("""输入端
A：数据一
B：数据二
T%：AB约等的差值范围""")
panel_3 = Panel("\"等于”“大于”“小于”判断工具")
panel_5 = Panel("”约等于“判断工具")
panel_6 = Panel("余数")
panel_7 = Panel("“加减乘除”工具")
add = Addition(A=slider, B=slider_2)
minus = Subtraction(A=slider, B=slider_2)
div = Division(A=slider, B=slider_2)
mult = Multiplication(A=slider, B=slider_2)
equals = Equality(A=slider_4, B=slider_3)  # -> port, port_2
similar = Similarity(A=Slider(5.530864574, range=0..10), B=Slider(5.728396192, range=0..10), T=Slider(4.444444444, range=0..10))  # -> port, Dt
panel_8 = Panel("A的B次幂")
pow = Power(A=Slider(4, range=0..10), B=Slider(2, range=0..10))
panel_9 = Panel("""输入端
A：基数
B：除以的系数""")
larger = LargerThan(A=slider_4, B=slider_3)  # -> port, port_2
smaller = SmallerThan(A=slider_4, B=slider_3)  # -> port, port_2
mod = Modulus(A=Slider(10, range=0..10), B=Slider(3, range=0..10))
panel_13 = Panel("""输出端
R：A除以B的余数""")
panel_14 = Panel("""输出端
＝：若A=B，则为ture,反之false
＝/：若A=/B,则为ture,反之false""")
panel_15 = Panel(equals.port)
panel_16 = Panel(equals.port_2)
panel_17 = Panel("""输出端
＞：若A＞B，则为ture,反之false
＞＝：若A≥B，则为ture,反之false""")
panel_18 = Panel("""输出端
＝：若A≈B，则为ture,反之false
dt：A与B差值的绝对值""")
panel_19 = Panel("""输出端
R：所得结果""")
panel_20 = Panel(mod)
panel_22 = Panel(add)
panel_23 = Panel(minus)
panel_24 = Panel(div)
panel_25 = Panel(mult)
panel_26 = Panel(smaller.port_2)
panel_27 = Panel(similar.port)
panel_28 = Panel(similar.Dt)
panel_29 = Panel(pow)
panel_30 = Panel(larger.port)
panel_31 = Panel(larger.port_2)
panel_32 = Panel("""输出端
＜：若A＜B，则为ture,反之false
＜＝：若A≤B，则为ture,反之false""")
panel_33 = Panel(smaller.port)
