# Grasshopper definition Cd Scalar_Polynomials.ghx (Grasshopper 0.6.19)

panel = Panel("以10为底的对数 Lg")
panel_2 = Panel("以e为底的对数 Ln")
panel_3 = Panel("阶乘 n!")
panel_4 = Panel("对数 Log")
panel_5 = Panel("10的X次幂")
panel_6 = Panel("e的X次幂")
panel_7 = Panel("2的X次幂")
logn = LogN(V=Slider(9, range=0..10), B=Slider(10, range=0..10))
log = Logarithm(X=Slider(9, range=0..10))
panel_8 = Panel("""输入端
X：数值""")
panel_9 = Panel("""输入端
N：输入的整数""")
panel_10 = Panel("""输入端
V：对数的真数
B：对数的底数""")
panel_11 = Panel("""输入端
X：常用对数的真数""")
fac = Factorial(N=Slider(4, range=0..10))
panel_14 = Panel("""输入端
X：自然对数的真数""")
ln = NaturalLogarithm(X=Slider(3, range=0..10))
_10º = PowerOf10(X=Slider(2, range=0..10))
_2º = PowerOf2(X=Slider(6, range=0..10))
eº = PowerOfE(X=Slider(1, range=0..10))
panel_15 = Panel("""输出端
F：N的阶乘""")
panel_16 = Panel("""输出端
R：得到的结果""")
panel_17 = Panel("""输出端
Y：得到的结果""")
panel_19 = Panel(ln)
panel_21 = Panel(_10º)
panel_23 = Panel(eº)
panel_24 = Panel(fac)
panel_25 = Panel(logn)
panel_26 = Panel(log)
panel_28 = Panel(_2º)
