# Grasshopper definition Ce Scalar_Trig.ghx (Grasshopper 0.6.19)

# 三角函数
# 
# 注意：默认的数据单位为弧度，在X上右键Expression 输入rad(x)可以把数据单位转换成度。
slider = Slider(1, range=0..1)
panel = Panel("反正弦函数")
panel_2 = Panel("反余弦函数")
panel_3 = Panel("余弦函数")
panel_4 = Panel("正弦函数")
panel_5 = Panel("正切函数")
panel_6 = Panel("反正切函数")
panel_7 = Panel("""输入端
X：输入的数值""")
acos = ArcCosine(X=expr("rad(x)", slider))
panel_8 = Panel("""输入端
X：输入的角度""")
asin = ArcSine(X=Slider(0.575, range=0..1))
atan = ArcTangent(X=Slider(1.851851852, range=0..10))
cos = Cosine(X=expr("rad(x)", Slider(60, range=0..90)))
sin = Sine(X=expr("rad(x)", Slider(30, range=0..90)))
tan = Tangent(X=expr("rad(x)", Slider(45, range=0..90)))
panel_13 = Panel("""输出端
Y：输出值""")
panel_15 = Panel(acos)
panel_17 = Panel(asin)
panel_18 = Panel(cos)
panel_20 = Panel(tan)
panel_22 = Panel(atan)
panel_24 = Panel(sin)
