# Grasshopper definition Cf Scalar_Util.ghx (Grasshopper 0.6.19)

# 求平均数：计算一组数据的各种平均数
# 
# 输入I：数据列表
# 输出AM：代数平均数
#          GM：几何平均数
#          HM：调和平均数（计算机用）
recgrid = GridRectangular(P=PlaneXY(0, 0, 0), X=5, Y=5, S=1)  # -> G, C, M
# 加合：将所输入的数据列表加合或依次加合
# 
# 输入I：数据列表
# 输出R：加合      Pr：依次加合
series = Series(S=0, N=1, C=10)
# Min：把A项中所有大于等于B项的数据都转化为B项，其他数据保持不变
# 
# 输入A：数据列表       B：参考值
# 输出R：输出的数据列表
series_2 = Series(S=0, N=1, C=10)
# Max：把A项中所有小于等于B项的数据都转化为B项，其他数据保持不变
# 
# 输入A：数据列表       B：参考值
# 输出R：输出的数据列表
series_3 = Series(S=0, N=1, C=10)
# 截断：切除一个数据列表中的极端数据（具体用途有待分析）
# 
# 输入I：数据列表        t：截断系数
# 输出T：截断设置(Truncated set)
series_4 = Series(S=0, N=1, C=100)
cir = Circle(P=recgrid.M, R=recgrid.C)
ma = MassAddition(I=series)  # -> R, Pr
min = Minimum(A=series_2, B=Slider(5, range=0..5))
max = Maximum(A=series_3, B=Slider(5, range=0..5))
trunc = Truncate(I=series_4, t=Slider(0.5554794312, range=0..1))
mean = Mean(I=cir)  # -> AM, GM, HM
panel = Panel(ma.R)
panel_2 = Panel(ma.Pr)
panel_3 = Panel(trunc)
panel_4 = Panel(mean.AM)
panel_5 = Panel(mean.GM)
panel_6 = Panel(mean.HM)
panel_7 = Panel(min)
panel_8 = Panel(max)
ma_2 = MassAddition()  # -> R, Pr
mean_2 = Mean()  # -> AM, GM, HM
min_2 = Minimum()
max_2 = Maximum()
trunc_2 = Truncate(t=0)
