# Grasshopper definition Da Vector_Colour.ghx (Grasshopper 0.6.19)

panel = Panel("Add Colours用于使连个颜色相加，相加原则遵循RGB的规则")
panel_2 = Panel("Multiply Colours用于使连个颜色相乘，相乘原则遵循RGB的规则。（具体规则不明）")
panel_3 = Panel("Subtract Colours用于使连个颜色相减，相减原则遵循RGB的规则")
swatch = ColourSwatch()
swatch_2 = ColourSwatch()
swatch_3 = ColourSwatch()
swatch_4 = ColourSwatch()
swatch_5 = ColourSwatch()
swatch_6 = ColourSwatch()
panel_4 = Panel(swatch_5)
panel_5 = Panel(swatch_2)
panel_6 = Panel(swatch_4)
panel_7 = Panel(swatch_6)
panel_8 = Panel(swatch)
panel_9 = Panel(swatch_3)
sub = SubtractColours(A=swatch_5, B=swatch_6)
add = AddColours(A=swatch_4, B=swatch)
mul = MultiplyColours(A=swatch_2, B=swatch_3)
panel_10 = Panel(sub)
panel_11 = Panel(add)
panel_12 = Panel(mul)
box = Box({Plane=Plane(origin=(-27, 45, 0), x=(0, 1, 0), y=(1, 0, 0)), X=Domain(0, 5), Y=Domain(0, 6), Z=Domain(0, -5)})
box_2 = Box({Plane=Plane(origin=(-40, 32, 0), x=(0, 1, 0), y=(1, 0, 0)), X=Domain(0, 6), Y=Domain(0, 6), Z=Domain(0, -4)})
box_3 = Box({Plane=PlaneXY(-35, 41, 0), X=Domain(0, 6), Y=Domain(0, 8), Z=Domain(0, 4)})
add_2 = AddColours()
sub_2 = SubtractColours()
mul_2 = MultiplyColours()
preview = CustomPreview(G=box, S=add)
preview_2 = CustomPreview(G=box_2, S=sub)
preview_3 = CustomPreview(G=box_3, S=mul)
# Create Shader可以用来创建一个材质
# 
# Kd:漫反射颜色     Ks:高光色    Ke:固有色    T:透明度    S:发光度
swatch_7 = ColourSwatch()
# Blend Colours可以按照一定百分比自由混合两种颜色，当F值为0时，输出为颜色A；当F值为1时，输出为颜色B；当F值为0.3时，输出色为70%A与30%B的混合色
# 
# A:颜色A     B:颜色B    F:混合系数
swatch_8 = ColourSwatch()
blend = BlendColours(A=swatch_8, B=ColourSwatch(), F=Slider(0.5013397217, range=0..1))
shader = CreateShader(Kd=ColourSwatch(), Ks=ColourSwatch(), Ke=swatch_7, T=Slider(0.6512008667, range=0..1), S=Slider(66, range=0..100))
box_4 = Box({Plane=PlaneXY(-10, 29, 0), X=Domain(0, 8), Y=Domain(0, 7), Z=Domain(0, 6)})
panel_13 = Panel(blend)
box_5 = Box({Plane=PlaneXY(-10, 16, 0), X=Domain(0, 7), Y=Domain(0, 7), Z=Domain(0, 5)})
panel_14 = Panel(shader)
shader_2 = CreateShader(Kd=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, Ks=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, Ke=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, S=0)
preview_4 = CustomPreview(G=box_4, S=blend)
blend_2 = BlendColours(F=0.5)
preview_5 = CustomPreview(G=box_5, S=shader)
# ARGB 通过ARGB生成一个颜色
# 
# A:Alpha通道   R:Red通道   G:Green通道   B:Blue通道
slider = Slider(160, range=0..255)
# ARGB Fractional通过ARGB生成一个颜色,与ARGB不同，改运算器输入的值是百分比，1=255
# 
# A:Alpha通道   R:Red通道   G:Green通道   B:Blue通道
slider_2 = Slider(0.5352295299, range=0..1)
# Split ARGB  过程与ARGB相反，可以将个颜色转换成各各值。
# 
# A:Alpha通道   R:Red通道   G:Green通道   B:Blue通道
slider_3 = Slider(160, range=0..255)
# AHSV 通过AHSV生成一个颜色
# 
# A:Alpha通道   H:色相   S:饱和度   V:亮度
slider_4 = Slider(0.5352295299, range=0..1)
# AHSV 过程与AHSV相反，可以将个颜色转换成各各值。
# 
# 
# A:Alpha通道   H:色相   S:饱和度   V:亮度
slider_5 = Slider(0.5352295299, range=0..1)
argb = ARGB(A=slider, R=Slider(150, range=0..255), G=Slider(185, range=0..255), B=Slider(226, range=0..255))
argb_2 = ARGB(A=slider_3, R=Slider(150, range=0..255), G=Slider(185, range=0..255), B=Slider(226, range=0..255))
ahsv = AHSV(A=slider_4, H=Slider(0.9595001221, range=0..1), S=Slider(0.5959798813, range=0..1), V=Slider(1, range=0..1))
argb_3 = ARGBFractional(A=slider_2, R=Slider(0.4300001144, range=0..1), G=Slider(0.4800001144, range=0..1), B=Slider(1, range=0..1))
ahsv_2 = AHSV(A=slider_5, H=Slider(0.9595001221, range=0..1), S=Slider(0.5959798813, range=0..1), V=Slider(1, range=0..1))
ahsv_3 = SplitAHSV(C=ahsv_2)  # -> A, H, S, V
argb_4 = SplitARGB(C=argb_2)  # -> A, R, G, B
box_6 = Box({Plane=PlaneXY(-27, 34, 0), X=Domain(0, 6), Y=Domain(0, 6), Z=Domain(0, 7)})
panel_15 = Panel(argb)
box_7 = Box({Plane=Plane(origin=(-27, 17, 0), x=(0, 1, 0), y=(1, 0, 0)), X=Domain(0, 6), Y=Domain(0, 7), Z=Domain(0, -6)})
box_8 = Box({Plane=PlaneXY(-27, 25, 0), X=Domain(0, 7), Y=Domain(0, 6), Z=Domain(0, 5)})
panel_16 = Panel(argb_3)
panel_17 = Panel(ahsv)
panel_18 = Panel(argb_4.A)
panel_19 = Panel(ahsv_3.A)
panel_20 = Panel(argb_4.R)
panel_21 = Panel(ahsv_3.H)
panel_22 = Panel(argb_4.G)
panel_23 = Panel(ahsv_3.S)
panel_24 = Panel(argb_4.B)
argb_5 = ARGB(A=0, G=0, B=0)
panel_25 = Panel(ahsv_3.V)
argb_6 = ARGBFractional(A=1, G=0, B=0)
preview_6 = CustomPreview(G=box_6, S=argb)
ahsv_4 = AHSV(A=1, H=0, V=0.5)
preview_7 = CustomPreview(G=box_7, S=argb_3)
preview_8 = CustomPreview(G=box_8, S=ahsv)
argb_7 = SplitARGB()  # -> A, R, G, B
ahsv_5 = SplitAHSV()  # -> A, H, S, V
