# Grasshopper definition Db Vector_Constants.ghx (Grasshopper 0.6.19)

panel = Panel("""X、Y、Z方向的向量

F：向量长度       V：输出向量""")
panel_2 = Panel("""XY、XZ、YZ的平面

O：平面原点        P：输出平面""")
pt = PointXYZ(X=0, Y=0, Z=0)
xy = XYPlane(O=pt)
xz = XZPlane(O=pt)
yz = YZPlane(O=pt)
Y = UnitY(F=Slider(0.5, range=0..1))
Z = UnitZ(F=Slider(0.5, range=0..1))
X = UnitX(F=Slider(0.5, range=0..1))
