# Grasshopper definition Dc Vector_Plane.ghx (Grasshopper 0.6.19)

# 创建平面工具：通过一个原点和两个向量来创建一个平面
# 
# 输入端O：平面的原点     X：平面的X轴方向
#                                                 Y：平面的Y轴的参考方向
# 输出端Pl：生成的平面
O = Point(Point(-4, 0, 0))
X = Vector(Vector(-6, 8, 0))
# 三点创建平面：通过三个点创建一个平面
# 
# 输入端A：平面的原点
#              B：平面的X轴方向上的点
#              C：平面空间定位点
# 
# 输出端Pl：生成的平面
Y = Vector(Vector(8, 1, 0))
A = Point(Point(-5.4, 2.9, 0))
B = Point(Point(-1.1, 4.9, 0))
C = Point(Point(0, -6.8, 7.1))
pl = Plane(O=O, X=X, Y=Y)
pl_3pt = Plane3Pt(A=A, B=B, C=C)
pl_2 = Plane(O=Point(0, 0, 0), X=Vector(1, 0, 0), Y=Vector(0, 1, 0))
pl_3pt_2 = Plane3Pt()
O_2 = Point(Point(-4.3, 4.3, 0))
X_2 = Vector(Vector(4.8, 6.3, 0))
Y_2 = Vector(Vector(-0.8, 7.6, 0))
# 分解平面工具：分解一个平面，得到这个片面的原点及控制xyz个方向的向量。
# 
# 输入端P：需分解的平面
# 
# 输出端O：平面的原点     X：平面X方向的向量
#                                                 Y：平面Y方向的向量
#                                                 Z：平面Z方向的向量
A_2 = Point(Point(-5.4, 2.9, 0))
B_2 = Point(Point(-1.1, 4.9, 0))
# 点在平面上的投影：找到一个点在一个平面上的投影点。
# 
# 输入端S：取样点     P：投影平面
# 输出端P：投影点     uv：投影点在此面上的坐标  D：点到平面的距离
C_2 = Point(Point(0.1, 4.4, 0))
xy = XYPlane(O=Point(0, 0, 0))
# 旋转平面工具：通过一个向量来旋转一个平面。
# 
# 输入端P：需旋转的平面       D：旋转后平面的方向
# 输出端P：旋转后的平面       A：旋转角度
xy_2 = XYPlane(O=Point(0, 0, 0))
# 旋转平面工具：通过另一个平面法线来旋转一个平面
# 
# 输入端P：需旋转的平面       M：参考面
# 输出端P：旋转后的平面
D = Vector(Vector(-2, -5, 0))
# 旋转平面工具：通过输入角度旋转曲面
# 
# 输入端P：需旋转的平面    A：旋转的弧度
# 输出端P：旋转后的平面
M = Plane(Plane(origin=(0, 0, 0), x=(-0.7071067812, 0.7071067812, 0), y=(-0.6974858325, -0.6974858325, 0.1643989873)))
# 创建平面工具：通过平面的原点和法线方向来创建一个平面。
# 
# 输入端O：平面的原点     Z：与平面垂直的向量
# 输出端P：创建的平面
O_3 = Point(Point(5.4, 1.9, 0))
Z = Vector(Vector(9.6, 0, 3.6))
P = Plane(Plane(origin=(-1.8, 0.4, 0), x=(0.5038710255, 0.8637789009, 0), y=(-0.8637789009, 0.5038710255, 0)))
pl_3pt_3 = Plane3Pt(A=A_2, B=B_2, C=C_2)
pl_3 = Plane(O=O_2, X=X_2, Y=Y_2)
S = Point(Point(5, 2, 0))
align = AlignPlanes(P=xy, M=M)
align_2 = AlignPlane(P=xy_2, D=D)  # -> P, A
pl_4 = PlaneNormal(O=O_3, Z=Z)
rot = RotatePlane(P=P, A=Slider(4.1128479, range=0..11))
cp = PlaneCP(S=S, P=pl_3)  # -> P, uv, D
panel = Panel(align_2.A)
pcomp = PlaneComponents(P=flatten(pl_3pt_3))  # -> O, X, Y, Z
align_3 = AlignPlanes()
align_4 = AlignPlane()  # -> P, A
rot_2 = RotatePlane()
panel_2 = Panel(cp.P)
panel_3 = Panel(cp.uv)
panel_4 = Panel(cp.D)
panel_5 = Panel(pcomp.O)
panel_6 = Panel(pcomp.X)
panel_7 = Panel(pcomp.Y)
panel_8 = Panel(pcomp.Z)
cp_2 = PlaneCP()  # -> P, uv, D
cp_3 = PlaneCP()  # -> P, uv, D
pcomp_2 = PlaneComponents(P=PlaneXY(0, 0, 0))  # -> O, X, Y, Z
