# Grasshopper definition Dd Vector_Point.ghx (Grasshopper 0.6.19)

# 在几何体上寻找距离目标点最近的点
# 
# 输入端P：目标点
# 输入端G：几何形状、表面或物体
# 输入端C：是否在所有几何体上都寻找距离目标点最近的点
# 
# 输出端P：距离目标点最近的点
# 输出端D：距离目标点最近的点与目标点之间的距离
slider = Slider(4, range=0..10)
# 输入XYZ三点坐标生成点
# 
# 输入端X：X坐标值
# 输入端Y：Y坐标值
# 输入端Z：Z坐标值
# 
# 输出端Pt：生成的点
P = Point(Point(-35.25334607, -20.55923618, 0))
pt = PointXYZ(X=0, Y=0, Z=0)
# 将点的三维坐标提取出来
# 
# 输入端P：点
# 
# 输出端X：该点的X坐标值
# 输出端Y：该点的Y坐标值
# 输出端Z：该点的Z坐标值
pt_2 = PointXYZ(X=2, Y=5, Z=0)
# 在一个点集中寻找距离目标点最近的点
# 
# 输入端P：目标点
# 输入端S：给定的点集
# 
# 输出端P：距离目标点最近的点
# 输出端i：距离目标点最近的点在点集中的位置
# 输出端D：距离目标点最近的点与目标点之间的距离。
P_2 = Point(Point(14.05519039, 4.35323, 0))
# 两点之间的距离
# 
# 输入端A：第一点
# 输入端B：第二点
# 
# 输出端D：两个点之间的距离
recgrid = GridRectangular(P=PlaneXY(0, 0, 0), X=5, Y=5, S=1)  # -> G, C, M
P_3 = Point(Point(37, 3, 0))
circle = Circle([{Plane=Plane(origin=(29, -2, 0), x=(0.9284766909, -0.3713906764, 0), y=(0.3713906764, 0.9284766909, 0)), Radius=5.385164807}, {Plane=Plane(origin=(36, 15, 0), x=(0.7071067812, -0.7071067812, 0), y=(0.7071067812, 0.7071067812, 0)), Radius=7.071067812}, {Plane=Plane(origin=(52, 3, 0), x=(0.7071067812, -0.7071067812, 0), y=(0.7071067812, 0.7071067812, 0)), Radius=5.656854249}])
panel = Panel(P)
dist = Distance(A=pt, B=pt_2)
cp = ClosestPoint(P=P_2, S=recgrid.G)  # -> P, i, D
pcomp = Decompose(P=P)  # -> X, Y, Z
pull = PullPoint(P=P_3, G=circle, C=Toggle(True))  # -> P, D
pt_3 = PointXYZ(X=Slider(6.375, range=0..10), Y=Slider(3.75, range=0..10), Z=slider)
panel_2 = Panel(dist)
panel_3 = Panel(cp.P)
panel_4 = Panel(cp.i)
panel_5 = Panel(cp.D)
panel_6 = Panel(pcomp.X)
panel_7 = Panel(pcomp.Y)
panel_8 = Panel(pcomp.Z)
panel_9 = Panel(pull.P)
panel_10 = Panel(pull.D)
panel_11 = Panel(pt_3)
pt_4 = PointXYZ(Y=0, Z=0)
pull_2 = PullPoint(C=True)  # -> P, D
dist_2 = Distance()
cp_2 = ClosestPoint()  # -> P, i, D
pcomp_2 = Decompose(P=Point(-35.25334607, -20.55923618, 0))  # -> X, Y, Z
# 用一个连线画一系列点
# 
# 输入端P：一系列点
# 输入端T：是否为点标上顺序
# 输入端L：是否将点依次连接
# 输入端S：标记数目的字体大小
slider_2 = Slider(2.128197941, range=0..10)
# 在指定平面上标注文字信息
# 
# 输入端P：需要标注文字的平面
# 输入端A：需要标注的文字内容
# 输入端S：标注文字的大小尺寸
slider_3 = Slider(5.650009155, range=0..10)
# 基于平面生成一个点
# 
# 输入端P：平面
# 输入端U：平面投影的U值
# 输入端V：平面投影的V值
# 输入端W：垂直平面的高度
# 
# 输入端Pt：生成的点
slider_4 = Slider(10, range=0..10)
# 相对于一个点以孤度和长度生成另一个点
# 
# 输入端P：原始点所在平面
# 输入端A：相对于原始点，生成的点与之连线和面的X轴的弧度
# 输入端R：生成点与原始点之间的距离
# 输入端E：生成点相对于平面的垂直高度
# 
# 输出端Pt：生成的另一个点
slider_5 = Slider(4.999992465, range=0..10)
L = Plane(Plane(origin=(44.82795037, 0.1119332587, 0), x=(0.857974738, -0.5136918813, 0), y=(0.4308013791, 0.719529963, 0.5446896401)))
P_4 = Plane(PlaneXY(0, 0, 0))
P_5 = Plane(PlaneXY(0, 0, 0))
# 根据球面坐标和距球心距离生成一个点
# 
# 输入端P：球面赤道里所在平面
# 输入端xy：生成点的球面经度（弧度）
# 输入端R：生成点的球面纬度（弧度）
# 输入端E：生成点距球心距离。
# 
# 输出端Pt：生成的另一个点
P_6 = Plane(PlaneXY(32, 5, 0))
P_7 = Point([Point(-41.87210298, 3.552603499, 0), Point(-33.14112077, 14.77815206, 0), Point(-17.13432005, 20.39092633, 0), Point(0.119763845, 18.7278821, 0), Point(21.94721937, 10.41266095, 0), Point(25.68906889, -4.138976069, 0), Point(23.40238308, -23.67974578, 0)])
tag = TextTag3D(L=L, T="ncf.5d6d.com", S=slider_2)
pt_5 = PointPolar(P=P_6, xy=Slider(0, range=0..6.28), z=Slider(0, range=0..6.28), d=slider_5)
# 在某点上标注文字信息，并且文字信息显示的大小和方向固定不变
# 
# 输入端L：点
# 输入端T：文字信息
pt_6 = PointOriented(P=P_4, U=Slider(6.814823857, range=0..10), V=Slider(5.675003052, range=0..10), W=slider_3)
pt_7 = PointCylindrical(P=P_5, A=Slider(0, range=0..10), R=Slider(8.785174334, range=0..10), E=slider_4)
points = PointList(P=P_7, T=Toggle(True), L=Toggle(True), S=Slider(2.360478154, range=0..10))
L_2 = Point(Point(38.2629006, 42.03378789, 0))
panel_12 = Panel(pt_5)
panel_13 = Panel(pt_6)
points_2 = PointList(T=True, L=True)
panel_14 = Panel(pt_7)
pt_8 = PointOriented(P=PlaneXY(0, 0, 0), V=0, W=0)
pt_9 = PointCylindrical(P=PlaneXY(0, 0, 0), R=1, E=0)
pt_10 = PointPolar(P=PlaneXY(0, 0, 0), z=0, d=1)
tag_2 = TextTag(L=L_2, T="ncf.5d6d.com")
# 生成四边形网格及点阵
# 
# 输入端P：四边形网格所在平面（默认为XY平面）
# 输入端X：（正负）X方向的网格数
# 输入端Y：（正负）Y方向的网格数
# 输入端S：单位网格的边长
# 
# 输出端G：网格角点
# 输出端C：生成的网格线
# 输出端M：以网格角点生成的平面
P_8 = Plane(PlaneXY(0, 0, 0))
recgrid_2 = GridRectangular(P=P_8, X=Slider(5, range=0..10), Y=Slider(5, range=0..10), S=Slider(3.627085745, range=0..10))  # -> G, C, M
panel_15 = Panel(recgrid_2.G)
panel_16 = Panel(recgrid_2.C)
panel_17 = Panel(recgrid_2.M)
recgrid_3 = GridRectangular(P=PlaneXY(0, 0, 0), Y=5, S=1)  # -> G, C, M
# 生成一个正六边形的网格
# 
# 输入端P：生成正六边形的平面
# 输入端R：六边形网格的半径（以晶格数为单位）
# 输入端S：每两个相邻小六边形中心点之间的距离
# 
# 输出端G：生成的正六边形的角点
# 输出端C：生成的正六边形的边线
# 输出端M：每个小六形中心点形成的平面
P_9 = Plane(Plane(origin=(-2, 0, 21), x=(0.3939192986, 0, 0.91914503), y=(0.8345463557, 0.4190581775, -0.3576627239)))
hexgrid = GridHexagonal(P=P_9, R=Slider(6, range=0..10), S=Slider(3.664001465, range=0..10))  # -> G, C, M
panel_18 = Panel(hexgrid.G)
panel_19 = Panel(hexgrid.C)
panel_20 = Panel(hexgrid.M)
hexgrid_2 = GridHexagonal(P=PlaneXY(0, 0, 0), S=1)  # -> G, C, M
