# Grasshopper definition De Vector_Vector.ghx (Grasshopper 0.6.19)

# Vector XYZ由指定的X,Y,Z坐标生成向量。输出L为向量长度。
# 
# Decompose分解一个向量，将坐标表示的向量的X,Y,Z坐标分别取出
panel = Panel("12")
# Vector 2Pt指定起始点和终点生成向量
# 
# 输入A：起始点    B：终止点     U为是否单位向量
# 输出V：输出向量    L：向量长度
xy = XYPlane(O=Point(0, 0, 0))
# Angle用于求两个向量间的夹角，当有投影平面设定时先将向量投影至目标平面再取夹角，投影面不能和任意一个向量垂直。
# 
# 输入A：向量A      B：向量B       P：投影平面
# 输出A：逆时针夹角      R：顺时针夹角（单位弧度）
vec = Vector(Vector(13, 0, 0))
vec_2 = Vector(Vector(12, -9, 0))
pt = Point(Point(4, 1, 0))
pt_2 = Point(Point(13, 0, 6))
angle = Angle(A=vec, B=vec_2, P=xy)  # -> A, R
vec_3 = VectorXYZ(X=panel, Y="-14", Z="5")  # -> V, L
vec2pt = Vector2Pt(A=pt, B=pt_2, U=Toggle(False))  # -> V, L
panel_2 = Panel(vec_3.L)
panel_3 = Panel(angle.A)
panel_4 = Panel(angle.R)
vcomp = Decompose(V=vec_3.V)  # -> X, Y, Z
vec_4 = VectorXYZ(Y=0, Z=0)  # -> V, L
panel_5 = Panel(vec2pt.V)
panel_6 = Panel(vec2pt.L)
panel_7 = Panel(vcomp.X)
panel_8 = Panel(vcomp.Y)
panel_9 = Panel(vcomp.Z)
vec2pt_2 = Vector2Pt(U=False)  # -> V, L
vcomp_2 = Decompose()  # -> X, Y, Z
angle_2 = Angle()  # -> A, R
panel_10 = Panel("Vector Length 输出向量长度")
panel_11 = Panel("""Amplitude用于给一个向量赋予一个长度。

V：原始向量      A：指定长度""")
panel_12 = Panel("Reverse用于输出相反向量，即原向量×(-1)")
panel_13 = Panel("Unit Vector将原始向量转化成单位向量")
# Multiply可以计算向量与实数的乘积（可以看作将向量按比例缩放）
# 
# 输入V：原始向量      F：实数
# 输出V：输出向量      L：向量长度
slider = Slider(1.377777476, range=0..2)
vec_5 = Vector([Vector(4, 5, 0), Vector(4, -5, 0), Vector(-7, 0, 0)])
vec_6 = Vector([Vector(4, 5, 0), Vector(4, -5, 0), Vector(-7, 0, 0)])
vec_7 = Vector([Vector(4, 5, 0), Vector(4, -5, 0), Vector(-7, 0, 0)])
Z = UnitZ(F=1)
Z_2 = UnitZ(F="2")
panel_14 = Panel(vec_5)
panel_15 = Panel(vec_6)
panel_16 = Panel(vec_7)
panel_17 = Panel(Z)
panel_18 = Panel(Z_2)
rev = Reverse(V=vec_6)
vlen = VectorLength(V=vec_5)
amp = Amplitude(V=Z, A=slider)
unit = UnitVector(V=vec_7)
mul = Multiply(V=Z_2, F=Slider(1.377777476, range=0..2))  # -> V, L
panel_19 = Panel(vlen)
panel_20 = Panel(unit)
panel_21 = Panel(amp)
panel_22 = Panel(mul.V)
panel_23 = Panel(mul.L)
panel_24 = Panel(rev)
amp_2 = Amplitude(A=1)
rev_2 = Reverse()
vlen_2 = VectorLength()
unit_2 = UnitVector()
mul_2 = Multiply(F=1)  # -> V, L
# DotProduct计算两个向量间的点积(内积)
# 坐标公式(xa,ya,za)·(xb,yb,zb)=xaxb+yayb+zazb
# 
# 输入端AB为向量，U为是否取单位向量
toggle = BooleanToggle(False)
# CrossProduct向量间的X乘(外积）
# 坐标公式(xa,ya,za)X(xb,yb,zb)=(yazb-ybza,zaxb-xazb,xayb-xbya)
# 
# 输入端AB为向量，U为是否取单位向量
# 输出V：输出向量      L：向量长度
toggle_2 = BooleanToggle(False)
# Summation计算两个向量之和
# 求和公式(xa,ya,za)+(xb,yb,zb)=(xa+xb,ya+yb,za+zb)
# 
# 输入端AB为向量，U为是否取单位向量
# 输出V：输出向量      L：向量长度
vec_8 = Vector(Vector(13, 0, 0))
vec_9 = Vector(Vector(12, -9, 0))
vec_10 = Vector(Vector(13, 0, 0))
vec_11 = Vector(Vector(12, -9, 0))
vec_12 = Vector(Vector(13, 0, 0))
vec_13 = Vector(Vector(12, -9, 0))
sum = Summation(A=vec_8, B=vec_9, U=toggle)  # -> V, L
dprod = DotProduct(A=vec_12, B=vec_13, U=toggle_2)
xprod = CrossProduct(A=vec_10, B=vec_11, U=Toggle(False))  # -> V, L
panel_25 = Panel(dprod)
panel_26 = Panel(sum.V)
panel_27 = Panel(sum.L)
panel_28 = Panel(xprod.V)
panel_29 = Panel(xprod.L)
xprod_2 = CrossProduct(U=False)  # -> V, L
dprod_2 = DotProduct(U=False)
sum_2 = Summation(U=False)  # -> V, L
