# Grasshopper definition Ea curve_analysis.ghx (Grasshopper 0.6.19)

# 曲线参数生成水平面：  用曲线上一点的切线方向来指定一个水平面。
# 
# 输入C：评估曲线
# 输入t ：曲线范围上的评估参数
# 
# 输出F ：在曲线参数控制下的水平面
slider = Slider(2.2875, range=0..3)
# 端点：输出曲线的连个端点。
# 
# 输出S：起始点      输出E：终到点
pt = PointXYZ(X=0, Y=0, Z=0)
X = UnitX(F=5)
# 评估曲线：在指定的叁数评估一个曲线。
# 
# 输入C：基本曲线
# 输入t：评价的曲线参数
# 输出P：在参数控制下曲线上的点
# 输出T：在参数控制点处的切线方向
# 输出L：起点到参数控制点的曲线距离
panel = Panel("5")
crv = Curve(<curve referenced from the Rhino model>)
circle = Circle({Plane=Plane(origin=(7, -39, 0), x=(0.7071067812, -0.7071067812, 0), y=(0.7071067812, 0.7071067812, 0)), Radius=7.071067812})
crv_2 = Curve([<curve referenced from the Rhino model> x2])
# 中心：  找弧和圆周的中心点和半径
# 
# 输出C：圆心          输出R：半径
# 封闭：  测试一个曲线是否是封闭或者是周期的。
# 
# 输出C：boolean值，是否闭合。
# 输出P：boolean值，是否成周期性。
cir = Circle(P=PlaneXY(-35, 0, 0), R=10)
panel_2 = Panel("注意：曲线来源不同，会以树形数据的形式呈现在不同路径上。")
cir_2 = Circle(P=PlaneXY(0, 0, 0), R=3)
# 曲率曲线图：  绘制犀牛曲率曲线图，是曲线的曲率关系可视化
# 
# 输入C：原曲线
# 输入D：拾取点密度
# 输入S：曲率图缩放
line = Line(Line((-13, -8, 0), (-7, 8, 0)))
# 长度：测量曲线的长度。
# 
# 输入C： 待测量的曲线。     输出L：曲线长度。
# 曲线参数生成垂直面：  用曲线上一点的切线方向来指定一个垂直面。
# 
# 输入C：评估曲线
# 输入t ：曲线范围上的评估参数
# 
# 输出F ：在曲线参数控制下的垂直面（跟随曲面）
crv_3 = Curve(<curve referenced from the Rhino model>)
# 曲线参数生成平面：  用曲线上一点的切线方向来指定一个平面。
# 
# 输入C：评估曲线
# 输入t ：曲线范围上的评估参数
# 
# 输出F ：在曲线参数控制下的平面（跟随曲线）
slider_2 = Slider(107.1606, range=0..150)
crv_4 = Curve(<curve referenced from the Rhino model>)
crv_5 = Curve(<curve referenced from the Rhino model>)
# 不连续：找出一个曲线找所有的不连续。
# 
# 输入C：分析的曲线
# 输入L：待测试的不连续性等级
# 
# 输出P：不连续处的点
# 输出t ：不连续处的曲线参数信息
range = Range(D=Domain(0, 1), N=10)
range_2 = Range(D=Domain(0, 1), N=10)
crv_6 = Curve(<curve referenced from the Rhino model>)
# 平面测试：测试一个曲线的平面度。
# 
# 输入C：待分析曲线
# 
# 输出P：(Boolean) 曲线的平面度（平：true）
# 输出P：(Plane) 曲线平面
# 输出D：(Number) 曲线平面的偏差
range_3 = Range(D=Domain(0, 1), N=10)
line_2 = LineSDL(S=pt, D=X, L=panel)
crv_7 = Curve(<curve referenced from the Rhino model>)
dis = Display(A=pt, V=X)
disc = Discontinuity(C=crv_2, L=1)  # -> P, t
cen = Center(A=cir)  # -> C, R
cls = Closed(C=[cir_2, line])  # -> C, P
cir_3 = Circle(P=PlaneXY(81, 3, 0), R=5)
planar = Planar(C=[crv, circle])  # -> P, P_2, D
crv_8 = Curve(<curve referenced from the Rhino model>)
len = Length(C=crv_3)
eval = EvaluateCurve(C=crv_4, t=slider)  # -> P, T, L
frame = CurveFrame(C=crv_5, t=range)
end = EndPoints(C=line_2)  # -> S, E
frame_2 = HorizontalFrame(C=crv_6, t=range_2)
frame_3 = PerpFrame(C=crv_7, t=range_3)
panel_3 = Panel(cen.C)
panel_4 = Panel(cen.R)
panel_5 = Panel(disc.P)
panel_6 = Panel(disc.t)
panel_7 = Panel(cls.C)
panel_8 = Panel(cls.P)
panel_9 = Panel(len)
panel_10 = Panel(planar.P)
panel_11 = Panel(planar.D)
panel_12 = Panel(planar.P_2)
panel_13 = Panel(eval.L)
panel_14 = Panel(eval.P)
panel_15 = Panel(eval.T)
panel_16 = Panel(end.S)
panel_17 = Panel(end.E)
pln = Plane(frame)
pln_2 = Plane(frame_2)
crvgraph = CurvatureGraph(C=[crv_8, cir_3], D=Slider(9.372829861, range=0..20), S=slider_2)
pln_3 = Plane(frame_3)
cls_2 = Closed()  # -> C, P
cen_2 = Center()  # -> C, R
frame_4 = CurveFrame()
end_2 = EndPoints()  # -> S, E
eval_2 = EvaluateCurve()  # -> P, T, L
frame_5 = HorizontalFrame()
frame_6 = PerpFrame()
planar_2 = Planar()  # -> P, P_2, D
disc_2 = Discontinuity(L=1)  # -> P, t
len_2 = Length()
crvgraph_2 = CurvatureGraph(D=5, S=105)
circle_2 = Circle({Plane=Plane(origin=(41, -87, 0), x=(0.9970544855, -0.07669649888, 0), y=(0.07669649888, 0.9970544855, 0)), Radius=13.03840481})
# 曲线 CP：  在一个曲线上找最靠近的点。
# 输入P：样点　　　输入C：基本曲线
# 
# 输出P： 曲线上最近点
# 输出t ：参数调节最近点
# 输出D：样点到1曲线最近距离
slider_3 = Slider(4.575, range=0..6)
# 评估长度：通过长度来得到曲线上一点，并输出曲线上该点的评估值t
# 
# 输入C：曲线
# 输入L：该曲线上所得点与起始点间额长度
# 输入N ：选择true，则L端转化为曲线全长的百分比
# 
# 输出P：所得点
# 输出T：曲线在该点处的切线方向
# 输出t：该点的曲线评估值
crv_9 = Curve(<curve referenced from the Rhino model>)
P = Point(<point referenced from the Rhino model>)
# 曲率：  用一个指定的参数评估曲线的曲率
# 输入C：曲线
# 输入t：评估曲线的曲率参数
# 
# 输出P：用参数ｔ定义的曲线上的点
# 输出K：曲线上该点的法线方向
# 输出C：与曲线相切与该点，曲率等于曲线该点曲率的圆
ellipse = Ellipse(B=PlaneXY(36, 0, 0), R1=5, R2=10)  # -> E, F1, F2
# 分解：分解一个曲线进入它的成份部份。
# 
# 输入C：待分解的曲线。
# 输入R：true为循环分解单元的到基本元素。
# 
# 输出S：组成曲线的元素。
# 输出V：曲线元素的顶点。
toggle = BooleanToggle(False)
divide = DivideCurve(C=circle_2, N=3, K=False)  # -> P, T, t
crv_10 = Curve([<curve referenced from the Rhino model> x2])
cir_4 = Circle(P=divide.P, R=15)
crv_cp = CurveCP(P=P, C=crv_9)  # -> P, t, D
eval_3 = EvaluateLength(C=crv_10, L=Slider(27.84751434, range=0..47), N=toggle)  # -> P, T, t
curvature = Curvature(C=ellipse.E, t=slider_3)  # -> P, K, C
union = RegionUnion(C=cir_4)
panel_18 = Panel(crv_cp.t)
panel_19 = Panel(crv_cp.P)
panel_20 = Panel(crv_cp.D)
panel_21 = Panel(eval_3.P)
panel_22 = Panel(eval_3.T)
panel_23 = Panel(eval_3.t)
fillet = Fillet(C=union, R=10)
explode = Explode(C=fillet, R=Toggle(False))  # -> S, V
panel_24 = Panel(curvature.K)
panel_25 = Panel(curvature.P)
panel_26 = Panel(curvature.C)
panel_27 = Panel(explode.S)
panel_28 = Panel(fillet)
curvature_2 = Curvature()  # -> P, K, C
crv_cp_2 = CurveCP()  # -> P, t, D
eval_4 = EvaluateLength(L=0, N=True)  # -> P, T, t
explode_2 = Explode(R=True)  # -> S, V
