# Grasshopper definition Eb curve_Division.ghx (Grasshopper 0.6.19)

slider = Slider(5, range=0..5)
panel = Panel("注意：这个强调等距离。即以上一点为圆心以D为半径作圆，应该与曲线交于下一点。")
# 分割曲线：  把一个曲线分为相等的长度片段.
# 
# 输入C：带分割的曲线。
# 输入N：段数
# 输入K：(Boolean) 在节点处拆开曲线。（True：拆开）
# 
# 输出P：分割点
# 输出T：在分割点处的切线方向。
# 输出t：分割点出的参数值。
slider_2 = Slider(5, range=0..20)
# 沿曲线水平框架：按曲线长度等分曲线，再在等分点生成一个水平框架。
# 
# 输入C：带分割的曲线。
# 输入N：段数。
# 输入A：false为跟随扭转
# 
# 输出F：水平框架。
# 输出t：分割点处的参数值。
slider_3 = Slider(4, range=0..6)
crv = Curve(<curve referenced from the Rhino model>)
range = Range(D=Domain(0, 1), N=10)
# 按去曲线长度分割：用预设的长度分割曲线
# 
# 输入C：待分割的曲线．
# 输入L：拆分长度．
# 
# 输出P：分割点．
# 输出T：在分割点处的切线方向．
# 输出t：在分割点处的参数值．
crv_2 = Curve(<curve referenced from the Rhino model>)
# 按距离分割：  用在点之间的被预先设定的距离分割曲线．
# 
# 输入C：待分割的曲线．
# 输入D：拆分距离．
# 
# 输出P：分割点．
# 输出T：在分割点处的切线方向．
# 输出t：在分割点处的参数值．
crv_3 = Curve(<curve referenced from the Rhino model>)
# 打碎： 打碎一个曲线进入片段。
# 
# 输入C：带修剪曲线。
# 输入t：分割的控制参数。
# 
# 输出S：打碎后的片段。
toggle = BooleanToggle(False)
crv_4 = Curve(<curve referenced from the Rhino model>)
# 曲线框架：  沿曲线产生多个相等间隔的框架。
# 
# 输入C：待拆分的曲线。
# 输入N：段数
# 
# 输出F：曲线框架
# 输出t：在拆分点处的参数值。
crv_5 = Curve(<curve referenced from the Rhino model>)
crv_6 = Curve(<curve referenced from the Rhino model>)
# 沿曲线水平框架：按曲线长度等分曲线，再在等分点生成一个水平框架。
# 
# 输入C：带分割的曲线。
# 输入N：段数。
# 
# 输出F：水平框架。
# 输出t：分割点处的参数值。
crv_7 = Curve(<curve referenced from the Rhino model>)
divide = DivideLength(C=crv_2, L=Slider(5, range=0..5))  # -> P, T, t
divide_2 = DivideCurve(C=crv_4, N=Slider(6, range=0..20), K=True)  # -> P, T, t
divide_3 = DivideDistance(C=crv_3, D=slider)  # -> P, T, t
panel_2 = Panel(range)
cir = Circle(P=divide_3.P, R=slider)
shatter = Shatter(C=crv, t=range)
frames = CurveFrames(C=crv_5, N=slider_2)  # -> F, t
frames_2 = PerpFrames(C=crv_6, N=Slider(4, range=0..6), A=toggle)  # -> F, t
frames_3 = HorizontalFrames(C=crv_7, N=slider_3)  # -> F, t
panel_3 = Panel(frames_3.F)
panel_4 = Panel(divide_2.P)
panel_5 = Panel(divide_2.T)
panel_6 = Panel(divide_2.t)
panel_7 = Panel(frames_3.t)
panel_8 = Panel(divide.t)
panel_9 = Panel(divide.P)
panel_10 = Panel(divide.T)
panel_11 = Panel(divide_3.t)
panel_12 = Panel(divide_3.P)
panel_13 = Panel(divide_3.T)
panel_14 = Panel(shatter)
panel_15 = Panel(frames.t)
pln = Plane(frames.F)
panel_16 = Panel(frames_2.F)
panel_17 = Panel(frames_2.t)
frames_4 = HorizontalFrames(N=10)  # -> F, t
shatter_2 = Shatter()
frames_5 = CurveFrames(N=10)  # -> F, t
divide_4 = DivideCurve(N=10, K=False)  # -> P, T, t
divide_5 = DivideDistance()  # -> P, T, t
divide_6 = DivideLength()  # -> P, T, t
frames_6 = PerpFrames(N=10, A=True)  # -> F, t
