# Grasshopper definition Ec curve_Primitive.ghx (Grasshopper 0.6.19)

# 圆绘制工具：通过平面和半径定义一个圆
# 
# 输入端P：圆所在平面     R：圆半径
# 输出端C：生成的圆
slider = Slider(0, range=0..1)
# 圆弧绘制工具：用两点加一个矢量定义一个圆弧
# 
# 输入端S：起始点      E：终点      D：圆弧在起点的切线方向
# 输出端A：生成的圆弧      P：圆弧所在平面      R：圆弧半径
slider_2 = Slider(0, range=0..1)
# 双圆弧绘制工具：用起始两个点加两个矢量定义一个双圆弧
# 
# 输入端
# S：双圆弧起始点       Ts：起始点的切线方向
# E：双圆弧的终点       Te：终点的切线方向      R：双圆弧半径
# 输出端
# A1：生成的圆弧段1       A2：生成的圆弧段2
# B：生成的双圆弧
slider_3 = Slider(0, range=0..1)
# 圆弧绘制工具：通过半径、角度定义一个圆弧。
# 
# 输入端  P：圆弧基准面      R：圆弧半径     A：角度
# 输出端 A：生成的圆弧       L：圆弧弧长
slider_4 = Slider(0.55, range=0..1)
# 圆弧绘制工具：三点定义一个圆弧
# 
# 输入端   A：起始点     B：圆弧上的点     C：终点
# 输出端   A：生成的圆弧     P：圆弧所在平面     R：圆弧半径
slider_5 = Slider(5.436000824, range=0..10)
# 圆绘制工具：通过三个点定义一个圆
# 
# 输入端A：圆上的点1      B：圆上的点2      C：圆上的点3
# 输出端A：生成的圆       P：圆所在的平面       R：圆的半径
slider_6 = Slider(6.392196655, range=0..10)
P = Plane(PlaneXY(0, 0, 0))
P_2 = Plane(PlaneXY(0, 0, 0))
pt = PointXYZ(X=Slider(2.625, range=0..10), Y=Slider(5.5, range=0..10), Z=Slider(0, range=0..1))
pt_2 = PointXYZ(X=Slider(8.25, range=0..10), Y=Slider(8.625, range=0..10), Z=slider)
te = Vector(Vector(-22.3, 24.8, 0))
ts = Vector(Vector(-20.3, 6.8, 0))
pt_3 = PointXYZ(X=Slider(1.875, range=0..10), Y=Slider(1.5, range=0..10), Z=Slider(0, range=0..1))
pt_4 = PointXYZ(X=Slider(2.625, range=0..10), Y=Slider(5.5, range=0..10), Z=slider_3)
pt_5 = PointXYZ(X=Slider(1.875, range=0..10), Y=Slider(1.5, range=0..10), Z=Slider(0, range=0..1))
pt_6 = PointXYZ(X=Slider(2.625, range=0..10), Y=Slider(5.5, range=0..10), Z=Slider(0, range=0..1))
pt_7 = PointXYZ(X=Slider(8.25, range=0..10), Y=Slider(8.625, range=0..10), Z=slider_2)
D = Vector(Vector(1.445324443, 7.764746314, 0))
pt_8 = PointXYZ(X=Slider(2.625, range=0..10), Y=Slider(5.5, range=0..10), Z=Slider(0, range=0..1))
pt_9 = PointXYZ(X=Slider(1.875, range=0..10), Y=Slider(1.5, range=0..10), Z=Slider(0, range=0..1))
pt_10 = PointXYZ(X=Slider(8.25, range=0..10), Y=Slider(8.625, range=0..10), Z=Slider(0, range=0..1))
arc = Arc(P=P, R=slider_4, A=slider_5)  # -> A, L
cir = Circle(P=P_2, R=slider_6)
biarc = BiArc(S=pt, Ts=ts, E=pt_2, Te=te, R=Slider(3.604932243, range=0..10))  # -> A1, A2, B
circle = Circle3Pt(A=pt_9, B=pt_8, C=pt_10)  # -> C, P, R
arc_2 = Arc3Pt(A=pt_5, B=pt_6, C=pt_7)  # -> A, P, R
arc_3 = ArcSED(S=pt_3, E=pt_4, D=D)  # -> A, P, R
panel = Panel(arc.A)
panel_2 = Panel(arc.L)
panel_3 = Panel(cir)
panel_4 = Panel(circle.C)
panel_5 = Panel(circle.R)
panel_6 = Panel(biarc.A1)
panel_7 = Panel(biarc.A2)
panel_8 = Panel(biarc.B)
panel_9 = Panel(arc_2.A)
panel_10 = Panel(arc_2.R)
panel_11 = Panel(arc_3.A)
panel_12 = Panel(arc_3.R)
biarc_2 = BiArc(R=0.5)  # -> A1, A2, B
cir_2 = Circle(P=PlaneXY(0, 0, 0))
arc_4 = Arc(P=PlaneXY(0, 0, 0), A=Domain(0, 3.141592654))  # -> A, L
circle_2 = Circle3Pt()  # -> C, P, R
arc_5 = Arc3Pt()  # -> A, P, R
arc_6 = ArcSED()  # -> A, P, R
# 圆绘制工具：通过圆心、轴线、半径定义一个圆。
# 
# 输入端C：圆的中心点       N：圆面的垂直方向      R：圆的半径
# 输出端A：生成的圆        P：圆所在的平面         R：圆的半径
slider_7 = Slider(2.271604185, range=0..10)
# 椭圆绘制工具：通过圆心和长短轴定义一个椭圆
# 
# 输入端B：圆心       R1：圆面的法线方向      R2：圆的半径
# 输出端E：生成的椭圆        F1：椭圆第一个聚焦点
#              F2：椭圆第二个聚焦点
slider_8 = Slider(0, range=0..1)
# 直线绘制工具：通过起始点和一个矢量定义一条直线
# 
# 输入端S：起始点       D：线段方向        L：线段长度
# 输出端L：生成的线段
slider_9 = Slider(0, range=0..1)
# 多边形绘制工具：通过中心点，半径，边数来定义一个多边形
# 
# 输入端P：多边形的基面       R：多边形顶点到中心的距离
#              S：多边形段数           Rf：倒角圆弧半径
# 
# 输出端P：生成的多边形        L：多边形周长
slider_10 = Slider(0, range=0..1)
# 直线绘制工具：通过两个点定义一条直线
# 
# 输入端A：起始点        B：终点
# 输出端L：生成的线段
slider_11 = Slider(0.736790033, range=0..1)
# 倒角长方形绘制工具：通过平面，边长，倒角半径来绘制一个倒角的长方形。
# 
# 输入端P：长方形的基面      X：X方向的长度
#              Y：Y方向的长度       R：倒角圆弧半径
# 
# 输出端R：生成的长方形      L：长方形周长
slider_12 = Slider(0, range=0..10)
B = Plane(PlaneXY(0, 0, 0))
P_3 = Plane(PlaneXY(0, 0, 0))
P_4 = Plane(PlaneXY(0, 0, 0))
pt_11 = PointXYZ(X=slider_7, Y=Slider(9.580247667, range=0..10), Z=slider_8)
N = Vector(Vector(0, 7.901097447, 15.61407353))
pt_12 = PointXYZ(X=Slider(8.765432099, range=0..10), Y=Slider(4.716058425, range=0..10), Z=slider_10)
D_2 = Vector(Vector(7.213959849, 20.76343208, 0))
pt_13 = PointXYZ(X=Slider(22.83950617, range=0..50), Y=Slider(27.16049383, range=0..50), Z=slider_9)
pt_14 = PointXYZ(X=Slider(25.625, range=0..50), Y=Slider(2.098765432, range=0..10), Z=Slider(0, range=0..1))
ellipse = Ellipse(B=B, R1=Slider(9.580247667, range=0..10), R2=slider_11)  # -> E, F1, F2
polygon = Polygon(P=P_3, R=flatten(Slider(9.100006104, range=0..10)), S=Slider(8.150009155, range=0..10), Rf=slider_12)  # -> P, L
rectangle = Rectangle(P=P_4, X=Slider(9.100006104, range=0..10), Y=Slider(6.562952112, range=0..10), R=Slider(0, range=0..10))  # -> R, L
circle_3 = CircleCNR(C=pt_11, N=N, R=Slider(4.050003052, range=0..10))
panel_13 = Panel("ncf.5d6d.com")
line = LineSDL(S=pt_12, D=D_2, L=Slider(7.950620298, range=0..10))
ln = Line(A=pt_14, B=pt_13)
panel_14 = Panel(ellipse.E)
panel_15 = Panel(ellipse.F1)
panel_16 = Panel(ellipse.F2)
panel_17 = Panel(polygon.P)
panel_18 = Panel(polygon.L)
panel_19 = Panel(rectangle.R)
panel_20 = Panel(rectangle.L)
panel_21 = Panel(circle_3)
panel_22 = Panel(line)
panel_23 = Panel(ln)
ellipse_2 = Ellipse(B=PlaneXY(0, 0, 0), R2=1)  # -> E, F1, F2
rectangle_2 = Rectangle(P=PlaneXY(0, 0, 0), X=0, Y=0.5, R=0)  # -> R, L
polygon_2 = Polygon(P=PlaneXY(0, 0, 0), S=6, Rf=0)  # -> P, L
circle_4 = CircleCNR(N=Vector(0, 0, 1), R=1)
line_2 = LineSDL(D=Vector(0, 0, 1), L=1)
ln_2 = Line()
