# Grasshopper definition Ed curve_spline.ghx (Grasshopper 0.6.19)

# 面上穿越线绘制工具：通过曲面上多个控制点在曲面上绘制一条穿过各点的曲线
# 
# 输入端S：曲面       uv：点的uv坐标       C: 是否闭合
# 输出端C：生成的曲线       L：生成曲线的长度       D：生成曲线的区间
pt = PointXYZ(X=expr("1", 50), Y=expr("1", 50), Z=0)
# 外切圆绘制工具：绘制两个圆的外切圆
# 
# 输入端A：第一个基圆      B：第二个基圆        R：相切圆半径
# 输出端A：第一个相切圆       B：第二个相切圆
slider = Slider(0, range=0..1)
# 贝塞尔曲线绘制工具：通过多个控制点绘制一条贝塞尔曲线
# 
# 输入端V：曲线控制点      D：阶数       P：是否闭合
# 输出端C：生成的曲线      L：生成曲线的长度       D：生成曲线的区间
slider_2 = Slider(10, range=0..10)
# 贝塞尔曲线绘制工具:通过两个端点和两个向量定义一个贝塞尔曲线。
# 
# 输入端
# A：曲线其实点    At：曲线在起点的切线方向
# B：曲线终点        Bt：曲线在终点的切线方向
# 输出端
# C：生成的曲线     L：曲线长度
# D：生成曲线的区间
slider_3 = Slider(3.90625, range=0..10)
# 穿越线绘制工具：通过多个控制点绘制一条穿过各点的曲线
# 
# 输入端V：曲线控制点      D：阶数       P：是否闭合
# 输出端C：生成的曲线      L：生成曲线的长度       D：生成曲线的区间
slider_4 = Slider(3, range=0..11)
P = Plane(PlaneXY(15, -6, 0))
P_2 = Plane(Plane(origin=(36.32354362, -6.368039214, 0), x=(0.9938837347, -0.1104315261, 0), y=(0.1104315261, 0.9938837347, 0)))
V = Point([Point(-26.33716218, 18.51194691, 0), Point(-18.65815412, 18.51194691, 0), Point(-21.42259702, 12.67590078, 0), Point(-30.17666622, 10.67935869, 0), Point(-37.08777347, 19.27984772, 0), Point(-32.32678847, 22.19787078, 0), Point(-30.6374067, 18.05120643, 0)])
sph = Sphere(B=pt, R=20)
V_2 = Point([Point(-26.33716218, 18.51194691, 0), Point(-18.65815412, 18.51194691, 0), Point(-21.42259702, 12.67590078, 0), Point(-30.17666622, 10.67935869, 0), Point(-37.08777347, 19.27984772, 0), Point(-32.32678847, 22.19787078, 0), Point(-30.6374067, 18.05120643, 0)])
pt_2 = PointXYZ(X=slider_3, Y=Slider(1.71875, range=0..10), Z=Slider(0, range=0..1))
pt_3 = PointXYZ(X=Slider(8.875, range=0..10), Y=Slider(5.5625, range=0..10), Z=slider)
cir = Circle(P=P, R=Slider(4.375, range=0..10))
cir_2 = Circle(P=P_2, R=slider_2)
at = Vector(Vector(1.367163109, 22.62943104, 0))
bt = Vector(Vector(-0.1256360589, -14.0685485, 0))
divide = DivideSurface(S=sph, U=10, V=10)  # -> P, N, uv
crv = Curve(V=V, D=Slider(3, range=0..10), P=Toggle(True))  # -> C, L, D
intcrv = Interpolate(V=V_2, D=slider_4, P=Toggle(False))  # -> C, L, D
bzspan = BezierSpan(A=pt_2, At=at, B=pt_3, Bt=bt)  # -> C, L, D
crvsrf = CurveOnSurface(S=sph, uv=divide.uv, C=Toggle(True))  # -> C, L, D
cfit = CircleFit(A=cir, B=cir_2, R=Slider(6.304992676, range=0..10))  # -> A, B
panel = Panel(crv.C)
panel_2 = Panel(crv.L)
panel_3 = Panel(crv.D)
panel_4 = Panel(intcrv.C)
panel_5 = Panel(intcrv.L)
panel_6 = Panel(intcrv.D)
panel_7 = Panel(bzspan.C)
panel_8 = Panel(bzspan.L)
panel_9 = Panel(bzspan.D)
panel_10 = Panel(crvsrf.C)
panel_11 = Panel(crvsrf.L)
panel_12 = Panel(crvsrf.D)
panel_13 = Panel(cfit.A)
panel_14 = Panel(cfit.B)
bzspan_2 = BezierSpan()  # -> C, L, D
crv_2 = Curve(D=3, P=False)  # -> C, L, D
crvsrf_2 = CurveOnSurface(C=False)  # -> C, L, D
cfit_2 = CircleFit()  # -> A, B
intcrv_2 = Interpolate(D=3, P=False)  # -> C, L, D
# 穿越线绘制工具：通过多个控制点绘制一条穿过各点的曲线，同时当该控制点与相邻两个控制点的连线小于一定角度时，该控制点呈现折角。
# 
# 输入端V：曲线控制点     D：阶数      A：弧度大于此值出现折角
# 输出端C：生成的曲线      L：生成曲线的长度      D：生成曲线的区间
slider_5 = Slider(3, range=0..11)
# 圆弧反圆弧绘制工具：通过多个控制点绘制一条圆弧反圆弧线
# 
# 输入端V：圆弧曲线控制点      T：起始点的切线方向      C：是否闭合
# 输出端Crv：生成的圆弧曲线
slider_6 = Slider(0.8142361111, range=0..3)
# 曲面UV线绘制工具：通过曲面和点uv坐标来绘制该曲面的UV线
# 
# 输入端S：曲面       uv：点的uv坐标
# 输出端U：生成的u线        V：生成的v线
pt_4 = PointXYZ(X=50, Y=50, Z=0)
# 多段线绘制工具：通过多个控制点绘制一条多段线
# 
# 输入端V：多段线控制点        C：是否闭合
# 输出端PL：生成的pl线
toggle = BooleanToggle(False)
# 曲线截取工具：通过设置一个区间从曲线上截取一段曲线
# 
# 输入端C：曲线      D：截取的区间
# 输出端C：截取的曲线
toggle_2 = BooleanToggle(False)
V_3 = Point([Point(-16.2, 5.5, 0), Point(-14.9, 1.4, 0), Point(-11.3, 5.1, 0)])
T = Vector(Vector(0, -13.7, 0))
V_4 = Point([Point(1, 92, 0), Point(16, 88, 0), Point(10, 73, 0), Point(-5, 70, 0), Point(8, 55, 0), Point(7, 41, 0), Point(-14, 45, 0)])
V_5 = Point([Point(1.921587491, 24.80873353, 0), Point(8.832694748, 25.57663433, 0), Point(12.67219878, 20.04774853, 0), Point(5.761091523, 18.35836675, 0), Point(-6.525321379, 15.13318337, 0), Point(-7.293222186, 9.911457882, 0)])
sph_2 = Sphere(B=pt_4, R=20)
crv_3 = Curve(
    V=[Point(-26.33716218, 18.51194691, 0), Point(-18.65815412, 18.51194691, 0), Point(-21.42259702, 12.67590078, 0), Point(-30.17666622, 10.67935869, 0), Point(-37.08777347, 19.27984772, 0), Point(-32.32678847, 22.19787078, 0), Point(-30.6374067, 18.05120643, 0)],
    D=4,
    P=True)  # -> C, L, D
int = Interval(A=Slider(0.7695194842, range=0..1), B=Slider(0.7851013184, range=0..1))
parc = PolyArc(V=V_3, T=T, C=toggle)
pt_5 = PointXYZ(X=Slider(6.060760498, range=0..10), Y=Slider(0.35, range=0..1), Z=0)
pline = PolyLine(V=V_5, C=toggle_2)
kinkcrv = KinkyCurve(V=V_4, D=slider_5, A=slider_6)  # -> C, L, D
iso = IsoCurve(S=sph_2, uv=pt_5)  # -> U, V
subcrv = SubCurve(C=crv_3.C, D=int)
panel_15 = Panel(parc)
panel_16 = Panel(pline)
panel_17 = Panel(kinkcrv.C)
panel_18 = Panel(kinkcrv.D)
panel_19 = Panel(kinkcrv.L)
panel_20 = Panel(subcrv)
panel_21 = Panel(iso.V)
panel_22 = Panel(iso.U)
iso_2 = IsoCurve()  # -> U, V
pline_2 = PolyLine(C=False)
subcrv_2 = SubCurve()
parc_2 = PolyArc(C=False)
kinkcrv_2 = KinkyCurve(D=3, A=0.1745329252)  # -> C, L, D
