# Grasshopper definition Ee curve_util.ghx (Grasshopper 0.9.76)

crv = Curve(<curve referenced from the Rhino model>)
# 延长：以一个特定的长度延长一条曲线
# 输入端：
# C(Curve to extend:要延长的曲线）
# T(Type of extension:延长的类型，0直线1圆弧2光滑的曲线）
# L0(在曲线起点延长的距离)
# L1(在曲线重点延长的距离)
# 输出端：
# C(Extended Curve:延长后的曲线)
type_of_extension = Slider(1, range=0..2)
# 优化曲线:把一条自由曲线分段后，用相对简单的参量（圆弧和直线）描述。
# 输入端：
# C(curve to analyse: 待优化的曲线）
# t(deviation tolerance: 偏离容差)
# a(angle tolerance: 角度容差)
# 输出端：
# C(simplified curve: 优化曲线)
# S(Boolean: true为曲线被优化)
number = Slider(9, range=0..20)
# 偏移:以特定的距离把一条曲线偏移到某个平面上
# 输入端：
# C(Curve to offset:要偏移的曲线）
# D(Offset distance:偏移距离)
# S(Surface for offset operation:偏移到的平面）
# 输出端：
# C(Resulting offsets:偏移后的曲线)
distance = Slider(2.175, range=0..10)
# 倒角:用指定的距离将锐角曲线进行倒角
# 输入端：
# C(Curve to fillet:要倒角的曲线）
# D(Distance from corner of fillet start:倒角距离<从角的顶点算起>)
# 输出端：
# C(Curve with filleted corners:倒角后的曲线)
radius_of_fillet = Slider(2.0202, range=0..10)
# 转换:使用指定引导曲线转换曲线的法向（如果不设定引导曲线就自动反向）
# 输入端：
# C(Curve to offset:要变动的曲线<三维曲线>）
# G(Optional guide curve:指定引导曲线)
# 输出端：
# C(Flipped Curves:转向后的曲线)
# F(Flip action:检测转向操作是否成功）
radius_of_fillet_2 = Slider(8.4397, range=0..10)
number_2 = Slider(2, range=0..20)
# 简化多段线:通过减去不重要的顶点来简化一条多段线
# 输入端：
# P(Polyline to reduce:要简化的多段线）
# T(tolerance:容差)
# 输出端：
# P(Reduced Polyline:简化后的多段线)
# R(Number of vertices removed during reduction:一共被简化的点数 )
number_3 = Slider(9, range=0..20)
# 投影:把一条曲线投影到某个面上
# 输入端：
# C(Curve to project:要投影的曲线）
# B(BRep to project onto:投影到的面)
# D(Projestion direction:投影方向<可设定向量>）
# 输出端：
# C(Projected Curves:投影后的曲线)
distance_2 = Slider(4.642, range=0..10)
l0 = Slider(4.3546, range=0..10)
# 倒角:用指定的半径将锐角曲线进行倒角
# 输入端：
# C(Curve to fillet:要倒角的曲线）
# R(Radius of fillet:倒角半径)
# 输出端：
# C(Curve with filleted corners:倒角后的曲线)
l1 = Slider(2.5361, range=0..10)
divide = DivideCurve(Curve=crv, Count=20, Kinks=False)  # -> Points, Tangents, Parameters
# 偏移:以特定的距离偏移一条曲线
# 输入端：
# C(Curve to offset:要偏移的曲线）
# D(Offset distance:偏移距离)
# P(Plan for offset operation:偏移操做所在平面）
# C(Corner type:角的类型<0无1锐角2圆角3曲线4斜角>
# 输出端：
# C(Resulting offsets:偏移后的曲线)
toggle = BooleanToggle(False)
srf = Surface(<surface referenced from the Rhino model>)
crv_2 = Curve(<curve referenced from the Rhino model>)
# 重建:重建一条曲线
# 输出端：
# C(Curve to analyse:要分析的曲线）
# D(Optional degree of curve:选择的曲线的段数)
# N(Number of control points:控制点的个数）
# T(Preserve curve end tangents:是否保留曲线终点的切线方向<通过设定布尔值真假>)
# 输入端：
# C(Rebuild Curves:重建后的曲线)
vec = Vector(Vector(0, 0, 7))
crv_3 = Curve(<curve referenced from the Rhino model>)
crv_4 = Curve(<curve referenced from the Rhino model>)
crv_5 = Curve(<curve referenced from the Rhino model>)
# 组合:组合多条曲线
# 输入端：
# C(Curves to join:要组合的曲线）
# P(Preserve direction of input curve:是否保持输入曲线的方向)
# 输出端：
# C(Joined Curves:组合后的曲线)
crv_6 = Curve(<curve referenced from the Rhino model>)
crv_7 = Curve(<curve referenced from the Rhino model>)
srf_2 = Surface(<surface referenced from the Rhino model>)
crv_8 = Curve(<curve referenced from the Rhino model>)
crv_9 = Curve(<curve referenced from the Rhino model>)
crv_10 = Curve(<curve referenced from the Rhino model>)
crv_11 = Curve(<curve referenced from the Rhino model>)
crv_12 = Curve(<curve referenced from the Rhino model>)
crv_13 = Curve(<curve referenced from the Rhino model>)
shatter = Shatter(Curve=crv, Parameters=divide.Parameters)
redpline = Reduce(Polyline=crv_8, Tolerance=number)  # -> Polyline, Reduction
flip = FlipCurve(Curve=crv_3, Guide=crv_5)  # -> Curve, Flag
project = Project(Curve=crv_2, Brep=srf, Direction=vec)
divide_2 = DivideCurve(Curve=crv_3, Count=10, Kinks=False)  # -> Points, Tangents, Parameters
join = JoinCurves(Curves=[crv_6, crv_7], Preserve=toggle)
offset = Offset(Curve=crv_9, Distance=distance, Plane=PlaneXY(0, 0, 0), Corners=1)
offsets = OffsetOnSrf(Curve=crv_4, Distance=distance_2, Surface=srf_2)
reb = RebuildCurve(Curve=crv_12, Degree=number_2, Count=number_3, Tangents=True)
simplify = SimplifyCurve(Curve=shatter, Tolerance=Slider(0.1151, range=0..1))  # -> Curve, Simplified
fillet = FilletDistance(Curve=crv_11, Distance=radius_of_fillet_2)
ext = ExtendCurve(Curve=crv_13, Type=type_of_extension, Start=l0, End=l1)
fillet_2 = Fillet(Curve=crv_10, Radius=radius_of_fillet, DataComparison="shortest_list")
points = PointList(Points=divide_2.Points, Tags=True, Lines=True, Size=2)
panel = Panel(flip.Flag)
crv_14 = Curve(flip.Curve)
panel_2 = Panel(join)
panel_3 = Panel(simplify.Curve)
panel_4 = Panel(simplify.Simplified)
panel_5 = Panel(offset)
panel_6 = Panel(project)
panel_7 = Panel(offsets)
panel_8 = Panel(fillet)
panel_9 = Panel(fillet_2)
panel_10 = Panel("接入输出的曲线，数字顺序会颠倒")
panel_11 = Panel(ext)
panel_12 = Panel(reb)
panel_13 = Panel(redpline.Reduction)
panel_14 = Panel(redpline.Polyline)
ext_2 = ExtendCurve(Type=0, Start=0, End=0)
reb_2 = RebuildCurve(Count=10, Tangents=False)
fillet_3 = FilletDistance()
project_2 = Project(Direction=Vector(0, 0, 1))
offsets_2 = OffsetOnSrf(Distance=1)
fillet_4 = Fillet()
simplify_2 = SimplifyCurve()  # -> Curve, Simplified
flip_2 = FlipCurve()  # -> Curve, Flag
redpline_2 = Reduce(Tolerance=1)  # -> Polyline, Reduction
join_2 = JoinCurves(Preserve=False)
offset_2 = Offset(Distance=1, Plane=PlaneXY(0, 0, 0), Corners=1)
