# Grasshopper definition Fa Surface_Analysis.ghx (Grasshopper 0.6.19)

# 曲面相切圆：根据曲面上某uv坐标点的最小曲率和方向做相切圆。
# 
# 输入S：曲面       uv：该点的uv坐标
# 输出P：曲面上的点
# 输出C1：曲面法线方向一侧的相切圆
# 输出C2：曲面法线方向背面的相切圆
srf = Surface(<surface referenced from the Rhino model>)
# 分解Brep：将Brep分解成面，边界线，顶点坐标
# 
# 输入B：要分解的表面
# 输出F：面     E：边      V：点
box = Box({Plane=Plane(origin=(0, -14, 0), x=(0, 1, 0), y=(1, 0, 0)), X=Domain(0, 14), Y=Domain(0, 18), Z=Domain(0, -10)})
panel = Panel("在这里输入一个box，将得到这个box的6个面，12条棱和8个顶点。")
# 输出线框：将Brep的线框输出，可以控制输出线的密度。
# 
# 输入B：Brep表面      D：线框密度
# 输出W：Brep的线框
brep = BRep(<brep referenced from the Rhino model>)
# 分解box：分解一个box，输出一个以这个box的中心平面和在xyz各轴上的所占区间
# 
# 输入B：box
# 输出P：中心平面
# 输出xyz：在各轴上的区间
# 计算面积：算出一个Brep表面或围合边界的表面积，并输出其几何中心点
# 
# 输入B：表面或围合边界
# 输出A：表面积
# 输出C：几何中心点
box_2 = Box({Plane=Plane(origin=(0, -14, 0), x=(0, 1, 0), y=(1, 0, 0)), X=Domain(0, 14), Y=Domain(0, 18), Z=Domain(0, -10)})
cir = Circle(P=PlaneXY(0, 0, 0), R=1)
divide = DivideSurface(S=srf, U=10, V=10)  # -> P, N, uv
sph = Sphere(B=PlaneXY(0, 0, 0), R=1)
# D端只能输入整数，该版本在调整D值时，容易产生错误，需要B端重新拾取Brep后修复。
brep_2 = BRep(<brep referenced from the Rhino model>)
# 搜索最近点：在Berp表面上找到与指定点距离最近的点，并输出距离
# 
# 输入P：指定点       B：Brep表面
# 输出P：表面上最近点       D：最近点距指定点距离
pt = Point(<point referenced from the Rhino model>)
# 计算体积：计算一个封闭Brep表面的体积，并找出几何中心
# 
# 输入B：封闭Brep表面
# 输出V：该Brep的体积
# 输出C：几何中心点
brep_3 = BRep(<brep referenced from the Rhino model>)
explode = BRepComponents(B=box)  # -> F, E, V
item = ListItem(L=divide.uv, i=Slider(35, range=0..100), W=False)
box_3 = BoxComponents(B=box_2)  # -> P, X, Y, Z
volume = BRepVolume(B=brep)  # -> V, C
area = BRepArea(B=[cir, sph])  # -> A, C
wires = BRepWireframe(B=brep_2, D=Slider(3, range=0..10))
brep_cp = BRepCP(P=pt, B=brep_3)  # -> P, D
osc = OscCircles(S=srf, uv=item)  # -> P, C1, C2
panel_2 = Panel(volume.V)
panel_3 = Panel(volume.C)
panel_4 = Panel(box_3.P)
panel_5 = Panel(box_3.X)
panel_6 = Panel(box_3.Y)
panel_7 = Panel(box_3.Z)
panel_8 = Panel(area.A)
panel_9 = Panel(area.C)
panel_10 = Panel(brep_cp.P)
panel_11 = Panel(brep_cp.D)
panel_12 = Panel(explode.F)
panel_13 = Panel(wires)
panel_14 = Panel(explode.E)
panel_15 = Panel(explode.V)
panel_16 = Panel(osc.P)
panel_17 = Panel(osc.C1)
panel_18 = Panel(osc.C2)
osc_2 = OscCircles()  # -> P, C1, C2
wires_2 = BRepWireframe(D=-1)
brep_cp_2 = BRepCP()  # -> P, D
volume_2 = BRepVolume()  # -> V, C
box_4 = BoxComponents()  # -> P, X, Y, Z
explode_2 = BRepComponents()  # -> F, E, V
area_2 = BRepArea()  # -> A, C
ｕ = Slider(0.506333669, range=0..1)
# 搜索最近点：在曲面上找到与指定点距离最近的点，并输出它的uv坐标和距离
# 
# 输入P：指定点       S：曲面
# 输出P：表面上最近点
#         uvP：该点的uv坐标
#         D：最近点距指定点距离
ｖ = Slider(0.7695677452, range=0..1)
ｕ_2 = Slider(0.789583842, range=0..1)
# 检验修减点：检验一个被修建过的曲面上某个UV坐标是否被修剪。
# 
# 输入S：被修剪的曲面
# 输入P：待检测的UV值
# 输出I：boolean值，true为此点在保留曲面内
ｖ_2 = Slider(0.4991658529, range=0..1)
series = Series(S=0, N=1, C=10)
# 检验内部点：检验一个点是否在一个闭合表面的内部。
# 
# 输入B：闭合的Brep
# 输入P：待检测的点
# 输入S：boolean值，true为严格意义的包含
# 输出I：boolean值，true为此点曲面内
panel_19 = Panel("""S1：修剪后的曲面
S2：修剪前的曲面""")
# 表面平面：找到曲面上一点的曲面法线和相切平面
# 
# 输入S：曲面       uv：曲面上一定的uv值
# 输出P：曲面上一点       N：曲面法线       F：表面切面
srf_2 = Surface(<surface referenced from the Rhino model>)
w = Slider(0.5242718447, range=0..1)
u = Slider(1, range=0..1)
v = Slider(0.9117647059, range=0..1)
s1 = Surface(<surface referenced from the Rhino model>)
s2 = Surface(<surface referenced from the Rhino model>)
# box顶点：输出一个box的8个顶点。
# 
# 输入B：box
# 输出ABCDEFGH：8个顶点
box_5 = Box({Plane=Plane(origin=(0, -14, 0), x=(0, 1, 0), y=(1, 0, 0)), X=Domain(0, 14), Y=Domain(0, 18), Z=Domain(0, -10)})
# 检测曲率：检测曲面上一点的主要曲率属性
# 
# 输入S：曲面      uv：曲面上一点的uv值
# 输出F：曲面上该点的切面
# 输出G：高斯曲率
# 输出M：平均曲率
srf_3 = Surface(<surface referenced from the Rhino model>)
pt_2 = Point(<point referenced from the Rhino model>)
# 曲面边长：输出一个曲面在UV两个方向的边缘长度
# 
# 输入S：曲面
# 输出UV：各方向边长
srf_4 = Surface(<surface referenced from the Rhino model>)
# box空间点：在一个box空间或一个扭曲box空间中，利用UVW值找到空间内一点。
# 
# 输入B：box或扭曲box
# 输入UVW：uvw值
# 输出Pl：该box的中心平面     Pt：该box的几何中心点
# 输出I：boolean值，true为该点在box内
box_6 = Box({Plane=PlaneXY(-4, 8, 0), X=Domain(0, 34), Y=Domain(0, 15), Z=Domain(0, 7)})
Z = UnitZ(F=series)
recgrid = GridRectangular(P=PlaneXY(0, 0, 0), X=5, Y=5, S=1)  # -> G, C, M
# 检测曲率：检测曲面上一点的主要曲率属性
# 
# 输入S：曲面      uv：曲面上一点的uv值
# 输出F：曲面上该点的切面
# 输出C1：该点的最小曲率
# 输出C2：该点的最大曲率
# 输出K1：该点的最小曲率方向
# 输出K2：该点的最大曲率方向
panel_20 = Panel("S上右键reparameterize重新定义曲面uv坐标")
divide_2 = DivideSurface(S=srf_2, U=10, V=10)  # -> P, N, uv
srf_5 = Surface(<surface referenced from the Rhino model>)
pt_3 = PointXYZ(X=ｕ, Y=ｖ, Z=0)
box_corners = BoxCorners(B=box_5)  # -> A, B, C, D, E, F, G, H
srf_6 = Surface(<surface referenced from the Rhino model>)
pt_4 = PointXYZ(X=ｕ_2, Y=ｖ_2, Z=0)
graft = GraftTree(D=Z, S=False)
srf_cp = SurfaceCP(P=pt_2, S=srf_3)  # -> P, uvP, D
dim = Dimensions(S=srf_4)  # -> U, V
eval = EvaluateSurface(S=srf_2, uv=divide_2.uv)  # -> P, N, F
divide_3 = DivideSurface(S=s2, U=10, V=10)  # -> P, N, uv
box_7 = EvaluateBox(B=box_6, U=u, V=v, W=w)  # -> Pl, Pt, I
tbox = TwistedBox(
    A=box_corners.A,
    B=box_corners.B,
    C=box_corners.C,
    D=box_corners.D,
    E=box_corners.F,
    F=box_corners.G,
    G=box_corners.H,
    H=box_corners.E)
move = Move(G=recgrid.G, T=graft)
curvature = SurfaceCurvature(S=srf_6, uv=pt_4)  # -> F, G, M
curvature_2 = PrincipalCurvature(S=unitize(srf_5), uv=pt_3)  # -> F, C¹, C², K¹, K²
trim = TrimInclusion(S=s1, P=divide_3.uv)
sph_2 = Sphere(B=PlaneXY(5, -5, 0), R=10)
panel_21 = Panel(eval.P)
panel_22 = Panel(srf_cp.P)
panel_23 = Panel(srf_cp.uvP)
panel_24 = Panel(srf_cp.D)
panel_25 = Panel(eval.N)
panel_26 = Panel(eval.F)
panel_27 = Panel(dim.U)
panel_28 = Panel(dim.V)
panel_29 = Panel(box_7.Pl)
panel_30 = Panel(box_7.Pt)
panel_31 = Panel(box_7.I)
panel_32 = Panel("有的适合可以配合扭曲box创建其他Box")
panel_33 = Panel(curvature.F)
panel_34 = Panel(curvature.G)
panel_35 = Panel(curvature.M)
panel_36 = Panel(curvature_2.F)
panel_37 = Panel(curvature_2.C¹)
panel_38 = Panel(curvature_2.C²)
panel_39 = Panel(curvature_2.K¹)
panel_40 = Panel(curvature_2.K²)
panel_41 = Panel(trim)
in = Inside(B=sph_2, P=flatten(move), S=False)
dispatch = Dispatch(L=flatten(move), P=in)  # -> A, B
pt_5 = Point(dispatch.A)
pt_6 = Point(dispatch.B)
srf_cp_2 = SurfaceCP()  # -> P, uvP, D
box_8 = EvaluateBox(U=0.5, V=0.5, W=0.5)  # -> Pl, Pt, I
box_corners_2 = BoxCorners()  # -> A, B, C, D, E, F, G, H
dim_2 = Dimensions()  # -> U, V
eval_2 = EvaluateSurface()  # -> P, N, F
trim_2 = TrimInclusion()
curvature_3 = SurfaceCurvature()  # -> F, G, M
curvature_4 = PrincipalCurvature()  # -> F, C¹, C², K¹, K²
panel_42 = Panel(in)
in_2 = Inside(S=False)
