# Grasshopper definition Fb Surface_Freeform.ghx (Grasshopper 0.6.19)

panel = Panel("注意选择曲线的顺序将会影响到生成曲面通过的顺序。闭合放样等可以在O里设置")
panel_2 = Panel("有点时候我们需要同时放样多组物体，这时就需要用到graft把同一组的曲线设置在同一个路径上，这样loft工具会根据数据路径不同分组放样。")
recgrid = GridRectangular(P=PlaneXY(65, 25, 0), X=1, Y=1, S=3)  # -> G, C, M
Z = UnitZ(F=5)
# 四点曲面：通过四个点创建一个四点曲面
# 
# 输入ABCD：四个点
# 输出S：一个曲面
box = Box({Plane=PlaneXY(-4, -5, 0), X=Domain(0, 10), Y=Domain(0, 9), Z=Domain(0, 9)})
cir = Circle(P=PlaneXY(23, 3, 0), R=2)
# 挤压：将一个面或线沿着一个矢量挤出一个闭合曲面或表面
# 
# 输入B：需要被挤压的面或曲线
# 输入D：一个矢量
# 输出E：挤压结果
cir_2 = Circle(P=PlaneXY(17, 3, 0), R=2)
# 放样：创建一个曲面通过指定的几条曲线
# 
# 输入S：需要通过的曲线
# 输入O：右键Loft options设置放样选项
# 输出L：放样结果
crv = Curve([<curve referenced from the Rhino model> x3])
# 生成平面：在同一平面上的闭合线框里生成平面
# 
# 输入E：闭合线框
# 输出S：生成的平面
crv_2 = Curve(<curve referenced from the Rhino model>)
move = Move(G=recgrid.G, T=Z)
cir_3 = Circle(P=recgrid.G, R=1)
planar = PlanarSrf(E=cir)
box_corners = BoxCorners(B=box)  # -> A, B, C, D, E, F, G, H
Z_2 = UnitZ(F=Slider(4.509002686, range=0..10))
planar_2 = PlanarSrf(E=crv_2)
ellipse = Ellipse(B=move, R1=1, R2=1.5)  # -> E, F1, F2
loft = Loft(S=crv, O={Adjust=False, Closed=False, Rebuild=10, Refit=0.01, LoftType=0, LoftEnds=3, LoftSimp=0})
graft = GraftTree(D=cir_3, S=False)
srf4pt = _4PointSurface(A=box_corners.B, B=box_corners.C, C=box_corners.D, D=box_corners.G)
extr = Extrude(B=[cir_2, planar], D=Z_2)
panel_3 = Panel(planar_2)
graft_2 = GraftTree(D=ellipse.E, S=False)
panel_4 = Panel(loft)
panel_5 = Panel(graft)
panel_6 = Panel(srf4pt)
panel_7 = Panel(extr)
panel_8 = Panel(graft_2)
srf4pt_2 = _4PointSurface()
planar_3 = PlanarSrf()
loft_2 = Loft(O={Adjust=False, Closed=False, Rebuild=10, Refit=0.01, LoftType=0, LoftEnds=3, LoftSimp=0})
loft_3 = Loft(S=[graft, graft_2], O={Adjust=False, Closed=False, Rebuild=10, Refit=0.01, LoftType=0, LoftEnds=3, LoftSimp=0})
extr_2 = Extrude()
panel_9 = Panel(loft_3)
cir_4 = Circle(P=PlaneXY(23, 3, 0), R=2)
# 沿直线挤出：沿直线路径挤出曲线或曲面
# 
# 输入P：基准曲面或曲线
# 输入Po：曲面的基准平面
# 输入A：挤出出的轴线
# 输入Ao：轴线偏移的基准平面
cir_5 = Circle(P=PlaneXY(17, 3, 0), R=2)
# 挤压到一点：将一个面或线沿着一个矢量挤出一个闭合曲面或表面
# 
# 输入B：需要被挤压的面或曲线
# 输入P：挤压终到点
# 输出E：挤压结果
cir_6 = Circle(P=PlaneXY(17, 3, 0), R=2)
# 偏移曲面：将一个曲面偏移一定距离
# 
# 输入S：基准曲面
# 输入D：偏移的距离
# 输入T：boolean值，true为重新调整曲面
# 输出S：偏移的结果
cir_7 = Circle(P=PlaneXY(23, 3, 0), R=2)
# 单线生筒：以一条线为中心线生成一个空心筒
# 
# 输入C：中心线
# 输入R：截面半径
# 输出S：生成的空心筒
cir_8 = Circle(P=Plane(origin=(24, 25, 0), x=(1, 0, 0), y=(0, -0.3582514992, 0.9336251192)), R=5)
planar_4 = PlanarSrf(E=cir_7)
srf = Surface(<surface referenced from the Rhino model>)
planar_5 = PlanarSrf(E=cir_4)
xy = XYPlane(O=Point(0, 0, 0))
line = Line(Line((20, -16, 0), (17, 0, 17)))
pt = Point(<point referenced from the Rhino model>)
pipe = Pipe(C=cir_8, R=1)
offset = Offset(S=srf, D=Slider(8.40625, range=-5..25), T=Toggle(True))
extr_3 = ExtrudePoint(B=[cir_6, planar_4], P=pt)
extrude = ExtrudeLinear(P=[cir_5, planar_5], Po=xy, A=line, Ao=xy)
panel_10 = Panel(pipe)
panel_11 = Panel(extr_3)
panel_12 = Panel(offset)
panel_13 = Panel(extrude)
extr_4 = ExtrudePoint()
extrude_2 = ExtrudeLinear(Po=PlaneXY(0, 0, 0))
pipe_2 = Pipe(R=1)
offset_2 = Offset(D=0, T=True)
slider = Slider(10, range=0..10)
# 曲线生面：由两条曲线生成一个曲面
# 
# 输入A：起始曲线
# 输入B：路径曲线
# 输出S：输出曲面
slider_2 = Slider(0.88125, range=0..2)
# 按轴旋转：按轴旋转一条曲线生成一个曲面
# 
# 输入P：截面轮廓
# 输入A：旋转轴线
# 输入I：旋转角度，默认值为2pi
toggle = BooleanToggle(False)
crv_3 = Curve(<curve referenced from the Rhino model>)
crv_4 = Curve(<curve referenced from the Rhino model>)
# 沿轨道旋转：用轨道旋转来生成一个旋转曲面
# 
# 输入P：轨道屈膝
# 输入R：截面曲线
# 输入A：旋转轴线
# 输入S：boolean值，true为旋转面的各截面等宽
crv_5 = Curve(<curve referenced from the Rhino model>)
crv_6 = Curve(<curve referenced from the Rhino model>)
line_2 = Line(Line((-3, -28, 0), (-3, 0, 19)))
# 点生成面：用一个UV点阵来生成一个曲面
# 
# 输入P：生成曲面的点集
# 输入U：生成曲面的U值
# 输入I：boolean值，true为曲面通过所有点
# 输出S：输出曲面
srf_2 = Surface(<surface referenced from the Rhino model>)
crv_7 = Curve(<curve referenced from the Rhino model>)
line_3 = Line(Line((-16, -24, 0), (2, -47, 0)))
pi = Pi(N=slider_2)
divide = DivideSurface(S=srf_2, U=slider, V=10)  # -> P, N, uv
add = Addition(A=slider, B="1")
sumsrf = SumSurface(A=crv_3, B=crv_4)
railrev = RailRevolution(P=crv_5, R=crv_6, A=line_2, S=toggle)
revsrf = Revolution(P=crv_7, A=line_3, I=pi)
# 通常一个符合曲面UV特征的点集是不容易被得到了，我们可以通过Divide Surface得到一个合理的点集然后简单的编辑这些点再生成一个新的曲面。
# 
# 注意：SrfGrid的U值等于Divide Surface的U值+1。
# 原点阵的序列不能被打乱。
Z_3 = UnitZ(F=10)
cull = CullPattern(L=divide.P, P=[True, False])
cull_2 = CullPattern(L=divide.P, P=[False, True])
panel_14 = Panel(railrev)
panel_15 = Panel(sumsrf)
panel_16 = Panel(revsrf)
# 双轨放样：用两条轨迹放样出一个曲面
# 
# 输入R：轨迹曲线
# 输入S：断面曲线
# 输出H：boolean值，true为截面高度一致
toggle_2 = BooleanToggle(False)
# 单轨放样：用一条轨迹放样出一个曲面
# 
# 输入R：轨迹曲线
# 输入S：断面曲线
# 输出T：boolean值，true为修正曲面
crv_8 = Curve(<curve referenced from the Rhino model>)
crv_9 = Curve(<curve referenced from the Rhino model>)
crv_10 = Curve(<curve referenced from the Rhino model>)
crv_11 = Curve(<curve referenced from the Rhino model>)
crv_12 = Curve(<curve referenced from the Rhino model>)
move_2 = Move(G=cull_2, T=Z_3)
railrev_2 = RailRevolution(S=False)
revsrf_2 = Revolution(I=Domain(0, 6.283185307))
sumsrf_2 = SumSurface()
weave = Weave(P=[0, 1], _0=cull, _1=move_2, NullGaps=False)
swp2 = Sweep2(R¹=crv_10, R²=crv_11, S=crv_12, H=Toggle(True))
swp1 = Sweep1(R=crv_8, S=crv_9, T=toggle_2)
srfgrid = SurfaceFromPoints(I=False)
srfgrid_2 = SurfaceFromPoints(P=weave, U=add, I=Toggle(False))
panel_17 = Panel(swp2)
panel_18 = Panel(swp1)
swp1_2 = Sweep1(T=True)
swp1_3 = Sweep1(T=True)
