# Grasshopper definition Fc Surface_Primitive.ghx (Grasshopper 0.6.19)

# centerbox其实是两点box，初始点为中心点，第二个点为一个顶点，绘制中心盒子
# 
# 输入B：基准面；若输入点则默认为原点在该点的xy平面
# 输入xyz：xyz顶点的坐标
slider = Slider(0.7, range=0..1)
slider_2 = Slider(4.236198425, range=0..10)
# 两点Box：可以通过定义两个角点和一个基准面来创建一个box
# 
# 输入AB：A、B两个角点
# 输入P：基准面
# 输出B：输出box
toggle = BooleanToggle(True)
# Bounding Box可以创建一个包裹所选物体的最小box
# 
# 输入C：拾取物体
# 输入U：boolean值，true为对多个物体只创建一个box
# 输出B：输出box
pt = Point([<point referenced from the Rhino model> x6])
geo = Geometry(<0, culture=neutral, publickeytoken=null referenced from the Rhino model>)
pt_2 = Point(<point referenced from the Rhino model>)
pt_3 = Point(<point referenced from the Rhino model>)
# Box平面：创建一个矩形通过一个box
# 
# 输入P：基准面
# 输入B：要穿过的box
# 输入I：膨胀系数（可放大）
pln = Plane(Plane(origin=(35, 5, 0), x=(0.8081220356, -0.5050762723, 0.3030457634), y=(0.5835339026, 0.6164846581, -0.5286159767)))
pln_2 = Plane(Plane(origin=(55, 6, 0), x=(-0.9615239476, 0.2747211279, 0), y=(-0.2747211279, -0.9615239476, 0)))
box = Box({Plane=Plane(origin=(42, 10, 0), x=(0, 1, 0), y=(1, 0, 0)), X=Domain(0, 2), Y=Domain(0, 4), Z=Domain(0, -2)})
pln_3 = Plane(Plane(origin=(55, 6, 0), x=(-0.9615239476, 0.2747211279, 0), y=(-0.2747211279, -0.9615239476, 0)))
bbox = BoundingBox(C=[pt, geo], U=toggle)
box_2 = Box2Pt(A=pt_2, B=pt_3, P=pln)
pxb = BoxPlane(P=pln_2, B=box, I=slider)
box_3 = CenterBox(B=pln_3, X=slider_2, Y=slider_2, Z=slider_2)
panel = Panel(box_2)
panel_2 = Panel(bbox)
panel_3 = Panel(box_3)
panel_4 = Panel(pxb)
bbox_2 = BoundingBox(U=False)
pxb_2 = BoxPlane(I=1)
box_4 = Box2Pt(P=PlaneXY(0, 0, 0))
box_5 = CenterBox(B=PlaneXY(0, 0, 0), Y=1, Z=1)
# 中心球体：通过定义中心点和半径来创建一个球体
# 
# 输入B：基准面；若输入点则默认为原点在该点的xy平面
# 输入R：球体半径
slider_3 = Slider(0.5, range=0..1)
# 圆柱：创建一个圆柱
# 
# 输入B：底面基准面     R：底面圆半径     L：圆锥高度
# 输出C：圆柱表面
slider_4 = Slider(0.5, range=0..1)
# Sphere fit创建一个球，使球面通指定的几个点
# 
# 输入P：指定点（通常四个点可确定）
# 输出C：该球的中心点
# 输出R：该球的半径
# 输出S：该球的表面
slider_5 = Slider(0.5, range=0..1)
P = Point([<point referenced from the Rhino model> x3])
pln_4 = Plane(Plane(origin=(65, 11, 0), x=(-0.894427191, 0.4472135955, 0), y=(-0.4338609156, -0.8677218313, 0.242535625)))
# 圆锥：创建一个圆锥
# 
# 输入B：底面基准面     R：底面圆半径     L：圆锥高度
# 输出C：圆锥表面       T：顶点
pln_5 = Plane(Plane(origin=(65, 11, 0), x=(-0.894427191, 0.4472135955, 0), y=(-0.4338609156, -0.8677218313, 0.242535625)))
pln_6 = Plane(Plane(origin=(65, 11, 0), x=(-0.894427191, 0.4472135955, 0), y=(-0.4338609156, -0.8677218313, 0.242535625)))
sfit = SphereFit(P=P)  # -> C, R, S
cyl = Cylinder(B=pln_4, R=Slider(0.5, range=0..1), L=slider_3)
cone = Cone(B=pln_5, R=Slider(0.5, range=0..1), L=slider_4)  # -> C, T
sph = Sphere(B=pln_6, R=slider_5)
panel_5 = Panel(cone.T)
panel_6 = Panel(cone.C)
panel_7 = Panel(sfit.S)
panel_8 = Panel(sfit.C)
panel_9 = Panel(sfit.R)
panel_10 = Panel(cyl)
panel_11 = Panel(sph)
cyl_2 = Cylinder(B=PlaneXY(0, 0, 0), L=1)
cone_2 = Cone(B=PlaneXY(0, 0, 0), L=1)  # -> C, T
sfit_2 = SphereFit()  # -> C, R, S
sph_2 = Sphere(B=Plane(origin=(0, 0, 0), x=(0.8448993788, 0.5349252656, 0), y=(0.2849681328, -0.4500991333, 0.8462883276)))
# Interval box 可以通过定义起始点与长宽高确定一个box
# 
# 输入B：基准面，起始点为平面原点
# 输入XYZ：xyz各轴上的区间
# 输出B：输出box
slider_6 = Slider(0, range=0..1)
# 矩形：可以通过定义起始点与长宽确定一个矩形
# 
# 输入B：基准面，起始点为平面原点
# 输入XY：xy各轴上的区间
# 输出P：输出矩形
slider_7 = Slider(2.5, range=0..5)
pln_7 = Plane(PlaneXZ(3, 0, 1))
int = Interval(A=slider_6, B=slider_7)
pln_8 = Plane(PlaneXZ(3, 0, 1))
int_2 = Interval(A=Slider(0, range=0..1), B=Slider(2.5, range=0..5))
box_6 = IntervalBox(B=pln_7, X=int, Y=int, Z=int)
plane = PlaneSrf(P=pln_8, X=int_2, Y=int_2)
panel_12 = Panel(box_6)
panel_13 = Panel(plane)
box_7 = IntervalBox(
    B=Plane(origin=(6.970399006, -13.00419198, 0), x=(0.7239569195, 0.6898451846, 0), y=(0.6898451846, -0.7239569195, 0)),
    X=Domain(0, 1),
    Y=Domain(0, 1),
    Z=Domain(0, 1))
plane_2 = PlaneSrf(
    P=Plane(origin=(6.327513674, -5.202078351, 0), x=(0.743506763, 0.6687284152, 0), y=(-0.6687284152, 0.743506763, 0)),
    X=Domain(0, 3),
    Y=Domain(0, 1))
