# Grasshopper definition GB Mesh_Triangulation.ghx (Grasshopper 0.6.19)

# 三角网格
# 输入端P：形成三角形的点
# 输入端PL:自由选择基础平面，如果没有手动选择平面的话，就会自动生成一个最适合的平面。
# 
# 输出端M：形成的网格
pt = Point([<point referenced from the Rhino model> x9])
# BRep网格
# 输入端B：Brep几何体
# 输入端S：设置要使用的网格算法（右键点击S选择Set Mesh Options或者Manage Mesh Settings Collection)
# 
# 输出端M：生成接近BRep的网格
brep = BRep(<brep referenced from the Rhino model>)
# 轮廓找形（凸状）
# 计算空间内点的集合的凸状轮廓
# 输入端P：凸状外轮廓生成所需要的点集合
# 输入端PL:自由选择基础平面，如果没有手动选择平面的话，就会自动生成一个最适合的平面。
# 
# 输出端H：点集合的外轮廓在基础平面上的投影。
# 输出端Hz：点集合在空间的外轮廓。
# 输出端I：外轮廓上点的指数。
pt_2 = Point([<point referenced from the Rhino model> x11])
# 八叉树
# 输入端P：输入点集
# 输入端S：确认每个面是否为方形
# 输入端G：输入每个面上所切出的数量
# 
# 输出端B：八叉树盒子
# 输出端P：每个盒的点（与输入点重合）
pt_3 = Point([<point referenced from the Rhino model> x10])
# 三维跨界（寻找一定距离范围的点的集合）
# 输入端P：所有的点
# 输入端G：所找到的最近点的最大数量
# 输入端R-：设置搜索半径的最小值
# 输入端R+：设置搜索半径的最大值
# 
# 输出端L：相近点连线
# 输出端T：相近点拓朴
pt_4 = Point([<point referenced from the Rhino model> x12])
del = DelaunayMesh(P=pt, Pl=PlaneXY(0, 0, 0))
mesh = MeshBRep(
    B=brep,
    S={Refine=False, JaggedSeams=True, SimplePlanes=True, GridMinCount=16, GridMaxCount=400, Tolerance=0, RefineAngle=0, MinTolerance=0, RelativeTolerance=0, MinEdgeLength=0, MaxEdgeLength=0})
hull = ConvexHull(P=pt_2, Pl=PlaneXY(0, 0, 0))  # -> H, Hz, I
oct = OcTree(P=pt_3, S=False, G=Slider(0, range=0..10))  # -> B, P
prox = Proximity3D(P=pt_4, G=Slider(4, range=0..10), R=Slider(3, range=0..10), R_2=Slider(30, range=0..100))  # -> L, T
panel = Panel(del)
panel_2 = Panel(mesh)
mesh_2 = Mesh(mesh)
mesh_3 = Mesh(del)
panel_3 = Panel(oct.P)
panel_4 = Panel(hull.I)
crv = Curve(hull.H)
crv_2 = Curve(hull.Hz)
line = Line(prox.L)
panel_5 = Panel(prox.T)
box = Box(oct.B)
pt_5 = Point(oct.P)
prox_2 = Proximity3D(G=5)  # -> L, T
hull_2 = ConvexHull(Pl=PlaneXY(0, 0, 0))  # -> H, Hz, I
del_2 = DelaunayMesh(Pl=PlaneXY(0, 0, 0))
oct_2 = OcTree(S=False, G=5)  # -> B, P
mesh_4 = MeshBRep(S={Refine=False, JaggedSeams=True, SimplePlanes=True, GridMinCount=16, GridMaxCount=400, Tolerance=0, RefineAngle=0, MinTolerance=0, RelativeTolerance=0, MinEdgeLength=0, MaxEdgeLength=0})
panel_6 = Panel("粗糙的网格设置")
# 三角形边缘
# 输入端P：形成三角形的点
# 输入端PL：自由选择基础平面，如果没有手动选择平面的话，就会自动生成一个最适合的平面。
# 
# 输出端C：拓扑学的连通性图表
# 输出端E：连通性图表的边缘
# voronoi圆顶
# 输入端P：voronoi晶体单体的中心点
# 输入端B：为圆顶设置一下方体形的边界
# 输入端R：为圆顶设置一个半径
# 
# 输入端P：圆顶曲线
# 输入端D：圆顶的面
pt_6 = Point([<point referenced from the Rhino model> x7])
# 创建一个基于UV曲面的网格
# 输入端S：曲面几何体
# 输入端U：U方向的方格数
# 输入端V：V方向的方格数
# 输入端H：是否剪除多余的部分
# 输入端Q：是否均衡两界限之间的距离
# 
# 输出端M：生成UV网格
slider = Slider(5, range=0..10)
pt_7 = Point([<point referenced from the Rhino model> x10])
B = Box({Plane=PlaneXY(7.302480459, 0, -25.11369236), X=Domain(0, 59.40317868), Y=Domain(0, 85.15152908), Z=Domain(0, 48.01747427)})
# 网格的习惯设置
# Stitch：如果True，则进行相邻面边缘的匹配
# Planes：是否在平面上进行生成最小量的三角形的网格划分
# Refine：是否超过公差精度就进行网格细化
# Min：每个面的最初网格的最低的方形数
# Max：每个面的最初网格的最高的方形数
# Aspect：最初网格的最大长宽比
# Max Dist：边缘的中点到基础曲面之间允许的最大值
# Max Angle：正常的两个相邻四边形所允许的角度的最大值
# Min Edge：边缘长度所允许的最小值
# Max Edge：边缘长度所允许的最大值
# 
# 输出端M：光滑的曲面设置
bool = Boolean(True)
bool_2 = Boolean(True)
bool_3 = Boolean(True)
srf = Surface(<surface referenced from the Rhino model>)
bool_4 = Boolean(False)
bool_5 = Boolean(True)
jagged = SettingsSpeed()
con = DelaunayEdges(P=pt_6, Pl=PlaneXY(0, 0, 0))  # -> C, E
facet = FacetDome(P=pt_7, B=B, R=slider)  # -> P, D
mesh_uv = MeshSurface(S=srf, U=Slider(8, range=0..10), V=Slider(10, range=0..10), H=bool_4, Q=bool_5)
custom_mesh_settings = SettingsCustom(
    Stitch=bool,
    Planes=bool_2,
    Refine=bool_3,
    Min=Slider(4.099998474, range=0..10),
    Max=Slider(2.900001526, range=0..10),
    Aspect=Slider(4.883950316, range=0..10),
    Max_Dist=Slider(2.493828668, range=0..10),
    Max_Angle=Slider(4.300003052, range=0..10),
    Min_Edge=Slider(6.444445951, range=0..10),
    Max_Edge=Slider(6.069132487, range=0..10))
panel_7 = Panel(jagged)
line_2 = Line(con.E)
panel_8 = Panel(mesh_uv)
mesh_5 = Mesh(mesh_uv)
panel_9 = Panel(con.C)
crv_3 = Curve(facet.P)
srf_2 = Surface(facet.D)
panel_10 = Panel(facet.P)
panel_11 = Panel(custom_mesh_settings)
custom_mesh_settings_2 = SettingsCustom(Stitch=True, Planes=False, Refine=True, Max=400, Aspect=20, Max_Dist=0, Max_Angle=20, Min_Edge=0, Max_Edge=0)
mesh_uv_2 = MeshSurface(U=5, V=5, H=True, Q=False)
con_2 = DelaunayEdges(Pl=PlaneXY(0, 0, 0))  # -> C, E
facet_2 = FacetDome()  # -> P, D
jagged_2 = SettingsSpeed()
panel_12 = Panel("光滑的网格设置")
# 四叉树
# 输入端P：所有的点
# 输入端PL：自由选择基础平面，如果没有手动选择平面的话，就会自动生成一个最适合的平面
# 输入端S：确认切出的面是否为方形
# 输入端G：输入面所切出的数量
# 
# 输出端Q：四叉树形成的线
# 输出端P：每个面上的点（与输入点重合）
slider_2 = Slider(72, range=0..100)
# voronoi结构
# 输入端P：voronoi图解的点
# 输入端R：voronoi晶格单元半径
# 输入端B：为voronoi结构设置一个方形体边界
# 输入端PL：自由选择基础平面，如果没有手动选择平面的话，就会自动生成一个最适合的平面
# 
# 输出端C：平面voronoi晶格单元图
pt_8 = Point([<point referenced from the Rhino model> x10])
B_2 = Box({Plane=PlaneXY(188.3559324, -132.7795072, 0), X=Domain(0, 129.3949199), Y=Domain(0, 112.6628182), Z=Domain(0, 31.23239189)})
# 二维跨界（寻找一定距离范围的点的集合）
# 输入端P：所有的点
# 输入端PL：自由选择基础平面，如果没有手动选择平面的话，就会自动生成一个最适合的平面。
# 输入端G：所找到的最近点的最大数量
# 输入端R-：设置搜索半径的最小值
# 输入端R+：设置搜索半径的最大值
# 
# 输出端L：相近点连线
# 输出端T：相近点拓朴
pt_9 = Point([<point referenced from the Rhino model> x12])
smooth = SettingsQuality()
pt_10 = Point([<point referenced from the Rhino model> x9])
bool_6 = Boolean(True)
qt = QuadTree(P=pt_10, Pl=PlaneXY(0, 0, 0), S=bool_6, G=Slider(5, range=0..10))  # -> Q, P
prox_3 = Proximity2D(P=pt_9, Pl=PlaneXY(0, 0, 0), G=Slider(4, range=0..10), R=Slider(3, range=0..10), R_2=slider_2)  # -> L, T
voronoi = Voronoi(P=pt_8, R=Slider(92, range=0..100), B=B_2, Pl=PlaneXY(0, 0, 0), BruteForceOverride=False)
panel_13 = Panel(smooth)
crv_4 = Curve(qt.Q)
panel_14 = Panel(qt.P)
panel_15 = Panel(voronoi)
crv_5 = Curve(voronoi)
line_3 = Line(prox_3.L)
panel_16 = Panel(prox_3.T)
prox_4 = Proximity2D(Pl=PlaneXY(0, 0, 0), G=5)  # -> L, T
qt_2 = QuadTree(Pl=PlaneXY(0, 0, 0), S=False, G=5)  # -> Q, P
voronoi_2 = Voronoi(Pl=PlaneXY(0, 0, 0), BruteForceOverride=False)
smooth_2 = SettingsQuality()
