# Grasshopper definition Gc Mesh_Util.ghx (Grasshopper 0.6.19)

box = MeshBox(B={Plane=PlaneXY(0, 0, 0), X=Domain(-10, 10), Y=Domain(-10, 10), Z=Domain(-10, 10)}, X=10, Y=10, Z=10)
# 将网格涂上颜色
# 
# 输入端M：需要改变颜色的网格
# 输入端C：需要改变的颜色
# 
# 输出端M：改变颜色后的网格
plane = MeshPlane(B=PlaneXY(0, 0, 0), W=Domain(-10, 10), H=Domain(-10, 10), Cw=10, Ch=10)  # -> M, A
# 将形成单元面的几个点分解出来
# 
# 输入端F：单元面
# 
# 输出端A：第一点（数值代表点集中第几个点）
# 输出端B：第二点（数值代表点集中第几个点）
# 输出端C：第三点（数值代表点集中第几个点）
# 输出端D：第四点（数值代表点集中第几个点）
sphere = MeshSphere(B=PlaneXY(0, 0, 0), R=10, U=20, V=10)
mesh = MeshComponents(M=box)  # -> V, F, C, N
# 提取网格的属性
# 
# 输入端M：目标网格
# 
# 输出端V：组成网格的点集
# 输出端F：组成网格的单元面
# 输出端C：目标网格的颜色
# 输出端N：网格中心到每个单元面的单位向量
swatch = ColourSwatch()
mesh_2 = MeshComponents(M=sphere)  # -> V, F, C, N
face = FaceComponents(F=mesh.F)  # -> A, B, C, D
pt = Point(mesh_2.V)
col = Colour(mesh_2.C)
vec = Vector(mesh_2.N)
col_2 = MeshPaint(M=plane.M, C=[ColourSwatch(), ColourSwatch(), swatch])
quad = MeshQuad(A=face.A, B=face.B, C=face.C, D=face.D)
panel = Panel(mesh_2.F)
panel_2 = Panel(col_2)
panel_3 = Panel(quad)
mesh_3 = MeshComponents()  # -> V, F, C, N
face_2 = FaceComponents()  # -> A, B, C, D
col_3 = MeshPaint(C=[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])
