# Grasshopper definition Ha Intersect_Boolean.ghx (Grasshopper 0.6.19)

panel = Panel("""物体之间作并集运算

输入端B：BRep

输出端B：并集运算后生成的BRep(相交部分消失）""")
circle = Circle({Plane=Plane(origin=(360, -167, 0), x=(0.6, -0.8, 0), y=(0.8, 0.6, 0)), Radius=15})
circle_2 = Circle({Plane=Plane(origin=(69, 152, 0), x=(0, -1, 0), y=(1, 0, 0)), Radius=17})
circle_3 = Circle({Plane=Plane(origin=(64, 151, 0), x=(0, -1, 0), y=(1, 0, 0)), Radius=8})
# 曲线之间做交集运算
# 
# 输入端A：闭合曲线A
# 输入端B：闭合曲线B
# 输入端P：两条曲线投影平面
# 
# 输出端R：曲线交集之后生成的闭合曲线
xy = XYPlane(O=Point(0, 0, 0))
circle_4 = Circle({Plane=PlaneXY(203, -87, 0), Radius=19})
circle_5 = Circle({Plane=PlaneXY(216, -81, 0), Radius=18})
# 物体T切割物体S
# 
# 输入端S：BRep
# 输入端T：BRep
# 
# 输出端R：差集（T端BRep切掉S端BRep）后生成的BRep，不含切面。
xy_2 = XYPlane(O=Point(0, 0, 0))
circle_6 = Circle({Plane=Plane(origin=(299, -44, 0), x=(0.9922778767, 0.1240347346, 0), y=(-0.1240347346, 0.9922778767, 0)), Radius=24.18677324})
circle_7 = Circle({Plane=Plane(origin=(302, -51, 0), x=(0.4819187498, -0.8762159087, 0), y=(0.8762159087, 0.4819187498, 0)), Radius=22.82542442})
circle_8 = Circle({Plane=Plane(origin=(0, 284, 0), x=(0, -1, 0), y=(1, 0, 0)), Radius=22})
circle_9 = Circle({Plane=Plane(origin=(10, 316, 0), x=(0, -1, 0), y=(1, 0, 0)), Radius=36})
# 曲线之间进行并集运算
# 
# 输入端C：闭合曲线
# 输入端P：两条曲线投影平面
# 
# 输出端R：并集后形成的闭合曲线
xy_3 = XYPlane(O=Point(0, 0, 0))
# 曲线B切割曲线A
# 
# 输入端A：闭合曲线A
# 输入端B：闭合曲线B
# 输入端P：两条曲线投影平面
# 
# 输出端R：切割后的曲线，含切边
circle_10 = Circle({Plane=PlaneXY(200, -17, 0), Radius=23})
circle_11 = Circle({Plane=PlaneXY(217, -19, 0), Radius=17})
circle_12 = Circle({Plane=Plane(origin=(205, -38, 0), x=(0.7071067812, -0.7071067812, 0), y=(0.7071067812, 0.7071067812, 0)), Radius=8.485281374})
box = Box(flatten({Plane=PlaneXY(225, -245, 0), X=Domain(0, 43), Y=Domain(0, 43), Z=Domain(0, 18)}))
# BRep之间进行交集运算
# 
# 输入端A：BRep
# 输入端B：BRep
# 
# 输出端R：交集后生成的BRep
box_2 = Box({Plane=PlaneXY(204, -220, 0), X=Domain(0, 37), Y=Domain(0, 32), Z=Domain(0, 53)})
box_3 = Box({Plane=PlaneXY(41, -104, 0), X=Domain(0, 51), Y=Domain(0, 41), Z=Domain(0, 27)})
box_4 = Box(flatten({Plane=PlaneXY(16, -133, 0), X=Domain(0, 51), Y=Domain(0, 43), Z=Domain(0, 15)}))
# 两个物体之间的差集
# 
# 输入端A：第一个BRep
# 输入端B：第二个BRep
# 
# 输出端B：物体A被物体B切割之后剩下的(含切面）
box_5 = Box({Plane=PlaneXY(81, -223, 0), X=Domain(0, 35), Y=Domain(0, 44), Z=Domain(0, 37)})
box_6 = Box(flatten({Plane=PlaneXY(98, -248, 0), X=Domain(0, 43), Y=Domain(0, 43), Z=Domain(0, 25)}))
planar = PlanarSrf(E=circle_2)
planar_2 = PlanarSrf(E=circle_3)
box_7 = Box({Plane=Plane(origin=(312, -164, 0), x=(0, 1, 0), y=(1, 0, 0)), X=Domain(0, 46), Y=Domain(0, 48), Z=Domain(0, -43)})
extr = Extrude(B=circle, D=Vector(0, 0, 60))
planar_3 = PlanarSrf(E=circle_8)
planar_4 = PlanarSrf(E=circle_9)
union = RegionUnion(C=[circle_4, circle_5], P=xy)
union_2 = SolidUnion(B=[box_3, box_4])
diff = RegionDifference(A=circle_10, B=[circle_11, circle_12], P=xy_3)
int = RegionIntersection(A=circle_6, B=circle_7, P=xy_2)
int_2 = SolidIntersection(A=box_2, B=box)
trim = TrimSolid(S=box_7, T=extr)
dif = SolidDifference(A=box_5, B=box_6)
dif_2 = SolidDifference(A=planar, B=planar_2)
union_3 = SolidUnion(B=[planar_4, planar_3])
planar_5 = PlanarSrf(E=union)
planar_6 = PlanarSrf(E=diff)
panel_2 = Panel(union_2)
panel_3 = Panel(union_3)
panel_4 = Panel(int_2)
panel_5 = Panel(trim)
panel_6 = Panel(diff)
panel_7 = Panel(union)
planar_7 = PlanarSrf(E=int)
panel_8 = Panel(int)
panel_9 = Panel(dif_2)
panel_10 = Panel(dif)
union_4 = SolidUnion()
union_5 = RegionUnion()
trim_2 = TrimSolid()
dif_3 = SolidDifference()
diff_2 = RegionDifference()
int_3 = RegionIntersection()
int_4 = SolidIntersection()
