# Grasshopper definition Hc Intersect_Physical.ghx (Grasshopper 0.6.19)

C = Curve(<curve referenced from the Rhino model>)
srf = Surface(<surface referenced from the Rhino model>)
# 曲线与BRep相交
# 
# 输入端B：BRep
# 输入端C：曲线
# 
# 输出端C：相交线（当存在相交线时）
# 输出端P：相交点
B = BRep(<brep referenced from the Rhino model>)
# 曲线与面相交
# 
# 输入端S：面
# 输入端C：曲线
# 
# 输出端C：相交曲线（当存在相交线时）
# 输出端P：相交点
# 输出端UV：相交部分的曲面UV坐标
# 输出端N：相交部分的曲面标准向量
# 输出端t：相交点在曲线上的评估参数
# 输出端T：相交部分的曲线切线向量
C_2 = Curve(<curve referenced from the Rhino model>)
circle = Circle({Plane=PlaneXY(11, 24, 0), Radius=8})
B_2 = Curve(<curve referenced from the Rhino model>)
# 曲线相交
# 
# 输入端A：曲线1
# 输入端B：曲线2
# 
# 输出端P：交点
# 输出端tA：交点在曲线A上的评估参数
# 输出端tA：交点在曲线B上的评估参数
box = Box({Plane=PlaneXY(12, -43, 0), X=Domain(0, 10), Y=Domain(0, 10), Z=Domain(0, 12)})
# 两个BRep的相交线/点
# 
# 输入端A：一个BRep
# 输入端B：另一个BRep
# 
# 输出端C：交线
# 输出端P：交点（当存在相交点时）
brep = BRep(<brep referenced from the Rhino model>)
bbx = BRepBRep(A=brep, B=box)  # -> C, P
scx = SurfaceCurve(S=srf, C=C)  # -> C, P, uv, N, t, T
ccx = CurveCurve(A=unitize(circle), B=B_2)  # -> P, tA, tB
bcx = BRepCurve(B=B, C=C_2)  # -> C, P
panel = Panel(bbx.C)
panel_2 = Panel(bbx.P)
panel_3 = Panel(ccx.P)
panel_4 = Panel(ccx.tA)
panel_5 = Panel(ccx.tB)
panel_6 = Panel(scx.uv)
panel_7 = Panel(scx.N)
panel_8 = Panel(scx.t)
panel_9 = Panel(scx.C)
panel_10 = Panel(scx.P)
panel_11 = Panel(scx.T)
panel_12 = Panel(bcx.C)
panel_13 = Panel(bcx.P)
ccx_2 = CurveCurve()  # -> P, tA, tB
bcx_2 = BRepCurve()  # -> C, P
bbx_2 = BRepBRep()  # -> C, P
scx_2 = SurfaceCurve()  # -> C, P, uv, N, t, T
