# Grasshopper definition Hd Intersect_Region.ghx (Grasshopper 0.6.19)

circle = Circle({Plane=Plane(origin=(0, 0, 7), x=(-0.6401843997, 0.7682212796, 0), y=(-0.7682212796, -0.6401843997, 0)), Radius=7.810249676})
# 曲线被一个或多个(图标带有加号的)BRep切分
# 
# 输入端C：曲线
# 输入端B：BRep
# 
# 输出端C：被BRep切分后的N段曲线
# 输出端P：曲线与BRep的交点
box = Box({Plane=PlaneXY(0, -11, 0), X=Domain(0, 13), Y=Domain(0, 11), Z=Domain(0, 13)})
# 某曲线被一个或多个(图标带有加号的)闭合曲线切分
# 
# 输入端C：被切分的曲线
# 输入端R：闭合曲线
# 输入端P：平面
# 
# 输出端Ci：被切分后闭合曲线内的曲线
# 输出端Co：被切分后闭合曲线外的曲线
crv = Curve(
    V=[Point(-26, 4, 0), Point(-54, -17, 0), Point(-84, 3, 0), Point(-85, -38, 0), Point(-47, -25, 0), Point(-23, -50, 0), Point(-18, -22, 0)],
    D=3,
    P=True)  # -> C, L, D
# 曲线被一个或多个(图标带有加号的)BRep切分成内外两部分
# 
# 输入端C：曲线
# 输入端B：BRep
# 
# 输出端C：被BRep切分后的BRep里的曲线
# 输出端P：被BRep切分后的BRep外的曲线
circle_2 = Circle({Plane=PlaneXY(-51, -20, 0), Radius=23})
circle_3 = Circle({Plane=Plane(origin=(0, 0, 7), x=(-0.6401843997, 0.7682212796, 0), y=(-0.7682212796, -0.6401843997, 0)), Radius=7.810249676})
box_2 = Box({Plane=PlaneXY(0, -11, 0), X=Domain(0, 13), Y=Domain(0, 11), Z=Domain(0, 13)})
P = Plane(Plane(origin=(-54.20118535, -13.54247982, 0), x=(0.894427191, -0.4472135955, 0), y=(0.4467987848, 0.8935975697, -0.0430607633)))
trim = TrimWithBReps()  # -> Ci, Co
trim_2 = TrimWithBRep(C=circle, B=box)  # -> Ci, Co
split = SplitWithBRep(C=circle_3, B=box_2)  # -> C, P
split_2 = SplitWithBReps()  # -> C, P
trim_3 = TrimWithRegions()  # -> Ci, Co
trim_4 = TrimWithRegion(C=crv.C, R=circle_2, P=P)  # -> Ci, Co
panel = Panel(split.C)
panel_2 = Panel(split.P)
panel_3 = Panel(trim_2.Ci)
panel_4 = Panel(trim_2.Co)
panel_5 = Panel(trim_4.Ci)
panel_6 = Panel(trim_4.Co)
trim_5 = TrimWithRegion()  # -> Ci, Co
trim_6 = TrimWithRegions()  # -> Ci, Co
trim_7 = TrimWithBRep()  # -> Ci, Co
trim_8 = TrimWithBReps()  # -> Ci, Co
split_3 = SplitWithBRep()  # -> C, P
split_4 = SplitWithBReps()  # -> C, P
