# Grasshopper definition Ia XForm_Affine.ghx (Grasshopper 0.6.19)

# Shear G可以根据角度使物体残生倾斜变形
# 
# 输入G：原物体     P：基准平面
#          Ax：绕x轴旋转的角度
#          Ay：绕y轴旋转的角度
# 输出G：生成的物体
slider = Slider(0.5879999161, range=0..1)
panel = Panel("基准向量与参考向量间的关系将决定生成物体的旋转和缩放比例")
# Shear可以把一个物体沿一个向量产生挤压变形
# 
# 输入G：原物体     P：基准平面      G：基准点     T：目标点
# 输出G：生成的物体
slider_2 = Slider(0.483950768, range=0..2)
sph = Sphere(B=PlaneXY(41, -38, 0), R=5)
# Scale用于让一个物体按比例向一点缩放
# 
# 输入G：原物体     C：基准点    F：缩放比例
# 输出G：生成的物体
# Project用于得到一个物体在某个面上的投影面
# 
# 输入G：原物体     P：投影面
# 输出G：生成的物体
slider_3 = Slider(0.5378772123, range=0..2)
sph_2 = Sphere(B=Plane(origin=(12, -45, 0), x=(0.9486832981, 0.316227766, 0), y=(-0.316227766, 0.9486832981, 0)), R=5)
panel_2 = Panel("曲面的uv坐标也会跟随曲面一同投影到平面上")
sph_3 = Sphere(B=Plane(origin=(-8, 0, 6), x=(0, 0.894427191, -0.4472135955), y=(1, 0, 0)), R=5)
xy = XYPlane(O=Point(0, 0, 0))
# Orient用于实现一个点到另个一个点参考移动及旋转缩放。
# 
# 输入G：原物体      pA：基准点    pB：基准向量
#                                     pB：参考点    pB：参考向量
# 输出G：生成的物体
box = Box({Plane=PlaneXY(4, -4, 0), X=Domain(0, 5), Y=Domain(0, 5), Z=Domain(0, 4)})
X = UnitX(F=1)
Y = UnitY(F="2")
# Scale NU可以通过基准平面上xyz三轴各自的缩放比例来缩放原物体
# 
# 输入G：原物体     P：基准平面      XYZ：各轴缩放比例
# 输出G：生成的物体
sph_4 = Sphere(B=Plane(origin=(-39, -31, 0), x=(0.4472135955, 0.894427191, 0), y=(-0.632455532, 0.316227766, 0.7071067812)), R=5)
pln = Plane(Plane(origin=(-19, -25, 0), x=(0.6054728455, 0.6581226581, 0.4475234075), y=(-0.7276516853, 0.2299973457, 0.6462385363)))
P = Plane(PlaneXY(0, 0, 0))
box_2 = Box({Plane=PlaneXY(40, -7, 0), X=Domain(0, 9), Y=Domain(0, 9), Z=Domain(0, 6)})
C = Point(Point(51, -12, 0))
pt = PointXYZ(X=Slider(1, range=0..1), Y=Slider(0.7985184281, range=0..1), Z=slider)
P_2 = Plane(PlaneXY(0, 0, 0))
G = Point(Point(0, 0, 1))
pt_2 = Point(Point(4, -4, 0))
pt_3 = Point(Point(20, 6, 0))
project = Project(G=sph_3, P=xy)
scale_nu = ScaleNU(G=sph_4, P=pln, X=Slider(0.4778003693, range=0..2), Y=Slider(0.7466003418, range=0..2), Z=slider_2)
scale = Scale(G=box_2, C=C, F=slider_3)
shear = ShearAngle(G=sph, P=P, Ax=Slider(0.5309997559, range=0..2), Ay=Slider(0, range=0..2))
orient = OrientDirection(G=box, pA=pt_2, dA=X, pB=pt_3, dB=Y)
shear_2 = Shear(G=sph_2, P=P_2, G_2=G, T=pt)
panel_3 = Panel(project)
panel_4 = Panel(scale_nu)
panel_5 = Panel(scale)
panel_6 = Panel(shear)
panel_7 = Panel(orient)
panel_8 = Panel(shear_2)
orient_2 = OrientDirection(pA=Point(0, 0, 0), dA=Vector(0, 0, 1), pB=Point(0, 0, 0), dB=Vector(0, 0, 1))
shear_3 = ShearAngle(P=PlaneXY(0, 0, 0), Ax=0, Ay=0)
scale_2 = Scale(C=Point(0, 0, 0), F=0.5)
project_2 = Project()
scale_nu_2 = ScaleNU(P=PlaneXY(0, 0, 0), X=1, Y=1, Z=1)
shear_4 = Shear(P=PlaneXY(0, 0, 0), G_2=Point(0, 0, 1), T=Point(0, 0, 1))
