# Grasshopper definition Ib XForm_Euclidian.ghx (Grasshopper 0.6.19)

panel = Panel("A项右键Expression输入rad(a)可将输入值单位转化为角度")
# RotAx G按轴旋转一个物体
# 
# 输入G：原物体     A：角度     X：旋转轴
# 输出G：生成的物体
cone = Cone(B=Plane(origin=(-40, -26, 0), x=(0.4472135955, -0.894427191, 0), y=(-0.894427191, -0.4472135955, 0)), R=3, L=3)  # -> C, T
# Rotate沿基准面法线旋转一个物体
# 
# 输入G：原物体     A：角度     P：基准面
# 输出G：生成的物体
cone_2 = Cone(B=Plane(origin=(21, -26, 0), x=(1, 0, 0), y=(0, 0.8, 0.6)), R=3, L=3)  # -> C, T
# Orient通过设置参考面来移动旋转一个物体
# 
# 输入G：原物体     A：基准面     B：参考面
# 输出G：生成的物体
cone_3 = Cone(B=Plane(origin=(1, -7, 0), x=(0.9991330731, 0.04163054471, 0), y=(-0.04163054471, 0.9991330731, 0)), R=3, L=3)  # -> C, T
# Move沿向量移动一个物体
# 
# 输入G：原物体     T：参考向量
# 输出G：生成的物体
cone_4 = Cone(B=Plane(origin=(32, -47, 0), x=(0.9965457582, -0.08304547985, 0), y=(0.08304547985, 0.9965457582, 0)), R=3, L=3)  # -> C, T
# Mirror根据一个镜面镜像一个物体
# 
# 输入G：原物体     P：镜面
# 输出G：生成的物体
cone_5 = Cone(B=PlaneXY(9, -1, 0), R=3, L=3)  # -> C, T
yz = YZPlane(O=Point(0, 0, 0))
xy = XYPlane(O=Point(0, 0, 0))
xz = XZPlane(O=Point(0, 0, 0))
X = Line(Line((-38, -38, 0), (-31, -21, 0)))
Z = UnitZ(F=Slider(5.579998016, range=0..10))
mirror = Mirror(G=cone_5.C, P=yz)
P = Plane(PlaneXY(30, -23, 0))
orient = Orient(G=cone_3.C, A=xy, B=xz)
move = Move(G=cone_4.C, T=Z)
rotate = Rotate(G=cone_2.C, A=expr("rad(a)", Slider(128.1599808, range=0..180)), P=P)
panel_3 = Panel(mirror)
rotax = RotateAxis(G=cone.C, A=expr("rad(a)", Slider(128.1599808, range=0..180)), X=X)
panel_4 = Panel(orient)
panel_5 = Panel(move)
panel_6 = Panel(rotate)
panel_7 = Panel(rotax)
rotate_2 = Rotate(P=PlaneXY(0, 0, 0))
rotax_2 = RotateAxis()
orient_2 = Orient(A=PlaneXY(0, 0, 0))
mirror_2 = Mirror()
move_2 = Move()
