# Grasshopper definition Ic xForm_Morph.ghx (Grasshopper 0.6.19)

# SBox可以用来在一个曲面表面生成一个有几何特征的方盒空间。
# 与Divide连用，可以在一个曲面上出创建一组附有规律的几何空间群。
# 
# Sa:输入曲面a
# Da:输入曲面a上需要与曲面b相连接的区域
# Sb:输入曲面b
# Db:输入曲面b上需要与曲面a相连接的区域
slider = Slider(1.720000458, range=0..2)
# BlendBox可以用来在两个曲面之间生成一个有几何特征的方盒空间。
# 与Divide连用，可以两个曲面之间创建一组附有规律的几何空间群。
# 
# Sa:输入曲面a
# Da:输入曲面a上需要与曲面b相连接的区域
# Sb:输入曲面b
# Db:输入曲面b上需要与曲面a相连接的区域
slider_2 = Slider(0.175, range=0..1)
box = Box({Plane=PlaneXY(50, 6, 0), X=Domain(0, 8), Y=Domain(0, 11), Z=Domain(0, 7)})
G = Geometry(<0, culture=neutral, publickeytoken=null referenced from the Rhino model>)
# SrfMorph 可以在一个曲面表面阵列扭曲某物体。原理和Morph相同，之不过扭转盒子需要用曲面的UV值和W值确定
# 
# G:被扭转的物体    R:起始盒子   S:曲面    U\V：曲面的UV值    W:盒子的沿曲面发现的长度。
S = Surface(<surface referenced from the Rhino model>)
G_2 = Geometry(flatten(<0, culture=neutral, publickeytoken=null referenced from the Rhino model>))
box_corners = BoxCorners(B=box)  # -> A, B, C, D, E, F, G, H
bbox = BoundingBox(C=G_2, U=False)
bbox_2 = BoundingBox(C=G, U=False)
int = Interval(A=Slider(0.2200000763, range=0..1), B=Slider(0.4074074074, range=0..1))
int_2 = Interval(A=Slider(0.4200000763, range=0..1), B=slider)
int_3 = Interval(A=slider_2, B=Slider(0.7283950617, range=0..1))
int_4 = Interval(A=Slider(0.3150001526, range=0..1), B=Slider(0.9, range=0..1))
# TBox比较简单通过八个顶点来创建一个扭曲的盒子空间
# 
# Morph是一个很有用的运算器，它可以让一个物体按照一个规则扭转。扭转的规则需要用一个起始的盒子和一个按法则扭转的盒子来确定。
# 
# G:被扭转的物体    R:起始盒子（可以由BBox提供）
# W:扭转的盒子（根据需要不同，可以由不同运算器提供，如：TBox\blendBox\SBox 等
slider_3 = Slider(-8.599998474, range=-10..10)
int_5 = Interval(A=Slider(0.3174999237, range=0..1), B=Slider(0.5700000763, range=0..1))
int_6 = Interval(A=Slider(0.3150001526, range=0..1), B=Slider(0.9, range=0..1))
pcomp = Decompose(P=box_corners.A)  # -> X, Y, Z
int² = Interval²(U=int, V=int_2)
sa = Surface(<surface referenced from the Rhino model>)
sa_2 = Surface(<surface referenced from the Rhino model>)
int²_2 = Interval²(U=int_3, V=int_4)
srfmorph = SurfaceMorph(
    G=G_2,
    R=bbox,
    S=S,
    U=Slider(0.1920398712, range=0..1),
    V=Slider(0.4070796967, range=0..1),
    W=Slider(-12.87112766, range=-50..100))
int²_3 = Interval²(U=int_5, V=int_6)
S_2 = Surface(<surface referenced from the Rhino model>)
add = Addition(A=slider_3, B=pcomp.X)
blendbox = BlendBox(Sa=sa_2, Da=int²_2, Sb=sa, Db=int²)
sbox = SurfaceBox(S=S_2, D=int²_3, H=Slider(6.800003052, range=0..20))
pt = PointXYZ(X=add, Y=pcomp.Y, Z=pcomp.Z)
G_3 = Geometry(flatten(<0, culture=neutral, publickeytoken=null referenced from the Rhino model>))
S_3 = Surface(<surface referenced from the Rhino model>)
S_4 = Surface(<surface referenced from the Rhino model>)
sa_3 = Surface(<surface referenced from the Rhino model>)
sa_4 = Surface(<surface referenced from the Rhino model>)
tbox = TwistedBox(
    A=pt,
    B=box_corners.B,
    C=box_corners.C,
    D=box_corners.D,
    E=box_corners.E,
    F=box_corners.F,
    G=box_corners.G,
    H=box_corners.H)
divide = DivideInterval²(I=S_3, U=10, V=10)
bbox_3 = BoundingBox(C=G_3, U=False)
divide_2 = DivideInterval²(I=S_4, U=10, V=10)
divide_3 = DivideInterval²(I=sa_3, U=10, V=10)
divide_4 = DivideInterval²(I=sa_4, U=10, V=10)
morph = BoxMorph(G=G, R=bbox_2, T=tbox)
int_7 = Interval²Components(I=divide)  # -> U, V
morph_2 = BoxMorph()
blendbox_2 = BlendBox(Sa=sa_3, Da=divide_3, Sb=sa_4, Db=divide_4)
blendbox_3 = BlendBox()
sbox_2 = SurfaceBox(S=S_4, D=divide_2, H=Slider(3.456790123, range=0..20))
tbox_2 = TwistedBox()
sbox_3 = SurfaceBox(H=1)
srfmorph_2 = SurfaceMorph()
srfmorph_3 = SurfaceMorph(G=G_3, R=bbox_3, S=S_3, U=int_7.U, V=int_7.V, W=Slider(-5, range=-50..100))
panel = Panel("""CO用于做物体的中心对称

G:母体     P:中心对称点     F:缩放比例""")
panel_2 = Panel("Deform 功能尚不明确，有待讨论")
# Mirror surface 可以将母体细分后沿一个不规则曲面对称再重新生成新的形体
# 
# G:母体   S:镜像用的曲面   F:boolean 影响对称法则
slider_4 = Slider(0.4483947754, range=0..1)
# Mirror curve 可以将母体细分后沿一个自由曲线对称再重新生成新的形体
# 
# G:母体   C:镜像用的曲线   F:boolean 影响对称法则
toggle = BooleanToggle(True)
G_4 = Geometry(<0, culture=neutral, publickeytoken=null referenced from the Rhino model>)
S_5 = Surface(<surface referenced from the Rhino model>)
C = Curve(<curve referenced from the Rhino model>)
G_5 = Geometry(<0, culture=neutral, publickeytoken=null referenced from the Rhino model>)
P = Point(Point(1.968428335, -14, 0))
G_6 = Geometry(<0, culture=neutral, publickeytoken=null referenced from the Rhino model>)
sph = Sphere(B=Plane(origin=(98, -39, 0), x=(0.2576626506, 0.9662349396, 0), y=(-0.9641866239, 0.257116433, -0.06507913735)), R=12)
pt_2 = PointXYZ(X=0, Y=0, Z=0)
Z = UnitZ(F=Slider(16.99002075, range=0..20))
co = CameraObscura(G=G_6, P=P, F=slider_4)
mirror = MirrorSurface(G=G_4, S=S_5, F=toggle)
mirror_2 = MirrorCurve(G=G_5, C=C, T=Toggle(True))
deform = SpatialDeform(G=sph, S=pt_2, F=Z)
co_2 = CameraObscura(P=Point(0, 0, 0), F=1)
mirror_3 = MirrorCurve(T=True)
mirror_4 = MirrorSurface(F=True)
