# Grasshopper definition GA GC Mesh_primitive，util.ghx (Grasshopper 0.9.76)

# 生成一个球形网格
# 
# 输入端B：球心所在的平面
# 输入端R：球的半径
# 输入端U：U方向分隔出单元面数目
# 输入端V：V方向分隔出单元面数目
# 
# 输出端M：生成的球形网格
# 建立方体的网格
# 
# 输入端B：建立一个或几个方体
# 输入端X：X方向单元面数目
# 输入端Y：Y方向单元面数目
# 输入端Z：Z方向单元面数目
# 
# 输入端M：生成的方体的网格
sphere = MeshSphere(Base=PlaneXY(0, 0, 0), Radius=10, UCount=20, VCount=10)
box = MeshBox(Base={Plane=PlaneXY(0, 0, 0), X=Domain(-10, 10), Y=Domain(-10, 10), Z=Domain(-10, 10)}, XCount=10, YCount=10, ZCount=10)
# 提取网格的属性
# 
# 输入端M：目标网格
# 
# 输出端V：组成网格的点集
# 输出端F：组成网格的单元面
# 输出端C：目标网格的颜色
# 输出端N：网格中心到每个单元面的单位向量
sphere_2 = MeshSphere(Base=PlaneXY(0, 0, 0), Radius=10, UCount=20, VCount=10)
box_2 = MeshBox(Base={Plane=PlaneXY(0, 0, 0), X=Domain(-10, 10), Y=Domain(-10, 10), Z=Domain(-10, 10)}, XCount=10, YCount=10, ZCount=10)
move = Move(Geometry=box, Translation=Vector(44.17017134, 0.2675686528, 0))
mesh = DeconstructMesh(Mesh=sphere)  # -> Vertices, Faces, Colours, Normals
# 在某平面上生成的平面网格
# 
# 输入端B：生成网格的平面
# 输入端W：生成网格的宽度范围
# 输入端H：生成网格的长度范围
# 输入端Cw：宽度方向的单元面数
# 输入端Ch：长度方向的单元面数
# 
# 输出端M：生成的平面网格
# 输出端A：生成的平面网格的面积
mesh_2 = DeconstructMesh()  # -> Vertices, Faces, Colours, Normals
mesh_3 = DeconstructMesh(Mesh=move)  # -> Vertices, Faces, Colours, Normals
pl = PlaneNormal(Origin=mesh.Vertices, ZAxis=mesh.Normals)
slider = Slider(1.2274, range=0..10)
quad = MeshQuad(
    CornerA=Slider(18, range=0..100),
    CornerB=Slider(43, range=0..100),
    CornerC=Slider(62, range=0..100),
    CornerD=Slider(45, range=0..100))
triangle = MeshTriangle(CornerA=Slider(20, range=0..100), CornerB=Slider(75, range=0..100), CornerC=Slider(39, range=0..100))
plane = MeshPlane(Base=pl, Width=slider, Height=slider, WidthCount=10, HeightCount=10)  # -> Mesh, Area
# 将形成单元面的几个点分解出来
# 
# 输入端F：单元面
# 
# 输出端A：第一点（数值代表点集中第几个点）
# 输出端B：第二点（数值代表点集中第几个点）
# 输出端C：第三点（数值代表点集中第几个点）
# 输出端D：第四点（数值代表点集中第几个点）
face = DeconstructFace(Face=mesh_3.Faces)  # -> CornerA, CornerB, CornerC, CornerD
# 从点集合中抽取四个点组成单元面
# 
# 输入端A：第一点（数值代表点集中第几个点）
# 输入端B：第二点（数值代表点集中第几个点）
# 输入端C：第三点（数值代表点集中第几个点）
# 输入端D：第四点（数值代表点集中第几个点）
# 
# 输出端F：生成的单元面
# 从点集合中抽取三个点组成单元面
# 
# 输入端A：第一点（数值代表点集中第几个点）
# 输入端B：第二点（数值代表点集中第几个点）
# 输入端C：第三点（数值代表点集中第几个点）
# 
# 输出端F：生成的单元面
mesh_4 = ConstructMesh(Vertices=mesh_3.Vertices, Faces=[quad, triangle], Colours=RGB(204, 43, 0))
# 将网格涂上颜色
# 
# 输入端M：需要改变颜色的网格
# 输入端C：需要改变的颜色
# 
# 输出端M：改变颜色后的网格
plane_2 = MeshPlane(Base=PlaneXY(0, 0, 0), Width=Domain(-10, 10), Height=Domain(-10, 10), WidthCount=10, HeightCount=10)  # -> Mesh, Area
# 通过一系列点和单元面来生成带颜色的网格
# 
# 输入端V：点阵
# 输入端F：单元面
# 输入端C：生成网格的颜色
# 
# 输出端M：网格
C = Colour(RGB(136, 255, 0))
col = MeshColours(Mesh=plane.Mesh, Colours=C)
mesh_5 = ConstructMesh()
face_2 = DeconstructFace()  # -> CornerA, CornerB, CornerC, CornerD
col_2 = MeshColours(Colours=[RGB(127, 255, 0), RGB(0, 100, 0), RGB(34, 139, 34), RGB(124, 252, 0), RGB(154, 205, 50), RGB(173, 255, 47), RGB(50, 205, 50), RGB(152, 251, 152)])
mesh_6 = DeconstructMesh()  # -> Vertices, Faces, Colours, Normals
triangle_2 = MeshTriangle()
