# Grasshopper definition GA GC Mesh_primitive，util2.ghx (Grasshopper 0.6.19)

B = Box({Plane=PlaneXY(0, 0, 0), X=Domain(-10, 10), Y=Domain(-10, 10), Z=Domain(-10, 10)})
X = Integer(10)
Y = Integer(10)
# 在某平面上生成的平面网格
# 
# 输入端B：生成网格的平面
# 输入端W：生成网格的宽度范围
# 输入端H：生成网格的长度范围
# 输入端Cw：宽度方向的单元面数
# 输入端Ch：长度方向的单元面数
# 
# 输出端M：生成的平面网格
# 输出端A：生成的平面网格的面积
Z = Integer(10)
# 生成一个球形网格
# 
# 输入端B：球心所在的平面
# 输入端R：球的半径
# 输入端U：U方向分隔出单元面数目
# 输入端V：V方向分隔出单元面数目
# 
# 输出端M：生成的球形网格
B_2 = Plane(PlaneXY(0, 0, 0))
R = Number(10)
U = Integer(20)
# 建立方体的网格
# 
# 输入端B：建立一个或几个方体
# 输入端X：X方向单元面数目
# 输入端Y：Y方向单元面数目
# 输入端Z：Z方向单元面数目
# 
# 输入端M：生成的方体的网格
V = Integer(10)
B_3 = Plane(PlaneXY(0, 0, 0))
W = Interval(Domain(-10, 10))
H = Interval(Domain(-10, 10))
cw = Integer(10)
# 从点集合中抽取三个点组成单元面
# 
# 输入端A：第一点（数值代表点集中第几个点）
# 输入端B：第二点（数值代表点集中第几个点）
# 输入端C：第三点（数值代表点集中第几个点）
# 
# 输出端F：生成的单元面
# 从点集合中抽取四个点组成单元面
# 
# 输入端A：第一点（数值代表点集中第几个点）
# 输入端B：第二点（数值代表点集中第几个点）
# 输入端C：第三点（数值代表点集中第几个点）
# 输入端D：第四点（数值代表点集中第几个点）
# 
# 输出端F：生成的单元面
ch = Integer(10)
sphere = MeshSphere(B=B_2, R=R, U=U, V=V)
box = MeshBox(B=B, X=X, Y=Y, Z=Z)
plane = MeshPlane(B=B_3, W=W, H=H, Cw=cw, Ch=ch)  # -> M, A
panel = Panel(box)
panel_2 = Panel(sphere)
panel_3 = Panel(plane.A)
panel_4 = Panel(plane.M)
sphere_2 = MeshSphere(B=PlaneXY(0, 0, 0), U=20, V=10)
box_2 = MeshBox(B={Plane=PlaneXY(0, 0, 0), X=Domain(-10, 10), Y=Domain(-10, 10), Z=Domain(-10, 10)}, X=10, Z=10)
plane_2 = MeshPlane(B=PlaneXY(0, 0, 0), W=Domain(-10, 10), H=Domain(-10, 10), Ch=10)  # -> M, A
triangle = MeshTriangle()
quad = MeshQuad()
# 通过一系列点和单元面来生成带颜色的网格
# 
# 输入端V：点阵
# 输入端F：单元面
# 输入端C：生成网格的颜色
# 
# 输出端M：网格
mesh = Mesh()
box_3 = MeshBox(B={Plane=PlaneXY(0, 0, 0), X=Domain(-10, 10), Y=Domain(-10, 10), Z=Domain(-10, 10)}, X=10, Y=10, Z=10)
move = Move(G=box_3, T=Vector(44.17017134, 0.2675686528, 0))
mesh_2 = MeshComponents(M=move)  # -> V, F, C, N
quad_2 = MeshQuad(A=Slider(19, range=0..100), B=Slider(32, range=0..100), C=Slider(60, range=0..100), D=Slider(44, range=0..100))
triangle_2 = MeshTriangle(A=Slider(21, range=0..100), B=Slider(74, range=0..100), C=Slider(38, range=0..100))
mesh_3 = Mesh(V=mesh_2.V, F=[quad_2, triangle_2], C=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)
face = FaceComponents(F=mesh_2.F)  # -> A, B, C, D
panel_5 = Panel(quad_2)
# 将网格涂上颜色
# 
# 输入端M：需要改变颜色的网格
# 输入端C：需要改变的颜色
# 
# 输出端M：改变颜色后的网格
plane_3 = MeshPlane(B=PlaneXY(0, 0, 0), W=Domain(-10, 10), H=Domain(-10, 10), Cw=10, Ch=10)  # -> M, A
# 将形成单元面的几个点分解出来
# 
# 输入端F：单元面
# 
# 输出端A：第一点（数值代表点集中第几个点）
# 输出端B：第二点（数值代表点集中第几个点）
# 输出端C：第三点（数值代表点集中第几个点）
# 输出端D：第四点（数值代表点集中第几个点）
swatch = ColourSwatch()
col = MeshPaint(M=plane_3.M, C=[ColourSwatch(), ColourSwatch(), swatch])
panel_6 = Panel(col)
col_2 = MeshPaint(C=[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])
face_2 = FaceComponents()  # -> A, B, C, D
# 提取网格的属性
# 
# 输入端M：目标网格
# 
# 输出端V：组成网格的点集
# 输出端F：组成网格的单元面
# 输出端C：目标网格的颜色
# 输出端N：网格中心到每个单元面的单位向量
sphere_3 = MeshSphere(B=PlaneXY(0, 0, 0), R=10, U=20, V=10)
mesh_4 = MeshComponents(M=sphere_3)  # -> V, F, C, N
pt = Point(mesh_4.V)
col_3 = Colour(mesh_4.C)
vec = Vector(mesh_4.N)
panel_7 = Panel(mesh_4.F)
mesh_5 = MeshComponents()  # -> V, F, C, N
