# Grasshopper definition Ga Mesh_primitive.ghx (Grasshopper 0.6.19)

# 通过一系列点和单元面来生成带颜色的网格
# 
# 输入端V：点阵
# 输入端F：单元面
# 输入端C：生成网格的颜色
# 
# 输出端M：网格
slider = Slider(38, range=0..100)
# 从点集合中抽取四个点组成单元面
# 
# 输入端A：第一点（数值代表点集中第几个点）
# 输入端B：第二点（数值代表点集中第几个点）
# 输入端C：第三点（数值代表点集中第几个点）
# 输入端D：第四点（数值代表点集中第几个点）
# 
# 输出端F：生成的单元面
slider_2 = Slider(44, range=0..100)
B = Box({Plane=PlaneXY(0, 0, 0), X=Domain(-10, 10), Y=Domain(-10, 10), Z=Domain(-10, 10)})
X = Integer(10)
Y = Integer(10)
# 在某平面上生成的平面网格
# 
# 输入端B：生成网格的平面
# 输入端W：生成网格的宽度范围
# 输入端H：生成网格的长度范围
# 输入端Cw：宽度方向的单元面数
# 输入端Ch：长度方向的单元面数
# 
# 输出端M：生成的平面网格
# 输出端A：生成的平面网格的面积
Z = Integer(10)
# 生成一个球形网格
# 
# 输入端B：球心所在的平面
# 输入端R：球的半径
# 输入端U：U方向分隔出单元面数目
# 输入端V：V方向分隔出单元面数目
# 
# 输出端M：生成的球形网格
B_2 = Plane(PlaneXY(0, 0, 0))
R = Number(10)
U = Integer(20)
# 建立方体的网格
# 
# 输入端B：建立一个或几个方体
# 输入端X：X方向单元面数目
# 输入端Y：Y方向单元面数目
# 输入端Z：Z方向单元面数目
# 
# 输入端M：生成的方体的网格
V = Integer(10)
B_3 = Plane(PlaneXY(0, 0, 0))
W = Interval(Domain(-10, 10))
H = Interval(Domain(-10, 10))
cw = Integer(10)
# 从点集合中抽取三个点组成单元面
# 
# 输入端A：第一点（数值代表点集中第几个点）
# 输入端B：第二点（数值代表点集中第几个点）
# 输入端C：第三点（数值代表点集中第几个点）
# 
# 输出端F：生成的单元面
ch = Integer(10)
sphere = MeshSphere(B=B_2, R=R, U=U, V=V)
box = MeshBox(B=B, X=X, Y=Y, Z=Z)
plane = MeshPlane(B=B_3, W=W, H=H, Cw=cw, Ch=ch)  # -> M, A
recgrid = GridRectangular(P=PlaneXY(0, 0, 0), X=5, Y=5, S=1)  # -> G, C, M
triangle = MeshTriangle(A=Slider(31, range=0..100), B=Slider(75, range=0..100), C=Slider(38, range=0..100))
triangle_2 = MeshTriangle(A=Slider(21, range=0..100), B=Slider(74, range=0..100), C=slider)
quad = MeshQuad(A=Slider(19, range=0..100), B=Slider(32, range=0..100), C=Slider(60, range=0..100), D=slider_2)
panel = Panel(box)
panel_2 = Panel(sphere)
panel_3 = Panel(quad)
panel_4 = Panel(triangle_2)
panel_5 = Panel(plane.A)
panel_6 = Panel(plane.M)
mesh = Mesh(V=recgrid.G, F=triangle, C=ColourSwatch())
sphere_2 = MeshSphere(B=PlaneXY(0, 0, 0), U=20, V=10)
box_2 = MeshBox(B={Plane=PlaneXY(0, 0, 0), X=Domain(-10, 10), Y=Domain(-10, 10), Z=Domain(-10, 10)}, X=10, Z=10)
plane_2 = MeshPlane(B=PlaneXY(0, 0, 0), W=Domain(-10, 10), H=Domain(-10, 10), Ch=10)  # -> M, A
quad_2 = MeshQuad()
triangle_3 = MeshTriangle()
mesh_2 = Mesh()
