# Grasshopper definition HA——Intersect_Boolean.ghx (Grasshopper 0.6.19)

crv = Curve(
    V=[Point(55.87099536, 43.83885603, 0), Point(24.24732313, 35.25528786, 0), Point(6.17665328, 10.40811682, 0), Point(-2.406914896, -21.21555541, 0), Point(20.63318916, -50.12862716, 0), Point(56.3227621, -69.55459725, 0), Point(103.3065037, -64.13339629, 0), Point(123.1842405, -36.12385803, 0)],
    D=3,
    P=Toggle(True))  # -> C, L, D
# 两个物体之间的差集
# 
# 输入端A：第一个BRep
# 输入端B：第二个BRep
# 
# 输出端B：物体A被物体B切割之后剩下的(含切面）
intcrv = Interpolate(
    V=[Point(-47.58358951, -67.74753026, 0), Point(-35.83765411, -25.73322287, 0), Point(-2.858681643, -6.307252788, 0), Point(54.51569512, -8.566086519, 0), Point(72.58636496, -46.96625994, 0), Point(70.32753123, -101.6300362, 0), Point(32.8308913, -120.6042396, 0), Point(-3.310448389, -116.0865721, 0)],
    D=3,
    P=Toggle(True))  # -> C, L, D
brep = BRep(<brep referenced from the Rhino model>)
brep_2 = BRep(<brep referenced from the Rhino model>)
panel = Panel("""物体之间作并集运算

输入端B：BRep

输出端B：并集运算后生成的BRep(相交部分消失）""")
# 曲线B切割曲线A
# 
# 输入端A：闭合曲线A
# 输入端B：闭合曲线B
# 输入端P：两条曲线所在平面
# 
# 输出端R：切割后的曲线，含切边
# 曲线之间进行并集运算
# 
# 输入端C：闭合曲线
# 输入端P：闭合曲线所在的平面
# 
# 输出端R：并集后形成的闭合曲线
diff = RegionDifference()
# BRep之间进行交集运算
# 
# 输入端A：BRep
# 输入端B：BRep
# 
# 输出端R：交集后生成的BRep
union = RegionUnion()
# 物体T切割物体S
# 
# 输入端S：BRep
# 输入端T：BRep
# 
# 输出端R：差集（T端BRep切掉S端BRep）后生成的BRep，不含切面。
int = SolidIntersection()
# 曲线之间做交集运算
# 
# 输入端A：闭合曲线A
# 输入端B：闭合曲线B
# 输入端P：闭合曲线所在的平面
# 
# 输出端R：曲线交集之后生成的闭合曲线
trim = TrimSolid()
dif = SolidDifference(A=<geometry referenced from the Rhino model>, B=<geometry referenced from the Rhino model>)
union_2 = SolidUnion(B=[brep_2, brep])
int_2 = RegionIntersection(A=crv.C, B=intcrv.C)
union_3 = RegionUnion()
crv_2 = Curve(union)
diff_2 = RegionDifference()
int_3 = RegionIntersection()
crv_3 = Curve(diff)
int_4 = SolidIntersection()
brep_3 = BRep(int)
union_4 = SolidUnion()
dif_2 = SolidDifference()
brep_4 = BRep(dif)
brep_5 = BRep(union_2)
crv_4 = Curve(int_2)
trim_2 = TrimSolid()
brep_6 = BRep(trim)
