# Grasshopper definition HC HD Intersect_Physical，Region.ghx (Grasshopper 0.6.19)

crv = Curve(
    V=[Point(29.77305572, 0, -7.235879272), Point(32.97686657, 0, 3.701268105), Point(40.59972686, 0, 7.788888841), Point(46.45496738, 0, 6.242221536), Point(51.64735048, 0, -2.706353591), Point(52.08925542, 0, -8.340641633)],
    D=3,
    P=False)  # -> C, L, D
crv_2 = Curve(
    V=[Point(25.75036288, -11.5166851, 0), Point(30.50084103, -4.88811093, 0), Point(29.50655491, 0.8566533488, 0), Point(30.72179351, 7.264275044, 0), Point(40.11227358, 10.7995146, 0), Point(48.72942, 9.363323531, 0), Point(49.72370612, 3.287130544, 0), Point(47.29322893, -3.893824805, 0), Point(48.39799129, -11.40620886, 0), Point(52.37513579, -11.95859004, 0), Point(64.637998, -9.196684139, 0)],
    D=3,
    P=False)  # -> C, L, D
sph = Sphere(
    B=Plane(origin=(0.01502906677, -1.596906407, 0), x=(0.999599742, -0.02829055874, 0), y=(0.0281752327, 0.9955248888, 0.0902017301)),
    R=10)
cyl = Cylinder(
    B=Plane(origin=(0.1167965584, -0.1725588269, 0), x=(0.7736600588, -0.6336009102, 0), y=(0.5648598176, 0.6897235668, 0.4530063884)),
    R=10,
    L=5)
crv_3 = Curve(
    V=[Point(16.82849333, -12.41736699, 0), Point(22.02087643, -1.369743373, 0), Point(31.30088027, 3.38073478, 0), Point(44.33707613, 2.386448655, 0), Point(53.39612749, -4.02117304, 0), Point(56.71041458, -11.86498581, 0)],
    D=3,
    P=False)  # -> C, L, D
intcrv = Interpolate(
    V=[Point(16.60754086, -4.573554221, 0), Point(29.97516543, -7.887841305, 0), Point(34.94659606, -0.2649810119, 0), Point(43.34279001, 6.474069392, 0), Point(53.83803244, 1.39216253, 0), Point(50.63422159, -9.103079902, 0), Point(51.62850771, -18.2726075, 0)],
    D=3,
    P=False)  # -> C, L, D
crv_4 = Curve(
    V=[Point(-13.2895917, -10.78462217, 0), Point(-5.089419601, 0, 3.021252734), Point(-0.3240831205, -3.880909811, 0), Point(11.63112609, 10.09489814, 0)],
    D=3,
    P=False)  # -> C, L, D
filter = StreamFilter(G=Slider(1, range=0..1), _0=crv.C, _1=crv_2.C)
intcrv_2 = Interpolate(
    V=[Point(-86.02487124, -28.42775225, 0), Point(-71.39624143, -28.94103751, 0), Point(-64.7235331, -12.77255193, 0), Point(-73.19273983, -2.250204176, 0), Point(-64.7235331, 6.732287811, 0), Point(-49.83826067, 9.81199935, 0), Point(-35.97955874, 1.856077875, 0), Point(-34.95298823, -9.692840393, 0), Point(-35.72291611, -20.72847341, 0), Point(-33.15648983, -28.94103751, 0), Point(-23.40406996, -35.61374584, 0), Point(-38.80262765, -46.1360936, 0), Point(-51.89140169, -47.67594937, 0)],
    D=3,
    P=False)  # -> C, L, D
crv_5 = Curve(
    V=[Point(-17.24464688, -46.64937885, 0), Point(-34.95298823, -39.20674264, 0), Point(-46.5019065, -32.5340343, 0), Point(-45.98862124, -22.01168655, 0), Point(-31.35999144, -16.1089061, 0), Point(-26.22713887, -6.613128855, 0), Point(-25.45721099, 11.60849775, 0), Point(-36.74948663, 17.5112782, 0), Point(-59.59068054, 22.90077339, 0), Point(-62.9270347, 15.20149454, 0), Point(-55.22775586, 0.8295073627, 0), Point(-56.510969, -8.409627252, 0), Point(-68.57317252, -7.896341996, 0), Point(-79.86544816, -8.666269881, 0), Point(-78.3255924, -20.72847341, 0), Point(-73.70602509, -33.56060482, 0), Point(-81.14866131, -41.51652629, 0)],
    D=3,
    P=True)  # -> C, L, D
loft = Loft(S=[crv_3.C, intcrv.C], O={Adjust=False, Closed=False, Rebuild=10, Refit=0.01, LoftType=0, LoftEnds=3, LoftSimp=0})
B = BRep(sph)
# 曲线与面相交
# 
# 输入端S：面
# 输入端C：曲线
# 
# 输出端C：相交曲线
# 输出端P：相交点
# 输出端UV：相交部分的曲面UV坐标
# 输出端N：相交部分的曲面标准向量
# 输出端t：相交部分的曲线参数？
# 输出端T：相交部分的曲线切线向量
C = Curve(crv_4.C)
C_2 = Curve(intcrv_2.C)
R = Curve(crv_5.C)
# 曲线被一个或多个(图标带有加号的)BRep切分成内外两部分
# 
# 输入端C：曲线
# 输入端B：BRep
# 
# 输出端C：被BRep切分后的BRep里的曲线
# 输出端P：被BRep切分后的BRep外的曲线
P = Plane(Plane(origin=(-54.20118535, -13.54247982, 0), x=(0.894427191, -0.4472135955, 0), y=(0.4467987848, 0.8935975697, -0.0430607633)))
# 某曲线被一个或多个(图标带有加号的)闭合曲线切分
# 
# 输入端C：被切分的曲线
# 输入端R：闭合曲线
# 输入端P：平面
# 
# 输出端Ci：被切分后闭合曲线内的曲线
# 输出端Co：被切分后闭合曲线外的曲线
C_3 = Curve(filter)
srf = Surface(loft)
A = Curve(unitize(crv_3.C))
# 曲线与BRep相交
# 
# 输入端B：BRep
# 输入端C：曲线
# 
# 输出端C：相交线
# 输出端P：相交点
B_2 = Curve(intcrv.C)
# 两个BRep的相交线/点
# 
# 输入端A：一个BRep
# 输入端B：另一个BRep
# 
# 输出端C：交线
# 输出端P：交点
A_2 = BRep(cyl)
# 曲线相交
# 
# 输入端A：曲线1
# 输入端B：曲线2
# 
# 输出端P：交点
# 输出端tA：
# 输出端tA：
B_3 = BRep(sph)
scx = SurfaceCurve(S=srf, C=C_3)  # -> C, P, uv, N, t, T
trim = TrimWithRegions()  # -> Ci, Co
trim_2 = TrimWithRegion(C=C_2, R=R, P=P)  # -> Ci, Co
ccx = CurveCurve(A=unitize(A), B=B_2)  # -> P, tA, tB
trim_3 = TrimWithBRep(C=C, B=B)  # -> Ci, Co
# 曲线被一个或多个(图标带有加号的)BRep切分
# 
# 输入端C：曲线
# 输入端B：BRep
# 
# 输出端C：被BRep切分后的N段曲线
# 输出端P：曲线与BRep的交点
trim_4 = TrimWithBReps()  # -> Ci, Co
split = SplitWithBRep(C=C, B=B)  # -> C, P
split_2 = SplitWithBReps()  # -> C, P
bbx = BRepBRep(A=A_2, B=B_3)  # -> C, P
bcx = BRepCurve(B=B, C=C)  # -> C, P
pt = Point(scx.P)
pt_2 = Point(scx.uv)
vec = Vector(scx.N)
vec_2 = Vector(scx.T)
crv_6 = Curve(scx.C)
trim_5 = TrimWithRegion()  # -> Ci, Co
trim_6 = TrimWithRegions()  # -> Ci, Co
bbx_2 = BRepBRep()  # -> C, P
crv_7 = Curve(trim_2.Ci)
pt_3 = Point(bbx.P)
ccx_2 = CurveCurve()  # -> P, tA, tB
crv_8 = Curve(trim_2.Co)
trim_7 = TrimWithBRep()  # -> Ci, Co
trim_8 = TrimWithBReps()  # -> Ci, Co
crv_9 = Curve(bbx.C)
crv_10 = Curve(trim_3.Ci)
crv_11 = Curve(trim_3.Co)
scx_2 = SurfaceCurve()  # -> C, P, uv, N, t, T
bcx_2 = BRepCurve()  # -> C, P
pt_4 = PointXYZ(X=30, Y=30, Z=0)
split_3 = SplitWithBRep()  # -> C, P
split_4 = SplitWithBReps()  # -> C, P
crv_12 = Curve(bcx.C)
crv_13 = Curve(split.C)
pt_5 = Point(split.P)
pt_6 = Point(bcx.P)
filter_2 = StreamFilter(G=Slider(0, range=0..1), _0=vec, _1=vec_2)
move = Move(G=pt_4, T=filter_2)
