# Grasshopper definition Hb Intersect_Mathematical.ghx (Grasshopper 0.6.19)

# 直线与BRep相交
# 
# 输入端B：BRep
# 输入端L：直线
# 输入端Lf：布尔值是否仅为第一个相交点
# 
# 输出端C：相交后形成的线（若不成线则则为NULL）
# 输出端P：相交后形成的点
cyl = Cylinder(
    B=Plane(origin=(-120.7644378, 45.32885415, 0), x=(0.9999396263, 0.01098834754, 0), y=(-0.01098834754, 0.9999396263, 0)),
    R=10,
    L=20)
# 直线与平面相交
# 
# 输入端L：直线
# 输入端P：平面
# 
# 输出端P：相交点
# 输出端t：相交点在曲线上评估参数
# 输出端uv：相交点的UV坐标值
crv = Curve(
    V=[Point(52.59014662, -27.72871072, 0), Point(68.59694734, -20.03713115, 0), Point(61.1132483, -9.227343649, 0), Point(48.43253604, -4.446091486, 0), Point(43.44340335, 6.155815485, 0), Point(48.01677499, 12.80799241, 0), Point(61.94477042, 20.08381092, 0), Point(73.58608003, 22.57837726, 0), Point(62.15265095, 34.84332846, 0), Point(47.80889446, 37.33789481, 0)],
    D=3,
    P=False)  # -> C, L, D
sph = Sphere(
    B=Plane(origin=(21.80752095, 44.74862059, 0), x=(-0.2148617827, -0.9766444667, 0), y=(-0.9766444667, 0.2148617827, 0)),
    R=20)
# 曲线和平面相交
# 
# 输入端C：曲线
# 输入端P：平面
# 
# 输出端P：相交产生的点
# 输出端t：相交点在曲线上评估参数
# 输了端uv：相交点的UV坐标值
cone = Cone(
    B=Plane(origin=(106.224101, -89.17356477, 0), x=(0.7071067812, -0.7071067812, 0), y=(0.7071067812, 0.7071067812, 0)),
    R=10,
    L=30)  # -> C, T
# 两个平面相交
# 
# 输入端A：平面A
# 输入端B：平面B
# 
# 输出端L：两平面相交产生的直线
intcrv = Interpolate(
    V=[Point(-196.3585469, 0, -2.593029229), Point(-190.0999247, 0, 21.26796806), Point(-177.5826802, 0, 6.79490413), Point(-177.1915163, 0, -19.4130765), Point(-161.1537968, 0, -25.67169874), Point(-150.9835357, 0, -20.97773206), Point(-149.4188801, 0, -1.419537559), Point(-143.9425856, 0, 18.52982083), Point(-132.9899967, 0, 25.96193474), Point(-122.0374078, 0, 23.22378751), Point(-115.7787856, 0, 12.66236248), Point(-110.693655, 0, -15.89260149), Point(-102.4792133, 0, -21.36889595), Point(-97.00291884, 0, -19.80424039), Point(-89.96196882, 0, -1.419537559), Point(-86.44149381, 0, 7.18606802), Point(-83.70334658, 0, 11.09770692)],
    D=3,
    P=False)  # -> C, L, D
L = Line(Line((111.7527869, -37.06371452, 0), (150.0449698, 0, 34.13219006)))
# 三个平面相交
# 
# 输入端A：平面A
# 输入端B：平面B
# 输入端C：平面C
# 
# 输出端Pt：三个平面的相交点
# 输出端AB：平面A和平面B的相交线
# 输出端AC：平面A和平面C的相交线
# 输出端BC：平面B和平面C的相交线
P = Plane(Plane(origin=(132.0933091, -19.07017558, 0), x=(0.6877446479, -0.7259526839, 0), y=(-0.4061063458, -0.3847323276, 0.8288900241)))
A = Plane(Plane(origin=(-3.286725911, -68.73977479, 0), x=(0.7831108475, 0.6218821436, 0), y=(0.6218821436, -0.7831108475, 0)))
B = Plane(Plane(origin=(-18.87588265, -35.27864298, 0), x=(0.9899494937, 0.1414213562, 0), y=(0.1121467305, -0.7850271134, -0.6092253623)))
# 平面与BRep相交
# 
# 输入端B：BRep
# 输入端P：平面
# 
# 输出端C：相交产生的曲线
# 输出端P：相交产生的点集
C = Plane(Plane(origin=(-36.12517593, 0.3175539313, 0), x=(0.7071067812, 0.7071067812, 0), y=(0.5674433063, -0.5674433063, -0.5966709212)))
# 直线与曲线相交
# 
# 输入端C：曲线
# 输入端L：直线
# 输入端Lf：布尔值是否仅为第一个相交点
# 
# 输出端P：相交点
# 输出端t：相交点在曲线上评估参数
# 输出端E：相交点的数目
toggle = BooleanToggle(False)
A_2 = Plane(Plane(origin=(-40.68680253, 69.47554968, 0), x=(0.99980006, -0.0199960012, 0), y=(-0.0199960012, -0.99980006, 0)))
# 直线与曲面相交
# 
# 输入端S：曲面
# 输入端L：直线
# 输入端Lf：布尔值是否仅为第一个相交点
# 
# 输出端C：相交产生的曲线
# 输出端P：相交产生的点
# 输出端uv：相交点的UV坐标值
# 输出端N：相交部分的单位向量
B_2 = Plane(Plane(origin=(-40.3060602, 67.9859819, 0), x=(0.06408816224, 0.9979442407, 0), y=(-0.5362827295, 0.03444017529, 0.8433354661)))
L_2 = Line(Line((20.99680519, -21.71542487, 14.14095822), (-21.75749819, 10.21220737, 14.14095822)))
S = Surface(sph)
L_3 = Line(Line((-6.260258599, 29.38263239, 0), (55.89601952, 48.50764104, 0)))
L_4 = Line(Line((52.38226609, 42.74278856, 0), (62.77629253, -30.43115759, 0)))
B_3 = BRep(cone.C)
P_2 = Plane(Plane(origin=(107.2668344, -104.5838034, 0), x=(0.9999843954, 0.005586505002, 0), y=(-0.005260137582, 0.9415646271, 0.3367913062)))
C_2 = Curve(intcrv.C)
P_3 = Plane(Plane(origin=(-167.9388752, -21.08229321, 0), x=(0.09811584509, 0.9951750002, 0), y=(0.9672193894, -0.09535965811, 0.2353575754)))
plx = LinePlane(L=L, P=P)  # -> P, t, uv
_3px = PlanePlanePlane(A=A, B=B, C=C)  # -> Pt, AB, AC, BC
blx = BRepLine(B=cyl, L=L_2, Lf=toggle)  # -> C, P
ppx = PlanePlane(A=A_2, B=B_2)
scx = SurfaceLine(S=S, L=L_3, Lf=Toggle(False))  # -> C, P, uv, N
clx = CurveLine(C=crv.C, L=L_4, Lf=Toggle(False))  # -> P, t, E
sec = BRepPlane(B=B_3, P=P_2)  # -> C, P
pcx = CurvePlane(C=C_2, P=P_3)  # -> P, t, uv
pt = Point(plx.P)
line = Line(ppx)
crv_2 = Curve(blx.C)
pt_2 = Point(blx.P)
line_2 = Line(_3px.BC)
pt_3 = Point(_3px.Pt)
line_3 = Line(_3px.AB)
line_4 = Line(_3px.AC)
crv_3 = Curve(sec.C)
pt_4 = Point(sec.P)
pt_5 = Point(scx.P)
vec = Vector(scx.N)
crv_4 = Curve(scx.C)
pt_6 = Point(pcx.P)
pt_7 = Point(clx.P)
_3px_2 = PlanePlanePlane()  # -> Pt, AB, AC, BC
scx_2 = SurfaceLine(Lf=False)  # -> C, P, uv, N
pcx_2 = CurvePlane()  # -> P, t, uv
plx_2 = LinePlane()  # -> P, t, uv
blx_2 = BRepLine(Lf=False)  # -> C, P
clx_2 = CurveLine(Lf=False)  # -> P, t, E
sec_2 = BRepPlane()  # -> C, P
ppx_2 = PlanePlane()
