# Grasshopper definition 20170904-level1-框架为基础的构思方式.gh (Grasshopper 0.9.76)

panel = Panel("""逻辑阐述
A生成基本网格
B利用area提取每一个rec的形心点
C利用scale缩放每一个rec的大小，利用随机
D最后成面
E单元的部分可以基于网格下无限拓展""")

# ---- group: Frame 网架
xy = XYPlane(Origin=Point(0, 0, 0))
sqgrid = Square(Plane=xy, Size=Slider(1, range=0..50), ExtentX=Slider(35, range=0..50), ExtentY=Slider(20, range=0..50))  # -> flatten(Cells), Points

# ---- group: Variate 变量
lng = ListLength(List=sqgrid.Cells)
random = Random(Range=Domain(0, 1), Number=lng, Seed=Slider(2, range=0..10))

# ---- group: Unit 单元
area = Area(Geometry=sqgrid.Cells)  # -> Area, Centroid
scale = Scale(Geometry=sqgrid.Cells, Center=area.Centroid, Factor=random)  # -> flatten(Geometry), Transform
boundary = BoundarySurfaces(Edges=scale.Geometry)

# ---- group: 拓展B
explode = Explode(Curve=graft(scale.Geometry), Recursive=True)  # -> Segments, Vertices
intcrv = Interpolate(Vertices=explode.Vertices, Degree=3, Periodic=True, KnotStyle=1)  # -> Curve, Length, Domain
boundary_2 = BoundarySurfaces(Edges=intcrv.Curve)

# ---- group: 拓展A
graft = GraftTree(Tree=scale.Geometry, IncludeEmptyLists=True, IncludeNullItems=True)  # disabled
graft_2 = GraftTree(Tree=sqgrid.Cells, IncludeEmptyLists=True, IncludeNullItems=True)  # disabled
Z = UnitZ(Factor=flatten(random))  # -> graft(UnitVector); disabled
boundary_3 = BoundarySurfaces(Edges=[graft, graft_2])  # disabled
extr = Extrude(Base=boundary_3, Direction=Z)  # disabled
