# Grasshopper definition 20170904-level2-加深单元和干扰变量.gh (Grasshopper 0.9.76)

# ---- group: Frame 网架
# 逻辑阐述
# A生成基本网格
# B利用area提取每一个rec的形心点
# C利用eval去每一条边上的某一对应点
# D对边相连后，同理得出的上面的点
# E整理结构，merge，成面
# 
# 核心想法:以单独个体进行分析，再复杂化
number_slider = Slider(15, range=0..50)
xy = XYPlane(Origin=Point(0, 0, 0))
sqgrid = Square(Plane=xy, Size=Slider(1, range=0..50), ExtentX=Slider(20, range=0..50), ExtentY=number_slider)  # -> flatten(Cells), Points

# ----
pt = Point(flatten(sqgrid.Points))
item = ListItem(List=pt, Index=-1, Wrap=True)
item_2 = ListItem(List=pt, Index=0, Wrap=True)
ln = Line(StartPoint=item_2, EndPoint=item)

# ---- group: Variate 变量
lng = ListLength(List=sqgrid.Cells)
random = Random(Range=Domain(0, 0.95), Number=lng, Seed=Slider(4, range=0..10))  # -> flatten(Random)

# ----
panel = Panel("纯随机变化")
panel_2 = Panel("干扰变量效果")
graft = GraftTree(Tree=random, IncludeEmptyLists=True, IncludeNullItems=True)
panel_3 = Panel("嵌套取值可以达到联动变化的效果")

# ---- group: Variate 变量
line = Line(ln)

# ---- group: Unit 单元
crv = Curve(sqgrid.Cells)
explode = Explode(Curve=crv, Recursive=True)  # -> Segments, Vertices
area = Area(Geometry=graft(crv))  # -> Area, Centroid
pt_2 = Point(explode.Vertices)
shift = ShiftList(List=pt_2, Shift=-1, Wrap=False)  # -> simplify(List)
shift_2 = ShiftList(List=shift, Shift=1, Wrap=True)  # -> simplify(List)
crv_2 = Curve(simplify(explode.Segments))
graft_2 = GraftTree(Tree=crv_2, IncludeEmptyLists=True, IncludeNullItems=True)

# ---- group: Variate 变量 (continued)
pt_3 = Point(area.Centroid)
crv_cp = CurveClosestPoint(Point=pt_3, Curve=reparameterize(line))  # -> Point, flatten(Parameter), Distance

# ----
graft_3 = GraftTree(Tree=crv_cp.Parameter, IncludeEmptyLists=True, IncludeNullItems=True)

# ---- group: Unit 单元 (continued)
eval = EvaluateCurve(Curve=explode.Segments, Parameter=graft_3)  # -> Point, Tangent, Angle
ln_2 = Line(StartPoint=area.Centroid, EndPoint=eval.Point)
eval_2 = EvaluateCurve(Curve=ln_2, Parameter=graft_3)  # -> simplify(Point), Tangent, Angle
ln_3 = Line(StartPoint=eval_2.Point, EndPoint=shift_2)  # -> graft(Line)
ln_4 = Line(StartPoint=eval_2.Point, EndPoint=shift)  # -> graft(Line)
merge = Merge(Data1=graft_2, Data2=ln_4, Data3=ln_3)
join = JoinCurves(Curves=merge, Preserve=False)
boundary = BoundarySurfaces(Edges=join)
