# Grasshopper definition 20170920-level3-0叠加干扰和找形.gh (Grasshopper 0.9.76)

# 逻辑阐述
# A 变量可以为干扰变量，先定好外界干扰物
# B 将干扰的数据提取，整理，作为可用的变量
# 核心想法:干扰规则不止一个，其之间的叠加可能会有全新的规则出现
panel = Panel("""干扰项的变化可以带来变量的改变
进而带来形体的改变
这就是参数化设计的方法之一“找形”""")

# ---- group: Frame 网架
xy = XYPlane(Origin=Point(0, 0, 0))
sqgrid = Square(Plane=xy, Size=Slider(1, range=0..50), ExtentX=Slider(20, range=0..50), ExtentY=Slider(15, range=0..50))  # -> flatten(Cells), Points

# ----
crv0 = Curve(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)
crv1 = Curve(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)
crv_cp = CurveClosestPoint()  # -> Point, Parameter, Distance; disabled
panel_2 = Panel("提取有效最小值")
panel_3 = Panel("""graph mapper
更加细致直观的调节递变的趋势""")
panel_4 = Panel("映射为可用变量")

# ---- group: Variate 变量
merge = Merge(Data1=crv0, Data2=crv1)  # -> graft(Result)

pt = Point(<point referenced from the Rhino model>)

# ---- group: Unit 单元
crv = Curve(sqgrid.Cells)
number_slider = Slider(0.229, range=0..1)
explode = Explode(Curve=crv, Recursive=True)  # -> Segments, Vertices
area = Area(Geometry=graft(crv))  # -> Area, Centroid
number_slider_2 = Slider(0.522, range=0..1)
pt_2 = Point(explode.Vertices)
shift = ShiftList(List=pt_2, Shift=-1, Wrap=False)  # -> simplify(List)
shift_2 = ShiftList(List=shift, Shift=1, Wrap=True)  # -> simplify(List)
crv_2 = Curve(simplify(explode.Segments))
graft = GraftTree(Tree=crv_2, IncludeEmptyLists=True, IncludeNullItems=True)

# ----
pt_3 = Point(flatten(area.Centroid))

# ---- group: Variate 变量 (continued)
pt_4 = Point(flatten(area.Centroid))
dist = Distance(PointA=pt_4, PointB=pt)
bnd = Bounds(Numbers=dist)
remap = RemapNumbers(Value=dist, Source=bnd, Target=Domain(0, 1))  # -> Mapped, Clipped

# ----
pull = PullPoint(Point=pt_4, Geometry=pt, ClosestOnly=True)  # -> ClosestPoint, Distance
bnd_2 = Bounds(Numbers=pull.Distance)
remap_2 = RemapNumbers(Value=pull.Distance, Source=bnd_2, Target="0.1 to 0.9")  # -> Mapped, Clipped
graft_2 = GraftTree(Tree=remap_2.Mapped, IncludeEmptyLists=True, IncludeNullItems=True)

# ---- group: Variate 变量 (continued)
pull_2 = PullPoint(Point=pt_3, Geometry=merge, ClosestOnly=True)  # -> ClosestPoint, Distance
bang = ExplodeTree(Data=pull_2.Distance)  # -> flatten(Branch0), flatten(Branch1)
larger = LargerThan(FirstNumber=bang.Branch0, SecondNumber=bang.Branch1)  # -> graft(LargerThan), OrEqualTo
num = Number(graft(bang.Branch0))
num_2 = Number(graft(bang.Branch1))
merge_2 = Merge(Data1=num, Data2=num_2)
item = ListItem(List=merge_2, Index=larger.LargerThan, Wrap=True)  # -> flatten(Item)
bnd_3 = Bounds(Numbers=item)

# ----
int = Integer(larger.LargerThan)
graph = GraphMapper(
    item,
    x0=0,
    x1=10,
    y0=0,
    y1=10,
    container_name="Bezier",
    cpx=[0, 0.1434786171, 0.5452173352, 1],
    cpy=[0, 0.5938543677, 0.8831884265, 1])

# ---- group: Variate 变量 (continued)
remap_3 = RemapNumbers(Value=graph, Source=bnd_3, Target="0.1 to 0.9")  # -> Mapped, Clipped

# ----
graft_3 = GraftTree(Tree=remap_3.Mapped, IncludeEmptyLists=True, IncludeNullItems=True)

# ---- group: Unit 单元 (continued)
eval = EvaluateCurve(Curve=explode.Segments, Parameter=graft_3)  # -> Point, Tangent, Angle
ln = Line(StartPoint=area.Centroid, EndPoint=eval.Point)
eval_2 = EvaluateCurve(Curve=ln, Parameter=graft_3)  # -> simplify(Point), Tangent, Angle
ln_2 = Line(StartPoint=eval_2.Point, EndPoint=shift_2)  # -> graft(Line)
ln_3 = Line(StartPoint=eval_2.Point, EndPoint=shift)  # -> graft(Line)
merge_3 = Merge(Data1=graft, Data2=ln_3, Data3=ln_2)
join = JoinCurves(Curves=merge_3, Preserve=False)
boundary = BoundarySurfaces(Edges=join)
