# Grasshopper definition 20170920-level3-1加入纵向干扰变化形体.gh (Grasshopper 0.9.76)

# 逻辑阐述
# A 变量可以为干扰变量，先定好外界干扰物
# B 将干扰的数据提取，整理，作为可用的变量
# 核心想法:干扰规则不止一个，其之间的叠加可能会有全新的规则出现
panel = Panel("""干扰项的变化可以带来变量的改变
进而带来形体的改变
这就是参数化设计的方法之一“找形”""")

# ---- group: Frame 网架
xy = XYPlane(Origin=Point(0, 0, 0))
sqgrid = Square(Plane=xy, Size=Slider(1, range=0..50), ExtentX=Slider(20, range=0..50), ExtentY=Slider(15, range=0..50))  # -> flatten(Cells), Points

# ----
crv0 = Curve(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)
crv1 = Curve(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)
panel_2 = Panel("这一节的核心就是通过改变单元构件和参数干扰规则这两个要点")
panel_3 = Panel("x*4")
panel_4 = Panel("""graph mapper
更加细致的调节递变的趋势""")
panel_5 = Panel("优化处理")

# ---- group: Variate 变量
merge = Merge(Data1=crv0, Data2=crv1)  # -> graft(Result)

# ---- group: Unit 单元
crv = Curve(sqgrid.Cells)
explode = Explode(Curve=crv, Recursive=True)  # -> Segments, Vertices
curvepoint = PointOnCurve(explode.Segments, parameter=0.5)
area = Area(Geometry=graft(crv))  # -> Area, Centroid
end = EndPoints(Curve=simplify(explode.Segments))  # -> graft(Start), graft(End)
ln = Line(StartPoint=area.Centroid, EndPoint=curvepoint)

# ----
pt = Point(flatten(area.Centroid))

# ---- group: Variate 变量 (continued)
pull = PullPoint(Point=pt, Geometry=merge, ClosestOnly=True)  # -> ClosestPoint, Distance
bang = ExplodeTree(Data=pull.Distance)  # -> flatten(Branch0), flatten(Branch1)
num = Number(graft(bang.Branch1))
num_2 = Number(graft(bang.Branch0))
larger = LargerThan(FirstNumber=bang.Branch0, SecondNumber=bang.Branch1)  # -> graft(LargerThan), OrEqualTo
merge_2 = Merge(Data1=num_2, Data2=num)
item = ListItem(List=merge_2, Index=larger.LargerThan, Wrap=True)  # -> flatten(Item)
bnd = Bounds(Numbers=item)

# ----
graph = GraphMapper(
    item,
    x0=0,
    x1=10,
    y0=0,
    y1=10,
    container_name="Bezier",
    cpx=[0, 0.4628985822, 0.6391300559, 1],
    cpy=[0, 0.4426092505, 0.618840754, 1])

# ---- group: Variate 变量 (continued)
remap = RemapNumbers(Value=graph, Source=bnd, Target="0.1 to 0.9")  # -> Mapped, Clipped

# ----
graft = GraftTree(Tree=remap.Mapped, IncludeEmptyLists=True, IncludeNullItems=True)
graft_2 = GraftTree(Tree=remap.Mapped, IncludeEmptyLists=True, IncludeNullItems=True)  # -> simplify(Tree)

# ---- group: Unit 单元 (continued)
eval = EvaluateCurve(Curve=ln, Parameter=graft)  # -> simplify(Point), Tangent, Angle
Z = UnitZ(Factor=expr("x*4", graft_2))
move = Move(Geometry=eval.Point, Motion=Z)  # -> Geometry, Transform
merge_3 = Merge(Data1=graft(move.Geometry), Data2=end.Start, Data3=end.End)
nurbs = NurbsCurve(Vertices=merge_3, Degree=2, Periodic=False)  # -> Curve, Length, Domain

# ----
path_mapper = PathMapper(nurbs.Curve, source="{A;B}", target="{A}")
shift = ShiftList(List=path_mapper, Shift=-1, Wrap=True)  # -> simplify(List)
crv_2 = Curve(graft(shift))
crv_3 = Curve(graft(path_mapper))
merge_4 = Merge(Data1=crv_2, Data2=crv_3)
loft = Loft(Curves=merge_4, Options={Adjust=False, Closed=False, LoftEnds=0, LoftSimp=0, LoftType=0, Rebuild=10, Refit=0.01})
preview = CustomPreview(Geometry=loft, Shader=ColourSwatch(SwatchColor=RGB(207, 207, 207)))
