# Grasshopper definition 20170923-level4-0曲面细分加入网架.gh (Grasshopper 0.9.76)

# ---- group: Frame 网架
u_count_细分数 = Slider(13, range=0..100)
v_count_细分数 = Slider(22, range=0..100)
crv = Curve([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])
loft = Loft(Curves=crv, Options={Adjust=False, Closed=False, LoftEnds=0, LoftSimp=0, LoftType=0, Rebuild=10, Refit=0.01})
divide = DivideDomain²(Domain=loft, UCount=u_count_细分数, VCount=v_count_细分数)
subsrf = Isotrim(Surface=loft, Domain=divide)
debrep = DeconstructBrep(Brep=subsrf)  # -> Faces, Edges, Vertices

# ----
panel = Panel("""利用uv曲面细分
将网架的思路引入""")
pt = Point(simplify(debrep.Vertices))

# ---- group: Unit 单元
item = ListItem(List=pt, Index=[0, 2, 3], Wrap=True)
item_2 = ListItem(List=pt, Index=[0, 1, 2], Wrap=True)
pline = PolyLine(Vertices=item_2, Closed=True)
pline_2 = PolyLine(Vertices=item, Closed=True)
merge = Merge(Data1=pline, Data2=pline_2)
graft = GraftTree(Tree=merge, IncludeEmptyLists=True, IncludeNullItems=True)
offset = Offset(Curve=merge, Distance=Slider(0.74, range=0..1), Plane=PlaneXY(0, 0, 0), Corners=1)
boundary = BoundarySurfaces(Edges=[graft, offset])
