# Grasshopper definition 20170923-level4-1平面网架映射曲面.gh (Grasshopper 0.9.76)

crv = Curve([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])

# ---- group: 一级单元 / 二级网架
xy = XYPlane(Origin=Point(0, 0, 0))
sqgrid = Square(Plane=xy, Size=Slider(1, range=0..50), ExtentX=Slider(20, range=0..50), ExtentY=Slider(15, range=0..50))  # -> flatten(Cells), Points

# ---- group: 一级曲面网架
loft = Loft(Curves=crv, Options={Adjust=False, Closed=False, LoftEnds=0, LoftSimp=0, LoftType=0, Rebuild=10, Refit=0.01})

# ----
crv0 = Curve(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)
crv1 = Curve(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)
panel = Panel("数据处理代替重复运算")

# ---- group: Variate 一级变量
merge = Merge(Data1=crv0, Data2=crv1)  # -> graft(Result)

# ---- group: 一级单元 / 二级平面单元
crv_2 = Curve(sqgrid.Cells)
explode = Explode(Curve=crv_2, Recursive=True)  # -> Segments, Vertices
area = Area(Geometry=graft(crv_2))  # -> Area, Centroid
pt = Point(explode.Vertices)
shift = ShiftList(List=pt, Shift=-1, Wrap=False)  # -> simplify(List)
shift_2 = ShiftList(List=shift, Shift=1, Wrap=True)  # -> simplify(List)
crv_3 = Curve(simplify(explode.Segments))
graft = GraftTree(Tree=crv_3, IncludeEmptyLists=True, IncludeNullItems=True)

# ----
pt_2 = Point(flatten(area.Centroid))

# ---- group: Variate 一级变量 (continued)
pull = PullPoint(Point=pt_2, Geometry=merge, ClosestOnly=True)  # -> ClosestPoint, Distance
bang = ExplodeTree(Data=pull.Distance)  # -> flatten(Branch0), flatten(Branch1)
num = Number(graft(bang.Branch1))
num_2 = Number(graft(bang.Branch0))
larger = LargerThan(FirstNumber=bang.Branch0, SecondNumber=bang.Branch1)  # -> graft(LargerThan), OrEqualTo
merge_2 = Merge(Data1=num_2, Data2=num)
item = ListItem(List=merge_2, Index=larger.LargerThan, Wrap=True)  # -> flatten(Item)
bnd = Bounds(Numbers=item)

# ----
graph = GraphMapper(
    item,
    x0=0,
    x1=10,
    y0=0,
    y1=10,
    container_name="Bezier",
    cpx=[0, 0.1891019493, 0.9237104654, 1],
    cpy=[0, 0.3972167969, 0.4862599969, 1])

# ---- group: Variate 一级变量 (continued)
remap = RemapNumbers(Value=graph, Source=bnd, Target="0.1 to 0.9")  # -> Mapped, Clipped

# ---- group: 一级单元
graft_2 = GraftTree(Tree=remap.Mapped, IncludeEmptyLists=True, IncludeNullItems=True)

# ---- group: 一级单元 / 二级平面单元 (continued)
eval = EvaluateCurve(Curve=explode.Segments, Parameter=graft_2)  # -> Point, Tangent, Angle
ln = Line(StartPoint=area.Centroid, EndPoint=eval.Point)
eval_2 = EvaluateCurve(Curve=ln, Parameter=graft_2)  # -> simplify(Point), Tangent, Angle
ln_2 = Line(StartPoint=eval_2.Point, EndPoint=shift_2)  # -> graft(Line)
ln_3 = Line(StartPoint=eval_2.Point, EndPoint=shift)  # -> graft(Line)
merge_3 = Merge(Data1=graft, Data2=ln_3, Data3=ln_2)
join = JoinCurves(Curves=merge_3, Preserve=False)

# ----
path_mapper = PathMapper(shift, source="{A}(i)", target="{A;i\2}")
path_mapper_2 = PathMapper(shift_2, source="{A}(i)", target="{A;i\2}")
ins = InsertItems(List=path_mapper, Item=path_mapper_2, Indices=2, Wrap=True)  # -> flatten(List)
path_mapper_3 = PathMapper(ins, source="{A}(i)", target="{A;i\2}")
pt_3 = Point(flatten(eval_2.Point))
ins_2 = InsertItems(List=path_mapper_3, Item=graft(pt_3), Indices=0, Wrap=True)

# ---- group: 一级单元 / 曲面单元映射
runion = RegionUnion(Curves=sqgrid.Cells)
explode_2 = Explode(Curve=join, Recursive=True)  # -> Segments, Vertices
boundary = BoundarySurfaces(Edges=runion)
shift_3 = ShiftList(List=explode_2.Vertices, Shift=1, Wrap=False)  # -> simplify(List)
srf_cp = SurfaceClosestPoint(Point=ins_2, Surface=reparameterize(boundary))  # -> Point, UVPoint, Distance
evalsrf = EvaluateSurface(Surface=reparameterize(loft), Point=srf_cp.UVPoint)  # -> Point, Normal, Frame
panel_2 = Panel("""UV点坐标映射
重置uv坐标
将xy坐标转为uv坐标""")
pline = PolyLine(Vertices=evalsrf.Point, Closed=True)
boundary_2 = BoundarySurfaces(Edges=pline)
