# Grasshopper definition 20170924-level5-干扰全局多次利用重建.gh (Grasshopper 0.9.76)

panel = Panel("""这是一个动态六边形网架
逻辑思路是
利用干扰点来产生变量，控制点阵，产生新的网架""")
panel_2 = Panel("不在一平面优化构件")

# ---- group: 建立一个动态的Frame
hexgrid = Hexagonal(Plane=PlaneXY(0, 0, 0), Size=Slider(2, range=0..10), ExtentX=Slider(15, range=0..100), ExtentY=Slider(15, range=0..100))  # -> Cells, Points
crv = Curve(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)
eval = EvaluateCurve(Curve=reparameterize(crv), Parameter=Slider(0.7, range=0..1))  # -> Point, Tangent, Angle
panel_3 = Panel("""取极值时，最最最要考虑相对的联系
每个六边形的取值要源于整个最值，这样每个形才能有联系""")
panel_4 = Panel("""数学原理
最小值被放大，而最大值并没有所以相对就有更大差距""")

# ---- group: 建立一个动态的Frame / 提取六个点
explode = Explode(Curve=hexgrid.Cells, Recursive=True)  # -> Segments, simplify(Vertices)
shift = ShiftList(List=explode.Vertices, Shift=1, Wrap=False)

# ---- group: 建立一个动态的Frame (continued)
pt = Point(shift)

# ---- group: 建立一个动态的Frame / 提取移动点到顶点的矢量
vec2pt = Vector2Pt(PointA=eval.Point, PointB=pt, Unitize=False)  # -> Vector, simplify(Length)

# ---- group: 建立一个动态的Frame / 这里是利用区间映射和graph mapper结合调节变量
bnd = Bounds(Numbers=flatten(vec2pt.Length))
remap = RemapNumbers(Value=vec2pt.Length, Source=bnd, Target="0.1 to 1.0")  # -> Mapped, Clipped
graph = GraphMapper(remap.Mapped, x0=0, x1=1, y0=0, y1=1, container_name="Bezier", cpx=[0, 0, 0, 1], cpy=[0, 1, 1, 1])
multiplication = Multiplication(A=graph, B=Slider(6, range=0..10))

# ---- group: 二层缩放比例
item = ListItem(List=graph, Index=0, Wrap=True)  # -> simplify(Item)
panel_5 = Panel("""这里在网架中提取数据是为了利用数据结构
增强效果""")
subtraction = Subtraction(A="1.25", B=item)

# ---- group: 建立一个动态的Frame / 重建
amp = Amplitude(Vector=vec2pt.Vector, Amplitude=multiplication)
move = Move(Geometry=pt, Motion=amp)  # -> Geometry, Transform
pline = PolyLine(Vertices=move.Geometry, Closed=True)

# ----
crv_2 = Curve(pline)
box = EvaluateBox(Box=crv_2, UParameter=0.5, VParameter=0.5, WParameter=0.5)  # -> Plane, Point, Include
pt_2 = Point(box.Point)

# ---- group: 构件B
number_slider = Slider(-0.26, range=-1..1)
scale = Scale(Geometry=crv_2, Center=pt_2, Factor=subtraction)  # -> Geometry, Transform
Z = UnitZ(Factor=number_slider)
move_2 = Move(Geometry=scale.Geometry, Motion=Z)  # -> Geometry, Transform

# ---- group: 构件A
一层缩放比例 = Slider(0.75, range=0..1)
multiplication_2 = Multiplication(A=number_slider, B=2)
scale_2 = Scale(Geometry=crv_2, Center=pt_2, Factor=1)  # -> Geometry, Transform
scale_3 = Scale(Geometry=crv_2, Center=pt_2, Factor=一层缩放比例)  # -> Geometry, Transform
Z_2 = UnitZ(Factor=multiplication_2)
move_3 = Move(Geometry=scale_3.Geometry, Motion=Z_2)  # -> Geometry, Transform
move_4 = Move(Geometry=scale_2.Geometry, Motion=Z_2)  # -> Geometry, Transform
loft = Loft(
    Curves=[scale_3.Geometry, scale_2.Geometry],
    Options={Adjust=False, Closed=False, LoftEnds=0, LoftSimp=0, LoftType=0, Rebuild=10, Refit=0.01})
loft_2 = Loft(
    Curves=[move_3.Geometry, move_4.Geometry],
    Options={Adjust=False, Closed=False, LoftEnds=0, LoftSimp=0, LoftType=0, Rebuild=10, Refit=0.01})
extr = Extrude(Base=scale_2.Geometry, Direction=Z_2)
brep = Brep([loft, extr, loft_2])

# ---- group: 构件C
crv_3 = Curve(flatten(move_2.Geometry))
explode_2 = Explode(Curve=crv_3, Recursive=True)  # -> Segments, Vertices
flip = FlipMatrix(Data=explode_2.Vertices)
bang = ExplodeTree(Data=flip)  # -> Branch0, Branch1, Branch2, Branch3, Branch4, Branch5, Branch6
srf4pt = _4PointSurface(CornerA=bang.Branch4, CornerB=bang.Branch5, CornerC=bang.Branch6, CornerD=bang.Branch3)
srf4pt_2 = _4PointSurface(CornerA=bang.Branch0, CornerB=bang.Branch1, CornerC=bang.Branch2, CornerD=bang.Branch3)
brep_2 = Brep([srf4pt_2, srf4pt])

# ---- group: 构件B (continued)
loft_3 = Loft(
    Curves=[move_3.Geometry, move_2.Geometry],
    Options={Adjust=False, Closed=False, LoftEnds=0, LoftSimp=0, LoftType=0, Rebuild=10, Refit=0.01})
loft_4 = Loft(
    Curves=[move_2.Geometry, scale_3.Geometry],
    Options={Adjust=False, Closed=False, LoftEnds=0, LoftSimp=0, LoftType=0, Rebuild=10, Refit=0.01})
brep_3 = Brep([loft_4, loft_3])

# ----
preview = CustomPreview(Geometry=brep, Shader=ColourSwatch(SwatchColor=RGB(227, 227, 227)))
preview_2 = CustomPreview(Geometry=brep_3, Shader=ColourSwatch(SwatchColor=RGB(163, 163, 163)))
preview_3 = CustomPreview(Geometry=brep_2, Shader=ColourSwatch(SwatchColor=RGB(51, 51, 51)))
