# Grasshopper definition 20171108-leve3-path结构处理.gh (Grasshopper 0.9.76)

# ---- group: frame
number_slider = Slider(10, range=0..10)
hexgrid = Hexagonal(Plane=PlaneXY(0, 0, 0), Size=Slider(5, range=0..10), ExtentX=number_slider, ExtentY=number_slider)  # -> flatten(Cells), flatten(Points)
debrep = DeconstructBrep(Brep=hexgrid.Cells)  # -> Faces, Edges, simplify(Vertices)

# ---- group: variate
graft = GraftTree(Tree=hexgrid.Points, IncludeEmptyLists=True, IncludeNullItems=True)  # -> simplify(Tree)
Z = UnitZ(Factor=Slider(2, range=0..10))
lng = ListLength(List=flatten(graft))
random = Random(Range=Domain(0.1, 1), Number=lng, Seed=2)  # -> graft(Random)

# ---- group: frame (continued)
move = Move(Geometry=debrep.Vertices, Motion=Z)  # -> simplify(Geometry), Transform
scale = Scale(Geometry=move.Geometry, Center=graft, Factor=simplify(random))  # -> Geometry, Transform

# ----
pt = Point(graft(debrep.Vertices))
pt_2 = Point(graft(scale.Geometry))
pt_3 = Point(graft(move.Geometry))
merge = Merge(Data1=pt, Data2=pt_2, Data3=pt_3)

# ---- group: unit
intcrv = Interpolate(Vertices=merge, Degree=3, Periodic=False, KnotStyle=1)  # -> Curve, Length, Domain

panel = Panel("B除以三向下取整")
path_mapper = PathMapper(intcrv.Curve, source="{A;B}", target="{A;B\3}")

loft = Loft(Curves=path_mapper, Options={Adjust=False, Closed=False, LoftEnds=0, LoftSimp=0, LoftType=0, Rebuild=10, Refit=0.01})
