# Grasshopper definition 20171123-leve4-组内组外数据处理.gh (Grasshopper 0.9.76)

merge = Merge(Data1="0", Data2="2", Data3="0", Data4="2")
sqgrid = Square(Plane=PlaneXY(0, 0, 0), Size=Slider(4, range=0..10), ExtentX=5, ExtentY=6)  # -> Cells, Points
debrep = DeconstructBrep(Brep=sqgrid.Cells)  # -> Faces, Edges, Vertices
Z = UnitZ(Factor=merge)

# ---- group: 计算形心
area = Area(Geometry=debrep.Faces)  # -> Area, simplify(Centroid)

# ----
move = Move(Geometry=debrep.Vertices, Motion=Z)  # -> Geometry, Transform
nurbs = NurbsCurve(Vertices=move.Geometry, Degree=3, Periodic=True)  # -> simplify(Curve), Length, Domain
path_mapper = PathMapper(area.Centroid, source="{A;B}", target="{A}")
path_mapper_2 = PathMapper(nurbs.Curve, source="{A;B}", target="{A}")

# ----
# 成组随机
item = ListItem(List=path_mapper_2, Index=0, Wrap=True)  # -> flatten(Item)
# 组内随机
number_slider = Slider(4, range=0..10)
lng = ListLength(List=item)
random = Random(Range=Domain(0.1, 1), Number=lng, Seed=number_slider)  # -> graft(Random)
# 就tm用path mapper而且可以非常灵活
# (数据结构的改变除了path mapper应该有更方便的方法做成需要的数据结构)
# 
# 利用已有的数据结构分类数据就是一个问题，
scale = Scale(Geometry=path_mapper_2, Center=path_mapper, Factor=random)  # -> simplify(Geometry), Transform

branch = TreeBranch(Tree=path_mapper_2, Path="{0}", MaintainPaths=True)
lng_2 = ListLength(List=branch)
random_2 = Random(Range=Domain(0, 1), Number=lng_2, Seed=Slider(9, range=0..10))
scale_2 = Scale(Geometry=path_mapper_2, Center=path_mapper, Factor=random_2)  # -> simplify(Geometry), Transform

Z_2 = UnitZ(Factor=1)
move_2 = Move(Geometry=scale.Geometry, Motion=Z_2)  # -> Geometry, Transform
# 源数据
graft = GraftTree(Tree=move_2.Geometry, IncludeEmptyLists=True, IncludeNullItems=True)
graft_2 = GraftTree(Tree=path_mapper_2, IncludeEmptyLists=True, IncludeNullItems=True)
graft_3 = GraftTree(Tree=scale_2.Geometry, IncludeEmptyLists=True, IncludeNullItems=True)
loft = Loft(
    Curves=[graft_2, graft, graft_3],
    Options={Adjust=False, Closed=False, LoftEnds=0, LoftSimp=0, LoftType=0, Rebuild=10, Refit=0.01})
