# Grasshopper definition 20171124-leve5-各种属性数据处理加干扰点.gh (Grasshopper 0.9.76)

number_slider = Slider(24, range=0..100)
number_slider_2 = Slider(4, range=0..10)
sqgrid = Square(Plane=PlaneXY(0, 0, 0), Size=1, ExtentX=number_slider, ExtentY=number_slider)  # -> Cells, Points
integer_division = IntegerDivision(A=number_slider, B=number_slider_2)
pt = Point(simplify(sqgrid.Points))
series = Series(Start=0, Step=number_slider_2, Count=expr("x+1", integer_division))
series_2 = Series(Start=Slider(2, range=0..10), Step=number_slider_2, Count=integer_division)
branch = TreeBranch(Tree=pt, Path=series, MaintainPaths=True)
branch_2 = TreeBranch(Tree=pt, Path=series_2, MaintainPaths=True)

panel = Panel("""灵活拆分合并数据
分离数据，分别处理""")
panel_2 = Panel("""0
0
1
0""")
panel_3 = Panel("""1
0
0
0""")
panel_4 = Panel("""1
0
0
0""")
panel_5 = Panel("""0
0
1
0""")
cull = CullPattern(List=branch, CullPattern=panel_4)
cull_2 = CullPattern(List=branch_2, CullPattern=panel_5)
cull_3 = CullPattern(List=branch, CullPattern=panel_2)
cull_4 = CullPattern(List=branch_2, CullPattern=panel_3)
pt_2 = Point([cull, cull_2])

# ---- group: 干扰点
pt_3 = Point(Point(20.0953412, 11.90984111, 0))

# ----
pt_4 = Point([cull_3, cull_4])
panel_6 = Panel("加入干扰点，树形的变化更加灵动")

dist = Distance(PointA=flatten(pt_2), PointB=pt_3)
bnd = Bounds(Numbers=dist)
remap = RemapNumbers(Value=dist, Source=bnd, Target=Domain(0, 1))  # -> graft(Mapped), Clipped
graph = GraphMapper(
    remap.Mapped,
    x0=0,
    x1=1,
    y0=0,
    y1=1,
    container_name="Bezier",
    cpx=[0, 0.07095880061, 0.1673968583, 1],
    cpy=[0, 0.6224657893, 1, 1])
subtraction = Subtraction(A=1, B=graph)

pt_5 = Point(pt_2)
polygon = Polygon(Plane=pt_5, Radius=Slider(1.27, range=0..2), Segments=8, FilletRadius=0)  # -> Polygon, Length
division = Division(A=3.141592654, B=8)
rotate = Rotate(Geometry=polygon.Polygon, Angle=division, Plane=pt_5)  # -> Geometry, Transform
explode = Explode(Curve=rotate.Geometry, Recursive=True)  # -> Segments, Vertices
curvepoint = PointOnCurve(explode.Segments, parameter=0.5)

explode_2 = Explode(Curve=polygon.Polygon, Recursive=True)  # -> Segments, Vertices

ln = Line(StartPoint=graft(pt_5), EndPoint=explode_2.Vertices)

line = Line(flatten(ln))
path_mapper = PathMapper(line, source="{A}(i)", target="{A;i\9}")
eval = EvaluateCurve(Curve=reparameterize(path_mapper), Parameter=subtraction)  # -> Point, Tangent, Angle

pt_6 = Point(pt_4)
polygon_2 = Polygon(Plane=pt_6, Radius=Slider(0.808, range=0..2), Segments=4, FilletRadius=0)  # -> Polygon, Length
division_2 = Division(A=3.141592654, B=2)
rotate_2 = Rotate(Geometry=polygon_2.Polygon, Angle=division_2, Plane=pt_6)  # -> Geometry, Transform
explode_3 = Explode(Curve=rotate_2.Geometry, Recursive=True)  # -> Segments, Vertices
curvepoint_2 = PointOnCurve(explode_3.Segments, parameter=0.5)

explode_4 = Explode(Curve=polygon_2.Polygon, Recursive=True)  # -> Segments, Vertices

ln_2 = Line(StartPoint=graft(pt_6), EndPoint=explode_4.Vertices)

dist_2 = Distance(PointA=flatten(pt_4), PointB=pt_3)
bnd_2 = Bounds(Numbers=dist_2)
remap_2 = RemapNumbers(Value=dist_2, Source=bnd_2, Target=Domain(0, 1))  # -> graft(Mapped), Clipped
graph_2 = GraphMapper(
    remap_2.Mapped,
    x0=0,
    x1=1,
    y0=0,
    y1=1,
    container_name="Bezier",
    cpx=[0, 0.04081632569, 0.4217686951, 1],
    cpy=[0, 0.6788729429, 1, 1])
subtraction_2 = Subtraction(A=1, B=graph_2)
line_2 = Line(flatten(ln_2))
path_mapper_2 = PathMapper(line_2, source="{A}(i)", target="{A;i\5}")
eval_2 = EvaluateCurve(Curve=reparameterize(path_mapper_2), Parameter=subtraction_2)  # -> Point, Tangent, Angle

curvepoint_3 = PointOnCurve(ln, parameter=1)
curvepoint_4 = PointOnCurve(ln_2, parameter=1)
cull_i = CullIndex(List=explode.Vertices, Indices="0", Wrap=True)
cull_i_2 = CullIndex(List=explode_3.Vertices, Indices="0", Wrap=True)

merge = Merge(Data1=cull_i, Data2=eval.Point, Data3=eval_2.Point, Data4=cull_i_2)  # -> flatten(Result)
voronoi = Voronoi(Points=merge, Radius=Slider(1.258, range=0..2), BruteForceOverride=False)
explode_5 = Explode(Curve=voronoi, Recursive=True)  # -> Segments, Vertices
cull_i_3 = CullIndex(List=explode_5.Vertices, Indices="0", Wrap=True)
nurbs = NurbsCurve(Vertices=cull_i_3, Degree=3, Periodic=True)  # -> Curve, Length, Domain
