# Grasshopper definition 20171220_partC-level1-0Bezier原理和t值.gh (Grasshopper 0.9.76)

细分点数 = Slider(13, range=0..30)
number_slider = Slider(100, range=0..100)
series = Series(Start=0, Step=1, Count=10)
range = Range(Domain=Domain(0, 1), Steps=细分点数)
item = ListItem(List=series, Index=[7, 8, 9, 4, 5], Wrap=True)
num = Number(graft(range))

# ---- group: 迭代0
# Bezier Curve 生成原理
pt = Point([Point(-34.18189089, -7.521323881, 0), Point(-6.073545192, 27.08672056, 0), Point(35.06313527, -28.73645837, 0), Point(78.90863959, 32.59524943, 0)])
shift = ShiftList(List=pt, Shift=1, Wrap=False)
short = ShortestList(ListA=pt, ListB=shift, TrimMode=2)  # -> ListA, ListB
ln = Line(StartPoint=short.ListA, EndPoint=short.ListB)
eval = EvaluateCurve(Curve=reparameterize(ln), Parameter=num)  # -> Point, Tangent, Angle

# ----
series_2 = Series(Start=0, Step=1, Count=number_slider)

# ---- group: 在Alist中提取与B同数量的值
short_2 = ShortestList(ListA=series, ListB=item, TrimMode=2)  # -> ListA, ListB

# ----
graph = GraphMapper(series_2, x0=0, x1=100, y0=0, y1=50, container_name="Gaussian", factor=0.165433228, mean=0.4855072498, sdev=0.100359261)
Z = UnitZ(Factor=graph)

# ---- group: 迭代1
pt_2 = Point(eval.Point)
shift_2 = ShiftList(List=pt_2, Shift=1, Wrap=False)
short_3 = ShortestList(ListA=pt_2, ListB=shift_2, TrimMode=2)  # -> ListA, ListB
ln_2 = Line(StartPoint=short_3.ListA, EndPoint=short_3.ListB)
eval_2 = EvaluateCurve(Curve=reparameterize(ln_2), Parameter=num)  # -> Point, Tangent, Angle

# ---- group: 迭代2
pt_3 = Point(eval_2.Point)
shift_3 = ShiftList(List=pt_3, Shift=1, Wrap=False)
short_4 = ShortestList(ListA=pt_3, ListB=shift_3, TrimMode=2)  # -> ListA, ListB
ln_3 = Line(StartPoint=short_4.ListA, EndPoint=short_4.ListB)
eval_3 = EvaluateCurve(Curve=reparameterize(ln_3), Parameter=num)  # -> flatten(Point), Tangent, Angle

# ----
# 找形
intcrv = Interpolate(Vertices=eval_3.Point, Degree=3, Periodic=False, KnotStyle=1)  # -> Curve, Length, Domain
crv = Curve(intcrv.Curve)
divide = DivideCurve(Curve=crv, Count=number_slider, Kinks=False)  # -> Points, Tangents, Parameters
shift_4 = ShiftList(List=divide.Points, Shift=Slider(9, range=0..100), Wrap=True)
move = Move(Geometry=shift_4, Motion=Z)  # -> Geometry, Transform
panel = Panel("""t的值相当点的运动时间所对应的位置
控制点的间距越长速度越快""")
intcrv_2 = Interpolate(Vertices=eval_3.Point, Degree=3, Periodic=False, KnotStyle=1)  # -> Curve, Length, Domain
crv_2 = Curve(reparameterize(intcrv_2.Curve))
