# Grasshopper definition 20171223_partC-level1-1找形思路.gh (Grasshopper 0.9.76)

缩进间距 = Slider(26, range=0..100)
crv = Curve(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)
offset = Offset(Curve=crv, Distance=缩进间距, Plane=PlaneXY(0, 0, 0), Corners=1)  # -> flatten(Curve)
细分点数 = Slider(100, range=0..100)
crv_2 = Curve(graft([offset, crv]))
series = Series(Start=0, Step=1, Count=细分点数)
抬升位置 = Slider(100, range=0..100)
graph = GraphMapper(
    series,
    x0=0,
    x1=100,
    y0=0,
    y1=40,
    container_name="Sinc",
    Equation_X0=0.5,
    Equation_X1=0.7849162221,
    Equation_Y0=0.8,
    Equation_Y1=0.3139158487)
graph_2 = GraphMapper(
    series,
    x0=0,
    x1=100,
    y0=0,
    y1=70,
    container_name="Sinc",
    Equation_X0=0.5,
    Equation_X1=0.8350723982,
    Equation_Y0=0.8,
    Equation_Y1=0.3713042736)
divide = DivideCurve(Curve=crv_2, Count=细分点数, Kinks=False)  # -> Points, Tangents, Parameters
shift = ShiftList(List=divide.Points, Shift=抬升位置, Wrap=True)
Z = UnitZ(Factor=graph)
Z_2 = UnitZ(Factor=graph_2)
move = Move(Geometry=shift, Motion=Z_2)  # -> simplify(Geometry), Transform
move_2 = Move(Geometry=shift, Motion=Z)  # -> simplify(Geometry), Transform
panel = Panel("graph的找形思路")
intcrv = Interpolate(Vertices=move.Geometry, Degree=3, Periodic=True, KnotStyle=1)  # -> flatten(Curve), Length, Domain
intcrv_2 = Interpolate(Vertices=move_2.Geometry, Degree=3, Periodic=True, KnotStyle=1)  # -> flatten(Curve), Length, Domain
merge = Merge(Data1=intcrv_2.Curve, Data2=reverse(intcrv.Curve))
loft = Loft(Curves=merge, Options={Adjust=False, Closed=True, LoftEnds=0, LoftSimp=0, LoftType=0, Rebuild=10, Refit=0.01})
