# Grasshopper definition 20171223_partC-level2-曲面细分和嵌套.gh (Grasshopper 0.9.76)

crv = Curve(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)
offset = Offset(Curve=crv, Distance=Slider(18, range=0..100), Plane=PlaneXY(0, 0, 0), Corners=1)  # -> flatten(Curve)
panel = Panel("""曲面细分
嵌套""")
srf = Surface(reparameterize(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))

crv_2 = Curve(graft([offset, crv]))
number_slider = Slider(100, range=0..100)
series = Series(Start=0, Step=1, Count=number_slider)
graph = GraphMapper(
    series,
    x0=0,
    x1=100,
    y0=0,
    y1=70,
    container_name="Sinc",
    Equation_X0=0.5,
    Equation_X1=0.8350723982,
    Equation_Y0=0.8,
    Equation_Y1=0.3713042736)
graph_2 = GraphMapper(
    series,
    x0=0,
    x1=100,
    y0=0,
    y1=40,
    container_name="Sinc",
    Equation_X0=0.5,
    Equation_X1=0.7849162221,
    Equation_Y0=0.8,
    Equation_Y1=0.3139158487)
divide = DivideCurve(Curve=crv_2, Count=number_slider, Kinks=False)  # -> Points, Tangents, Parameters
shift = ShiftList(List=divide.Points, Shift=Slider(26, range=0..100), Wrap=True)
Z = UnitZ(Factor=graph_2)
Z_2 = UnitZ(Factor=graph)
move = Move(Geometry=shift, Motion=Z)  # -> simplify(Geometry), Transform
move_2 = Move(Geometry=shift, Motion=Z_2)  # -> simplify(Geometry), Transform
intcrv = Interpolate(Vertices=move.Geometry, Degree=3, Periodic=True, KnotStyle=1)  # -> flatten(Curve), Length, Domain
intcrv_2 = Interpolate(Vertices=move_2.Geometry, Degree=3, Periodic=True, KnotStyle=1)  # -> flatten(Curve), Length, Domain

dom²num = ConstructDomain²(
    UMin=Slider(0.27, range=0..1),
    UMax=Slider(0.68, range=0..1),
    VMin=Slider(0.25, range=0..1),
    VMax=Slider(0.8, range=0..1))
subsrf = Isotrim(Surface=srf, Domain=dom²num)
panel_2 = Panel("改变数据顺序")
merge = Merge(Data1=intcrv.Curve, Data2=reverse(intcrv_2.Curve))
loft = Loft(Curves=merge, Options={Adjust=False, Closed=True, LoftEnds=0, LoftSimp=0, LoftType=0, Rebuild=10, Refit=0.01})

rec = Rectangle([{Plane=PlaneXY(-75.74122541, 34.24786631, 0), Size=Domain2(u=0..29.96064455, v=0..29.96064455)}, {Plane=PlaneXY(-71.46113333, 38.41228022, 0), Size=Domain2(u=0..21.74749488, v=0..21.74749488)}])
Z_3 = UnitZ(Factor=Slider(10, range=-1..20))
move_3 = Move(Geometry=rec, Motion=Z_3)  # -> reverse(Geometry), Transform
fillet = Fillet(Curve=[rec, move_3.Geometry], Radius=Slider(100, range=0..100))
loft_2 = Loft(Curves=fillet, Options={Adjust=False, Closed=True, LoftEnds=0, LoftSimp=0, LoftType=0, Rebuild=10, Refit=0.01})
bbox = BoundingBox(Content=loft_2, Plane=PlaneXY(0, 0, 0))  # -> Box, Box_2

panel_3 = Panel("""false
true""")
divide_2 = DivideDomain²(Domain=loft, UCount=Slider(10, range=0..100), VCount=Slider(41, range=0..200))
cull = CullPattern(List=divide_2, CullPattern=panel_3)
sbox = SurfaceBox(Surface=loft, Domain=cull, Height=Slider(3, range=0..10))
subsrf_2 = Isotrim(Surface=loft, Domain=cull)
morph = BoxMorph(Geometry=loft_2, Reference=bbox.Box, Target=sbox)
