# Grasshopper definition 20180129_partC-level3-uv上的创作.gh (Grasshopper 0.9.76)

crv = Curve(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)
offset = Offset(Curve=crv, Distance=Slider(18, range=0..100), Plane=PlaneXY(0, 0, 0), Corners=1)  # -> flatten(Curve)

crv_2 = Curve(graft([offset, crv]))
number_slider = Slider(100, range=0..100)
series = Series(Start=0, Step=1, Count=number_slider)
graph = GraphMapper(
    series,
    x0=0,
    x1=100,
    y0=0,
    y1=70,
    container_name="Sinc",
    Equation_X0=0.5,
    Equation_X1=0.8350723982,
    Equation_Y0=0.8,
    Equation_Y1=0.3713042736)
graph_2 = GraphMapper(
    series,
    x0=0,
    x1=100,
    y0=0,
    y1=40,
    container_name="Sinc",
    Equation_X0=0.5,
    Equation_X1=0.7849162221,
    Equation_Y0=0.8,
    Equation_Y1=0.3139158487)
divide = DivideCurve(Curve=crv_2, Count=number_slider, Kinks=False)  # -> Points, Tangents, Parameters
shift = ShiftList(List=divide.Points, Shift=Slider(26, range=0..100), Wrap=True)
Z = UnitZ(Factor=graph_2)
Z_2 = UnitZ(Factor=graph)
move = Move(Geometry=shift, Motion=Z)  # -> simplify(Geometry), Transform
move_2 = Move(Geometry=shift, Motion=Z_2)  # -> simplify(Geometry), Transform
intcrv = Interpolate(Vertices=move.Geometry, Degree=3, Periodic=True, KnotStyle=1)  # -> flatten(Curve), Length, Domain
intcrv_2 = Interpolate(Vertices=move_2.Geometry, Degree=3, Periodic=True, KnotStyle=1)  # -> flatten(Curve), Length, Domain

panel = Panel("""曲面细分
嵌套""")
panel_2 = Panel("改变数据顺序")
merge = Merge(Data1=intcrv.Curve, Data2=reverse(intcrv_2.Curve))
panel_3 = Panel("几乎所有几何元素都可分析的结构")
loft = Loft(Curves=merge, Options={Adjust=False, Closed=True, LoftEnds=0, LoftSimp=0, LoftType=0, Rebuild=10, Refit=0.01})
divide_2 = DivideDomain²(Domain=loft, UCount=Slider(7, range=0..100), VCount=Slider(50, range=0..200))
subsrf = Isotrim(Surface=loft, Domain=divide_2)
debrep = DeconstructBrep(Brep=subsrf)  # -> Faces, Edges, Vertices
box = EvaluateBox(Box=debrep.Faces, UParameter=0.5, VParameter=0.5, WParameter=0.5)  # -> Plane, Point, Include
pt = Point(box.Point)
panel_4 = Panel("曲面上的uv创作")

# ---- group: 单元1
item = ListItem(List=debrep.Vertices, Index=[0, 1, 2], Wrap=True)
item_2 = ListItem(List=debrep.Vertices, Index=[0, 3, 2], Wrap=True)
nurbs = NurbsCurve(Vertices=item, Degree=2, Periodic=False)  # -> Curve, Length, Domain
nurbs_2 = NurbsCurve(Vertices=item_2, Degree=2, Periodic=False)  # -> Curve, Length, Domain
loft_2 = Loft(
    Curves=[nurbs.Curve, nurbs_2.Curve],
    Options={Adjust=False, Closed=False, LoftEnds=0, LoftSimp=0, LoftType=0, Rebuild=10, Refit=0.01})  # -> flatten(Loft)
reduce = RandomReduce(List=loft_2, Reduction=Slider(136, range=0..1000), Seed=1)

# ----
panel_5 = Panel("曲面法线向量")

# ---- group: 单元0
curvepoint = PointOnCurve(debrep.Edges, parameter=0.5)
srf_cp = SurfaceClosestPoint(Point=curvepoint, Surface=loft)  # -> Point, UVPoint, Distance
evalsrf = EvaluateSurface(Surface=loft, Point=srf_cp.UVPoint)  # -> Point, Normal, Frame
amp = Amplitude(Vector=evalsrf.Normal, Amplitude=Slider(2, range=0..10))
end = EndPoints(Curve=debrep.Edges)  # -> Start, End
move_3 = Move(Geometry=evalsrf.Point, Motion=amp)  # -> Geometry, Transform
graft = GraftTree(Tree=move_3.Geometry, IncludeEmptyLists=True, IncludeNullItems=True)
graft_2 = GraftTree(Tree=end.End, IncludeEmptyLists=True, IncludeNullItems=True)
graft_3 = GraftTree(Tree=end.Start, IncludeEmptyLists=True, IncludeNullItems=True)
arc = Arc3Pt(PointA=graft_3, PointB=graft, PointC=graft_2)  # -> simplify(Arc), Plane, Radius
path_mapper = PathMapper(arc.Arc, source="{A;B}", target="{A}")
flip = FlipMatrix(Data=path_mapper)
bang = ExplodeTree(Data=flip)  # -> Branch0, Branch1, Branch2, Branch3
edgesrf = EdgeSurface(CurveA=bang.Branch0, CurveB=bang.Branch1, CurveC=bang.Branch2, CurveD=bang.Branch3)
