# Grasshopper definition 20180129_partC-level4-母线设计和工程设计.gh (Grasshopper 0.9.76)

pt = Point(Point(49, 16, 0))

# ---- group: 母线原则
number_slider = Slider(45, range=0..100)
number_slider_2 = Slider(74, range=0..100)
cir = Circle(Plane=pt, Radius=number_slider)
ellipse = Ellipse(Plane=pt, Radius1=Slider(80, range=0..100), Radius2=number_slider)  # -> Ellipse, Focus1, Focus2
divide = DivideCurve(Curve=cir, Count=number_slider_2, Kinks=False)  # -> Points, Tangents, Parameters
divide_2 = DivideCurve(Curve=ellipse.Ellipse, Count=number_slider_2, Kinks=False)  # -> Points, Tangents, Parameters
ln = Line(StartPoint=divide.Points, EndPoint=divide_2.Points)

# ---- group: 变量
上升节点数 = Slider(75, range=0..100)
高 = Slider(30, range=0..100)
dom = ConstructDomain(DomainStart=0, DomainEnd=1)
subtraction = Subtraction(A=上升节点数, B=1)
range = Range(Domain=dom, Steps=subtraction)
dom_2 = ConstructDomain(DomainStart=0, DomainEnd=高)
graph = GraphMapper(range, x0=0.7, x1=1, y0=0, y1=1, container_name="Bezier", cpx=[0, 0, 0.8535894156, 1], cpy=[0, 0, 0, 1])
range_2 = Range(Domain=dom_2, Steps=subtraction)
division = Division(A=上升节点数, B=2)
Z = UnitZ(Factor=range_2)

# ----
line = Line(ln)
panel = Panel("""数据约束和控制数据的一种方式
graph使得数，形竟产生了一种可视化的调整""")

# ---- group: 母线立体空间变化
shift = ShiftList(List=line, Shift=division, Wrap=True)
repeat = RepeatData(Data=line, Length=上升节点数)
repeat_2 = RepeatData(Data=shift, Length=上升节点数)
eval = EvaluateCurve(Curve=repeat, Parameter=graph)  # -> Point, Tangent, Angle
eval_2 = EvaluateCurve(Curve=repeat_2, Parameter=graph)  # -> Point, Tangent, Angle
move = Move(Geometry=eval.Point, Motion=Z)  # -> Geometry, Transform
move_2 = Move(Geometry=eval_2.Point, Motion=Z)  # -> Geometry, Transform
intcrv = Interpolate(Vertices=move_2.Geometry, Degree=3, Periodic=False, KnotStyle=1)  # -> Curve, Length, Domain
intcrv_2 = Interpolate(Vertices=move.Geometry, Degree=3, Periodic=False, KnotStyle=1)  # -> Curve, Length, Domain

# ----
桥面宽度 = Slider(-10, range=-20..20)

# ---- group: 母线
crv0 = Curve(intcrv_2.Curve)
crv1 = Curve(intcrv.Curve)

# ----
offset = Offset(Curve=crv0, Distance=桥面宽度, Plane=PlaneXY(0, 0, 0), Corners=1)
offset_2 = Offset(Curve=crv1, Distance=桥面宽度, Plane=PlaneXY(0, 0, 0), Corners=1)
loft = Loft(
    Curves=flatten([crv0, offset]),
    Options={Adjust=False, Closed=False, LoftEnds=0, LoftSimp=0, LoftType=0, Rebuild=10, Refit=0.01})
loft_2 = Loft(
    Curves=flatten([offset_2, crv1]),
    Options={Adjust=False, Closed=False, LoftEnds=0, LoftSimp=0, LoftType=0, Rebuild=10, Refit=0.01})
panel_2 = Panel("""处理已有的点数据一一对应不直观，太复杂
重新用曲面细分建立""")

# ---- group: 结构做法1
pt_2 = Point(flatten(move.Geometry))  # disabled
panel_3 = Panel("""0
0
0
0
0
1""")  # disabled
cull = CullPattern(List=pt_2, CullPattern=panel_3)  # -> flatten(List); disabled
pdecon = Deconstruct(Point=cull)  # -> XComponent, YComponent, ZComponent; disabled
pt_3 = ConstructPoint(XCoordinate=pdecon.XComponent, YCoordinate=pdecon.YComponent, ZCoordinate=0)  # disabled
crv_cp = CurveClosestPoint(Point=cull, Curve=offset)  # -> flatten(Point), Parameter, Distance; disabled
pdecon_2 = Deconstruct(Point=crv_cp.Point)  # -> XComponent, YComponent, ZComponent; disabled
pt_4 = ConstructPoint(XCoordinate=pdecon_2.XComponent, YCoordinate=pdecon_2.YComponent, ZCoordinate=0)  # disabled
merge = Merge(Data1=graft(pt_3), Data2=graft(cull), Data3=graft(crv_cp.Point), Data4=graft(pt_4))  # disabled
number_slider_3 = Slider(0.4, range=0..10)  # disabled
pline = PolyLine(Vertices=merge, Closed=False)  # disabled
pipe = Pipe(Curve=pline, Radius=number_slider_3, Caps=0)  # disabled

# ---- group: 扶手结构
立柱数 = Slider(28, range=0..100)
扶手高 = Slider(5.13, range=0..10)
crv = Curve(flatten([crv0, crv1, offset, offset_2]))
divide_3 = DivideCurve(Curve=crv, Count=立柱数, Kinks=False)  # -> Points, Tangents, Parameters
扶手半径 = Slider(0.2, range=0..1)
Z_2 = UnitZ(Factor=扶手高)
line_2 = LineSDL(Start=divide_3.Points, Direction=Vector(0, 0, 1), Length=扶手高)
move_3 = Move(Geometry=crv, Motion=Z_2)  # -> Geometry, Transform
pipe_2 = Pipe(Curve=flatten([line_2, move_3.Geometry]), Radius=扶手半径, Caps=0)

# ---- group: 结构做法2
srf = Surface([loft, loft_2])
sdivide = DivideSurface(Surface=srf, UCount=1, VCount=10)  # -> simplify(Points), Normals, Parameters
panel_4 = Panel("""1
-1""")
柱半径 = Slider(0.5, range=0..1)

# ---- group: 板
Z_3 = UnitZ(Factor=1)
extr = Extrude(Base=srf, Direction=Z_3)

# ---- group: 结构做法2 / 基层数据代替上升
path_mapper = PathMapper(sdivide.Points, source="{A;B}(i)", target="{A;i}")

# ---- group: 结构做法2 / 工程节点优化
梁厚 = Slider(-1, range=-10..10)
pt_5 = Point(path_mapper)
item = ListItem(List=pt_5, Index=0, Wrap=True)
item_2 = ListItem(List=pt_5, Index=1, Wrap=True)
Z_4 = UnitZ(Factor=梁厚)

# ---- group: 结构做法2 (continued)
pline_2 = PolyLine(Vertices=path_mapper, Closed=False)
offset_3 = Offset(Curve=pline_2, Distance=panel_4, Plane=PlaneXY(0, 0, 0), Corners=1)
path_mapper_2 = PathMapper(offset_3, source="{A;B;C}", target="{A;B}")
loft_3 = Loft(Curves=path_mapper_2, Options={Adjust=False, Closed=False, LoftEnds=0, LoftSimp=0, LoftType=0, Rebuild=10, Refit=0.01})
extr_2 = Extrude(Base=loft_3, Direction=Z_4)

# ---- group: 结构做法2 / 工程节点优化 (continued)
crv_2 = Curve(pline_2)
vec = Vector(crv_2)
move_4 = Move(Geometry=item_2, Motion=expr("x*-1", vec))  # -> Geometry, Transform
move_5 = Move(Geometry=item, Motion=vec)  # -> Geometry, Transform
pt_6 = Point([move_5.Geometry, move_4.Geometry])
move_6 = Move(Geometry=pt_6, Motion=Z_4)  # -> Geometry, Transform

# ---- group: 结构做法2 (continued)
pdecon_3 = Deconstruct(Point=move_6.Geometry)  # -> XComponent, YComponent, ZComponent
pt_7 = ConstructPoint(XCoordinate=pdecon_3.XComponent, YCoordinate=pdecon_3.YComponent, ZCoordinate=0)
ln_2 = Line(StartPoint=move_6.Geometry, EndPoint=pt_7)
pipe_3 = Pipe(Curve=ln_2, Radius=柱半径, Caps=0)

# ----
geo = Geometry(extr)
geo_2 = Geometry(extr_2)
geo_3 = Geometry(pipe_3)
geo_4 = Geometry(pipe_2)
