# Grasshopper definition 20180131_partC-level5-数据生成曲面和单元深化.gh (Grasshopper 0.9.76)

# ---- group: 通过控制点的移动 控制曲面 / 移动基数
series = Series(Start=Slider(90, range=0..100), Step=Slider(25.248, range=0..40), Count=Slider(10, range=0..10))

# ----
panel = Panel("值得深入去理解的曲线完全数据生成的逻辑")
panel_2 = Panel("三个方向的数据结合")

number_slider = Slider(0, range=0..0.5)
subtraction = Subtraction(A=1, B=number_slider)
dom²num = ConstructDomain²(UMin=subtraction, UMax=number_slider, VMin=subtraction, VMax=number_slider)

点数 = Slider(54, range=0..100)
line = Line(Line((-12, -51, 0), (-12, 729, 0)))
divide = DivideCurve(Curve=line, Count=点数, Kinks=False)  # -> Points, Tangents, Parameters

# ---- group: 通过控制点的移动 控制曲面
subtraction_2 = Subtraction(A=点数, B=1)
dom = ConstructDomain(DomainStart=0, DomainEnd=1)
range = Range(Domain=dom, Steps=subtraction_2)
graph = GraphMapper(
    range,
    x0=0,
    x1=1,
    y0=-1,
    y1=1,
    container_name="Sine Summation",
    Equation0_px=[0.1032809913, 0.3763476312],
    Equation0_py=[0.1920467019, 0.3048347831],
    Equation1_px=[0.3347941935, 0.7859477401],
    Equation1_py=[0.3107711077, 0.1208115816])
graph_2 = GraphMapper(
    range,
    x0=0,
    x1=1,
    y0=0,
    y1=1,
    container_name="Sine Summation",
    Equation0_px=[0.160869658, 0.8344929814],
    Equation0_py=[0.07246375084, 0.4358259439],
    Equation1_px=[0.2007999122, 0.7834782004],
    Equation1_py=[0.3445565104, 0.5536231399])
multiplication = Multiplication(A=graph, B=graft(series))
multiplication_2 = Multiplication(A=graph_2, B=graft(series))
Z = UnitZ(Factor=multiplication_2)
X = UnitX(Factor=multiplication)
Y = UnitY(Factor=multiplication)
addition = Addition(A=Y, B=X, C=Z)

# ----
move = Move(Geometry=divide.Points, Motion=addition)  # -> Geometry, Transform

# ---- group: 生成曲面
intcrv = Interpolate(Vertices=move.Geometry, Degree=3, Periodic=False, KnotStyle=1)  # -> flatten(Curve), Length, Domain
shift = ShiftList(List=intcrv.Curve, Shift=-1, Wrap=False)  # -> graft(List)
shift_2 = ShiftList(List=intcrv.Curve, Shift=1, Wrap=False)  # -> graft(List)
merge = Merge(Data1=shift, Data2=shift_2)
loft = Loft(Curves=merge, Options={Adjust=False, Closed=False, LoftEnds=0, LoftSimp=0, LoftType=0, Rebuild=10, Refit=0.01})

# ----
srf = Surface(reparameterize(loft))

# ---- group: 曲面细分，生成网架
细分数 = Slider(40, range=0..100)
重置uv值 = Slider(0.07, range=0..1)
divide_2 = DivideDomain²(Domain=srf, UCount=Slider(1, range=0..1), VCount=细分数)
subsrf = Isotrim(Surface=srf, Domain=divide_2)  # -> reparameterize(Surface)
dedom2num = DeconstructDomain²(Domain=subsrf)  # -> UMin, UMax, VMin, VMax
addition_2 = Addition(A=dedom2num.VMin, B=重置uv值)
subtraction_3 = Subtraction(A=dedom2num.VMax, B=重置uv值)
addition_3 = Addition(A=dedom2num.UMin, B=重置uv值)
subtraction_4 = Subtraction(A=dedom2num.UMax, B=重置uv值)
dom²num_2 = ConstructDomain²(UMin=addition_3, UMax=subtraction_4, VMin=addition_2, VMax=subtraction_3)
subsrf_2 = Isotrim(Surface=subsrf, Domain=dom²num_2)

# ----
srf_2 = Surface(subsrf_2)

# ---- group: create a box that have plane
sbox = SurfaceBox(Surface=reparameterize(srf_2), Domain=dom²num, Height=1)

# ---- group: 嵌套元素
tbox = TwistedBox(flatten(sbox))
dom_2 = ConstructDomain(DomainStart=Slider(-5, range=-40..100), DomainEnd=Slider(-50, range=-50..100))
lng = ListLength(List=tbox)
polygon = Polygon(Plane=PlaneXY(0, 0, 0), Radius=100, Segments=6, FilletRadius=0)  # -> Polygon, Length
random = Random(Range=dom_2, Number=lng, Seed=Slider(3, range=0..10))
Z_2 = UnitZ(Factor=1)
extr = Extrude(Base=polygon.Polygon, Direction=Z_2)  # -> simplify(Extrusion)
offset = Offset(Curve=polygon.Polygon, Distance=random, Plane=PlaneXY(0, 0, 0), Corners=1)
ins = InsertItems(List=offset, Item=polygon.Polygon, Indices=0, Wrap=True)
bbox = BoundingBox(Content=extr, Plane=PlaneXY(0, 0, 0))  # -> simplify(Box), Box_2
loft_2 = Loft(Curves=ins, Options={Adjust=False, Closed=False, LoftEnds=0, LoftSimp=0, LoftType=0, Rebuild=10, Refit=0.01})

# ---- group: 叶片元素
debrep = DeconstructBrep(Brep=subsrf_2)  # -> Faces, Edges, Vertices
item = ListItem(List=debrep.Vertices, Index=[0, 3, 2], Wrap=True)
item_2 = ListItem(List=debrep.Vertices, Index=[0, 1, 2], Wrap=True)
nurbs = NurbsCurve(Vertices=item_2, Degree=2, Periodic=False)  # -> Curve, Length, Domain
nurbs_2 = NurbsCurve(Vertices=item, Degree=2, Periodic=False)  # -> Curve, Length, Domain
loft_3 = Loft(
    Curves=[nurbs.Curve, nurbs_2.Curve],
    Options={Adjust=False, Closed=False, LoftEnds=0, LoftSimp=0, LoftType=0, Rebuild=10, Refit=0.01})

# ---- group: 寻找向量
box = EvaluateBox(Box=srf_2, UParameter=0.5, VParameter=0.5, WParameter=0.5)  # -> Plane, Point, Include
srf_cp = SurfaceClosestPoint(Point=box.Point, Surface=srf_2)  # -> Point, UVPoint, Distance
evalsrf = EvaluateSurface(Surface=srf_2, Point=srf_cp.UVPoint)  # -> Point, Normal, Frame

# ----
tbox_2 = TwistedBox(simplify(graft(tbox)))

# ---- group: 嵌套
morph = BoxMorph(Geometry=loft_2, Reference=bbox.Box, Target=tbox_2)

# ---- group: 通过向量拔起
vec = Vector(flatten(evalsrf.Normal))
amp = Amplitude(Vector=vec, Amplitude=Slider(2, range=0..10))  # -> graft(Vector)
extr_2 = Extrude(Base=morph, Direction=amp)
