# Grasshopper definition 20180202_partD-level1-逻辑优化排列清晰.gh (Grasshopper 0.9.76)

# ---- group: 网架
hexgrid = Hexagonal(
    Plane=PlaneXY(0, 0, 0),
    Size=Slider(5.83, range=0..10),
    ExtentX=Slider(20, range=0..100),
    ExtentY=Slider(26, range=0..100))  # -> Cells, Points
scale_nu = ScaleNU(Geometry=hexgrid.Cells, Plane=PlaneXY(0, 0, 0), ScaleX=0.5, ScaleY=1, ScaleZ=1)  # -> Geometry, Transform
explode = Explode(Curve=scale_nu.Geometry, Recursive=True)  # -> Segments, Vertices
area = Area(Geometry=scale_nu.Geometry)  # -> Area, Centroid
item = ListItem(List=explode.Segments, Index=[0, 1, 2], Wrap=True)
item_2 = ListItem(List=explode.Segments, Index=[3, 4, 5], Wrap=True)
crv = Curve(item)
crv_2 = Curve(item_2)
pt = Point(area.Centroid)

# ----
panel = Panel("""整理运算器
清晰，合理""")
panel_2 = Panel("用尽量可控的变量算法控制尽量复杂的结构")

# ---- group: 单元
join = JoinCurves(Curves=crv, Preserve=False)
join_2 = JoinCurves(Curves=crv_2, Preserve=False)
pt_2 = Point(pt)
number_slider = Slider(0.11, range=0..1)
fillet = Fillet(Curve=join, Radius=1)
fillet_2 = Fillet(Curve=join_2, Radius=1)  # -> simplify(Curve)
trim = TrimTree(Tree=fillet_2, Depth=1)
flip = FlipCurve(Curve=fillet)  # -> flatten(Curve), Flag
scale_nu_2 = ScaleNU(Geometry=trim, Plane=pt_2, ScaleX=1, ScaleY=1, ScaleZ=1)  # -> Geometry, Transform
addition = Addition(A=number_slider, B=3.141592654)
multiplication = Multiplication(A=number_slider, B=-1)
crv_3 = Curve(flatten(fillet_2))
yz = YZPlane(Origin=pt_2)
rotate = Rotate(Geometry=scale_nu_2.Geometry, Angle=addition, Plane=yz)  # -> flatten(Geometry), Transform
rotate_2 = Rotate(Geometry=scale_nu_2.Geometry, Angle=multiplication, Plane=yz)  # -> flatten(Geometry), Transform
merge = Merge(Data1=graft(flip.Curve), Data2=graft(rotate.Geometry), Data3=graft(rotate_2.Geometry), Data4=graft(crv_3))
loft = Loft(Curves=merge, Options={Adjust=False, Closed=False, LoftEnds=0, LoftSimp=0, LoftType=2, Rebuild=10, Refit=0.01})

# ---- group: 变量
pt_3 = Point(pt)
crv_4 = Curve(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)
pull = PullPoint(Point=pt_3, Geometry=crv_4, ClosestOnly=True)  # -> ClosestPoint, Distance
bnd = Bounds(Numbers=flatten(pull.Distance))
pt_4 = Point(flatten(pt_3))
remap = RemapNumbers(Value=pull.Distance, Source=bnd, Target=Domain(0, 1))  # -> flatten(Mapped), Clipped
graph = GraphMapper(
    remap.Mapped,
    x0=0,
    x1=1,
    y0=0,
    y1=5,
    container_name="Bezier",
    cpx=[0, 0.1626675427, 0.5981996059, 1],
    cpy=[0, 0.4186662436, 0.853495717, 1])

# ---- group: 变量 / 三轴缩放
scale_nu_3 = ScaleNU(Geometry=loft, Plane=graft(pt_4), ScaleX=1, ScaleY=1, ScaleZ=graft(graph))  # -> Geometry, Transform
