# Grasshopper definition 20180202_partD-level2-永远走向底层.gh (Grasshopper 0.9.76)

number_slider = Slider(10, range=0..40)
number_slider_2 = Slider(7, range=0..10)
sqgrid = Square(Plane=PlaneXY(0, 0, 0), Size=number_slider_2, ExtentX=number_slider, ExtentY=number_slider)  # -> Cells, Points
explode = Explode(Curve=sqgrid.Cells, Recursive=True)  # -> Segments, Vertices
shift = ShiftList(List=explode.Vertices, Shift=-1, Wrap=False)
pt = Point(shift)

panel = Panel("好的方法是寻找是否有简单底层的方法，和初级的数据来处理问题")

# ---- group: 取二互联思路
pt_2 = Point(simplify(pt))
shift_2 = ShiftList(List=pt_2, Shift=1, Wrap=True)

# ----
panel_2 = Panel("用对点的处理，来代替复杂的形体生成")
extr = ExtrudePoint()
graft = GraftTree(Tree=flatten(pt_2), IncludeEmptyLists=True, IncludeNullItems=True)
graft_2 = GraftTree(Tree=flatten(shift_2), IncludeEmptyLists=True, IncludeNullItems=True)
panel_3 = Panel("分组单元处理方法")

pt_3 = Point(simplify(pt))
pdecon = Deconstruct(Point=pt_3)  # -> XComponent, YComponent, ZComponent
ma = MassAddition(Input=pdecon.XComponent)  # -> Result, PartialResults
ma_2 = MassAddition(Input=pdecon.YComponent)  # -> Result, PartialResults
升高值 = Slider(3.9, range=0..10)
division = Division(A=ma.Result, B=4)
division_2 = Division(A=ma_2.Result, B=4)

num = Number(number_slider_2)
division_3 = Division(A=num, B=2)
neg = Negative(Value=division_3)
lng = ListLength(List=flatten(division))
dom = ConstructDomain(DomainStart=neg, DomainEnd=division_3)
random = Random(Range=dom, Number=lng, Seed=Slider(2, range=0..10))
random_2 = Random(Range=dom, Number=lng, Seed=Slider(7, range=0..10))
addition = Addition(A=division, B=graft(random))
addition_2 = Addition(A=division_2, B=graft(random_2))

pt_4 = ConstructPoint(XCoordinate=addition, YCoordinate=addition_2, ZCoordinate=升高值)
repeat = RepeatData(Data=pt_4, Length=4)

graft_3 = GraftTree(Tree=flatten(repeat), IncludeEmptyLists=True, IncludeNullItems=True)
merge = Merge(Data1=graft, Data2=graft_2, Data3=graft_3)

# ---- group: 单元
pline = PolyLine(Vertices=merge, Closed=True)  # -> simplify(Polyline)
offset = Offset(Curve=pline, Distance=-0.5, Plane=PlaneXY(0, 0, 0), Corners=1)
fillet = Fillet(Curve=offset, Radius=0.5)  # -> simplify(Curve)
loft = Loft(
    Curves=reparameterize([fillet, pline]),
    Options={Adjust=False, Closed=False, LoftEnds=0, LoftSimp=0, LoftType=4, Rebuild=10, Refit=0.01})
