# Grasshopper definition 20180202_partD-level3-利用源数学变换处理数据.gh (Grasshopper 0.9.76)

间距 = Slider(37, range=0..100)
层数 = Slider(23, range=0..50)
pt = Point(Point(34, 33, 0))
cir = Circle(Plane=pt, Radius=Slider(100, range=0..100))
series = Series(Start=0, Step=间距, Count=层数)
结数 = Slider(40, range=0..40)
Z = UnitZ(Factor=series)
move = Move(Geometry=cir, Motion=Z)  # -> Geometry, Transform
division = Division(A=结数, B=层数)
divide = DivideCurve(Curve=move.Geometry, Count=结数, Kinks=False)  # -> Points, Tangents, Parameters
series_2 = Series(Start=0, Step=division, Count=层数)
ma = MassAddition(Input=series_2)  # -> Result, PartialResults
shift = ShiftList(List=divide.Points, Shift=graft(ma.PartialResults), Wrap=True)  # -> simplify(List)
flip = FlipMatrix(Data=shift)
pline = PolyLine(Vertices=flip, Closed=False)
