# Grasshopper definition 20180202_partD-level4-最小单元处理简洁逻辑.gh (Grasshopper 0.9.76)

number_slider = Slider(10, range=0..100)
sqgrid = Square(Plane=PlaneXY(0, 0, 0), Size=Slider(10, range=0..10), ExtentX=number_slider, ExtentY=number_slider)  # -> Cells, Points

division = Division(A=number_slider, B=2)
addition = Addition(A=division, B=1)
division_2 = Division(A=number_slider, B=2)
series = Series(Start=0, Step=2, Count=addition)
series_2 = Series(Start=1, Step=2, Count=division_2)
pt = Point(sqgrid.Points)
path = DataPath(series)
path_2 = DataPath(series_2)
number_slider_2 = Slider(3, range=0..10)
branch = TreeBranch(Tree=simplify(pt), Path=path, MaintainPaths=True)
branch_2 = TreeBranch(Tree=simplify(pt), Path=path_2, MaintainPaths=True)
pt_2 = Point(branch)
pt_3 = Point(branch_2)
Z = UnitZ(Factor=number_slider_2)
cull = CullPattern(List=pt_2, CullPattern=[True, False])
cull_2 = CullPattern(List=pt_3, CullPattern=[False, True])
cull_3 = CullPattern(List=pt_2, CullPattern=[False, True])
cull_4 = CullPattern(List=pt_3, CullPattern=[True, False])
Z_2 = UnitZ(Factor=number_slider_2)
move = Move(Geometry=cull_3, Motion=Z)  # -> Geometry, Transform
weave = Weave(Pattern=[0, 1], Stream0=cull, Stream1=move.Geometry, NullGaps=False)
move_2 = Move(Geometry=cull_4, Motion=Z_2)  # -> Geometry, Transform
weave_2 = Weave(Pattern=[0, 1], Stream0=move_2.Geometry, Stream1=cull_2, NullGaps=False)
pline = PolyLine(Vertices=weave, Closed=False)
pline_2 = PolyLine(Vertices=weave_2, Closed=False)

pt_4 = Point(sqgrid.Points)
flip = FlipMatrix(Data=pt_4)
path_3 = DataPath(path_2)
path_4 = DataPath(path)
branch_3 = TreeBranch(Tree=simplify(flip), Path=path_3, MaintainPaths=True)
branch_4 = TreeBranch(Tree=simplify(flip), Path=path_4, MaintainPaths=True)
pt_5 = Point(branch_3)
pt_6 = Point(branch_4)
cull_5 = CullPattern(List=pt_5, CullPattern=[False, True])
Z_3 = UnitZ(Factor=number_slider_2)
cull_6 = CullPattern(List=pt_5, CullPattern=[True, False])
cull_7 = CullPattern(List=pt_6, CullPattern=[False, True])
cull_8 = CullPattern(List=pt_6, CullPattern=[True, False])
Z_4 = UnitZ(Factor=number_slider_2)
move_3 = Move(Geometry=cull_5, Motion=Z_3)  # -> Geometry, Transform
weave_3 = Weave(Pattern=[0, 1], Stream0=cull_6, Stream1=move_3.Geometry, NullGaps=False)
move_4 = Move(Geometry=cull_8, Motion=Z_4)  # -> Geometry, Transform
weave_4 = Weave(Pattern=[0, 1], Stream0=move_4.Geometry, Stream1=cull_7, NullGaps=False)
pline_3 = PolyLine(Vertices=weave_3, Closed=False)
pline_4 = PolyLine(Vertices=weave_4, Closed=False)

merge = Merge(Data1=pline, Data2=pline_2, Data3=pline_3, Data4=pline_4)
pipe = Pipe(Curve=merge, Radius=1, Caps=0)
pt_7 = Point(Point(-2, -144, 0))

# ---- group: 最小单元思想
sqgrid_2 = Square(Plane=pt_7, Size=Slider(10, range=0..10), ExtentX=Slider(13, range=0..100), ExtentY=Slider(11, range=0..100))  # -> flatten(Cells), Points
Z_5 = UnitZ(Factor=Slider(3, range=0..10))

# ---- group: 最小单元思想 / 奇数错位
cull_9 = CullPattern(List=sqgrid_2.Cells, CullPattern=[False, True])

# ---- group: 最小单元思想 (continued)
explode = Explode(Curve=cull_9, Recursive=True)  # -> Segments, Vertices
shift = ShiftList(List=explode.Vertices, Shift=-1, Wrap=False)
shift_2 = ShiftList(List=shift, Shift=1, Wrap=True)
move_5 = Move(Geometry=shift, Motion=Z_5)  # -> Geometry, Transform
ln = Line(StartPoint=shift_2, EndPoint=move_5.Geometry)
pipe_2 = Pipe(Curve=ln, Radius=1, Caps=0)
