# Grasshopper definition 20180203_partD-level5-不要有执念后馈优化问题.gh (Grasshopper 1.0.7)

box = Box({Plane=PlaneXY(0, 12, 0), X=Domain(0, 107), Y=Domain(0, 133), Z=Domain(0, 138)})

# ---- group: 网架
pop3d = Populate3D(Region=box, Count=Slider(17, range=0..40), Seed=Slider(4, range=0..9))
voronoi³ = Voronoi3D(Points=pop3d, Box=box)  # -> Cells, Boundary
brep = Brep(voronoi³.Cells)
debrep = DeconstructBrep(Brep=brep)  # -> Faces, Edges, Vertices
debrep_2 = DeconstructBrep(Brep=debrep.Faces)  # -> Faces, Edges, Vertices

# ----
crv = Curve(debrep_2.Edges)

# ---- group: 单元
number_slider = Slider(1.2, range=0..2)
join = JoinCurves(Curves=crv, Preserve=False)  # -> simplify(Curves)
neg = Negative(Value=number_slider)
offset = Offset(Curve=join, Distance=number_slider, Plane=debrep_2.Faces, Corners=1)  # -> simplify(Curve)
offset_2 = Offset(Curve=join, Distance=neg, Plane=debrep_2.Faces, Corners=1)  # -> simplify(Curve)
len = Length(Curve=offset)
len_2 = Length(Curve=offset_2)
larger = LargerThan(FirstNumber=len, SecondNumber=len_2)  # -> LargerThan, OrEqualTo
merge = Merge(Data1=offset, Data2=offset_2)
int = Integer(larger.LargerThan)
item = ListItem(List=merge, Index=int, Wrap=True)
fillet = Fillet(Curve=item, Radius=Slider(8, range=0..10))
merge_2 = Merge(Data1=join, Data2=fillet)

# ----
boundary = BoundarySurfaces(Edges=merge_2)  # -> flatten(Surfaces)

# ---- group: 单元优化
area = Area(Geometry=boundary)  # -> Area, Centroid
# 利用Cset运算器，可得重复数据的序号，和无重复数据做等于比较，产生重复源数据序号。
# 用此提取源面。
# 可将相同的面分在一个组里。
# 及可用item进行选取
cset = CreateSet(List=area.Area)  # -> Set, Map
cset_2 = CreateSet(List=cset.Map)  # -> graft(Set), Map
equals = Equality(FirstNumber=cset.Map, SecondNumber=cset_2.Set)  # -> Equality, Inequality
cull = CullPattern(List=boundary, CullPattern=equals.Equality)
item_2 = ListItem(List=cull, Index=0, Wrap=True)

# ----
equals_2 = Equality(FirstNumber=area.Area, SecondNumber=graft(cset.Set))  # -> Equality, Inequality
panel = Panel("""这个思路的核心是
在解决优化问题时，有时从源头解决可能过于复杂
某些时候，可以从结果来处理""")
cull_2 = CullPattern(List=boundary, CullPattern=equals_2.Equality)
item_3 = ListItem(List=cull_2, Index=0, Wrap=True)
