# Grasshopper definition 20180203_partE-level1-工程实践数据架构.gh (Grasshopper 1.0.7)

srf = Surface(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)
srf_2 = Surface(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)

# ---- group: 找形
srf外基准面 = Surface(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)

# ----
offset = Offset(Surface=srf外基准面, Distance="-8", Retrim=True)
offset_2 = Offset(Surface=srf外基准面, Distance="-3", Retrim=True)
srf龙骨基准面 = Surface(offset_2)
srf结构基准面 = Surface(offset)

# ---- group: 网架基准线
细分数量 = Slider(9, range=0..10)
srf结构基准面_2 = Surface(reparameterize(srf结构基准面))
# 基准体系
sdivide = DivideSurface(Surface=srf结构基准面_2, UCount=细分数量, VCount=细分数量)  # -> Points, Normals, Parameters
flip = FlipMatrix(Data=sdivide.Points)
pline = PolyLine(Vertices=sdivide.Points, Closed=False)
pline_2 = PolyLine(Vertices=flip, Closed=False)

# ---- group: 基准网架构建
divide = DivideDomain²(Domain=srf结构基准面_2, UCount=细分数量, VCount=细分数量)
subsrf = Isotrim(Surface=srf结构基准面_2, Domain=divide)
debrep = DeconstructBrep(Brep=subsrf)  # -> Faces, Edges, Vertices
area = Area(Geometry=debrep.Faces)  # -> Area, Centroid
srf_cp = SurfaceClosestPoint(Point=area.Centroid, Surface=debrep.Faces)  # -> Point, UVPoint, Distance
网架厚度 = Slider(20, range=0..20)
evalsrf = EvaluateSurface(Surface=debrep.Faces, Point=srf_cp.UVPoint)  # -> Point, Normal, Frame
amp = Amplitude(Vector=evalsrf.Normal, Amplitude=expr("x*-1", 网架厚度))
move = Move(Geometry=area.Centroid, Motion=amp)  # -> Geometry, Transform
ln = Line(StartPoint=move.Geometry, EndPoint=debrep.Vertices)
crv网格杆件b = Curve(ln)

# ---- group: 曲面工程优化
pt = Point(debrep.Vertices)
pline_3 = PolyLine(Vertices=pt, Closed=True)
explode = Explode(Curve=pline_3, Recursive=True)  # -> Segments, Vertices
flip_2 = FlipMatrix(Data=explode.Segments)  # -> simplify(Data)
bang = ExplodeTree(Data=flip_2)  # -> graft(Branch0), graft(Branch1), graft(Branch2), graft(Branch3)
edgesrf = EdgeSurface(CurveA=bang.Branch0, CurveB=bang.Branch1, CurveC=bang.Branch2, CurveD=bang.Branch3)

# ---- group: 底层网架
pt_2 = Point(flatten(move.Geometry))
partition = PartitionList(List=pt_2, Size=细分数量)
flip_3 = FlipMatrix(Data=partition)
pline_4 = PolyLine(Vertices=partition, Closed=False)
pline_5 = PolyLine(Vertices=flip_3, Closed=False)
explode_2 = Explode(Curve=pline_4, Recursive=True)  # -> Segments, Vertices
explode_3 = Explode(Curve=pline_5, Recursive=True)  # -> Segments, Vertices
crv网架c = Curve([explode_2.Segments, explode_3.Segments])

# ---- group: 网架基准线
explode_4 = Explode(Curve=pline, Recursive=True)  # -> Segments, Vertices
explode_5 = Explode(Curve=pline_2, Recursive=True)  # -> Segments, Vertices

crv网架a = Curve([explode_4.Segments, explode_5.Segments])

# ---- group: 间距初步评估
# 数据反馈
len = Length(Curve=flatten(crv网架a))
avr = Average(Input=len)
panel = Panel(avr)

# ----
len_2 = Length(Curve=flatten(crv网架c))
avr_2 = Average(Input=len_2)
panel_2 = Panel(avr_2)

# ---- group: 面向结构
merge = Merge(Data1=crv网架a, Data2=crv网格杆件b, Data3=crv网架c)  # -> flatten(Result)
# 数据梳理
merge_2 = Merge(Data1=simplify(sdivide.Points), Data2=simplify(partition))
杆件基准线 = Curve(merge)
球节点 = Point(merge_2)

# ---- group: 形象建模
球节点_2 = Point(球节点)
# 数据导出
msphere = MeshSphere(Base=球节点_2, Radius="2", UCount=10, VCount=20)  # -> flatten(Mesh)
mjoin = MeshJoin(Meshes=msphere)
球 = Mesh(mjoin)

杆件基准线_2 = Curve(杆件基准线)
smooth = SettingsQuality()
pipe = Pipe(Curve=杆件基准线_2, Radius="1", Caps=0)
mesh = MeshBrep(Brep=pipe, Settings=smooth)  # -> flatten(Mesh)
mjoin_2 = MeshJoin(Meshes=mesh)
杆件 = Mesh(mjoin_2)
