# Grasshopper definition 20180204_partE-level2-工程构造架构.gh (Grasshopper 0.9.76)

srf = Surface(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)
srf_2 = Surface(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)

# ---- group: 分段主控
细分数量 = Slider(9, range=0..10)
int = Integer(细分数量)

# ---- group: 找形
srf外基准面 = Surface(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)

# ----
offset = Offset(Surface=srf外基准面, Distance="-5", Retrim=True)
offset_2 = Offset(Surface=srf外基准面, Distance="-3", Retrim=True)
srf龙骨基准面 = Surface(offset_2)
srf结构基准面 = Surface(offset)

srf龙骨基准面_2 = Surface(reparameterize(srf龙骨基准面))
sdivide = DivideSurface(Surface=srf龙骨基准面_2, UCount=int, VCount=int)  # -> Points, Normals, Parameters
flip = FlipMatrix(Data=sdivide.Points)
intcrv = Interpolate(Vertices=sdivide.Points, Degree=3, Periodic=False, KnotStyle=1)  # -> Curve, Length, Domain
intcrv_2 = Interpolate(Vertices=flip, Degree=3, Periodic=False, KnotStyle=1)  # -> Curve, Length, Domain
crv主龙骨基准线 = Curve(intcrv.Curve)
crv次龙骨基准线 = Curve(intcrv_2.Curve)

# ---- group: 玻璃抓件
srf外基准面_2 = Surface(srf外基准面)
pt = Point(sdivide.Points)
主龙骨半径 = Slider(3, range=0..5)
srf_cp = SurfaceClosestPoint(Point=pt, Surface=srf外基准面_2)  # -> Point, UVPoint, Distance
evalsrf = EvaluateSurface(Surface=srf外基准面_2, Point=srf_cp.UVPoint)  # -> Point, Normal, Frame
neg = Negative(Value=主龙骨半径)
dom = ConstructDomain(DomainStart=neg, DomainEnd=主龙骨半径)
rectangle = Rectangle(Plane=evalsrf.Frame, XSize=dom, YSize=dom, Radius=0)  # -> Rectangle, Length
explode = Explode(Curve=rectangle.Rectangle, Recursive=True)  # -> Segments, Vertices
shift = ShiftList(List=explode.Vertices, Shift=-1, Wrap=False)
ln = Line(StartPoint=graft(pt), EndPoint=shift)

# ----
次龙骨半径 = Slider(1, range=0..3)
pframes = PerpFrames(Curve=crv次龙骨基准线, Count=int, Align=True)  # -> Frames, Parameters
neg_2 = Negative(Value=次龙骨半径)
dom_2 = ConstructDomain(DomainStart=neg_2, DomainEnd=次龙骨半径)
rectangle_2 = Rectangle(Plane=pframes.Frames, XSize=dom_2, YSize=dom_2, Radius=0)  # -> Rectangle, Length
loft = Loft(
    Curves=rectangle_2.Rectangle,
    Options={Adjust=False, Closed=False, LoftEnds=0, LoftSimp=0, LoftType=0, Rebuild=10, Refit=0.01})
cap = CapHoles(Brep=loft)

# ---- group: 垂直
pframes_2 = PerpFrames(Curve=crv主龙骨基准线, Count=int, Align=True)  # -> Frames, Parameters

# ----
主龙骨半径_2 = Slider(1.5, range=0..3)
neg_3 = Negative(Value=主龙骨半径_2)
dom_3 = ConstructDomain(DomainStart=neg_3, DomainEnd=主龙骨半径_2)
rectangle_3 = Rectangle(Plane=pframes_2.Frames, XSize=dom_3, YSize=dom_3, Radius=0)  # -> Rectangle, Length
loft_2 = Loft(
    Curves=rectangle_3.Rectangle,
    Options={Adjust=False, Closed=False, LoftEnds=0, LoftSimp=0, LoftType=0, Rebuild=10, Refit=0.01})
cap_2 = CapHoles(Brep=loft_2)

# ---- group: y向
hframes = HorizontalFrames(Curve=crv主龙骨基准线, Count=int)  # -> Frames, Parameters
xz = XZPlane(Origin=hframes.Frames)

# ---- group: 玻璃抓件
pt球节点 = Point(shift)
crv = Curve(ln)
msphere = MeshSphere(Base=pt球节点, Radius="1", UCount=10, VCount=20)
pipe = Pipe(Curve=crv, Radius="0.5", Caps=0)
mesh = MeshBrep(
    Brep=pipe,
    Settings={GridMaxCount=0, GridMinCount=16, JaggedSeams=False, MaxEdgeLength=0, MinEdgeLength=0.0001, MinTolerance=0, Refine=True, RefineAngle=0, RelativeTolerance=0.65, SimplePlanes=True, Tolerance=0})
mjoin = MeshJoin(Meshes=flatten([mesh, msphere]))
mesh玻璃抓件 = Mesh(mjoin)

# ----
panel = Panel(crv)
mesh_2 = MeshBrep(
    Brep=[cap_2, cap],
    Settings={GridMaxCount=0, GridMinCount=16, JaggedSeams=False, MaxEdgeLength=0, MinEdgeLength=0.0001, MinTolerance=0, Refine=True, RefineAngle=0, RelativeTolerance=0.65, SimplePlanes=True, Tolerance=0})  # -> flatten(Mesh)
mjoin_2 = MeshJoin(Meshes=mesh_2)
mesh龙骨 = Mesh(mjoin_2)

# ---- group: 网架基准线
srf结构基准面_2 = Surface(reparameterize(srf结构基准面))
# 基准体系
sdivide_2 = DivideSurface(Surface=srf结构基准面_2, UCount=int, VCount=int)  # -> Points, Normals, Parameters
flip_2 = FlipMatrix(Data=sdivide_2.Points)
pline = PolyLine(Vertices=sdivide_2.Points, Closed=False)
pline_2 = PolyLine(Vertices=flip_2, Closed=False)

# ---- group: 基准网架构建
divide = DivideDomain²(Domain=srf结构基准面_2, UCount=int, VCount=int)
subsrf = Isotrim(Surface=srf结构基准面_2, Domain=divide)
debrep = DeconstructBrep(Brep=subsrf)  # -> Faces, Edges, Vertices
area = Area(Geometry=debrep.Faces)  # -> Area, Centroid
srf_cp_2 = SurfaceClosestPoint(Point=area.Centroid, Surface=debrep.Faces)  # -> Point, UVPoint, Distance
网架厚度 = Slider(20, range=0..20)
evalsrf_2 = EvaluateSurface(Surface=debrep.Faces, Point=srf_cp_2.UVPoint)  # -> Point, Normal, Frame
amp = Amplitude(Vector=evalsrf_2.Normal, Amplitude=expr("x*-1", 网架厚度))
move = Move(Geometry=area.Centroid, Motion=amp)  # -> Geometry, Transform
ln_2 = Line(StartPoint=move.Geometry, EndPoint=debrep.Vertices)
crv网格杆件b = Curve(ln_2)

# ---- group: 曲面工程优化
pt_2 = Point(debrep.Vertices)
pline_3 = PolyLine(Vertices=pt_2, Closed=True)
explode_2 = Explode(Curve=pline_3, Recursive=True)  # -> Segments, Vertices
flip_3 = FlipMatrix(Data=explode_2.Segments)  # -> simplify(Data)
bang = ExplodeTree(Data=flip_3)  # -> graft(Branch0), graft(Branch1), graft(Branch2), graft(Branch3)
edgesrf = EdgeSurface(CurveA=bang.Branch0, CurveB=bang.Branch1, CurveC=bang.Branch2, CurveD=bang.Branch3)

# ---- group: 底层网架
pt_3 = Point(flatten(move.Geometry))
partition = PartitionList(List=pt_3, Size=int)
flip_4 = FlipMatrix(Data=partition)
pline_4 = PolyLine(Vertices=partition, Closed=False)
pline_5 = PolyLine(Vertices=flip_4, Closed=False)
explode_3 = Explode(Curve=pline_4, Recursive=True)  # -> Segments, Vertices
explode_4 = Explode(Curve=pline_5, Recursive=True)  # -> Segments, Vertices
crv网架c = Curve([explode_3.Segments, explode_4.Segments])

# ---- group: 网架基准线
explode_5 = Explode(Curve=pline, Recursive=True)  # -> Segments, Vertices
explode_6 = Explode(Curve=pline_2, Recursive=True)  # -> Segments, Vertices

crv网架a = Curve([explode_5.Segments, explode_6.Segments])

# ---- group: 间距初步评估
# 数据反馈
len = Length(Curve=flatten(crv网架a))
avr = Average(Input=len)
panel_2 = Panel(avr)

# ----
len_2 = Length(Curve=flatten(crv网架c))
avr_2 = Average(Input=len_2)
panel_3 = Panel(avr_2)

# ---- group: 面向结构
merge = Merge(Data1=crv网架a, Data2=crv网格杆件b, Data3=crv网架c)  # -> flatten(Result)
# 数据梳理
merge_2 = Merge(Data1=sdivide_2.Points, Data2=partition)  # -> flatten(Result)
杆件基准线 = Curve(merge)
球节点 = Point(merge_2)

# ---- group: 玻璃
srf_3 = Surface(srf外基准面)
divide_2 = DivideDomain²(Domain=srf_3, UCount=int, VCount=int)
number_slider = Slider(0.03, range=0..1)
subsrf_2 = Isotrim(Surface=srf_3, Domain=divide_2)  # -> reparameterize(Surface)
dedom2num = DeconstructDomain²(Domain=subsrf_2)  # -> UMin, UMax, VMin, VMax
addition = Addition(A=dedom2num.UMin, B=number_slider)
subtraction = Subtraction(A=dedom2num.UMax, B=number_slider)
addition_2 = Addition(A=dedom2num.VMin, B=number_slider)
subtraction_2 = Subtraction(A=dedom2num.VMax, B=number_slider)
dom²num = ConstructDomain²(UMin=addition, UMax=subtraction, VMin=addition_2, VMax=subtraction_2)
subsrf_3 = Isotrim(Surface=subsrf_2, Domain=dom²num)  # -> reparameterize(Surface)
dom_4 = ConstructDomain(DomainStart=0, DomainEnd=1)
vec = Vector(flatten(evalsrf_2.Normal))
amp_2 = Amplitude(Vector=vec, Amplitude=Slider(-1, range=-10..11))
extr = Extrude(Base=subsrf_3, Direction=amp_2)
mesh_3 = MeshBrep(
    Brep=extr,
    Settings={GridMaxCount=0, GridMinCount=16, JaggedSeams=False, MaxEdgeLength=0, MinEdgeLength=0.0001, MinTolerance=0, Refine=True, RefineAngle=0, RelativeTolerance=0.65, SimplePlanes=True, Tolerance=0})  # -> flatten(Mesh)
mjoin_3 = MeshJoin(Meshes=mesh_3)
mesh最外玻璃 = Mesh(mjoin_3)

# ---- group: 形象建模
球节点_2 = Point(球节点)
# 数据导出
msphere_2 = MeshSphere(Base=球节点_2, Radius="2", UCount=10, VCount=20)  # -> flatten(Mesh)
mjoin_4 = MeshJoin(Meshes=msphere_2)
球 = Mesh(mjoin_4)

杆件基准线_2 = Curve(杆件基准线)
smooth = SettingsQuality()
pipe_2 = Pipe(Curve=杆件基准线_2, Radius="1", Caps=0)
mesh_4 = MeshBrep(Brep=pipe_2, Settings=smooth)  # -> flatten(Mesh)
mjoin_5 = MeshJoin(Meshes=mesh_4)
杆件 = Mesh(mjoin_5)
