# Grasshopper definition 20180205_partE-level3-随机中的控制.gh (Grasshopper 1.0.7)

panel = Panel("""利用一些有趣的造型算法到建筑中去
恰当的算法，恰当的控制，恰当的效果很重要""")
panel_2 = Panel("""“控制”
原算法在必须受到实际结构的控制，和建筑生成的逻辑相关，由建筑的数据参与生成""")
Z = UnitZ(Factor=1)

一层圈数 = Slider(4, range=0..12)
series = Series(Start=0, Step=Slider(18, range=0..100), Count=Slider(4, range=0..12))
pt = Point(Point(16, -7, 0))
Y = UnitY(Factor=series)
move = Move(Geometry=pt, Motion=Y)  # -> Geometry, Transform
X = UnitX(Factor=1)
圆半径 = Slider(8.563, range=0..12)
line = LineSDL(Start=move.Geometry, Direction=X, Length="100")
divide = DivideCurve(Curve=line, Count=一层圈数, Kinks=False)  # -> Points, Tangents, Parameters
cir = Circle(Plane=divide.Points, Radius=圆半径)  # -> flatten(Circle)

number_slider = Slider(8, range=0..10)
lng = ListLength(List=cir)
series_2 = Series(Start=number_slider, Step=number_slider, Count=lng)
random = Random(Range=Domain(0, 1), Number="3", Seed=series_2)

number_slider_2 = Slider(10, range=0..10)
lng_2 = ListLength(List=cir)
series_3 = Series(Start=number_slider_2, Step=number_slider_2, Count=lng_2)
random_2 = Random(Range=Domain(0, 1), Number="3", Seed=series_3)

pt_2 = Point(flatten(divide.Points))
item = ListItem(List=pt_2, Index=0, Wrap=True)
item_2 = ListItem(List=pt_2, Index=-1, Wrap=True)
rec_2pt = Rectangle2Pt(Plane=PlaneXY(0, 0, 0), PointA=item, PointB=item_2, Radius=0)  # -> Rectangle, Length

eval = EvaluateCurve(Curve=reparameterize(graft(cir)), Parameter=random_2)  # -> flatten(Point), Tangent, Angle
eval_2 = EvaluateCurve(Curve=reparameterize(graft(cir)), Parameter=random)  # -> flatten(Point), Tangent, Angle

voronoi = Voronoi(Points=eval.Point, Boundary=rec_2pt.Rectangle, BruteForceOverride=False)
偏移值 = Slider(-0.753, range=-5..10)
clean = CleanTree(RemoveNulls=True, RemoveInvalid=True, RemoveEmpty=False, Tree=voronoi)  # -> graft(Tree)
offset = Offset(Curve=clean, Distance=偏移值, Plane=PlaneXY(0, 0, 0), Corners=1)
fillet = Fillet(Curve=offset, Radius="10")  # -> simplify(Curve)
merge = Merge(Data1=fillet, Data2=simplify(clean))
boundary = BoundarySurfaces(Edges=merge)
srf = Surface(boundary)
preview = CustomPreview(Geometry=srf, Shader=ColourSwatch(SwatchColor=RGB(0, 0, 0)))

voronoi_2 = Voronoi(Points=eval_2.Point, Boundary=rec_2pt.Rectangle, BruteForceOverride=False)
偏移值_2 = Slider(-0.753, range=-5..10)
clean_2 = CleanTree(RemoveNulls=True, RemoveInvalid=True, RemoveEmpty=False, Tree=voronoi_2)  # -> graft(Tree)
offset_2 = Offset(Curve=clean_2, Distance=偏移值_2, Plane=PlaneXY(0, 0, 0), Corners=1)
fillet_2 = Fillet(Curve=offset_2, Radius="10")  # -> simplify(Curve)
merge_2 = Merge(Data1=fillet_2, Data2=simplify(clean_2))
boundary_2 = BoundarySurfaces(Edges=merge_2)
srf_2 = Surface(boundary_2)

move_2 = Move(Geometry=srf_2, Motion=Z)  # -> Geometry, Transform

preview_2 = CustomPreview(Geometry=move_2.Geometry, Shader=ColourSwatch(SwatchColor=RGB(255, 255, 255)))
