# Grasshopper definition 20180205_partE-level4-工程数据导出.gh (Grasshopper 0.9.76)

# ---- group: 找形
ellipse = Ellipse(Plane=PlaneXY(0, 0, 0), Radius1=Slider(80, range=0..100), Radius2=Slider(100, range=0..100))  # -> Ellipse, Focus1, Focus2
scale = Scale(Geometry=ellipse.Ellipse, Center=Point(0, 0, 0), Factor=0.5)  # -> Geometry, Transform
Z = UnitZ(Factor=Slider(25, range=0..100))
move = Move(Geometry=scale.Geometry, Motion=Z)  # -> Geometry, Transform
eval = EvaluateCurve(Curve=[move.Geometry, ellipse.Ellipse], Parameter=0)  # -> flatten(Point), Tangent, Angle
pline = PolyLine(Vertices=eval.Point, Closed=False)
divide = DivideCurve(Curve=pline, Count=9, Kinks=False)  # -> Points, Tangents, Parameters
pdecon = Deconstruct(Point=divide.Points)  # -> XComponent, YComponent, ZComponent
graph = GraphMapper(
    pdecon.ZComponent,
    x0=0,
    x1=25,
    y0=0,
    y1=10,
    container_name="Bezier",
    cpx=[0, 0, 0.7586090565, 1],
    cpy=[0, 0.5104927421, 0.4882317185, 0])
addition = Addition(A=pdecon.ZComponent, B=graph)
pt = ConstructPoint(XCoordinate=pdecon.XComponent, YCoordinate=pdecon.YComponent, ZCoordinate=addition)

# ---- group: 工程优化
crv外基准线 = Curve(ellipse.Ellipse)
pt剖面基准点 = Point(pt)
item = ListItem(List=pt剖面基准点, Index=-1, Wrap=True)
divide_2 = DivideCurve(Curve=crv外基准线, Count=Slider(80, range=0..100), Kinks=False)  # -> Points, Tangents, Parameters
pdecon_2 = Deconstruct(Point=pt剖面基准点)  # -> XComponent, YComponent, ZComponent
pdecon_3 = Deconstruct(Point=item)  # -> XComponent, YComponent, ZComponent
pline_2 = PolyLine(Vertices=divide_2.Points, Closed=True)
area = Area(Geometry=crv外基准线)  # -> Area, Centroid
pt_2 = ConstructPoint(XCoordinate=pdecon_2.XComponent, YCoordinate=pdecon_2.YComponent, ZCoordinate=0)
pt_3 = ConstructPoint(XCoordinate=pdecon_3.XComponent, YCoordinate=pdecon_3.YComponent, ZCoordinate=0)
dist = Distance(PointA=area.Centroid, PointB=pt_3)
dist_2 = Distance(PointA=area.Centroid, PointB=pt_2)
division = Division(A=dist_2, B=dist)
scale_2 = Scale(Geometry=pline_2, Center=area.Centroid, Factor=division)  # -> Geometry, Transform
Z_2 = UnitZ(Factor=pdecon_2.ZComponent)
move_2 = Move(Geometry=scale_2.Geometry, Motion=Z_2)  # -> Geometry, Transform
explode = Explode(Curve=move_2.Geometry, Recursive=True)  # -> simplify(Segments), Vertices
flip = FlipMatrix(Data=explode.Segments)
shift = ShiftList(List=flip, Shift=1, Wrap=False)  # -> graft(List)
shift_2 = ShiftList(List=flip, Shift=-1, Wrap=False)  # -> graft(List)
end = EndPoints(Curve=shift)  # -> Start, End
end_2 = EndPoints(Curve=shift_2)  # -> Start, End
merge = Merge(Data1=end.Start, Data2=end.End, Data3=end_2.End, Data4=end_2.Start)
pline_3 = PolyLine(Vertices=merge, Closed=True)
crv = Curve(flatten(pline_3))
cull = CullPattern(List=crv, CullPattern=[False, True])
boundary = BoundarySurfaces(Edges=pline_3)  # disabled
pipe = Pipe(Curve=cull, Radius=0.2, Caps=0)  # disabled

# ---- group: 工程数据导出
pt_4 = Point(explode.Vertices)
shift_3 = ShiftList(List=pt_4, Shift=-1, Wrap=False)  # -> simplify(List)
Z_3 = UnitZ(Factor=1)
tstat = TreeStatistics(Tree=shift_3)  # -> graft(Paths), Length, Count
move_3 = Move(Geometry=shift_3, Motion=Z_3)  # -> Geometry, Transform
series = Series(Start=0, Step=1, Count=tstat.Length)
concat = Concatenate(FragmentA=tstat.Paths, FragmentB=",", FragmentC=series)
节点标记 = Panel(concat)
pt_5 = Point(shift_3)
rep = ReplaceText(Text=pt_5, Find="{", RecursiveReplace=False)
tag = TextTag(Location=move_3.Geometry, Text=concat, Colour=RGB(0, 0, 0))
rep_2 = ReplaceText(Text=rep, Find="}", RecursiveReplace=False)
concat_2 = Concatenate(FragmentA=concat, FragmentB=",", FragmentC=rep_2)
工程导出控制点定位坐标 = Panel(concat_2)
