# Grasshopper definition 20180206_partE-level5-曲面幕墙细分生化.gh (Grasshopper 1.0.7)

crv = Curve(graft([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]))
bang = ExplodeTree(Data=crv)  # -> Branch0, Branch1, Branch2, Branch3

# ---- group: 无法正常
intcrv = Interpolate(Degree=3, Periodic=False, KnotStyle=1)  # -> Curve, Length, Domain
pframes = PerpFrames(Curve=intcrv.Curve, Count=10, Align=True)  # -> Frames, Parameters

# ----
edgesrf = EdgeSurface(CurveA=bang.Branch0, CurveB=bang.Branch1, CurveC=bang.Branch2, CurveD=bang.Branch3)
srf基准面 = Surface(edgesrf)

sdivide = DivideSurface(Surface=srf基准面, UCount=Slider(45, range=0..100), VCount=Slider(39, range=0..100))  # -> simplify(Points), Normals, Parameters
flip = FlipMatrix(Data=sdivide.Points)
pline = PolyLine(Vertices=sdivide.Points, Closed=False)
pline_2 = PolyLine(Vertices=flip, Closed=False)
explode = Explode(Curve=pline_2, Recursive=True)  # -> Segments, Vertices
explode_2 = Explode(Curve=pline, Recursive=True)  # -> Segments, Vertices

# ---- group: 生成操作面
crv百叶开向线 = Curve(explode_2.Segments)
srf基准面_2 = Surface(srf基准面)
end = EndPoints(Curve=crv百叶开向线)  # -> Start, End
srf_cp = SurfaceClosestPoint(Point=end.Start, Surface=srf基准面_2)  # -> Point, UVPoint, Distance
evalsrf = EvaluateSurface(Surface=srf基准面_2, Point=srf_cp.UVPoint)  # -> Point, Normal, Frame
move = Move(Geometry=end.Start, Motion=evalsrf.Frame)  # -> Geometry, Transform
lnpt = LinePt(Line=crv百叶开向线, Point=move.Geometry)

# ----
len = Length(Curve=explode.Segments)  # -> flatten(Length)
len_2 = Length(Curve=explode_2.Segments)  # -> flatten(Length)
avr = Average(Input=len)
avr_2 = Average(Input=len_2)
构件y向长 = Panel(avr)
构件z向长 = Panel(avr_2)

panel = Panel("将曲面面板优化成三角形面板")

# ---- group: 干扰变量
number_slider = Slider(0.508, range=0..1)
pt = ConstructPoint(XCoordinate=Slider(0.718, range=0..1), YCoordinate=number_slider, ZCoordinate=0)
pt_2 = ConstructPoint(XCoordinate=Slider(0.185, range=0..1), YCoordinate=number_slider, ZCoordinate=0)
crvsrf = CurveOnSurface(Surface=reparameterize(srf基准面_2), UVCoordinates=[pt, pt_2], Closed=False)  # -> Curve, Length, Domain
crv_cp = CurveClosestPoint(Point=lnpt, Curve=crvsrf.Curve)  # -> Point, Parameter, Distance
bnd = Bounds(Numbers=flatten(crv_cp.Distance))
remap = RemapNumbers(Value=crv_cp.Distance, Source=bnd, Target=Domain(0, 1))  # -> Mapped, Clipped
graph = GraphMapper(
    remap.Mapped,
    x0=0,
    x1=1,
    y0=0,
    y1=1,
    container_name="Gaussian",
    factor=0.6639429331,
    mean=0.1032282934,
    sdev=0.2724909857)

# ----
graph_2 = GraphMapper(remap.Mapped, x0=0, x1=1, y0=0, y1=1, container_name="Gaussian", factor=0.6635649204, mean=0, sdev=0.1107374951)

# ---- group: 干扰变量 (continued)
multiplication = Multiplication(A=graph_2, B=Slider(0.5, range=0..1))

# ----
rotate = Rotate(Geometry=crv百叶开向线, Angle=multiplication, Plane=lnpt)  # -> Geometry, Transform
flip_2 = FlipMatrix(Data=rotate.Geometry)  # -> simplify(Data)
shift = ShiftList(List=flip_2, Shift=1, Wrap=False)  # -> graft(List)
shift_2 = ShiftList(List=flip_2, Shift=-1, Wrap=False)  # -> graft(List)
loft = Loft(
    Curves=[shift, shift_2],
    Options={Adjust=False, Closed=False, LoftEnds=0, LoftSimp=0, LoftType=0, Rebuild=10, Refit=0.01})

# ---- group: 判断输出
flip_3 = FlipMatrix(Data=multiplication)
shift_3 = ShiftList(List=flip_3, Shift=-1, Wrap=False)
larger = LargerThan(FirstNumber=shift_3, SecondNumber=Slider(0.23, range=0..0.23))  # -> LargerThan, OrEqualTo
trim = TrimTree(Tree=loft, Depth=1)
dispatch = Dispatch(List=trim, DispatchPattern=larger.LargerThan)  # -> ListA, ListB
srf放开的百叶 = Surface(dispatch.ListA)
srf未放开的百叶 = Surface(dispatch.ListB)

# ----
srf放开的百叶_2 = Surface(flatten(srf放开的百叶))
debrep = DeconstructBrep(Brep=srf放开的百叶_2)  # -> Faces, Edges, Vertices
flip_4 = FlipMatrix(Data=debrep.Vertices)
bang_2 = ExplodeTree(Data=flip_4)  # -> Branch0, Branch1, Branch2, Branch3
srf4pt = _4PointSurface(CornerA=bang_2.Branch0, CornerB=bang_2.Branch0, CornerC=bang_2.Branch1, CornerD=bang_2.Branch2)  # -> graft(Surface)
srf4pt_2 = _4PointSurface(CornerA=bang_2.Branch2, CornerB=bang_2.Branch2, CornerC=bang_2.Branch0, CornerD=bang_2.Branch3)  # -> graft(Surface)
divide = DivideDomain²(Domain=srf4pt, UCount=1, VCount=4)
divide_2 = DivideDomain²(Domain=srf4pt_2, UCount=1, VCount=4)
subsrf = Isotrim(Surface=srf4pt, Domain=divide)
subsrf_2 = Isotrim(Surface=srf4pt_2, Domain=divide_2)
srf放开的百叶_3 = Surface([subsrf_2, subsrf])

srf未放开的百叶_2 = Surface(flatten(srf未放开的百叶))
debrep_2 = DeconstructBrep(Brep=srf未放开的百叶_2)  # -> Faces, Edges, Vertices
flip_5 = FlipMatrix(Data=debrep_2.Vertices)
bang_3 = ExplodeTree(Data=flip_5)  # -> Branch0, Branch1, Branch2, Branch3
srf4pt_3 = _4PointSurface(CornerA=bang_3.Branch0, CornerB=bang_3.Branch0, CornerC=bang_3.Branch1, CornerD=bang_3.Branch2)  # -> graft(Surface)
srf4pt_4 = _4PointSurface(CornerA=bang_3.Branch2, CornerB=bang_3.Branch2, CornerC=bang_3.Branch0, CornerD=bang_3.Branch3)  # -> graft(Surface)
divide_3 = DivideDomain²(Domain=srf4pt_3, UCount=1, VCount=4)
divide_4 = DivideDomain²(Domain=srf4pt_4, UCount=1, VCount=4)
subsrf_3 = Isotrim(Surface=srf4pt_3, Domain=divide_3)
subsrf_4 = Isotrim(Surface=srf4pt_4, Domain=divide_4)
srf未放开的百叶_3 = Surface([subsrf_4, subsrf_3])

ln = Line(StartPoint=bang_2.Branch1, EndPoint=bang_2.Branch2)  # -> flatten(Line)
ln_2 = Line(StartPoint=bang_2.Branch0, EndPoint=bang_2.Branch3)  # -> flatten(Line)
Z = UnitZ(Factor=Slider(1, range=-3..1))
explode_3 = Explode(Curve=srf放开的百叶_2, Recursive=True)  # -> simplify(Segments), Vertices
move_2 = Move(Geometry=ln, Motion=Z)  # -> graft(Geometry), Transform
move_3 = Move(Geometry=ln_2, Motion=Z)  # -> graft(Geometry), Transform
item = ListItem(List=explode_3.Segments, Index=2, Wrap=True)

merge = Merge(Data1=move_3.Geometry, Data2=move_2.Geometry)

loft_2 = Loft(Curves=merge, Options={Adjust=False, Closed=False, LoftEnds=0, LoftSimp=0, LoftType=0, Rebuild=10, Refit=0.01})
explode_4 = Explode(Curve=loft_2, Recursive=True)  # -> simplify(Segments), Vertices
item_2 = ListItem(List=explode_4.Segments, Index=2, Wrap=True)
debrep_3 = DeconstructBrep(Brep=loft_2)  # -> Faces, Edges, Vertices
merge_2 = Merge(Data1=item_2, Data2=item)
flip_6 = FlipMatrix(Data=debrep_3.Vertices)
loft_3 = Loft(Curves=merge_2, Options={Adjust=False, Closed=False, LoftEnds=0, LoftSimp=0, LoftType=0, Rebuild=10, Refit=0.01})
bang_4 = ExplodeTree(Data=flip_6)  # -> Branch0, Branch1, Branch2, Branch3
divide_5 = DivideDomain²(Domain=loft_3, UCount=1, VCount=4)
subsrf_5 = Isotrim(Surface=loft_3, Domain=divide_5)
srf4pt_5 = _4PointSurface(CornerA=bang_4.Branch2, CornerB=bang_4.Branch2, CornerC=bang_4.Branch0, CornerD=bang_4.Branch3)  # -> graft(Surface)
srf4pt_6 = _4PointSurface(CornerA=bang_4.Branch0, CornerB=bang_4.Branch0, CornerC=bang_4.Branch1, CornerD=bang_4.Branch2)  # -> graft(Surface)
srf封边细分 = Surface(subsrf_5)
divide_6 = DivideDomain²(Domain=srf4pt_5, UCount=1, VCount=4)
divide_7 = DivideDomain²(Domain=srf4pt_6, UCount=1, VCount=4)
subsrf_6 = Isotrim(Surface=srf4pt_6, Domain=divide_7)
subsrf_7 = Isotrim(Surface=srf4pt_5, Domain=divide_6)
srf底层背板 = Surface([subsrf_7, subsrf_6])
