# Grasshopper definition 20180208_partF-level4迭代-山体寻径.gh (Grasshopper 1.0.7)

点间距 = Slider(58, range=20..60)
最大坡度 = Slider(10, range=5..20)
mesh = Mesh(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)
Z = UnitZ(Factor=1)
pt起始点 = Point(Point(89.74034373, 83, 0))
pt目标点 = Point(Point(914, 920, 0))
number_slider = Slider(1.703, range=0..20)  # disabled
rec = Rectangle({Plane=PlaneXY(10.58867884, 8.547873893, 0), Size=Domain2(u=0..982.8226572, v=0..985.5971548)})  # disabled
id = Guid([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])  # disabled
meshray = MeshRay(Mesh=mesh, Point=pt起始点, Direction=Z)  # -> Point, Hit
meshray_2 = MeshRay(Mesh=mesh, Point=pt目标点, Direction=Z)  # -> Point, Hit
preview = CustomPreview(Geometry=mesh, Shader=ColourSwatch(SwatchColor=RGB(178, 178, 178)))
pt目标点_2 = Point(meshray_2.Point)
cluster = Cluster(mesh=mesh, pt=meshray.Point, int=点间距, num=最大坡度, pt目标点=pt目标点_2)  # -> pt_5, L
hhhhhh = Hhhhhh(rec=rec, x=id, num=number_slider)  # disabled
cluster_2 = Cluster(mesh=mesh, pt=cluster.pt_5, int=点间距, num=最大坡度, pt目标点=pt目标点_2)  # -> pt_5, L
galapagos = Galapagos(fitness=num, gene=[点间距, 最大坡度])
mesh_2 = Mesh(hhhhhh)  # disabled
number_slider_2 = Slider(31, range=0..50)  # disabled
cluster_3 = Cluster(mesh=mesh, pt=cluster_2.pt_5, int=点间距, num=最大坡度, pt目标点=pt目标点_2)  # -> pt_5, L
cluster_4 = Cluster(mesh=mesh, pt=cluster_3.pt_5, int=点间距, num=最大坡度, pt目标点=pt目标点_2)  # -> pt_5, L
cluster_5 = Cluster(mesh=mesh, int=点间距, num=最大坡度, pt目标点=pt目标点_2)  # -> pt_5, L; disabled
cluster_6 = Cluster(mesh=mesh, pt=cluster_4.pt_5, int=点间距, num=最大坡度, pt目标点=pt目标点_2)  # -> pt_5, L
rec_2 = DataRecorder(cluster_5.L, DataLimit=-10, RecordData=True)  # disabled
rec_3 = DataRecorder(cluster_5.pt_5, DataLimit=-10, RecordData=True)  # disabled
cluster_7 = Cluster(mesh=mesh, pt=cluster_6.pt_5, int=点间距, num=最大坡度, pt目标点=pt目标点_2)  # -> pt_5, L
cluster_8 = Cluster(mesh=mesh, pt=cluster_7.pt_5, int=点间距, num=最大坡度, pt目标点=pt目标点_2)  # -> pt_5, L
cluster_9 = Cluster(mesh=mesh, pt=cluster_8.pt_5, int=点间距, num=最大坡度, pt目标点=pt目标点_2)  # -> pt_5, L
cluster_10 = Cluster(mesh=mesh, pt=cluster_9.pt_5, int=点间距, num=最大坡度, pt目标点=pt目标点_2)  # -> pt_5, L
cluster_11 = Cluster(mesh=mesh, pt=cluster_10.pt_5, int=点间距, num=最大坡度, pt目标点=pt目标点_2)  # -> pt_5, L
cluster_12 = Cluster(mesh=mesh, pt=cluster_11.pt_5, int=点间距, num=最大坡度, pt目标点=pt目标点_2)  # -> pt_5, L
cluster_13 = Cluster(mesh=mesh, pt=cluster_12.pt_5, int=点间距, num=最大坡度, pt目标点=pt目标点_2)  # -> pt_5, L
cluster_14 = Cluster(mesh=mesh, pt=cluster_13.pt_5, int=点间距, num=最大坡度, pt目标点=pt目标点_2)  # -> pt_5, L
cluster_15 = Cluster(mesh=mesh, pt=cluster_14.pt_5, int=点间距, num=最大坡度, pt目标点=pt目标点_2)  # -> pt_5, L
cluster_16 = Cluster(mesh=mesh, pt=cluster_15.pt_5, int=点间距, num=最大坡度, pt目标点=pt目标点_2)  # -> pt_5, L
cluster_17 = Cluster(mesh=mesh, pt=cluster_16.pt_5, int=点间距, num=最大坡度, pt目标点=pt目标点_2)  # -> pt_5, L
cluster_18 = Cluster(mesh=mesh, pt=cluster_17.pt_5, int=点间距, num=最大坡度, pt目标点=pt目标点_2)  # -> pt_5, L
cluster_19 = Cluster(mesh=mesh, pt=cluster_18.pt_5, int=点间距, num=最大坡度, pt目标点=pt目标点_2)  # -> pt_5, L
cluster_20 = Cluster(mesh=mesh, pt=cluster_19.pt_5, int=点间距, num=最大坡度, pt目标点=pt目标点_2)  # -> pt_5, L
cluster_21 = Cluster(mesh=mesh, pt=cluster_20.pt_5, int=点间距, num=最大坡度, pt目标点=pt目标点_2)  # -> pt_5, L
cluster_22 = Cluster(mesh=mesh, pt=cluster_21.pt_5, int=点间距, num=最大坡度, pt目标点=pt目标点_2)  # -> pt_5, L
cluster_23 = Cluster(mesh=mesh, pt=cluster_22.pt_5, int=点间距, num=最大坡度, pt目标点=pt目标点_2)  # -> pt_5, L
cluster_24 = Cluster(mesh=mesh, pt=cluster_23.pt_5, int=点间距, num=最大坡度, pt目标点=pt目标点_2)  # -> pt_5, L
cluster_25 = Cluster(mesh=mesh, pt=cluster_24.pt_5, int=点间距, num=最大坡度, pt目标点=pt目标点_2)  # -> pt_5, L
cluster_26 = Cluster(mesh=mesh, pt=cluster_25.pt_5, int=点间距, num=最大坡度, pt目标点=pt目标点_2)  # -> pt_5, L
cluster_27 = Cluster(mesh=mesh, pt=cluster_26.pt_5, int=点间距, num=最大坡度, pt目标点=pt目标点_2)  # -> pt_5, L
cluster_28 = Cluster(mesh=mesh, pt=cluster_27.pt_5, int=点间距, num=最大坡度, pt目标点=pt目标点_2)  # -> pt_5, L
cluster_29 = Cluster(mesh=mesh, pt=cluster_28.pt_5, int=点间距, num=最大坡度, pt目标点=pt目标点_2)  # -> pt_5, L
cluster_30 = Cluster(mesh=mesh, pt=cluster_29.pt_5, int=点间距, num=最大坡度, pt目标点=pt目标点_2)  # -> pt_5, L
cluster_31 = Cluster(mesh=mesh, pt=cluster_30.pt_5, int=点间距, num=最大坡度, pt目标点=pt目标点_2)  # -> pt_5, L
pt = Point(cluster_31.pt_5)
cluster_32 = Cluster(mesh=mesh, pt=cluster_31.pt_5, int=点间距, num=最大坡度, pt目标点=pt目标点_2)  # -> pt_5, L
dist = Distance(PointA=pt目标点_2, PointB=pt)
cluster_33 = Cluster(mesh=mesh, pt=cluster_32.pt_5, int=点间距, num=最大坡度, pt目标点=pt目标点_2)  # -> pt_5, L
panel = Panel(dist)
num = Number(dist)
cluster_34 = Cluster(mesh=mesh, pt=cluster_33.pt_5, int=点间距, num=最大坡度, pt目标点=pt目标点_2)  # -> pt_5, L
cluster_35 = Cluster(mesh=mesh, pt=cluster_34.pt_5, int=点间距, num=最大坡度, pt目标点=pt目标点_2)  # -> pt_5, L
cluster_36 = Cluster(mesh=mesh, pt=cluster_35.pt_5, int=点间距, num=最大坡度, pt目标点=pt目标点_2)  # -> pt_5, L
cluster_37 = Cluster(mesh=mesh, pt=cluster_36.pt_5, int=点间距, num=最大坡度, pt目标点=pt目标点_2)  # -> pt_5, L
cluster_38 = Cluster(mesh=mesh, pt=cluster_37.pt_5, int=点间距, num=最大坡度, pt目标点=pt目标点_2)  # -> pt_5, L
cluster_39 = Cluster(mesh=mesh, pt=cluster_38.pt_5, int=点间距, num=最大坡度, pt目标点=pt目标点_2)  # -> pt_5, L
cluster_40 = Cluster(mesh=mesh, pt=cluster_39.pt_5, int=点间距, num=最大坡度, pt目标点=pt目标点_2)  # -> pt_5, L
cluster_41 = Cluster(mesh=mesh, pt=cluster_40.pt_5, int=点间距, num=最大坡度, pt目标点=pt目标点_2)  # -> pt_5, L

# ==== cluster Hhhhhh
rec = ClusterInput()
rec_2 = Rectangle(rec)
x = ClusterInput()
vb = VBScript(x=x)  # -> out, A, B
# ---------- vb: VB ----------
    Dim obj As Rhino.DocObjects.TextObject
    obj = Rhino.RhinoDoc.ActiveDoc.Objects.Find(x)
    A = obj.DisplayText
    B = obj.Geometry.GetBoundingBox(false).Center
# ---------- end vb ----------
number_slider = Slider(20, range=0..100)
Z = UnitZ(Factor=vb.A)
boundary = BoundarySurfaces(Edges=rec_2)
dim = Dimensions(Surface=rec_2)  # -> UDimension, VDimension
pt = Point(vb.B)
move = Move(Geometry=pt, Motion=Z)  # -> Geometry, Transform
integer_division = IntegerDivision(A=dim.VDimension, B=number_slider)
integer_division_2 = IntegerDivision(A=dim.UDimension, B=number_slider)
sdivide = DivideSurface(Surface=boundary, UCount=integer_division_2, VCount=integer_division)  # -> Points, Normals, Parameters
Z_2 = UnitZ(Factor=1)
del = DelaunayMesh(Points=move.Geometry, Plane=PlaneXY(0, 0, 0))
project = ProjectPoint(Point=sdivide.Points, Direction=Z_2, Geometry=del)  # -> Point, Index
intcrv = Interpolate(Vertices=project.Point, Degree=3, Periodic=False, KnotStyle=0)  # -> flatten(Curve), Length, Domain
loft = Loft(Curves=intcrv.Curve, Options={Adjust=False, Closed=False, LoftEnds=0, LoftSimp=0, LoftType=0, Rebuild=10, Refit=0.01})
num = ClusterInput()
num_2 = Number(num)
dim_2 = Dimensions(Surface=rec_2)  # -> UDimension, VDimension
integer_division_3 = IntegerDivision(A=dim_2.UDimension, B=num_2)
integer_division_4 = IntegerDivision(A=dim_2.VDimension, B=num_2)
mesh_uv = MeshSurface(Surface=loft, UCount=integer_division_3, VCount=integer_division_4, Overhang=True, Equalize=False)
M = ClusterOutput(mesh_uv)

# ==== cluster Cluster
pt = ClusterInput()
int = ClusterInput()
num = ClusterInput()
mesh = ClusterInput()
pt目标点 = ClusterInput()
pt_2 = Point(pt)
int_2 = Integer(int)
num_2 = Number(num)
mesh_2 = Mesh(mesh)
pt目标点_2 = Point(pt目标点)
rad = Radians(Degrees=num_2)
tan = Tangent(Value=rad)
cir = Circle(Plane=pt_2, Radius=int_2)
multiplication = Multiplication(A=int_2, B=tan)
neg = Negative(Value=multiplication)
Z = UnitZ(Factor=[multiplication, neg])
extr = Extrude(Base=cir, Direction=Z)
mesh_3 = MeshBrep(
    Brep=extr,
    Settings={GridMaxCount=0, GridMinCount=16, JaggedSeams=False, MaxEdgeLength=0, MinEdgeLength=0.0001, MinTolerance=0, Refine=True, RefineAngle=0, RelativeTolerance=0.65, SimplePlanes=True, Tolerance=0})
mjoin = MeshJoin(Meshes=mesh_3)
mmx = MeshMesh(MeshA=mesh_2, MeshB=mjoin, UseMeshMeshFast=True)
crv = Curve(mmx)
crv_cp = CurveClosestPoint(Point=pt_2, Curve=crv)  # -> flatten(Point), Parameter, Distance
dist = Distance(PointA=crv_cp.Point, PointB=pt目标点_2)
bnd = Bounds(Numbers=dist)
dedomain = DeconstructDomain(Domain=bnd)  # -> Start, End
mindex = MemberIndex(Set=dist, Member=dedomain.Start)  # -> Index, Count
item = ListItem(List=crv_cp.Point, Index=mindex.Index, Wrap=True)
pt_3 = Point(item)
ln = Line(StartPoint=pt_3, EndPoint=pt_2)
pt_4 = Point(pt_3)
line = Line(ln)
pt_5 = ClusterOutput(pt_4)
L = ClusterOutput(ln)
