# Grasshopper definition 20180208_partF-level5AI.gh (Grasshopper 1.0.7)

timer = Timer(TimerInterval=500, Target=panel)  # disabled
panel = Panel("1")
rec = DataRecorder(panel, DataLimit=-10, RecordData=True)
ma = MassAddition(Input=rec)  # -> Result, PartialResults
Y = UnitY(Factor=ma.Result)
pt = Point(Point(13, 1, 0))
move = Move(Geometry=pt, Motion=Y)  # -> Geometry, Transform

pt_2 = Point(move.Geometry)
pt_3 = Point(Point(13, 20.9729869, 0))
cir = Circle(Plane=pt_3, Radius=2)
incurves = PointInCurves(Point=pt_2, Curves=cir)  # -> Relationship, Index, Point
cull = CullPattern(List=ma.Result, CullPattern=incurves.Relationship)
cull_2 = CullPattern(List=pt_2, CullPattern=incurves.Relationship)
rec_2 = DataRecorder(cull_2, DataLimit=-10, RecordData=True)
rec_3 = DataRecorder(cull, DataLimit=-10, RecordData=True)
item = ListItem(List=rec_2, Index=1, Wrap=True)
item_2 = ListItem(List=rec_3, Index=0, Wrap=True)
item_3 = ListItem(List=rec_2, Index=0, Wrap=True)
vec2pt = Vector2Pt(PointA=item_3, PointB=item, Unitize=False)  # -> Vector, Length
Z = UnitZ(Factor=1)
subtraction = Subtraction(A=ma.Result, B=item_2)
vrot = Rotate(Vector=vec2pt.Vector, Axis=Z, Angle=-1.570796327)
amp = Amplitude(Vector=vrot, Amplitude=subtraction)
move_2 = Move(Geometry=item_3, Motion=amp)  # -> Geometry, Transform
null = NullItem(Item=move_2.Geometry)  # -> NullFlags, InvalidFlags, Description
pt_4 = Point(move_2.Geometry)
filter = StreamFilter(Gate=null.NullFlags, Stream0=pt_4, Stream1=pt_2)
rec_4 = DataRecorder(filter, DataLimit=-10, RecordData=True)
item_4 = ListItem(List=reverse(rec_4), Index=[0, 1, 2, 3, 4, 5, 6], Wrap=True)
item_5 = ListItem(List=item_4, Index=0, Wrap=True)
sph = Sphere(Base=item_4, Radius=0.5)
pt_5 = Point(item_5)

pt_6 = Point(Point(27.81654841, 20.00028512, 0))
pt_7 = Point(pt_5)
cir_2 = Circle(Plane=pt_6, Radius=2)
incurves_2 = PointInCurves(Point=pt_7, Curves=cir_2)  # -> Relationship, Index, Point
cull_3 = CullPattern(List=ma.Result, CullPattern=incurves_2.Relationship)
cull_4 = CullPattern(List=pt_7, CullPattern=incurves_2.Relationship)
rec_5 = DataRecorder(cull_4, DataLimit=-10, RecordData=True)
rec_6 = DataRecorder(cull_3, DataLimit=-10, RecordData=True)
item_6 = ListItem(List=rec_5, Index=1, Wrap=True)
item_7 = ListItem(List=rec_6, Index=0, Wrap=True)
item_8 = ListItem(List=rec_5, Index=0, Wrap=True)
vec2pt_2 = Vector2Pt(PointA=item_8, PointB=item_6, Unitize=False)  # -> Vector, Length
Z_2 = UnitZ(Factor=1)
subtraction_2 = Subtraction(A=ma.Result, B=item_7)
vrot_2 = Rotate(Vector=vec2pt_2.Vector, Axis=Z_2, Angle=-1.570796327)
amp_2 = Amplitude(Vector=vrot_2, Amplitude=subtraction_2)
move_3 = Move(Geometry=item_8, Motion=amp_2)  # -> Geometry, Transform
null_2 = NullItem(Item=move_3.Geometry)  # -> NullFlags, InvalidFlags, Description
pt_8 = Point(move_3.Geometry)
filter_2 = StreamFilter(Gate=null_2.NullFlags, Stream0=pt_8, Stream1=pt_7)
rec_7 = DataRecorder(filter_2, DataLimit=-10, RecordData=True)
item_9 = ListItem(List=reverse(rec_7), Index=[0, 1, 2, 3, 4, 5, 6], Wrap=True)
item_10 = ListItem(List=item_9, Index=0, Wrap=True)
sph_2 = Sphere(Base=item_9, Radius=0.5)
pt_9 = Point(item_10)

pt_10 = Point(Point(25.90328274, 9.570564837, 0))
pt_11 = Point(pt_9)
cir_3 = Circle(Plane=pt_10, Radius=2)
incurves_3 = PointInCurves(Point=pt_11, Curves=cir_3)  # -> Relationship, Index, Point
cull_5 = CullPattern(List=ma.Result, CullPattern=incurves_3.Relationship)
cull_6 = CullPattern(List=pt_11, CullPattern=incurves_3.Relationship)
rec_8 = DataRecorder(cull_6, DataLimit=-10, RecordData=True)
rec_9 = DataRecorder(cull_5, DataLimit=-10, RecordData=True)
item_11 = ListItem(List=rec_8, Index=1, Wrap=True)
item_12 = ListItem(List=rec_9, Index=0, Wrap=True)
item_13 = ListItem(List=rec_8, Index=0, Wrap=True)
vec2pt_3 = Vector2Pt(PointA=item_13, PointB=item_11, Unitize=False)  # -> Vector, Length
Z_3 = UnitZ(Factor=1)
subtraction_3 = Subtraction(A=ma.Result, B=item_12)
vrot_3 = Rotate(Vector=vec2pt_3.Vector, Axis=Z_3, Angle=-1.570796327)
amp_3 = Amplitude(Vector=vrot_3, Amplitude=subtraction_3)
move_4 = Move(Geometry=item_13, Motion=amp_3)  # -> Geometry, Transform
null_3 = NullItem(Item=move_4.Geometry)  # -> NullFlags, InvalidFlags, Description
pt_12 = Point(move_4.Geometry)
filter_3 = StreamFilter(Gate=null_3.NullFlags, Stream0=pt_12, Stream1=pt_11)
rec_10 = DataRecorder(filter_3, DataLimit=-10, RecordData=True)
item_14 = ListItem(List=reverse(rec_10), Index=[0, 1, 2, 3, 4, 5, 6], Wrap=True)
item_15 = ListItem(List=item_14, Index=0, Wrap=True)
sph_3 = Sphere(Base=item_14, Radius=0.5)
pt_13 = Point(item_15)
