# Grasshopper definition 圆的生成算法.gh (Grasshopper 0.9.76)

series = Series(Start=0, Step=1, Count=Slider(8, range=0..10))  # -> graft(Series)
bang = ExplodeTree(Data=series)  # -> Branch0, Branch1, Branch2, Branch3, Branch4, Branch5, Branch6, Branch7
number_slider = Slider(0, range=0..100)
multiplication = Multiplication(A="10", B=2)
pi = Pi(Factor=1)
subtraction = Subtraction(A=3, B=multiplication)
panel = Panel("角度的输入")
division = Division(A=pi, B=4)
range = Range(Domain=division, Steps=Slider(20, range=0..20))
pt = Point(Point(33.83301205, 32.66641495, 0))
pt_2 = Point(Point(-28.58192004, 33, 0))
panel_2 = Panel("""有点白痴了
完全可用更大的单元去做""")
panel_3 = Panel("半径")
# 直角坐标算法
multiplication_2 = Multiplication(A="10", B=2)
pdecon = Deconstruct(Point=pt_2)  # -> XComponent, YComponent, ZComponent
x = Number(bang.Branch7)
x_2 = Number(bang.Branch6)
multiplication_3 = Multiplication(A="10", B=-1)
addition = Addition(A=multiplication_2, B=1)
x_3 = Number(bang.Branch5)
x_4 = Number(bang.Branch4)
pdecon_2 = Deconstruct(Point=pt)  # -> XComponent, YComponent, ZComponent
x_5 = Number(bang.Branch3)
x_6 = Number(bang.Branch2)
x_7 = Number(bang.Branch1)
x_8 = Number(bang.Branch0)
y = Number(Slider(10, range=0..10))
p = Number(subtraction)
eval = Evaluate(F="Xc+r*cos(j)", Xc="0", j=range, r="10")
eval_2 = Evaluate(F="Yc+r*sin(j)", Yc="0", j=range, r="10")
panel_4 = Panel("x的值")
series_2 = Series(Start=multiplication_3, Step=1, Count=addition)  # -> flatten(Series)
addition_2 = Addition(A=series_2, B=pdecon_2.XComponent)
multiplication_4 = Multiplication(A=eval_2, B=-1)
multiplication_5 = Multiplication(A=eval, B=-1)
larger = LargerThan(FirstNumber=p, SecondNumber=0)  # -> LargerThan, OrEqualTo
eval_3 = Evaluate(F="p+4*(x-y)+10", x=x_8, y=y, p=p)
subtraction_2 = Subtraction(A=y, B=1)
eval_4 = Evaluate(F="p+4*x+6", x=x_8, p=p)
eval_5 = Evaluate(F="Yc+sqrt(r*r-(x-Xc)*(x-Xc))", x=addition_2, Yc=pdecon_2.YComponent, Xc=pdecon_2.XComponent, r="10")
eval_6 = Evaluate(F="Yc-sqrt(r*r-(x-Xc)*(x-Xc))", x=addition_2, Yc=pdecon_2.YComponent, Xc=pdecon_2.XComponent, r="10")
pt_3 = ConstructPoint(XCoordinate=eval, YCoordinate=eval_2, ZCoordinate=0)
pt_4 = ConstructPoint(XCoordinate=eval_2, YCoordinate=eval, ZCoordinate=0)  # -> reverse(Point)
pt_5 = ConstructPoint(XCoordinate=multiplication_4, YCoordinate=eval, ZCoordinate=0)
pt_6 = ConstructPoint(XCoordinate=multiplication_5, YCoordinate=eval_2, ZCoordinate=0)  # -> reverse(flatten(Point))
shift = ShiftList(List=pt_3, Shift=-1, Wrap=False)  # -> flatten(List)
shift_2 = ShiftList(List=pt_4, Shift=-1, Wrap=False)  # -> flatten(List)
shift_3 = ShiftList(List=pt_5, Shift=-1, Wrap=False)  # -> flatten(List)
filter = StreamFilter(Gate=larger.LargerThan, Stream0=y, Stream1=subtraction_2)
y_2 = Number(filter)
subtraction_3 = Subtraction(A=y_2, B=1)
filter_2 = StreamFilter(Gate=larger.LargerThan, Stream0=eval_4, Stream1=eval_3)
p_2 = Number(filter_2)
larger_2 = LargerThan(FirstNumber=p_2, SecondNumber=0)  # -> LargerThan, OrEqualTo
eval_7 = Evaluate(F="p+4*(x-y)+10", x=x_7, y=y_2, p=p_2)
eval_8 = Evaluate(F="p+4*x+6", x=x_7, p=p_2)
filter_3 = StreamFilter(Gate=larger_2.LargerThan, Stream0=y_2, Stream1=subtraction_3)
y_3 = Number(filter_3)
subtraction_4 = Subtraction(A=y_3, B=1)
filter_4 = StreamFilter(Gate=larger_2.LargerThan, Stream0=eval_8, Stream1=eval_7)
p_3 = Number(filter_4)
larger_3 = LargerThan(FirstNumber=p_3, SecondNumber=0)  # -> LargerThan, OrEqualTo
eval_9 = Evaluate(F="p+4*x+6", x=x_6, p=p_3)
eval_10 = Evaluate(F="p+4*(x-y)+10", x=x_6, y=y_3, p=p_3)
panel_5 = Panel(filter_4)
filter_5 = StreamFilter(Gate=larger_3.LargerThan, Stream0=y_3, Stream1=subtraction_4)
y_4 = Number(filter_5)
subtraction_5 = Subtraction(A=y_4, B=1)
filter_6 = StreamFilter(Gate=larger_3.LargerThan, Stream0=eval_9, Stream1=eval_10)
p_4 = Number(filter_6)
larger_4 = LargerThan(FirstNumber=p_4, SecondNumber=0)  # -> LargerThan, OrEqualTo
eval_11 = Evaluate(F="p+4*x+6", x=x_5, p=p_4)
eval_12 = Evaluate(F="p+4*(x-y)+10", x=x_5, y=y_4, p=p_4)
filter_7 = StreamFilter(Gate=larger_4.LargerThan, Stream0=y_4, Stream1=subtraction_5)
y_5 = Number(filter_7)
subtraction_6 = Subtraction(A=y_5, B=1)
filter_8 = StreamFilter(Gate=larger_4.LargerThan, Stream0=eval_11, Stream1=eval_12)
p_5 = Number(filter_8)
larger_5 = LargerThan(FirstNumber=p_5, SecondNumber=0)  # -> LargerThan, OrEqualTo
eval_13 = Evaluate(F="p+4*x+6", x=x_4, p=p_5)
eval_14 = Evaluate(F="p+4*(x-y)+10", x=x_4, y=y_5, p=p_5)
filter_9 = StreamFilter(Gate=larger_5.LargerThan, Stream0=y_5, Stream1=subtraction_6)
y_6 = Number(filter_9)
y_7 = Number(filter_9)
subtraction_7 = Subtraction(A=y_6, B=1)
subtraction_8 = Subtraction(A=y_7, B=1)
filter_10 = StreamFilter(Gate=larger_5.LargerThan, Stream0=eval_13, Stream1=eval_14)
p_6 = Number(filter_10)
p_7 = Number(filter_10)
larger_6 = LargerThan(FirstNumber=p_6, SecondNumber=0)  # -> LargerThan, OrEqualTo
eval_15 = Evaluate(F="p+4*x+6", x=x_2, p=p_6)
eval_16 = Evaluate(F="p+4*(x-y)+10", x=x_2, y=y_6, p=p_6)
larger_7 = LargerThan(FirstNumber=p_7, SecondNumber=0)  # -> LargerThan, OrEqualTo
eval_17 = Evaluate(F="p+4*x+6", x=x_3, p=p_7)
eval_18 = Evaluate(F="p+4*(x-y)+10", x=x_3, y=y_7, p=p_7)
filter_11 = StreamFilter(Gate=larger_6.LargerThan, Stream0=y_6, Stream1=subtraction_7)
y_8 = Number(filter_11)
subtraction_9 = Subtraction(A=y_8, B=1)
filter_12 = StreamFilter(Gate=larger_6.LargerThan, Stream0=eval_15, Stream1=eval_16)
p_8 = Number(filter_12)
larger_8 = LargerThan(FirstNumber=p_8, SecondNumber=0)  # -> LargerThan, OrEqualTo
eval_19 = Evaluate(F="p+4*x+6", x=x, p=p_8)
eval_20 = Evaluate(F="p+4*(x-y)+10", x=x, y=y_8, p=p_8)
filter_13 = StreamFilter(Gate=larger_8.LargerThan, Stream0=y_8, Stream1=subtraction_9)
filter_14 = StreamFilter(Gate=larger_8.LargerThan, Stream0=eval_19, Stream1=eval_20)
filter_15 = StreamFilter(Gate=larger_7.LargerThan, Stream0=y_7, Stream1=subtraction_8)
filter_16 = StreamFilter(Gate=larger_7.LargerThan, Stream0=eval_17, Stream1=eval_18)
pt_7 = ConstructPoint(XCoordinate=addition_2, YCoordinate=eval_5, ZCoordinate=0)
pt_8 = ConstructPoint(XCoordinate=addition_2, YCoordinate=eval_6, ZCoordinate=0)
panel_6 = Panel(filter_14)
panel_7 = Panel(filter_15)
merge = Merge(Data1=shift, Data2=shift_2, Data3=shift_3, Data4=pt_6)
pline = PolyLine(Vertices=pt_8, Closed=False)
pline_2 = PolyLine(Vertices=pt_7, Closed=False)
pdecon_3 = Deconstruct(Point=merge)  # -> XComponent, YComponent, ZComponent
multiplication_6 = Multiplication(A=pdecon_3.YComponent, B=-1)
pdecon_4 = Deconstruct(Point=merge)  # -> XComponent, YComponent, ZComponent
pt_9 = ConstructPoint(XCoordinate=pdecon_3.XComponent, YCoordinate=multiplication_6, ZCoordinate=0)
addition_3 = Addition(A=pdecon_4.XComponent, B=pdecon.XComponent)
addition_4 = Addition(A=pdecon_4.YComponent, B=pdecon.YComponent)
pdecon_5 = Deconstruct(Point=pt_9)  # -> XComponent, YComponent, ZComponent
pt_10 = ConstructPoint(XCoordinate=addition_3, YCoordinate=addition_4, ZCoordinate=0)
addition_5 = Addition(A=pdecon_5.XComponent, B=pdecon.XComponent)
addition_6 = Addition(A=pdecon_5.YComponent, B=pdecon.YComponent)
series_3 = Series(Start=0, Step=1, Count=8)
merge_2 = Merge(
    Data1=filter,
    Data2=filter_3,
    Data3=filter_5,
    Data4=filter_7,
    Data5=filter_9,
    Data6=filter_15,
    Data7=filter_11,
    Data8=filter_13)
pt_11 = ConstructPoint(XCoordinate=addition_5, YCoordinate=addition_6, ZCoordinate=0)
pline_3 = PolyLine(Vertices=pt_10, Closed=False)
pline_4 = PolyLine(Vertices=pt_11, Closed=False)
multiplication_7 = Multiplication(A=merge_2, B=-1)
multiplication_8 = Multiplication(A=series_3, B=-1)
pt_12 = ConstructPoint(XCoordinate=series_3, YCoordinate=merge_2, ZCoordinate=0)
pt_13 = ConstructPoint(XCoordinate=merge_2, YCoordinate=series_3, ZCoordinate=0)  # -> reverse(Point)
pt_14 = ConstructPoint(XCoordinate=multiplication_8, YCoordinate=merge_2, ZCoordinate=0)
pt_15 = ConstructPoint(XCoordinate=multiplication_7, YCoordinate=series_3, ZCoordinate=0)  # -> reverse(flatten(Point))
panel_8 = Panel(merge_2)
shift_4 = ShiftList(List=pt_12, Shift=-1, Wrap=False)  # -> flatten(List)
shift_5 = ShiftList(List=pt_13, Shift=-1, Wrap=False)  # -> flatten(List)
shift_6 = ShiftList(List=pt_14, Shift=-1, Wrap=False)  # -> flatten(List)
merge_3 = Merge(Data1=shift_4, Data2=shift_5, Data3=shift_6, Data4=pt_15)
pdecon_6 = Deconstruct(Point=merge_3)  # -> XComponent, YComponent, ZComponent
multiplication_9 = Multiplication(A=pdecon_6.YComponent, B=-1)
pt_16 = ConstructPoint(XCoordinate=pdecon_6.XComponent, YCoordinate=multiplication_9, ZCoordinate=0)
