# Grasshopper definition 20180206_partF-level1曲面函数生成算法.gh (Grasshopper 0.9.76)
# plug-ins: Python Interpreter

# ---- group: python函数效果
series = Series(Start=0, Step=1, Count=Slider(5, range=0..10))  # -> graft(Series)
bang = ExplodeTree(Data=series)  # -> Branch0, Branch1, Branch2, Branch3, Branch4, Branch5
int = Integer("10")
eval = Evaluate(F="(x+1)²+(y-1/2)²-r²", x=bang.Branch0, y=int, r=int)
larger = LargerThan(FirstNumber=eval, SecondNumber=0)  # -> LargerThan, OrEqualTo
subtraction = Subtraction(A=int, B=1)
subtraction_2 = Subtraction(A=int, B=1)
subtraction_3 = Subtraction(A=int, B=1)
subtraction_4 = Subtraction(A=int, B=1)
filter = StreamFilter(Gate=larger.LargerThan, Stream0=int, Stream1=subtraction_3)
eval_2 = Evaluate(F="(x+1)²+(y-1/2)²-r²", x=bang.Branch1, y=filter, r=int)
larger_2 = LargerThan(FirstNumber=eval_2, SecondNumber=0)  # -> LargerThan, OrEqualTo
filter_2 = StreamFilter(Gate=larger_2.LargerThan, Stream0=int, Stream1=subtraction_4)
eval_3 = Evaluate(F="(x+1)²+(y-1/2)²-r²", x=bang.Branch2, y=filter_2, r=int)
larger_3 = LargerThan(FirstNumber=eval_3, SecondNumber=0)  # -> LargerThan, OrEqualTo
filter_3 = StreamFilter(Gate=larger_3.LargerThan, Stream0=int, Stream1=subtraction)
eval_4 = Evaluate(F="(x+1)²+(y-1/2)²-r²", x=bang.Branch3, y=filter_3, r=int)
larger_4 = LargerThan(FirstNumber=eval_4, SecondNumber=0)  # -> LargerThan, OrEqualTo
filter_4 = StreamFilter(Gate=larger_4.LargerThan, Stream0=int, Stream1=subtraction_2)

# ---- group: 圆的算法
python = PythonScript(r=Slider(16, range=0..100))  # -> out, a
# ---------- python: Python ----------
x = 0
y = r
e = int(r/(2**0.5))
print(y)
print(x)
for i in range(e):
    p = (x+1)**2+(y-1/2)**2-r**2
    if p<0:
        y=y
    else:
        y=y-1
    x += 1
    i += 1
    print(y)
    print(x)
# ---------- end python ----------
dispatch = Dispatch(List=python.out, DispatchPattern=[True, False])  # -> ListA, ListB
y = Number(dispatch.ListA)
x = Number(dispatch.ListB)
neg = Negative(Value=x)
neg_2 = Negative(Value=y)
pt = ConstructPoint(XCoordinate=x, YCoordinate=y, ZCoordinate=0)
pt_2 = ConstructPoint(XCoordinate=neg, YCoordinate=y, ZCoordinate=0)
pt_3 = ConstructPoint(XCoordinate=neg_2, YCoordinate=x, ZCoordinate=0)
pt_4 = ConstructPoint(XCoordinate=y, YCoordinate=x, ZCoordinate=0)
merge = Merge(Data1=pt, Data2=pt_4, Data3=pt_2, Data4=pt_3)
neg_3 = Negative(Value=merge)
pt_5 = Point([neg_3, merge])

# ---- group: 三角函数曲面算法
number_slider = Slider(4, range=0..10)
number_slider_2 = Slider(16, range=0..30)
series_2 = Series(Start=0, Step=number_slider, Count=number_slider_2)  # -> graft(Series)
series_3 = Series(Start=0, Step=number_slider, Count=number_slider_2)
multiplication = Multiplication(A=series_2, B=Slider(2.529, range=-1..5))
addition = Addition(A=multiplication, B=Slider(5.259, range=-1..25))
sin = Sine(Value=series_3)
sin_2 = Sine(Value=series_2)
sin_3 = Sine(Value=addition)
addition_2 = Addition(A=sin, B=sin_2, C=sin_3)
pt_6 = ConstructPoint(XCoordinate=series_2, YCoordinate=series_3, ZCoordinate=addition_2)  # -> flatten(Point)
srfgrid = SurfaceFromPoints(Points=pt_6, UCount=number_slider_2, Interpolate=True)
preview = CustomPreview(Geometry=srfgrid, Shader=ColourSwatch(SwatchColor=RGB(255, 255, 255)))
