# Grasshopper definition 20180207_partF-level2遗传算法.gh (Grasshopper 0.9.76)

number_slider = Slider(0.63, range=0..1)
number_slider_2 = Slider(0.37, range=0..1)
crv基地红线 = Curve(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)
建筑高度 = Slider(60, range=30..60)
日照参数 = Slider(1.5, range=0..1.5)
建筑层高 = Slider(2.9, range=2.9..3.3)
建筑进深 = Slider(20, range=0..20)
srf山地 = Surface(reparameterize(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))
offset = Offset(Curve=crv基地红线, Distance="15", Plane=PlaneXY(0, 0, 0), Corners=1)
crv建筑退线 = Curve(offset)

# ---- group: 判定最高边
explode = Explode(Curve=crv建筑退线, Recursive=True)  # -> Segments, Vertices
explode_2 = Explode(Curve=explode.Segments, Recursive=True)  # -> Segments, Vertices
pdecon = Deconstruct(Point=explode_2.Vertices)  # -> XComponent, YComponent, ZComponent
avr = Average(Input=pdecon.YComponent)  # -> flatten(ArithmeticMean)
sort = SortList(Keys=avr)  # -> Keys, ValuesA
item = ListItem(List=sort.Keys, Index=-1, Wrap=True)
mindex = MemberIndex(Set=avr, Member=item)  # -> Index, Count
item_2 = ListItem(List=explode.Segments, Index=mindex.Index, Wrap=True)

# ----
preview = CustomPreview(Geometry=srf山地, Shader=ColourSwatch(SwatchColor=RGB(214, 214, 214)))
pt = ConstructPoint(XCoordinate=number_slider, YCoordinate=number_slider_2, ZCoordinate=0)
num = Number(建筑高度)
num_2 = Number(日照参数)
num_3 = Number(建筑层高)
num_4 = Number(建筑进深)

# ---- group: 曲面截面
iso = IsoCurve(Surface=reparameterize(srf山地), UVPoint=pt)  # -> UIsocurve, VIsocurve

# ---- group: 亦做取uv点之用
evalsrf = EvaluateSurface(Surface=srf山地, Point=pt)  # -> Point, Normal, Frame

# ---- group: 楼间距
multiplication = Multiplication(A=num, B=num_2)
addition = Addition(A=multiplication, B=num_4)

# ---- group: 层数
integer_division = IntegerDivision(A=num, B=num_3)

# ----
pdecon_2 = Deconstruct(Point=evalsrf.Point)  # -> XComponent, YComponent, ZComponent
pt最高点 = Point(evalsrf.Point)
galapagos = Galapagos(fitness=num_5, gene=[number_slider_2, number_slider])
Y = UnitY(Factor=num_4)
num_5 = Number(pdecon_2.ZComponent)
Y_2 = UnitY(Factor=-1)

# ---- group: 加入退线生成点
crv最边 = Curve(item_2)
pt基地边界点 = Point(explode.Vertices)
explode_3 = Explode(Curve=crv最边, Recursive=True)  # -> Segments, Vertices
pdecon_3 = Deconstruct(Point=pt基地边界点)  # -> graft(XComponent), YComponent, graft(ZComponent)
pdecon_4 = Deconstruct(Point=explode_3.Vertices)  # -> XComponent, YComponent, ZComponent
equals = Equality(FirstNumber=pdecon_4.YComponent, SecondNumber=pdecon_3.YComponent)  # -> Equality, Inequality
dispatch = Dispatch(List=graft(pdecon_3.YComponent), DispatchPattern=graft(equals.Equality))  # -> ListA, ListB
subtraction = Subtraction(A=dispatch.ListA, B=num_4)
merge = Merge(Data1=dispatch.ListB, Data2=subtraction)
pt_2 = ConstructPoint(XCoordinate=pdecon_3.XComponent, YCoordinate=merge, ZCoordinate=pdecon_3.ZComponent)  # -> flatten(Point)
pline = PolyLine(Vertices=pt_2, Closed=True)
boundary = BoundarySurfaces(Edges=pline)
srf基地 = Surface(boundary)

# ----
Z = UnitZ(Factor=num)
galapagos_2 = Galapagos(fitness=num_6, gene=[建筑高度, 建筑层高, 建筑进深])
cull = CullPattern(List=pt_2, CullPattern=equals.Equality)
pline_2 = PolyLine(Vertices=cull, Closed=False)
crv = Curve(pline_2)
end = EndPoints(Curve=crv)  # -> Start, End
contour = Contour(Shape=srf基地, Point=end.Start, Direction=Y_2, Distance=addition)
crv_2 = Curve(contour)
move = Move(Geometry=crv_2, Motion=Y)  # -> Geometry, Transform
len = Length(Curve=contour)
num南向面宽 = Number(len)
loft = Loft(
    Curves=[crv_2, move.Geometry],
    Options={Adjust=False, Closed=False, LoftEnds=0, LoftSimp=0, LoftType=0, Rebuild=10, Refit=0.01})
multiplication_2 = Multiplication(A=num南向面宽, B=num_4)
extr = Extrude(Base=loft, Direction=Z)
multiplication_3 = Multiplication(A=integer_division, B=multiplication_2)  # -> flatten(Result)
ma = MassAddition(Input=multiplication_3)  # -> Result, PartialResults
num_6 = Number(ma.Result)
总建筑面积 = Panel(ma.Result)
