# Grasshopper definition 20180207_partF-level3迭代分形.gh (Grasshopper 0.9.76)
# plug-ins: Anemone

迭代系数 = Slider(0.7, range=0..1)
初始高 = Slider(80, range=0..100)
Z = UnitZ(Factor=1)
pt = Point(Point(35, -66, 0))
X = UnitX(Factor=1)
pt_2 = Point(Point(0, -4, 0))
line = LineSDL(Start=pt_2, Direction=X, Length=Slider(1100, range=0..1100))
line_2 = LineSDL(Start=pt, Direction=Z, Length=初始高)

loop_start = LoopStart(Repeat=Slider(3, range=0..10), Data_0=line)  # -> port, _3, Data_0
crv = Curve(loop_start.Data_0)
divide = DivideCurve(Curve=crv, Count=3, Kinks=False)  # -> Points, Tangents, Parameters
item = ListItem(List=divide.Points, Index=1, Wrap=True)
item_2 = ListItem(List=divide.Points, Index=2, Wrap=True)
rotate = Rotate(Geometry=item_2, Angle=1.047197551, Plane=item)  # -> Geometry, Transform
item_3 = ListItem(List=divide.Points, Index=[0, -1], Wrap=True)
merge = Merge(Data1=item, Data2=rotate.Geometry, Data3=item_2)
ins = InsertItems(List=item_3, Item=merge, Indices=1, Wrap=True)
pline = PolyLine(Vertices=ins, Closed=False)
explode = Explode(Curve=pline, Recursive=True)  # -> Segments, Vertices
crv_2 = Curve(explode.Segments)
loop_end = LoopEnd(port=loop_start.port, Exit=False, Data_0=crv_2, pausedState=False, state="Constant output")

loop_start_2 = LoopStart(Repeat=Slider(7, range=0..10), Data_0=line_2)  # -> port, _7, Data_0
line_3 = Line(loop_start_2.Data_0)
len = Length(Curve=line_3)
multiplication = Multiplication(A=len, B=迭代系数)
end = EndPoints(Curve=line_3)  # -> Start, End
vec = Vector(line_3)
neg = Negative(Value="5")
pl = PlaneNormal(Origin=end.End, ZAxis=vec)
pt_3 = PointOriented(BasePlane=pl, UComponent=0, VComponent="5", WComponent="5")
pt_4 = PointOriented(BasePlane=pl, UComponent=0, VComponent=neg, WComponent="5")
vec2pt = Vector2Pt(PointA=pl, PointB=pt_3, Unitize=False)  # -> Vector, Length
vec2pt_2 = Vector2Pt(PointA=pl, PointB=pt_4, Unitize=False)  # -> Vector, Length
line_4 = LineSDL(Start=pl, Direction=vec2pt.Vector, Length=multiplication)
line_5 = LineSDL(Start=pl, Direction=vec2pt_2.Vector, Length=multiplication)
line_6 = Line([line_4, line_5, line_3])
loop_end_2 = LoopEnd(port=loop_start_2.port, Exit=False, Data_0=line_6, pausedState=False, state="Constant output")
