# Grasshopper definition OpenNestExample181202.gh (Grasshopper 0.9.76)
# plug-ins: OpenNest

# ----
# Text for engraving
pop2d = Populate2D(Region={Plane=PlaneXY(0, 0, 0), Size=Domain2(u=0..20, v=0..10)}, Count=100, Seed=1)  # disabled
pdecon = Deconstruct(Point=pop2d)  # -> XComponent, YComponent, ZComponent; disabled
round = Round(Number=pdecon.XComponent)  # -> Nearest, Floor, Ceiling; disabled
text = Text(Location=pop2d, Text=round.Nearest, Size=1)  # disabled

# ----
# If you want to unroll simple geometry
brep = Brep([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])  # disabled
unroll = Unroll(MeshOrBrep=brep)  # -> Brep, Curves, Points, TextDotsLocation, TextDots; disabled

# ---- group: This projects polygons to plane
crv = Curve([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])
project = Project(Polyline=crv)  # -> Polyline, Plane
pack = PackObjects(Geo=project.Polyline, Plane=project.Plane, X=1, Y=1, Tolerabce=3.14)  # -> Geo, Transformation

# ----
# If you just want to pack object into rectangle array
pln = Plane([Plane(origin=(177.2966553, -26.65196411, 44.30150529), x=(0, -1, 0), y=(-1, 0, 0)), Plane(origin=(236.1676684, -43.9024936, 40.92366467), x=(-0.4373626862, 0, -0.8992852054), y=(0, -1, 0)), Plane(origin=(206.5526304, -164.2693558, 0), x=(-0.7706951683, -0.6372040156, 0), y=(0.6372040156, -0.7706951683, 0)), Plane(origin=(268.3124917, -156.3636782, 0), x=(0.7372204611, 0.6756522713, 0), y=(0.6756522713, -0.7372204611, 0))])  # disabled
# Some additional helpers:
geo = Geometry([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])  # disabled
number_slider = Slider(8, range=0..100)  # disabled
number_slider_2 = Slider(53, range=0..100)  # disabled
entwine = Entwine(Branch00=pln, Branch01=pln, FlattenInputs=True)  # disabled
entwine_2 = Entwine(Branch00=geo, Branch01=geo, FlattenInputs=True)  # disabled
pack_2 = PackObjects(Geo=entwine_2, Plane=entwine, X=number_slider, Y=number_slider_2, Tolerabce=3.14)  # -> Geo, Transformation; disabled

# ----
# Basic Setup
# Nesting Polylines
crv_2 = Curve(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)
opennest = OpenNest(
    Sheets=crv_2,
    Geo=pack.Geo,
    Spacing=1,
    Placement=1,
    Tolerance=0.1,
    Rotations=4,
    Iterations=1,
    Seed=1,
    Reset=True,
    Run=False)  # -> Sheets, Geo, ID, Transform, IDS

# ---- group: This projects polygons to plane
crv_3 = Curve([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])
project_2 = Project(Polyline=crv_3)  # -> Polyline, Plane; disabled
pack_3 = PackObjects(Geo=project_2.Polyline, Plane=project_2.Plane, X=1, Y=1, Tolerabce=3.14)  # -> Geo, Transformation; disabled

# ----
# Nesting To Arbitrary Sheets
crv_4 = Curve([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])  # disabled
opennest_2 = OpenNest(
    Sheets=crv_4,
    Geo=pack_3.Geo,
    Spacing=1,
    Placement=1,
    Tolerance=0.1,
    Rotations=4,
    Iterations=1,
    Seed=1,
    Reset=True,
    Run=False)  # -> Sheets, Geo, ID, Transform, IDS; disabled

# ----
# If you want nest rhino objects
# Reference them as guids,
# convert to polylines
# And then press boolean button to bake them
number_slider_3 = Slider(3, range=0..10)  # disabled
id = Guid()  # disabled
crv_5 = Curve(<curve referenced from the Rhino model>)  # disabled
crv_6 = Curve(id)  # disabled
opennest_3 = OpenNest(
    Sheets=crv_5,
    Geo=crv_6,
    Spacing=1,
    Placement=number_slider_3,
    Tolerance=0.1,
    Rotations=4,
    Iterations=1,
    Seed=1,
    Reset=True,
    Run=False)  # -> Sheets, Geo, ID, Transform, IDS; disabled
button = Button()  # disabled
tguid = TransformGuid(Guid=id, Transform=opennest_3.Transform, Run=button)  # disabled

# ---- group: Parts can be either polylines or planar surfaces
number_slider_4 = Slider(100, range=0..100)  # disabled
number_slider_5 = Slider(2, range=0..10)  # disabled
crv_7 = Curve([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])  # disabled
boundary = BoundarySurfaces(Edges=crv_7)  # disabled
crv_8 = Curve(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)  # disabled
repeat = RepeatData(Data=boundary, Length=number_slider_5)  # disabled
repeat_2 = RepeatData(Data=crv_8, Length=number_slider_4)  # disabled
merge = Merge(Data1=repeat, Data2=repeat_2)  # -> flatten(Result); disabled

# ----
# Nesting Shape with Holes -> Planar Surfaces
crv_9 = Curve(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)  # disabled
area = Area(Geometry=merge)  # -> Area, Centroid; disabled
opennest_4 = OpenNest(Sheets=crv_9, Geo=merge, Spacing=1, Placement=1, Tolerance=0.1, Rotations=4, Iterations=1, Seed=1, Reset=True, Run=False)  # -> Sheets, Geo, ID, Transform, IDS; disabled
number_slider_6 = Slider(2, range=0..10)  # disabled
lng = ListLength(List=area.Centroid)  # disabled
series = Series(Start=0, Step=1, Count=lng)  # disabled
int = Integer(series)  # disabled
text_2 = Text(Location=area.Centroid, Text=int, Size=number_slider_6)  # disabled
group = Group(Objects=text_2)  # -> flatten(Group); disabled

# ---- group: If you want to nest additional goemetry
transform = Transform(Geometry=group, Transform=opennest_4.Transform)  # disabled

# ----
# Unroll + Nest
brep_2 = Brep([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])  # disabled
area_2 = Area(Geometry=brep_2)  # -> Area, Centroid; disabled
unroll_2 = Unroll(MeshOrBrep=brep_2, Points=area_2.Centroid)  # -> flatten(Brep), Curves, flatten(Points), TextDotsLocation, TextDots; disabled
number_slider_7 = Slider(0, range=0..100)  # disabled
crv_10 = Curve(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)  # disabled
opennest_5 = OpenNest(
    Sheets=crv_10,
    Geo=unroll_2.Brep,
    Spacing=number_slider_7,
    Placement=1,
    Tolerance=0.1,
    Rotations=4,
    Iterations=1,
    Seed=1,
    Reset=True,
    Run=False)  # -> Sheets, Geo, ID, Transform, IDS; disabled
transform_2 = Transform(Geometry=unroll_2.Points, Transform=opennest_5.Transform)  # disabled
points = PointList(Points=transform_2, Size=2)  # disabled

# ----
# Nesting Curves
# Internally component converts curves to polylines.
# Suggestion to convert to polylines.
number_slider_8 = Slider(30, range=0..100)  # disabled
toggle = BooleanToggle(True)  # disabled
toggle_2 = BooleanToggle(True)  # disabled
number_slider_9 = Slider(0.1, range=0..0.1)  # disabled
number_slider_10 = Slider(5, range=0..10)  # disabled
number_slider_11 = Slider(4, range=0..5)  # disabled
number_slider_12 = Slider(4, range=0..10000)  # disabled
number_slider_13 = Slider(2, range=0..10)  # disabled
number_slider_14 = Slider(1, range=0..100)  # disabled
number_slider_15 = Slider(1, range=0..100)  # disabled
crv_11 = Curve([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])  # disabled
repeat_3 = RepeatData(Data=crv_11, Length=number_slider_8)  # disabled
crv_12 = Curve(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)  # disabled
opennest_6 = OpenNest(
    Sheets=crv_12,
    Geo=repeat_3,
    Spacing=number_slider_14,
    Placement=number_slider_11,
    Tolerance=number_slider_9,
    Rotations=number_slider_12,
    Iterations=number_slider_15,
    Seed=number_slider_13,
    Reset=toggle,
    Run=toggle_2)  # -> Sheets, Geo, ID, Transform, IDS; disabled

# ----
# Nesting Breps and Meshes
toggle_3 = BooleanToggle(True)  # disabled
toggle_4 = BooleanToggle(True)  # disabled
number_slider_16 = Slider(0.1, range=0..0.1)  # disabled
number_slider_17 = Slider(5, range=0..10)  # disabled
number_slider_18 = Slider(4, range=0..10000)  # disabled
number_slider_19 = Slider(2, range=0..10)  # disabled
geo_2 = Geometry([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])  # disabled
number_slider_20 = Slider(1, range=0..100)  # disabled
number_slider_21 = Slider(4, range=0..5)  # disabled
number_slider_22 = Slider(1, range=0..100)  # disabled
crv_13 = Curve(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)  # disabled
crv_14 = Curve([<curve referenced from the Rhino model> x2])  # disabled
opennest_7 = OpenNest(
    Sheets=crv_13,
    Geo=geo_2,
    Spacing=number_slider_20,
    Placement=number_slider_21,
    Tolerance=number_slider_16,
    Rotations=number_slider_18,
    Iterations=number_slider_22,
    Seed=number_slider_19,
    Reset=toggle_3,
    Run=toggle_4)  # -> Sheets, Geo, ID, Transform, IDS; disabled

# ---- group: Must be set to 0 to run live
number_slider_23 = Slider(0, range=0..100)  # disabled

# ----
# Running Solver Iteratively.
# Only the most optimcal results
# are outputed
button_2 = Button()  # disabled
toggle_5 = BooleanToggle(False)  # disabled
crv_15 = Curve(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)  # disabled
crv_16 = Curve([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])  # disabled
opennest_8 = OpenNest(
    Sheets=crv_15,
    Geo=crv_16,
    Spacing=1,
    Placement=1,
    Tolerance=0.1,
    Rotations=4,
    Iterations=number_slider_23,
    Seed=1,
    Reset=button_2,
    Run=toggle_5)  # -> Sheets, Geo, ID, Transform, IDS; disabled
